# Grasshopper definition Comedor_Dalton.ghx (Grasshopper 1.0.8)

# ---- group: Dimensiones Principales
panel = Panel("1141 x 895")
rh_in_01_1_ancho_600_1400 = Slider(895, range=600..1400)
rh_in_01_0_largo_600_1800 = Slider(1141, range=600..1800)
unit_y = UnitY(Factor=rh_in_01_1_ancho_600_1400)
unit_x = UnitX(Factor=rh_in_01_0_largo_600_1800)
point = Point(Point(0, 0, 0))
point_2 = Point(Point(0, 0, 0))
move = Move(Geometry=point, Motion=unit_y)  # -> Geometry, Transform
move_2 = Move(Geometry=point_2, Motion=unit_x)  # -> Geometry, Transform
xy_plane = XYPlane(Origin=Point(0, 0, 0))
rectangle_2pt = Rectangle2Pt(Plane=xy_plane, PointA=move_2.Geometry, PointB=move.Geometry, Radius=0)  # -> Rectangle, Length
altura = Panel("792.9")
unit_z = UnitZ(Factor=altura)
rh_in_01_2_radio_esquina = Slider(5, range=5..200)
move_3 = Move(Geometry=rectangle_2pt.Rectangle, Motion=unit_z)  # -> Geometry, Transform
fillet = Fillet(Curve=move_3.Geometry, Radius=rh_in_01_2_radio_esquina)
deconstruct_brep = DeconstructBrep(Brep=fillet)  # -> Faces, Edges, Vertices
list_item = ListItem(List=deconstruct_brep.Vertices, Index=0, Wrap=True)
point_3 = Point(Point(-114.6548049, 0, 190.6754453))
rh_in_01_3_borde_a_estructura = Slider(85, range=50..200)
curve = Curve(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)
vector_2pt = Vector2Pt(PointA=point_3, PointB=list_item, Unitize=False)  # -> Vector, Length
panel_2 = Panel("85")
move_4 = Move(Geometry=curve, Motion=vector_2pt.Vector)  # -> Geometry, Transform
negative = Negative(Value=rh_in_01_3_borde_a_estructura)
xy_plane_2 = XYPlane(Origin=Point(0, 0, 0))
offset_curve = OffsetCurve(Curve=move_3.Geometry, Distance=negative, Plane=xy_plane_2, Corners=1)
sweep1 = Sweep1(Rail=fillet, Sections=move_4.Geometry, Miter=1)
deconstruct_brep_2 = DeconstructBrep(Brep=sweep1)  # -> Faces, Edges, Vertices
list_item_2 = ListItem(List=deconstruct_brep_2.Edges, Index=0, Wrap=True)
boundary_surfaces = BoundarySurfaces(Edges=[fillet, list_item_2])

# ----
borde_a_estructura = Slider(3, range=0..20)
borde_a_estructura_2 = Slider(1, range=0..20)

unit_z_2 = UnitZ(Factor="-31.6")
deconstruct_brep_3 = DeconstructBrep(Brep=offset_curve)  # -> Faces, Edges, Vertices
move_5 = Move(Geometry=offset_curve, Motion=unit_z_2)  # -> Geometry, Transform
area = Area(Geometry=offset_curve)  # -> Area, Centroid
list_item_3 = ListItem(List=deconstruct_brep_3.Vertices, Index=0, Wrap=True)
deconstruct_brep_4 = DeconstructBrep(Brep=move_5.Geometry)  # -> Faces, Edges, Vertices
yz_plane = YZPlane(Origin=area.Centroid)
xz_plane = XZPlane(Origin=area.Centroid)
negative_2 = Negative(Value="76")
list_item_4 = ListItem(List=deconstruct_brep_4.Vertices, Index=0, Wrap=True)
negative_3 = Negative(Value="76")
list_item_5 = ListItem(List=deconstruct_brep_4.Vertices, Index="3", Wrap=True)
unit_y_2 = UnitY(Factor="76")
unit_y_3 = UnitY(Factor=negative_2)
unit_x_2 = UnitX(Factor="76")
unit_x_3 = UnitX(Factor=negative_3)
list_item_6 = ListItem(List=deconstruct_brep_4.Vertices, Index="1", Wrap=True)
move_6 = Move(Geometry=list_item_4, Motion=unit_y_2)  # -> Geometry, Transform
move_7 = Move(Geometry=list_item_5, Motion=unit_y_3)  # -> Geometry, Transform
move_8 = Move(Geometry=list_item_4, Motion=unit_x_2)  # -> Geometry, Transform
move_9 = Move(Geometry=list_item_6, Motion=unit_x_3)  # -> Geometry, Transform
unit_x_4 = UnitX(Factor="16")
unit_y_4 = UnitY(Factor="16")
move_10 = Move(Geometry=move_7.Geometry, Motion=unit_x_4)  # -> Geometry, Transform
unit_z_3 = UnitZ(Factor="-56.5")
move_11 = Move(Geometry=move_9.Geometry, Motion=unit_y_4)  # -> Geometry, Transform
unit_z_4 = UnitZ(Factor="-56.5")
move_12 = Move(Geometry=move_10.Geometry, Motion=unit_z_3)  # -> Geometry, Transform
move_13 = Move(Geometry=move_11.Geometry, Motion=unit_z_4)  # -> Geometry, Transform
box_2pt = Box2Pt(PointA=move_6.Geometry, PointB=move_12.Geometry, Plane=PlaneXY(0, 0, 0))

# ---- group: Cubierta Apariencia
rh_in_02_0_mapeado = ValueList({"Longitudinal": 0, "Atravesada": 1}, selected="Longitudinal")
brep_join = BrepJoin(Breps=flatten([sweep1, boundary_surfaces]))  # -> Breps, Closed
python_3_script = Python3Script(M=brep_join.Breps, B=rh_in_02_0_mapeado)  # -> a; inputs M: Mesh, B: Int32
# ---------- python_3_script: Python ----------
"""
3BF Box Mapping v1.0 Cohesión Total
Respeta estrictamente la cohesión y topología proveniente de Mesh Join:
- CERO SplitDisjointPieces (no divide ni rompe mallas).
- CERO Unweld destructivo (mantiene la pieza 100% compacta y unida).
- Asigna coordenadas UV calculando la orientación de cada cara.
- Garantiza veta longitudinal a lo largo de cada tablero.
"""

import Rhino

def aplicar_box_mapping_cohesion_total(mesh_in, modo_veta=0, escala_caja_mm=600.0):
    if mesh_in is None or not isinstance(mesh_in, Rhino.Geometry.Mesh):
        return mesh_in

    # Preservar la malla cohesionada intacta sin romper vértices ni caras
    mesh = mesh_in.DuplicateMesh() if hasattr(mesh_in, "DuplicateMesh") else mesh_in
    
    mesh.Normals.ComputeNormals()
    mesh.TextureCoordinates.Clear()

    # Bounding Box individual de la pieza cohesionada
    bbox = mesh.GetBoundingBox(True)
    sx = max(1.0, bbox.Max.X - bbox.Min.X)
    sy = max(1.0, bbox.Max.Y - bbox.Min.Y)
    sz = max(1.0, bbox.Max.Z - bbox.Min.Z)

    es_atravesada = False
    if isinstance(modo_veta, str):
        es_atravesada = "atravesad" in modo_veta.lower() or modo_veta in ["1", "3", "5"]
    elif isinstance(modo_veta, (int, float)):
        es_atravesada = int(modo_veta) in [1, 3, 5]

    escala = float(escala_caja_mm)

    v_count = mesh.Vertices.Count
    norm_count = mesh.Normals.Count

    for idx in range(v_count):
        v = mesh.Vertices[idx]
        n = mesh.Normals[idx] if idx < norm_count else Rhino.Geometry.Vector3f(0, 0, 1)

        lx = v.X - bbox.Min.X
        ly = v.Y - bbox.Min.Y
        lz = v.Z - bbox.Min.Z

        nx, ny, nz = abs(n.X), abs(n.Y), abs(n.Z)

        # -------------------------------------------------------------
        # CASO A: Normal en Z (Caras Superiores / Inferiores / Cantos en Z)
        # -------------------------------------------------------------
        if nz >= nx and nz >= ny:
            if sy >= sx:
                # Lateral de cajón hacia el fondo (ej: 350mm en Y vs 15mm en X)
                u = ly / escala
                v_coord = lx / escala
            else:
                # Tablero horizontal normal o canto superior de frente (largo en X)
                u = ly / escala if es_atravesada else lx / escala
                v_coord = lx / escala if es_atravesada else ly / escala

        # -------------------------------------------------------------
        # CASO B: Normal en Y (Caras Frontales / Traseras / Cantos en Y)
        # -------------------------------------------------------------
        elif ny >= nx and ny >= nz:
            if sx >= sz:
                # Frente de cajón o traviesa horizontal (ancho en X)
                u = lz / escala if es_atravesada else lx / escala
                v_coord = lx / escala if es_atravesada else lz / escala
            else:
                # Pieza vertical alta
                u = lz / escala
                v_coord = lx / escala

        # -------------------------------------------------------------
        # CASO C: Normal en X (Caras Laterales / Cantos en X)
        # -------------------------------------------------------------
        else:
            if sy >= sz:
                # Lateral de cajón (cara plana hacia el fondo en Y)
                u = lz / escala if es_atravesada else ly / escala
                v_coord = ly / escala if es_atravesada else lz / escala
            else:
                # Costado vertical
                u = ly / escala if es_atravesada else lz / escala
                v_coord = lz / escala if es_atravesada else ly / escala

        mesh.TextureCoordinates.Add(float(u), float(v_coord))

    return mesh


# Ejecución universal compatible con Item Access o List Access
if isinstance(M, list):
    resultado = [aplicar_box_mapping_cohesion_total(item, B if 'B' in locals() else 0, 600.0) for item in M if item is not None]
else:
    resultado = aplicar_box_mapping_cohesion_total(M, B if 'B' in locals() else 0, 600.0)

a = resultado
# ---------- end python_3_script ----------
rh_out_cubierta = Mesh(python_3_script)

# ----
box_2pt_2 = Box2Pt(PointA=move_8.Geometry, PointB=move_13.Geometry, Plane=PlaneXY(0, 0, 0))

point_4 = Point(Point(-420.880757, 70.56869349, 793.1054277))
mesh = Mesh(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)

# ---- group: Travesaño Corto 2 Apariencia
mirror = Mirror(Geometry=box_2pt, Plane=yz_plane)  # -> Geometry, Transform
rh_in_04_0_mapeado = ValueList({"Longitudinal": 0, "Atravesada": 1}, selected="Longitudinal")
python_3_script_2 = Python3Script(M=mirror.Geometry, B=rh_in_04_0_mapeado)  # -> a; inputs M: Mesh, B: Int32; same code as python_3_script
rh_out_travesaño_corto_2 = Geometry(python_3_script_2)

# ---- group: Travesaño Corto 1 Apariencia
rh_in_3_0_mapeado = ValueList({"Longitudinal": 0, "Atravesada": 1}, selected="Longitudinal")
python_3_script_3 = Python3Script(M=box_2pt, B=rh_in_3_0_mapeado)  # -> a; inputs M: Mesh, B: Int32; same code as python_3_script
rh_out_travesaño_corto_1 = Geometry(python_3_script_3)

# ---- group: Travesaño Largo 1 Apariencia
rh_in_05_0_mapeado = ValueList({"Longitudinal": 0, "Atravesada": 1}, selected="Longitudinal")
python_3_script_4 = Python3Script(M=box_2pt_2, B=rh_in_05_0_mapeado)  # -> a; inputs M: Mesh, B: Int32; same code as python_3_script
rh_out_travesaño_largo_1 = Geometry(python_3_script_4)

# ---- group: Travesaño Largo 2 Apariencia
mirror_2 = Mirror(Geometry=box_2pt_2, Plane=xz_plane)  # -> Geometry, Transform
rh_in_2_0_mapeado = ValueList({"Longitudinal": 0, "Atravesada": 1}, selected="Longitudinal")
python_3_script_5 = Python3Script(M=mirror_2.Geometry, B=rh_in_2_0_mapeado)  # -> a; inputs M: Mesh, B: Int32; same code as python_3_script
rh_out_travesaño_largo_2 = Geometry(python_3_script_5)

# ----
vector_2pt_2 = Vector2Pt(PointA=point_4, PointB=list_item_3, Unitize=False)  # -> Vector, Length

# ---- group: Pata Diagonal Apariencia
move_14 = Move(Geometry=mesh, Motion=vector_2pt_2.Vector)  # -> Geometry, Transform
mirror_3 = Mirror(Geometry=move_14.Geometry, Plane=yz_plane)  # -> Geometry, Transform
mirror_4 = Mirror(Geometry=move_14.Geometry, Plane=xz_plane)  # -> Geometry, Transform
mirror_5 = Mirror(Geometry=mirror_3.Geometry, Plane=xz_plane)  # -> Geometry, Transform
rh_in_20_0_mapeado = ValueList({"Longitudinal": 0, "Atravesada": 1}, selected="Longitudinal")
python_3_script_6 = Python3Script(M=[move_14.Geometry, mirror_4.Geometry, mirror_3.Geometry, mirror_5.Geometry], B=rh_in_20_0_mapeado)  # -> a; inputs M: Mesh, B: Int32; same code as python_3_script
rh_out_pata_diagonal = Mesh(python_3_script_6)
