# Grasshopper definition Comoda Ravenna.ghx (Grasshopper 1.0.8)

# ---- group: Dimensões principais
rh_in_01_1_alto_400_1200 = Slider(930, range=400..1200)
rh_in_01_2_profundidad_350_600 = Slider(475, range=350..600)
rh_in_01_0_ancho_300_1600 = Slider(1295, range=300..1600)
subtraction = Subtraction(A=rh_in_01_1_alto_400_1200)
domain_box = DomainBox(Base=PlaneXY(0, 0, 0), X=rh_in_01_0_ancho_300_1600, Y=rh_in_01_2_profundidad_350_600, Z=subtraction)

# ----
comoda_ravenna = Panel("""1295
930
475""")
expression = Expression(
    x=rh_in_01_1_alto_400_1200,
    y=rh_in_01_0_ancho_300_1600,
    Expression="if(x ≤ 500, 1, if(x ≤ 800, 2, if(x ≤ 1000, 3, if(x ≤ 1200, 4, 0))))")
area = Area(Geometry=domain_box)  # -> Area, Centroid
cantidad_cajones = Panel(expression)
yz_plane = YZPlane(Origin=area.Centroid)
stream_filter = StreamFilter(Gate=0)

# ---- group: Origen
deconstruct_brep = DeconstructBrep(Brep=domain_box)  # -> Faces, Edges, Vertices

# ----
_02_2_desfase = Slider(6, range=0..20)
_01_2_altura = Slider(6, range=0..20)

unit_y = UnitY(Factor="-3")
unit_z = UnitZ(Factor="-20.5")
unit_y_2 = UnitY(Factor="5.5")
unit_x = UnitX(Factor="0.5")
unit_z_2 = UnitZ(Factor="-32")
unit_x_2 = UnitX(Factor="-0.5")
panel = Panel("12.5")
unit_z_3 = UnitZ(Factor="12.5")
unit_x_3 = UnitX(Factor="0.5")
unit_z_4 = UnitZ(Factor="-1")
espesor_mdf = Panel("3")
unit_y_3 = UnitY(Factor="-5.5")
unit_y_4 = UnitY(Factor="0.5")
unit_z_5 = UnitZ(Factor=espesor_mdf)
unit_z_6 = UnitZ(Factor="-32")
unit_y_5 = UnitY(Factor="3")
unit_y_6 = UnitY(Factor="-5.5")
mecanizado = Brep(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)
point = Point(Point(-952.7096132, 21.55827254, 0))
clavo_h = Mesh(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)
unit_y_7 = UnitY(Factor="-6")
unit_z_7 = UnitZ(Factor="-28")
unit_z_8 = UnitZ(Factor="-32")
unit_z_9 = UnitZ(Factor="-32")
unit_y_8 = UnitY(Factor="-34")
unit_y_9 = UnitY(Factor="36.6")
unit_y_10 = UnitY(Factor="23.6")
unit_y_11 = UnitY(Factor="32")
panel_3 = Panel("32")
unit_y_12 = UnitY(Factor="-19")
unit_y_13 = UnitY(Factor="22")
unit_y_14 = UnitY(Factor="-32")
unit_z_10 = UnitZ(Factor="-14")
unit_z_11 = UnitZ(Factor="-14")
unit_y_15 = UnitY(Factor="32")
unit_z_12 = UnitZ(Factor="-32")
unit_z_13 = UnitZ(Factor="-32")

parafuso_d = Mesh([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])
mesh = Mesh(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)
point_2 = Point(Point(-186.6000977, 13, 50))

unit_z_14 = UnitZ(Factor="-14")
unit_z_15 = UnitZ(Factor="14")
unit_z_16 = UnitZ(Factor="-32")
unit_z_17 = UnitZ(Factor="32")
unit_z_18 = UnitZ(Factor="-28")
unit_z_19 = UnitZ(Factor="-64")
porca = Mesh(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)

point_3 = Point(Point(-312.5, 12.5, 0))
cavilha = Mesh(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)

cantoneira = Mesh(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)
parafuso_e = Mesh([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])
point_4 = Point(Point(-263, 0, 7))

parafuso_f = Mesh(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)
suporte = Mesh(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)
point_5 = Point(Point(-991.4796253, 0, 8.5))
unit_y_16 = UnitY(Factor="8")

# ----
# Multiplocador de Verticales
panel_4 = Panel("6")

# ----
# Costado Izquierdo
panel_5 = Panel("0")
altura_pata = Panel("50")
list_item = ListItem(List=deconstruct_brep.Vertices, Index=panel_5, Wrap=True)
unit_z_20 = UnitZ(Factor=altura_pata)
move = Move(Geometry=list_item, Motion=unit_z_20)  # -> Geometry, Transform
desfase = Panel("16")
unit_x_4 = UnitX(Factor=desfase)
list_item_2 = ListItem(List=move.Geometry, Index="4", Wrap=True)
move_2 = Move(Geometry=list_item_2, Motion=unit_x_4)  # -> Geometry, Transform
unit_y_17 = UnitY(Factor="20")
move_3 = Move(Geometry=move_2.Geometry, Motion=unit_y_17)  # -> Geometry, Transform

unit_y_18 = UnitY(Factor="29.6")
unit_z_21 = UnitZ(Factor="-48.5")
unit_y_19 = UnitY(Factor="29.6")
unit_x_5 = UnitX(Factor="12")

unit_y_20 = UnitY(Factor="-90")
unit_y_21 = UnitY(Factor="80")
unit_y_22 = UnitY(Factor="-67.5")
unit_y_23 = UnitY(Factor="67.1")

# ----
# Espaldares
panel_6 = Panel("-9")
unit_x_6 = UnitX(Factor=panel_6)
unit_x_7 = UnitX(Factor="-9")
unit_z_22 = UnitZ(Factor="-105")

# ----
# Espaldares
deslocamento_superior = Slider(16, range=0..100)
deslocamento_inferior = Slider(15, range=0..100)
tipo_de_borda_d = ValueList({"Prego", "Parafuso", "Grampo", "Perfil"}, selected="Perfil")
tipo_de_borda_a = ValueList({"Prego", "Parafuso", "Grampo", "Perfil"}, selected="Prego")
tipo_de_borda_c = ValueList({"Prego", "Parafuso", "Grampo", "Perfil"}, selected="Grampo")
tipo_de_borda_x = ValueList({"Prego", "Parafuso", "Grampo", "Perfil"}, selected="Parafuso")
tipo_de_borda_b = ValueList({"Prego", "Parafuso", "Grampo", "Perfil"}, selected="Perfil")
tipo_de_borda_y = ValueList({"Prego", "Parafuso", "Grampo", "Perfil"}, selected="Prego")
tipo_de_borda_e = ValueList({"Prego", "Parafuso", "Grampo", "Perfil"}, selected="Prego")
parafuso = Mesh(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)
grampo = Mesh(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)
prego = Mesh(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)
point_6 = Point(Point(-819.4079518, 19.5, 0))
point_7 = Point(Point(-776.9966262, 7.283318153, 0))
point_8 = Point(Point(-865.2916289, 18.8, 0))
curve = Curve(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)
point_9 = Point(Point(-910.3114334, 1.25, 0))

# ----
# Costado Derecho
panel_7 = Panel("3")
unit_y_24 = UnitY(Factor=panel_7)

# ----
# Zocalos
rh_in_01_4_altura_zocalo = Slider(73, range=50..120)
unit_y_25 = UnitY(Factor="3")
unit_y_26 = UnitY(Factor="12")
unit_z_23 = UnitZ(Factor=rh_in_01_4_altura_zocalo)

addition = Addition(A=rh_in_01_4_altura_zocalo, B="2")
unit_z_24 = UnitZ(Factor=addition)

unit_z_25 = UnitZ(Factor=rh_in_01_4_altura_zocalo)

# ----
# Maquinados Lateral de Cajon
panel_8 = Panel("4")
unit_z_26 = UnitZ(Factor="-11.1")
unit_y_27 = UnitY(Factor="-9")
rh_in_02_1_ritmo = ValueList({"32", "64", "96"}, selected="64")
unit_z_27 = UnitZ(Factor=rh_in_02_1_ritmo)
negative = Negative(Value=unit_z_27)

# ----
# Parafuso C x0,x1
# 3BF Mecanizador V0.5
orientacion_mecanizado = ValueList({"x0,x1": 1, "x1,x0": 2, "y0,y1": 3, "y1,y0": 4, "z0,z1": 5, "z1,z0": 6}, selected="x1,x0")
giro_mecanizado = ValueList({"Frente": 0, "Arriba": 90, "Pesterior": 180, "Abajo": 270}, selected="Abajo")
mecanizados = Brep(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)
parafuso_c = Mesh(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)
point_10 = Point(Point(-724.6362607, 0, 0))

# ----
# Tarugo x0,x1
# 3BF Mecanizador V0.5
orientacion_mecanizado_2 = ValueList({"x0,x1": 1, "x1,x0": 2, "y0,y1": 3, "y1,y0": 4, "z0,z1": 5, "z1,z0": 6}, selected="z1,z0")
giro_mecanizado_2 = ValueList({"Frente": 0, "Arriba": 90, "Pesterior": 180, "Abajo": 270}, selected="Frente")
mecanizados_2 = Brep(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)
cavilha_2 = Mesh(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)
point_11 = Point(Point(-590.8767532, 0, 0))

# ---- group: Ranuras Laterales
unit_z_28 = UnitZ(Factor="16.5")
unit_x_8 = UnitX(Factor="6")
unit_x_9 = UnitX(Factor="6")

# ----
# Distribucion Tapaluces - Frente de Cajon
panel_9 = Panel("0")
unit_y_28 = UnitY(Factor="-0.6")
unit_y_29 = UnitY(Factor="-0.6")
unit_z_29 = UnitZ(Factor="20")
unit_z_30 = UnitZ(Factor="20")
unit_x_10 = UnitX(Factor="-4")
unit_x_11 = UnitX(Factor="4")
subtraction_2 = Subtraction(A=cantidad_cajones, B="1")
multiplication = Multiplication(A=subtraction_2, B="36")
unit_y_30 = UnitY(Factor="-15")

# ----
# Tapaluces - Frente de Cajon
panel_10 = Panel("8")
unit_z_31 = UnitZ(Factor=panel_10)
unit_x_12 = UnitX(Factor="-4")
unit_y_31 = UnitY(Factor="-0.6")
unit_y_32 = UnitY(Factor="-0.6")
unit_z_32 = UnitZ(Factor="20")
unit_z_33 = UnitZ(Factor="20")
subtraction_3 = Subtraction(A=cantidad_cajones, B="1")
negative_2 = Negative(Value="4")
unit_x_13 = UnitX(Factor=negative_2)
unit_x_14 = UnitX(Factor="4")
multiplication_2 = Multiplication(A=subtraction_3, B="36")
unit_y_33 = UnitY(Factor="-15")

# ----
# Cantoneira Top
# 3BF Mecanizador V0.5
orientacion_mecanizado_3 = ValueList({"x0,x1": 1, "x1,x0": 2, "y0,y1": 3, "y1,y0": 4, "z0,z1": 5, "z1,z0": 6}, selected="y0,y1")
giro_mecanizado_3 = ValueList({"Frente": 0, "Arriba": 90, "Pesterior": 180, "Abajo": 270}, selected="Frente")
cantoneira_2 = Mesh(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)
parafuso_d_2 = Mesh([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])
point_12 = Point(Point(-371.4723377, 7.025354377, 20.03542941))

# ----
# 3BF Mecanizador V0.5
# Clavo
orientacion_mecanizado_4 = ValueList({"x0,x1": 1, "x1,x0": 2, "y0,y1": 3, "y1,y0": 4, "z0,z1": 5, "z1,z0": 6}, selected="x0,x1")
giro_mecanizado_4 = ValueList({"Frente": 0, "Arriba": 90, "Pesterior": 180, "Abajo": 270}, selected="Frente")

unit_x_15 = UnitX(Factor="6")

unit_x_16 = UnitX(Factor="-6")
unit_z_34 = UnitZ(Factor=rh_in_01_4_altura_zocalo)
unit_y_34 = UnitY(Factor="-12")

# ----
# Refuerzos Inferiores
panel_11 = Panel("1")
unit_z_35 = UnitZ(Factor=rh_in_01_4_altura_zocalo)
unit_z_36 = UnitZ(Factor="12")
unit_y_35 = UnitY(Factor="80")

unit_y_36 = UnitY(Factor="0.6")
unit_z_37 = UnitZ(Factor="-60")
unit_y_37 = UnitY(Factor="12")

unit_z_38 = UnitZ(Factor="13.5")
unit_y_38 = UnitY(Factor="0.6")

unit_y_39 = UnitY(Factor="0.6")

unit_y_40 = UnitY(Factor="0.6")
unit_z_39 = UnitZ(Factor="-60")
unit_y_41 = UnitY(Factor="12")

# ----
# Paral Central
panel_12 = Panel("0")
addition_2 = Addition(A=rh_in_01_4_altura_zocalo, B="12")
unit_z_40 = UnitZ(Factor=addition_2)

# ----
# Refuerzos Unico Inferior Movil
panel_13 = Panel("-43.5")
unit_x_17 = UnitX(Factor=panel_13)
unit_z_41 = UnitZ(Factor="-20.5")
unit_z_42 = UnitZ(Factor="-32")

unit_y_42 = UnitY(Factor="0.6")

# ----
# Lateral de Cajon
panel_14 = Panel("14")
unit_x_18 = UnitX(Factor=panel_14)
rh_in_02_0_altura_lateral_de_cajon = ValueList({"80", "110", "120"}, selected="110")
unit_z_43 = UnitZ(Factor="17.5")
unit_z_44 = UnitZ(Factor=rh_in_02_0_altura_lateral_de_cajon)
unit_x_19 = UnitX(Factor="12")
unit_y_43 = UnitY(Factor="350")

unit_z_45 = UnitZ(Factor="-120")
unit_y_44 = UnitY(Factor="-12")

unit_z_46 = UnitZ(Factor="-120")
unit_y_45 = UnitY(Factor="-12")

# ----
# Maquinados Frente de Cajon
panel_15 = Panel("7")
unit_y_46 = UnitY(Factor="-10")
unit_z_47 = UnitZ(Factor="-20")
unit_z_48 = UnitZ(Factor="30")
unit_z_49 = UnitZ(Factor="34")
unit_x_20 = UnitX(Factor="4")
unit_x_21 = UnitX(Factor="-4")
unit_y_47 = UnitY(Factor="-6")
unit_y_48 = UnitY(Factor="-0.1")

# ----
# Parafuso B x0,x1 UNITARIO
# 3BF Mecanizador V0.5
orientacion_mecanizado_5 = ValueList({"x0,x1": 1, "x1,x0": 2, "y0,y1": 3, "y1,y0": 4, "z0,z1": 5, "z1,z0": 6}, selected="x0,x1")
giro_mecanizado_5 = ValueList({"Frente": 0, "Arriba": 90, "Pesterior": 180, "Abajo": 270}, selected="Frente")
mecanizados_3 = Brep(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)
parafuso_b = Mesh(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)
point_13 = Point(Point(-653.4233076, 0, 0))

# ----
# Tarugo x0,x1 UNITARIO
# 3BF Mecanizador V0.5
orientacion_mecanizado_6 = ValueList({"x0,x1": 1, "x1,x0": 2, "y0,y1": 3, "y1,y0": 4, "z0,z1": 5, "z1,z0": 6}, selected="x0,x1")
giro_mecanizado_6 = ValueList({"Frente": 0, "Arriba": 90, "Pesterior": 180, "Abajo": 270}, selected="Frente")
mecanizados_4 = Brep(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)
point_14 = Point(Point(-590.8767532, 0, 0))
cavilha_3 = Mesh(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)

# ----
# Cantoneira Top
# 3BF Mecanizador V0.5
orientacion_mecanizado_7 = ValueList({"x0,x1": 1, "x1,x0": 2, "y0,y1": 3, "y1,y0": 4, "z0,z1": 5, "z1,z0": 6}, selected="x1,x0")
giro_mecanizado_7 = ValueList({"Frente": 0, "Arriba": 90, "Pesterior": 180, "Abajo": 270}, selected="Abajo")
cantoneira_3 = Mesh(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)
parafuso_d_3 = Mesh([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])
point_15 = Point(Point(-371.4723377, 7.025354377, 20.03542941))

# ----
# Tarugo x0,x1
# 3BF Mecanizador V0.5
orientacion_mecanizado_8 = ValueList({"x0,x1": 1, "x1,x0": 2, "y0,y1": 3, "y1,y0": 4, "z0,z1": 5, "z1,z0": 6}, selected="x1,x0")
giro_mecanizado_8 = ValueList({"Frente": 0, "Arriba": 90, "Pesterior": 180, "Abajo": 270}, selected="Frente")
mecanizados_5 = Brep(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)
cavilha_4 = Mesh(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)
point_16 = Point(Point(-590.8767532, 0, 0))

# ----
# Parafuso B x0,x1 Z
# 3BF Mecanizador V0.5
orientacion_mecanizado_9 = ValueList({"x0,x1": 1, "x1,x0": 2, "y0,y1": 3, "y1,y0": 4, "z0,z1": 5, "z1,z0": 6}, selected="x1,x0")
giro_mecanizado_9 = ValueList({"Frente": 0, "Arriba": 90, "Pesterior": 180, "Abajo": 270}, selected="Frente")
mecanizados_6 = Brep(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)
parafuso_b_2 = Mesh(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)
point_17 = Point(Point(-653.4233076, 0, 0))

# ----
# Cubierta Superior
panel_16 = Panel("6")
unit_z_50 = UnitZ(Factor="-15")
list_item_3 = ListItem(List=deconstruct_brep.Vertices, Index="4", Wrap=True)
list_item_4 = ListItem(List=deconstruct_brep.Vertices, Index=panel_16, Wrap=True)
move_4 = Move(Geometry=list_item_3, Motion=unit_z_50)  # -> Geometry, Transform
addition_3 = Addition(A=desfase, B="12")
unit_x_22 = UnitX(Factor=addition_3)

# ---- group: Peca 13
box_2pt = Box2Pt(PointA=move_4.Geometry, PointB=list_item_4, Plane=PlaneXY(0, 0, 0))

# ----
deconstruct_brep_2 = DeconstructBrep(Brep=box_2pt)  # -> Faces, Edges, Vertices
list_item_5 = ListItem(List=deconstruct_brep_2.Vertices, Index="3", Wrap=True)
move_5 = Move(Geometry=list_item_5, Motion=unit_x_22)  # -> Geometry, Transform

box_2pt_2 = Box2Pt(PointA=move_3.Geometry, PointB=move_5.Geometry, Plane=PlaneXY(0, 0, 0))
deconstruct_brep_3 = DeconstructBrep(Brep=box_2pt_2)  # -> Faces, Edges, Vertices

list_item_6 = ListItem(List=deconstruct_brep_3.Edges, Index="8", Wrap=True)
curve_middle = CurveMiddle(Curve=list_item_6)
list_item_7 = ListItem(List=deconstruct_brep_3.Vertices, Index="5", Wrap=True)
move_6 = Move(Geometry=list_item_7, Motion=unit_y_18)  # -> Geometry, Transform
xy_plane = XYPlane(Origin=curve_middle)
move_7 = Move(Geometry=move_6.Geometry, Motion=unit_z_21)  # -> Geometry, Transform
move_8 = Move(Geometry=curve_middle, Motion=unit_y_19)  # -> Geometry, Transform
mirror = Mirror(Geometry=move_7.Geometry, Plane=xy_plane)  # -> Geometry, Transform
move_9 = Move(Geometry=move_8.Geometry, Motion=unit_x_5)  # -> Geometry, Transform
stream_filter_2 = StreamFilter(
    Gate=cantidad_cajones,
    Stream1=[move_7.Geometry, mirror.Geometry],
    Stream2=[move_7.Geometry, mirror.Geometry, move_9.Geometry],
    Stream3=[move_7.Geometry, mirror.Geometry, move_9.Geometry],
    Stream4=[move_7.Geometry, mirror.Geometry, move_9.Geometry])

list_item_8 = ListItem(List=deconstruct_brep_3.Vertices, Index="6", Wrap=True)
list_item_9 = ListItem(List=deconstruct_brep_3.Edges, Index="4", Wrap=True)
list_item_10 = ListItem(List=deconstruct_brep_3.Edges, Index="6", Wrap=True)
curve_middle_2 = CurveMiddle(Curve=list_item_10)
curve_middle_3 = CurveMiddle(Curve=list_item_9)
move_10 = Move(Geometry=list_item_8, Motion=unit_y_20)  # -> Geometry, Transform
move_11 = Move(Geometry=list_item_7, Motion=unit_y_21)  # -> Geometry, Transform
move_12 = Move(Geometry=curve_middle_2, Motion=unit_y_22)  # -> Geometry, Transform
move_13 = Move(Geometry=curve_middle_3, Motion=unit_y_23)  # -> Geometry, Transform

list_item_11 = ListItem(List=deconstruct_brep_3.Vertices, Index="2", Wrap=True)
move_14 = Move(Geometry=list_item_8, Motion=unit_x_6)  # -> Geometry, Transform
move_15 = Move(Geometry=list_item_11, Motion=unit_x_7)  # -> Geometry, Transform
move_16 = Move(Geometry=move_14.Geometry, Motion=unit_z_22)  # -> Geometry, Transform
move_17 = Move(Geometry=move_15.Geometry, Motion=unit_z_24)  # -> Geometry, Transform
mirror_2 = Mirror(Geometry=move_16.Geometry, Plane=yz_plane)  # -> Geometry, Transform
line = Line(StartPoint=move_16.Geometry, EndPoint=mirror_2.Geometry)

# ---- group: Peca 10
mirror_3 = Mirror(Geometry=box_2pt_2, Plane=yz_plane)  # -> Geometry, Transform

# ----
deconstruct_brep_4 = DeconstructBrep(Brep=mirror_3.Geometry)  # -> Faces, Edges, Vertices
deconstruct_brep_5 = DeconstructBrep(Brep=box_2pt_2)  # -> Faces, Edges, Vertices
list_item_12 = ListItem(List=deconstruct_brep_5.Edges, Index="2", Wrap=True)
list_item_13 = ListItem(List=deconstruct_brep_4.Edges, Index=panel_4, Wrap=True)
curve_middle_4 = CurveMiddle(Curve=list_item_12)
curve_middle_5 = CurveMiddle(Curve=list_item_13)
distance = Distance(PointA=curve_middle_4, PointB=curve_middle_5)
expression_2 = Expression(x=distance, y=rh_in_01_0_ancho_300_1600, Expression="if(x<700, 1,2)")
division = Division(A=distance, B=expression_2)
unit_x_23 = UnitX(Factor=division)
stream_gate = StreamGate(Segmentos=unit_x_23, Gate=expression_2)  # -> Target0, Target1, Target2, Target3, Target4

deconstruct_brep_6 = DeconstructBrep(Brep=mirror_3.Geometry)  # -> Faces, Edges, Vertices
list_item_14 = ListItem(List=deconstruct_brep_6.Vertices, Index="5", Wrap=True)
move_18 = Move(Geometry=list_item_14, Motion=unit_y_24)  # -> Geometry, Transform
move_19 = Move(Geometry=list_item_14, Motion=unit_z_25)  # -> Geometry, Transform

malla_b = Python3Script(
    Point_A=mirror_2.Geometry,
    Point_B=move_16.Geometry,
    Point_C=move_17.Geometry,
    Espaciado="1.5",
    Borde_A=tipo_de_borda_a,
    Borde_B=tipo_de_borda_b,
    Borde_C=tipo_de_borda_c,
    Borde_D=tipo_de_borda_d,
    Borde_E=tipo_de_borda_e,
    Borde_X=tipo_de_borda_x,
    Borde_Y=tipo_de_borda_y,
    Malla_Prego=prego,
    Point_Prego=point_6,
    Malla_Parafuso=parafuso,
    Point_Parafuso=point_7,
    Malla_Grampo=grampo,
    Point_Grampo=point_8,
    Curva_Perfil=curve,
    Point_Perfil=point_9,
    Deslocamento_Superior=deslocamento_superior,
    Deslocamento_Inferior=deslocamento_inferior)  # -> out, Fondos, Prego, Parafuso, Grampo, Perfil; inputs Point_A: Point3d, Point_B: Point3d, Point_C: Point3d, Espaciado: Double, Malla_Prego: Mesh, Point_Prego: Point3d, Malla_Parafuso: Mesh, Point_Parafuso: Point3d, Malla_Grampo: Mesh, Point_Grampo: Point3d, Curva_Perfil: Curve, Point_Perfil: Point3d
# ---------- malla_b: Python ----------
# -*- coding: utf-8 -*-
"""
=============================================================================
3BF Costas v0.8 - GENERADOR PARAMÉTRICO DE FONDOS CON EMPAQUE RTA INDUSTRIAL
Powered by 3dBimFab
=============================================================================
Reglas Físicas de Manufactura y Empaque:
1. Muebles Angostos (ancho_vano <= 800 mm):
   - Siempre 1 SOLO FONDO completo (ej. Cómoda 600x900, Mesas de Noche).
2. Muebles Bajos y Anchos (alto_vano <= ancho_caja):
   - El fondo cabe entero acostado a lo largo de la caja -> 1 SOLO FONDO (ej. Cómoda 1600).
3. Muebles Anchos y Altos (ancho_vano > 800 mm y alto_vano > ancho_caja):
   - Si (ancho_vano / 2) <= ancho_caja -> 2 FONDOS con 1 perfil central.
   - Si (ancho_vano / 2) > ancho_caja  -> 4 FONDOS con perfiles y grapas (ej. Cómoda 1395).
=============================================================================
"""

import math
import Rhino.Geometry as rg

def normalizar_herraje(valor):
    if not valor:
        return "ninguno"
    v = str(valor).strip().lower().replace('"', '').replace("'", "")
    if any(k in v for k in ["prego", "puntilla", "clavo"]):
        return "prego"
    if any(k in v for k in ["parafuso", "tornillo"]):
        return "parafuso"
    if any(k in v for k in ["grampo", "grapa"]):
        return "grampo"
    if any(k in v for k in ["perfil", "perfil_h", "perfil h"]):
        return "perfil"
    return "ninguno"

def calcular_puntos_equidistantes(p_ini, p_fin, paso_nominal=100.0, min_paso=80.0, max_paso=120.0):
    vector_linea = rg.Vector3d(p_fin - p_ini)
    longitud = vector_linea.Length
    if longitud < 1.0:
        return [p_ini]
    
    num_div = int(round(longitud / paso_nominal))
    if num_div < 1:
        num_div = 1
        
    paso = longitud / float(num_div)
    while paso > max_paso:
        num_div += 1
        paso = longitud / float(num_div)
        
    while paso < min_paso and num_div > 1:
        nuevo_paso = longitud / float(num_div - 1)
        if nuevo_paso <= max_paso:
            num_div -= 1
            paso = nuevo_paso
        else:
            break
            
    puntos = []
    vector_unitario = rg.Vector3d(vector_linea)
    vector_unitario.Unitize()
    
    for i in range(num_div + 1):
        dist = i * paso
        pt = p_ini + (vector_unitario * dist)
        puntos.append(pt)
        
    return puntos

def instanciar_geometria(geometria, pt_origen, pt_destino):
    if not geometria or not pt_destino:
        return None
    if not pt_origen:
        bbox = geometria.GetBoundingBox(True)
        pt_origen = bbox.Center
    vector_traslacion = rg.Vector3d(pt_destino - pt_origen)
    transformacion = rg.Transform.Translation(vector_traslacion)
    geo_copia = geometria.Duplicate()
    geo_copia.Transform(transformacion)
    return geo_copia

def extruir_perfil_malla_limpia(curva_base, pt_ref, pt_top, pt_bot):
    if not curva_base or not pt_top or not pt_bot:
        return None
        
    if isinstance(curva_base, (list, tuple)):
        curvas_unidas = rg.Curve.JoinCurves(curva_base)
        c_work = curvas_unidas[0] if curvas_unidas and len(curvas_unidas) > 0 else curva_base[0]
    else:
        c_work = curva_base

    if not pt_ref:
        bbox = c_work.GetBoundingBox(True)
        pt_ref = bbox.Center

    vec_ext = rg.Vector3d(pt_bot - pt_top)
    longitud = vec_ext.Length
    if longitud < 1.0:
        return None

    vec_pos = rg.Vector3d(pt_top - pt_ref)
    c_pos = c_work.DuplicateCurve()
    c_pos.Transform(rg.Transform.Translation(vec_pos))

    solido_brep = None
    try:
        exito, plano_curva = c_pos.TryGetPlane()
        if exito:
            dot = rg.Vector3d.Multiply(vec_ext, plano_curva.Normal)
            altura_firmada = -longitud if dot < 0.0 else longitud
            ext_geom = rg.Extrusion.Create(c_pos, altura_firmada, True)
            if ext_geom:
                solido_brep = ext_geom.ToBrep()
    except:
        pass

    if not solido_brep:
        carril = rg.Line(pt_top, pt_bot).ToNurbsCurve()
        try:
            barridos = rg.Brep.CreateFromSweep(carril, [c_pos], True, 0.01)
            if barridos and len(barridos) > 0:
                solido_brep = barridos[0]
                if not solido_brep.IsSolid:
                    solido_brep = solido_brep.CapPlanarHoles(0.01)
        except:
            pass

    if solido_brep:
        solido_brep.MergeCoplanarFaces(0.01)
        solido_brep.Compact()

        mp = rg.MeshingParameters()
        mp.SimplePlanes = True
        mp.RefineGrid = False
        mp.GridMinCount = 1
        mp.GridMaxCount = 0
        mp.GridAspectRatio = 0.0
        mp.MinimumEdgeLength = 0.0
        mp.MaximumEdgeLength = 0.0

        mallas = rg.Mesh.CreateFromBrep(solido_brep, mp)
        if mallas and len(mallas) > 0:
            malla_final = rg.Mesh()
            for m in mallas:
                malla_final.Append(m)
            malla_final.Weld(math.radians(35.0))
            malla_final.Compact()
            return malla_final

    return None

# Salidas
Fondos = []
Prego = []
Parafuso = []
Grampo = []
Perfil = []

if not Point_A or not Point_B or not Point_C:
    print("3BF Costas v0.8 | ERROR: Se requieren Point_A, Point_B y Point_C.")
else:
    # 1. Puntos del vano
    pts_vano = [Point_A, Point_B, Point_C]
    min_x = min(p.X for p in pts_vano)
    max_x = max(p.X for p in pts_vano)
    min_z = min(p.Z for p in pts_vano)
    max_z = max(p.Z for p in pts_vano)
    y_plano = (Point_A.Y + Point_B.Y + Point_C.Y) / 3.0
    
    ancho_vano = max_x - min_x
    alto_vano = max_z - min_z
    
    vec_H = rg.Vector3d(1.0, 0.0, 0.0) # +X
    vec_V = rg.Vector3d(0.0, 0.0, 1.0) # +Z

    pt_BL_global = rg.Point3d(min_x, y_plano, min_z)
    pt_TL_global = rg.Point3d(min_x, y_plano, max_z)
    pt_BR_global = rg.Point3d(max_x, y_plano, min_z)
    pt_TR_global = rg.Point3d(max_x, y_plano, max_z)
    
    # =========================================================================
    # 2. CLASIFICACIÓN ESTRICTA DE EMPAQUE RTA
    # =========================================================================
    ancho_caja = float(Ancho_Caja) if 'Ancho_Caja' in globals() and Ancho_Caja is not None else 475.0
    largo_caja = float(Largo_Caja) if 'Largo_Caja' in globals() and Largo_Caja is not None else 1600.0

    # Regla 1: Muebles Angostos (<= 800 mm de ancho de vano):
    # En cualquier mueble de 1 columna (600x900, mesas de noche), SIEMPRE es 1 solo fondo.
    es_mueble_angosto = (ancho_vano <= 800.0)

    # Regla 2: Fondos Acostados (alto del vano entra en el ancho de la caja, ej: cómoda 1600):
    cabe_acostado = (ancho_vano <= largo_caja and alto_vano <= ancho_caja) or \
                    (alto_vano <= largo_caja and ancho_vano <= ancho_caja)

    if es_mueble_angosto or cabe_acostado:
        num_fondos = 1
    else:
        # Mueble ancho y alto (ancho_vano > 800 mm y alto_vano > ancho_caja)
        if (ancho_vano / 2.0) <= ancho_caja:
            num_fondos = 2
        else:
            num_fondos = 4
        
    ancho_fondo = ancho_vano / float(num_fondos)
    alto_fondo = alto_vano
    
    espesor_fondo = float(Espesor) if 'Espesor' in globals() and Espesor is not None else 3.0
    sentido_y = float(Sentido_Y) if 'Sentido_Y' in globals() and Sentido_Y is not None else 1.0
    
    y_ini = y_plano
    y_fin = y_plano + (espesor_fondo * sentido_y)
    y_min_box = min(y_ini, y_fin)
    y_max_box = max(y_ini, y_fin)

    despl_sup = float(Deslocamento_Superior) if 'Deslocamento_Superior' in globals() and Deslocamento_Superior is not None else 0.0
    despl_inf = float(Deslocamento_Inferior) if 'Deslocamento_Inferior' in globals() and Deslocamento_Inferior is not None else 0.0
    
    val_esp = float(Espaciado) if 'Espaciado' in globals() and Espaciado is not None else 100.0
    paso_nom = 100.0 if val_esp < 50.0 else val_esp

    # 3. Creación de Fondos (Sólidos DfMA de 6 Caras)
    datos_fondos = []
    for i in range(num_fondos):
        x_ini = min_x + (i * ancho_fondo)
        x_fin = min_x + ((i + 1) * ancho_fondo)
        
        p_BL = rg.Point3d(x_ini, y_plano, min_z)
        p_BR = rg.Point3d(x_fin, y_plano, min_z)
        p_TL = rg.Point3d(x_ini, y_plano, max_z)
        p_TR = rg.Point3d(x_fin, y_plano, max_z)
        
        if espesor_fondo > 0.0:
            bbox_box = rg.BoundingBox(x_ini, y_min_box, min_z, x_fin, y_max_box, max_z)
            solido_fondo = bbox_box.ToBrep()
            if solido_fondo and solido_fondo.IsValid:
                Fondos.append(solido_fondo)
        else:
            superficie = rg.NurbsSurface.CreateFromCorners(p_TL, p_TR, p_BR, p_BL)
            if superficie:
                Fondos.append(superficie)
            
        datos_fondos.append({
            "BL": p_BL, "BR": p_BR, "TL": p_TL, "TR": p_TR
        })

    # 4. Herrajes
    tipo_X = normalizar_herraje(Borde_X if 'Borde_X' in globals() else None)
    tipo_Y = normalizar_herraje(Borde_Y if 'Borde_Y' in globals() else None)
    tipo_izq = normalizar_herraje(Borde_A if 'Borde_A' in globals() else "prego")
    borde_der_raw = globals().get('Borde_E') or globals().get('Borde_A')
    tipo_der = normalizar_herraje(borde_der_raw)

    tipo_B = normalizar_herraje(Borde_B if 'Borde_B' in globals() else None)
    tipo_C = normalizar_herraje(Borde_C if 'Borde_C' in globals() else None)
    tipo_D = normalizar_herraje(Borde_D if 'Borde_D' in globals() else None)

    geometria_perfil = globals().get('Curva_Perfil') or globals().get('Malla_Perfil')
    ref_pt_perfil = globals().get('Point_Perfil')

    def obtener_offset(tipo):
        if tipo == "prego":
            return 3.0
        elif tipo == "parafuso":
            return 7.5
        elif tipo == "grampo":
            return 3.0
        return 0.0

    lineas_distribucion = []

    # Bordes exteriores perimetrales
    if tipo_X in ["prego", "parafuso", "grampo"]:
        off = obtener_offset(tipo_X)
        p_ini = pt_TL_global + (vec_H * off) - (vec_V * off)
        p_fin = pt_TR_global - (vec_H * off) - (vec_V * off)
        lineas_distribucion.append((p_ini, p_fin, tipo_X))

    if tipo_Y in ["prego", "parafuso", "grampo"]:
        off = obtener_offset(tipo_Y)
        p_ini = pt_BL_global + (vec_H * off) + (vec_V * off)
        p_fin = pt_BR_global - (vec_H * off) + (vec_V * off)
        lineas_distribucion.append((p_ini, p_fin, tipo_Y))

    if tipo_izq in ["prego", "parafuso", "grampo"]:
        off = obtener_offset(tipo_izq)
        p_ini = pt_BL_global + (vec_H * off) + (vec_V * off)
        p_fin = pt_TL_global + (vec_H * off) - (vec_V * off)
        lineas_distribucion.append((p_ini, p_fin, tipo_izq))

    if tipo_der in ["prego", "parafuso", "grampo"]:
        off = obtener_offset(tipo_der)
        p_ini = pt_BR_global - (vec_H * off) + (vec_V * off)
        p_fin = pt_TR_global - (vec_H * off) - (vec_V * off)
        lineas_distribucion.append((p_ini, p_fin, tipo_der))

    # Juntas intermedias (solo si num_fondos >= 2)
    if num_fondos == 2:
        j_top = pt_TL_global + (vec_H * ancho_fondo)
        j_bot = pt_BL_global + (vec_H * ancho_fondo)
        herraje_junta_central = tipo_B if tipo_B in ["perfil", "grampo", "prego", "parafuso"] else tipo_C
        
        if herraje_junta_central == "perfil":
            if geometria_perfil:
                p_perfil_top = j_top - (vec_V * despl_sup)
                p_perfil_bot = j_bot + (vec_V * despl_inf)
                malla_perfil = extruir_perfil_malla_limpia(geometria_perfil, ref_pt_perfil, p_perfil_top, p_perfil_bot)
                if malla_perfil:
                    Perfil.append(malla_perfil)
        elif herraje_junta_central in ["grampo", "prego", "parafuso"]:
            p_ini = j_bot + (vec_V * 20.0)
            p_fin = j_top - (vec_V * 20.0)
            lineas_distribucion.append((p_ini, p_fin, herraje_junta_central))

    elif num_fondos == 4:
        tipos_junturas = [tipo_B, tipo_C, tipo_D]
        for idx_j, t_junt in enumerate(tipos_junturas, start=1):
            j_top = pt_TL_global + (vec_H * (idx_j * ancho_fondo))
            j_bot = pt_BL_global + (vec_H * (idx_j * ancho_fondo))
            
            if t_junt == "perfil":
                if geometria_perfil:
                    p_perfil_top = j_top - (vec_V * despl_sup)
                    p_perfil_bot = j_bot + (vec_V * despl_inf)
                    malla_perfil = extruir_perfil_malla_limpia(geometria_perfil, ref_pt_perfil, p_perfil_top, p_perfil_bot)
                    if malla_perfil:
                        Perfil.append(malla_perfil)
            elif t_junt in ["grampo", "prego", "parafuso"]:
                p_ini = j_bot + (vec_V * 20.0)
                p_fin = j_top - (vec_V * 20.0)
                lineas_distribucion.append((p_ini, p_fin, t_junt))

    # Puntos equidistantes y herrajes
    puntos_con_tipo = []
    for p_ini, p_fin, tipo in lineas_distribucion:
        pts = calcular_puntos_equidistantes(p_ini, p_fin, paso_nominal=paso_nom, min_paso=80.0, max_paso=120.0)
        for p in pts:
            duplicado = False
            for p_existente, _ in puntos_con_tipo:
                if p.DistanceTo(p_existente) < 15.0:
                    duplicado = True
                    break
            if not duplicado:
                puntos_con_tipo.append((p, tipo))

    puntillas_en_grapas = 0
    despl_grampo_y = float(Deslocamento_Grampo_Y) if 'Deslocamento_Grampo_Y' in globals() and Deslocamento_Grampo_Y is not None else 0.7
    vector_ajuste_y = rg.Vector3d(0.0, despl_grampo_y, 0.0)

    for pt, tipo in puntos_con_tipo:
        if tipo == "prego" and 'Malla_Prego' in globals() and Malla_Prego:
            pt_ref = Point_Prego if 'Point_Prego' in globals() and Point_Prego else None
            inst = instanciar_geometria(Malla_Prego, pt_ref, pt)
            if inst:
                Prego.append(inst)
        elif tipo == "parafuso" and 'Malla_Parafuso' in globals() and Malla_Parafuso:
            pt_ref = Point_Parafuso if 'Point_Parafuso' in globals() and Point_Parafuso else None
            inst = instanciar_geometria(Malla_Parafuso, pt_ref, pt)
            if inst:
                Parafuso.append(inst)
        elif tipo == "grampo":
            if 'Malla_Grampo' in globals() and Malla_Grampo:
                pt_ref_g = Point_Grampo if 'Point_Grampo' in globals() and Point_Grampo else None
                inst_g = instanciar_geometria(Malla_Grampo, pt_ref_g, pt)
                if inst_g:
                    Grampo.append(inst_g)
            if 'Malla_Prego' in globals() and Malla_Prego:
                pt_ref_p = Point_Prego if 'Point_Prego' in globals() and Point_Prego else None
                pt_puntilla_grapa = pt + vector_ajuste_y
                inst_p = instanciar_geometria(Malla_Prego, pt_ref_p, pt_puntilla_grapa)
                if inst_p:
                    Prego.append(inst_p)
                    puntillas_en_grapas += 1

    total_solidos = sum(1 for f in Fondos if hasattr(f, "IsSolid") and f.IsSolid)
    tipo_resumen = "Polisuperficies sólidas de 6 caras" if total_solidos == len(Fondos) else "Superficies de 1 cara"
    alt_perfil = alto_fondo - despl_sup - despl_inf

    print("3BF Costas v0.8 | Éxito")
    print("Vano: {:.1f} x {:.1f} mm -> Fondos: {} (Ancho c/u: {:.1f} mm) [{}]".format(
        ancho_vano, alto_vano, len(Fondos), ancho_fondo, tipo_resumen
    ))
    if len(Perfil) > 0:
        print("Perfil H -> Longitud: {:.1f} mm".format(alt_perfil))
    else:
        print("Perfil H -> Ninguno (Fondo único completo sin juntas)")
    print("Herrajes -> Pregos: {} | Parafusos: {} | Grampos: {} | Perfiles: {}".format(
        len(Prego), len(Parafuso), len(Grampo), len(Perfil)
    ))
# ---------- end malla_b ----------
parafuso_e_2 = Mesh(malla_b.Parafuso)
panel_17 = Panel(malla_b.out)
grampo_2 = Mesh(malla_b.Grampo)
brep = Brep(malla_b.Fondos)
prego_2 = Mesh(malla_b.Prego)
perfil = Mesh(malla_b.Perfil)
rh_out_grampo = Geometry(grampo_2)
rh_out_prego = Geometry(prego_2)
rh_out_perfil = Geometry(perfil)

point_18 = Point(stream_filter_2)
python_3_script = Python3Script(
    Point=point_18,
    Orientacion=orientacion_mecanizado,
    Giro=giro_mecanizado,
    Mecanizado_Nurbs=mecanizados,
    Dual_Point=point_10,
    Herraje_Malla_1=parafuso_c,
    Plane_Mirror_X=yz_plane)  # -> out, Mecanizado_Out, Herraje_Out_1, Herraje_Out_2; inputs Point: Point3d, Orientacion: String, Mecanizado_Nurbs: list of Brep, Dual_Point: Point3d, Herraje_Malla_1: Mesh, Herraje_Malla_2: Mesh, Plane_Mirror_X: Plane, Plane_Mirror_Y: Plane
# ---------- python_3_script: Python ----------
"""
================================================================================
NOMBRE:      3BF Mecanizador
VERSIÓN:     0.6 (Simetría y Espejos X/Y Automatizados)
AUTOR:       Mario Mojica
SUITE:       3dBimFab
ENTORNO:     Rhino 8 / Grasshopper (Python 3 CPython)
DESCRIPCIÓN: Posicionamiento, orientación 3D, giro axial y generación de copias
             en espejo automáticas a través de planos de simetría (Plane_Mirror_X 
             y Plane_Mirror_Y) para muebles y piezas simétricas.
================================================================================
"""

import Rhino.Geometry as rg
import math

# ==============================================================================
# 1. PARSEO DE GIRO AXIAL
# ==============================================================================
def parse_giro_axial(giro_val):
    if giro_val is None:
        return 0.0, "Frente (0°)"
    
    val_str = str(giro_val).strip().lower()
    
    if val_str in ["0", "0.0", "frente", "front"]:
        return 0.0, "Frente (0°)"
    elif val_str in ["90", "90.0", "posterior", "pesterior", "atras", "back"]:
        return math.radians(90.0), "Posterior (90°)"
    elif val_str in ["180", "180.0", "arriba", "up", "top"]:
        return math.radians(180.0), "Arriba (180°)"
    elif val_str in ["270", "270.0", "-90", "-90.0", "abajo", "down", "bottom"]:
        return math.radians(270.0), "Abajo (270°)"
    else:
        try:
            deg = float(val_str)
            return math.radians(deg), f"Personalizado ({deg}°)"
        except:
            return 0.0, "Frente (0°)"


# ==============================================================================
# 2. FUNCIÓN DE TRANSFORMACIÓN COMPUESTA (BASE -> DESTINO)
# ==============================================================================
def calcular_transformacion(pt_base, pt_destino, orientacion_val, giro_val):
    val_str = str(orientacion_val).strip().lower()
    
    # A. Giro axial sobre el eje X longitudinal del herraje
    angulo_rad, giro_label = parse_giro_axial(giro_val)
    if abs(angulo_rad) > 1e-6:
        rot_axial = rg.Transform.Rotation(angulo_rad, rg.Vector3d(1, 0, 0), pt_base)
    else:
        rot_axial = rg.Transform.Identity

    # B. Rotación principal según la orientación seleccionada
    if val_str in ["1", "x0,x1", "x0->x1", "x+"]:
        rot_orient = rg.Transform.Identity
        dir_label = "+X (Izquierda a Derecha)"
    elif val_str in ["2", "x1,x0", "x1->x0", "x-"]:
        rot_orient = rg.Transform.Rotation(math.pi, rg.Vector3d(0, 0, 1), pt_base)
        dir_label = "-X (Derecha a Izquierda)"
    elif val_str in ["3", "y0,y1", "y0->y1", "y+"]:
        rot_orient = rg.Transform.Rotation(math.pi / 2.0, rg.Vector3d(0, 0, 1), pt_base)
        dir_label = "+Y (Frente hacia Atrás)"
    elif val_str in ["4", "y1,y0", "y1->y0", "y-"]:
        rot_orient = rg.Transform.Rotation(-math.pi / 2.0, rg.Vector3d(0, 0, 1), pt_base)
        dir_label = "-Y (Atrás hacia el Frente)"
    elif val_str in ["5", "z0,z1", "z0->z1", "z+"]:
        rot_orient = rg.Transform.Rotation(-math.pi / 2.0, rg.Vector3d(0, 1, 0), pt_base)
        dir_label = "+Z (Abajo hacia Arriba)"
    elif val_str in ["6", "z1,z0", "z1->z0", "z-"]:
        rot_orient = rg.Transform.Rotation(math.pi / 2.0, rg.Vector3d(0, 1, 0), pt_base)
        dir_label = "-Z (Arriba hacia Abajo)"
    else:
        rot_orient = rg.Transform.Identity
        dir_label = "+X (Por defecto)"

    # C. Traslación desde pt_base hacia el punto destino
    vec_traslacion = pt_destino - pt_base
    trasl = rg.Transform.Translation(vec_traslacion)

    # Matriz total: Traslación * Rotación Orientación * Giro Axial
    xform_total = trasl * rot_orient * rot_axial
    return xform_total, dir_label, giro_label


# ==============================================================================
# 3. HELPER PARA APLICAR ESPEJO A GEOMETRÍAS (BREPS Y MESHES)
# ==============================================================================
def reflejar_geometrias(lista_breps, lista_meshes_1, lista_meshes_2, plano_espejo):
    if plano_espejo is None:
        return [], [], []
    
    xform_mirror = rg.Transform.Mirror(plano_espejo)
    
    breps_mirror = []
    m1_mirror = []
    m2_mirror = []

    for b in lista_breps:
        copia = b.DuplicateBrep() if hasattr(b, "DuplicateBrep") else b.Duplicate()
        copia.Transform(xform_mirror)
        breps_mirror.append(copia)

    for m in lista_meshes_1:
        copia = m.DuplicateMesh() if hasattr(m, "DuplicateMesh") else m.Duplicate()
        copia.Transform(xform_mirror)
        m1_mirror.append(copia)

    for m in lista_meshes_2:
        copia = m.DuplicateMesh() if hasattr(m, "DuplicateMesh") else m.Duplicate()
        copia.Transform(xform_mirror)
        m2_mirror.append(copia)

    return breps_mirror, m1_mirror, m2_mirror


def tiene_geometria(val):
    if val is None:
        return False
    if isinstance(val, list) and len(val) == 0:
        return False
    return True


# ==============================================================================
# 4. EJECUCIÓN DEL ALGORITMO PRINCIPAL
# ==============================================================================
mecanizados_base = []
herrajes_1_base = []
herrajes_2_base = []

mecanizados_out = []
herrajes_1_out = []
herrajes_2_out = []

puntos_destino = Point if isinstance(Point, list) else [Point] if Point is not None else []

hay_mecanizado = tiene_geometria(Mecanizado_Nurbs)
hay_malla_1 = tiene_geometria(Herraje_Malla_1)
hay_malla_2 = tiene_geometria(Herraje_Malla_2)

if not puntos_destino:
    print("⚠️ [3BF Mecanizador v0.6] Esperando punto(s) de inserción en 'Point'...")
elif not hay_mecanizado and not hay_malla_1 and not hay_malla_2:
    print("⚠️ [3BF Mecanizador v0.6] No se ha conectado BRep ni Mallas para orientar.")
else:
    pt_base = Dual_Point if Dual_Point is not None else rg.Point3d(0, 0, 0)
    
    dir_info = ""
    giro_info = ""

    # --- FASE 1: Generar elementos Base en los puntos destino ---
    for idx, pt in enumerate(puntos_destino):
        if pt is None:
            continue
        
        pt_dest = rg.Point3d(pt)
        xform, dir_info, giro_info = calcular_transformacion(pt_base, pt_dest, Orientacion, Giro)

        if hay_mecanizado:
            geom_mec = Mecanizado_Nurbs[idx] if isinstance(Mecanizado_Nurbs, list) and idx < len(Mecanizado_Nurbs) else (Mecanizado_Nurbs[0] if isinstance(Mecanizado_Nurbs, list) else Mecanizado_Nurbs)
            if geom_mec is not None:
                brep_copia = geom_mec.DuplicateBrep() if hasattr(geom_mec, "DuplicateBrep") else geom_mec.Duplicate()
                brep_copia.Transform(xform)
                mecanizados_base.append(brep_copia)

        if hay_malla_1:
            geom_m1 = Herraje_Malla_1[idx] if isinstance(Herraje_Malla_1, list) and idx < len(Herraje_Malla_1) else (Herraje_Malla_1[0] if isinstance(Herraje_Malla_1, list) else Herraje_Malla_1)
            if geom_m1 is not None:
                m1_copia = geom_m1.DuplicateMesh() if hasattr(geom_m1, "DuplicateMesh") else geom_m1.Duplicate()
                m1_copia.Transform(xform)
                herrajes_1_base.append(m1_copia)

        if hay_malla_2:
            geom_m2 = Herraje_Malla_2[idx] if isinstance(Herraje_Malla_2, list) and idx < len(Herraje_Malla_2) else (Herraje_Malla_2[0] if isinstance(Herraje_Malla_2, list) else Herraje_Malla_2)
            if geom_m2 is not None:
                m2_copia = geom_m2.DuplicateMesh() if hasattr(geom_m2, "DuplicateMesh") else geom_m2.Duplicate()
                m2_copia.Transform(xform)
                herrajes_2_base.append(m2_copia)

    # --- FASE 2: Aplicar Espejos (Plane_Mirror_X y Plane_Mirror_Y) ---
    mecanizados_out = list(mecanizados_base)
    herrajes_1_out = list(herrajes_1_base)
    herrajes_2_out = list(herrajes_2_base)

    # Espejo en X
    if Plane_Mirror_X is not None:
        mb_x, m1_x, m2_x = reflejar_geometrias(mecanizados_base, herrajes_1_base, herrajes_2_base, Plane_Mirror_X)
        mecanizados_out.extend(mb_x)
        herrajes_1_out.extend(m1_x)
        herrajes_2_out.extend(m2_x)

    # Espejo en Y (Aplica sobre todo el conjunto actual para permitir 4 esquinas si ambos están activos)
    if Plane_Mirror_Y is not None:
        mb_y, m1_y, m2_y = reflejar_geometrias(mecanizados_out, herrajes_1_out, herrajes_2_out, Plane_Mirror_Y)
        mecanizados_out.extend(mb_y)
        herrajes_1_out.extend(m1_y)
        herrajes_2_out.extend(m2_y)

    # Diagnóstico en la consola 'out'
    espejo_info = []
    if Plane_Mirror_X is not None: espejo_info.append("Espejo X Activo")
    if Plane_Mirror_Y is not None: espejo_info.append("Espejo Y Activo")
    if not espejo_info: espejo_info.append("Sin Espejo")

    print(f"✅ [3BF Mecanizador v0.6] {len(puntos_destino)} punto(s) origen ➔ Total generados: {len(herrajes_1_out) if hay_malla_1 else len(mecanizados_out)} elemento(s).")
    print(f"   • Orientación : {Orientacion} [{dir_info}]")
    print(f"   • Giro Axial  : {Giro} [{giro_info}]")
    print(f"   • Simetría    : {', '.join(espejo_info)}")
    print(f"   • BReps       : {len(mecanizados_out)} generados")
    print(f"   • Parafusos   : {len(herrajes_1_out)} generados")
    print(f"   • Porcas      : {len(herrajes_2_out)} generadas")

# ==============================================================================
# 5. SALIDAS DE GRASSHOPPER
# ==============================================================================
Mecanizado_Out = mecanizados_out if len(mecanizados_out) > 1 else (mecanizados_out[0] if mecanizados_out else None)
Herraje_Out_1 = herrajes_1_out if len(herrajes_1_out) > 1 else (herrajes_1_out[0] if herrajes_1_out else None)
Herraje_Out_2 = herrajes_2_out if len(herrajes_2_out) > 1 else (herrajes_2_out[0] if herrajes_2_out else None)
# ---------- end python_3_script ----------
mecanizados_7 = Brep(python_3_script.Mecanizado_Out)
parafuso_c_2 = Mesh(python_3_script.Herraje_Out_1)
diagnostico = Panel(python_3_script.out)

point_19 = Point([move_13.Geometry, move_12.Geometry])
python_3_script_2 = Python3Script(
    Point=point_19,
    Orientacion=orientacion_mecanizado_2,
    Giro=giro_mecanizado_2,
    Mecanizado_Nurbs=mecanizados_2,
    Dual_Point=point_11,
    Herraje_Malla_1=cavilha_2,
    Plane_Mirror_X=yz_plane)  # -> out, Mecanizado_Out, Herraje_Out_1, Herraje_Out_2; inputs Point: Point3d, Orientacion: String, Mecanizado_Nurbs: list of Brep, Dual_Point: Point3d, Herraje_Malla_1: Mesh, Herraje_Malla_2: Mesh, Plane_Mirror_X: Plane, Plane_Mirror_Y: Plane; same code as python_3_script
mecanizados_8 = Brep(python_3_script_2.Mecanizado_Out)
cavilha_5 = Mesh(python_3_script_2.Herraje_Out_1)
diagnostico_2 = Panel(python_3_script_2.out)

rh_out_parafuso_c = Geometry(parafuso_c_2)

move_20 = Move(Geometry=box_2pt_2, Motion=stream_gate.Target2)  # -> Geometry, Transform
deconstruct_brep_7 = DeconstructBrep(Brep=move_20.Geometry)  # -> Faces, Edges, Vertices
list_item_15 = ListItem(List=deconstruct_brep_7.Vertices, Index=panel_12, Wrap=True)
list_item_16 = ListItem(List=deconstruct_brep_7.Vertices, Index="6", Wrap=True)
move_21 = Move(Geometry=list_item_15, Motion=unit_z_40)  # -> Geometry, Transform

list_item_17 = ListItem(List=deconstruct_brep_3.Vertices, Index="5", Wrap=True)
move_22 = Move(Geometry=list_item_17, Motion=unit_y_36)  # -> Geometry, Transform
move_23 = Move(Geometry=move_22.Geometry, Motion=unit_z_37)  # -> Geometry, Transform
move_24 = Move(Geometry=move_23.Geometry, Motion=unit_y_37)  # -> Geometry, Transform

list_item_18 = ListItem(List=deconstruct_brep_7.Vertices, Index="4", Wrap=True)
move_25 = Move(Geometry=list_item_18, Motion=unit_y_39)  # -> Geometry, Transform

list_item_19 = ListItem(List=deconstruct_brep_7.Vertices, Index="5", Wrap=True)
move_26 = Move(Geometry=list_item_19, Motion=unit_y_40)  # -> Geometry, Transform
move_27 = Move(Geometry=move_26.Geometry, Motion=unit_z_39)  # -> Geometry, Transform
move_28 = Move(Geometry=move_27.Geometry, Motion=unit_y_41)  # -> Geometry, Transform

list_item_20 = ListItem(List=deconstruct_brep_6.Vertices, Index="1", Wrap=True)
# x
move_29 = Move(Geometry=list_item_20, Motion=unit_y_42)  # -> Geometry, Transform

list_item_21 = ListItem(List=deconstruct_brep_3.Vertices, Index="6", Wrap=True)
move_30 = Move(Geometry=list_item_21, Motion=unit_z_45)  # -> Geometry, Transform
move_31 = Move(Geometry=move_30.Geometry, Motion=unit_y_44)  # -> Geometry, Transform

# ---- group: Peca 6
box_2pt_3 = Box2Pt(PointA=move_21.Geometry, PointB=list_item_16, Plane=PlaneXY(0, 0, 0))

# ----
list_item_22 = ListItem(List=deconstruct_brep_7.Vertices, Index="7", Wrap=True)

list_item_23 = ListItem(List=deconstruct_brep_7.Vertices, Index="6", Wrap=True)
move_32 = Move(Geometry=list_item_23, Motion=unit_z_46)  # -> Geometry, Transform
move_33 = Move(Geometry=move_32.Geometry, Motion=unit_y_45)  # -> Geometry, Transform

deconstruct_brep_8 = DeconstructBrep(Brep=box_2pt_3)  # -> Faces, Edges, Vertices
list_item_24 = ListItem(List=deconstruct_brep_8.Vertices, Index="7", Wrap=True)
move_34 = Move(Geometry=list_item_24, Motion=unit_y_7)  # -> Geometry, Transform
move_35 = Move(Geometry=move_34.Geometry, Motion=unit_z_7)  # -> Geometry, Transform
list_item_25 = ListItem(List=deconstruct_brep_8.Edges, Index="4", Wrap=True)
list_item_26 = ListItem(List=deconstruct_brep_8.Edges, Index="6", Wrap=True)
move_36 = Move(Geometry=move_35.Geometry, Motion=unit_z_8)  # -> Geometry, Transform
curve_middle_6 = CurveMiddle(Curve=list_item_26)
curve_middle_7 = CurveMiddle(Curve=list_item_25)
move_37 = Move(Geometry=move_36.Geometry, Motion=unit_z_9)  # -> Geometry, Transform
move_38 = Move(Geometry=curve_middle_6, Motion=unit_y_8)  # -> Geometry, Transform
move_39 = Move(Geometry=curve_middle_7, Motion=unit_y_9)  # -> Geometry, Transform
list_item_27 = ListItem(List=deconstruct_brep_8.Edges, Index="5", Wrap=True)
list_item_28 = ListItem(List=deconstruct_brep_8.Edges, Index="2", Wrap=True)
list_item_29 = ListItem(List=deconstruct_brep_8.Edges, Index="0", Wrap=True)

list_item_30 = ListItem(List=deconstruct_brep_6.Vertices, Index="2", Wrap=True)

curve_middle_8 = CurveMiddle(Curve=list_item_27)
curve_middle_9 = CurveMiddle(Curve=list_item_28)
curve_middle_10 = CurveMiddle(Curve=list_item_29)

# ----
# Refuerzos Posteriores
box_2pt_4 = Box2Pt(PointA=move_31.Geometry, PointB=list_item_22, Plane=PlaneXY(0, 0, 0))
box_2pt_5 = Box2Pt(PointA=move_33.Geometry, PointB=list_item_30, Plane=PlaneXY(0, 0, 0))
box_2pt_6 = Box2Pt(PointA=move_31.Geometry, PointB=list_item_30, Plane=PlaneXY(0, 0, 0))
stream_filter_3 = StreamFilter(Gate=expression_2, Stream1=box_2pt_6, Stream2=[box_2pt_5, box_2pt_4])
dispatch = Dispatch(List=stream_filter_3, DispatchPattern=[True, False])  # -> ListA, ListB

point_20 = Point([move_35.Geometry, move_37.Geometry])
python_3_script_3 = Python3Script(
    Point=point_20,
    Orientacion=orientacion_mecanizado_8,
    Giro=giro_mecanizado_8,
    Mecanizado_Nurbs=mecanizados_5,
    Dual_Point=point_16,
    Herraje_Malla_1=cavilha_4,
    Plane_Mirror_X=yz_plane)  # -> out, Mecanizado_Out, Herraje_Out_1, Herraje_Out_2; inputs Point: Point3d, Orientacion: String, Mecanizado_Nurbs: list of Brep, Dual_Point: Point3d, Herraje_Malla_1: Mesh, Herraje_Malla_2: Mesh, Plane_Mirror_X: Plane, Plane_Mirror_Y: Plane; same code as python_3_script
mecanizados_9 = Brep(python_3_script_3.Mecanizado_Out)
cavilha_6 = Mesh(python_3_script_3.Herraje_Out_1)
diagnostico_3 = Panel(python_3_script_3.out)

move_40 = Move(Geometry=curve_middle_9, Motion=unit_y_12)  # -> Geometry, Transform
move_41 = Move(Geometry=curve_middle_10, Motion=unit_y_13)  # -> Geometry, Transform
move_42 = Move(Geometry=move_40.Geometry, Motion=unit_y_14)  # -> Geometry, Transform
move_43 = Move(Geometry=move_41.Geometry, Motion=unit_y_15)  # -> Geometry, Transform

point_21 = Point(move_36.Geometry)
python_3_script_4 = Python3Script(
    Point=point_21,
    Orientacion=orientacion_mecanizado_9,
    Giro=giro_mecanizado_9,
    Mecanizado_Nurbs=mecanizados_6,
    Dual_Point=point_17,
    Herraje_Malla_1=parafuso_b_2)  # -> out, Mecanizado_Out, Herraje_Out_1, Herraje_Out_2; inputs Point: Point3d, Orientacion: String, Mecanizado_Nurbs: list of Brep, Dual_Point: Point3d, Herraje_Malla_1: Mesh, Herraje_Malla_2: Mesh, Plane_Mirror_X: Plane, Plane_Mirror_Y: Plane; same code as python_3_script
mecanizados_10 = Brep(python_3_script_4.Mecanizado_Out)
parafuso_b_3 = Mesh(python_3_script_4.Herraje_Out_1)
diagnostico_4 = Panel(python_3_script_4.out)

# ----
# Reengrueces laterales
panel_18 = Panel("4")
list_item_31 = ListItem(List=deconstruct_brep_3.Vertices, Index="0", Wrap=True)
list_item_32 = ListItem(List=deconstruct_brep_3.Vertices, Index=panel_18, Wrap=True)
negative_3 = Negative(Value=unit_y_17)
line_2 = Line(StartPoint=list_item_32, EndPoint=list_item_31)
move_44 = Move(Geometry=list_item_31, Motion=negative_3)  # -> Geometry, Transform
unit_y_49 = UnitY(Factor="60")
length = Length(Curve=line_2)
move_45 = Move(Geometry=list_item_32, Motion=unit_y_49)  # -> Geometry, Transform
unit_x_24 = UnitX(Factor="-15")
move_46 = Move(Geometry=move_45.Geometry, Motion=unit_x_24)  # -> Geometry, Transform

# ---- group: Peca 9
brep_2 = Brep(dispatch.ListB)

# ---- group: Peca 12
brep_3 = Brep(dispatch.ListA)

# ----
deconstruct_brep_9 = DeconstructBrep(Brep=brep_2)  # -> Faces, Edges, Vertices
list_item_33 = ListItem(List=deconstruct_brep_9.Edges, Index="7", Wrap=True)
curve_middle_11 = CurveMiddle(Curve=list_item_33)
move_47 = Move(Geometry=curve_middle_11, Motion=unit_z_18)  # -> Geometry, Transform

point_22 = Point(move_47.Geometry)
python_3_script_5 = Python3Script(
    Point=point_22,
    Orientacion=orientacion_mecanizado_6,
    Giro=giro_mecanizado_6,
    Mecanizado_Nurbs=mecanizados_4,
    Dual_Point=point_14,
    Herraje_Malla_1=cavilha_3,
    Plane_Mirror_X=yz_plane)  # -> out, Mecanizado_Out, Herraje_Out_1, Herraje_Out_2; inputs Point: Point3d, Orientacion: String, Mecanizado_Nurbs: list of Brep, Dual_Point: Point3d, Herraje_Malla_1: Mesh, Herraje_Malla_2: Mesh, Plane_Mirror_X: Plane, Plane_Mirror_Y: Plane; same code as python_3_script
mecanizados_11 = Brep(python_3_script_5.Mecanizado_Out)
cavilha_7 = Mesh(python_3_script_5.Herraje_Out_1)
diagnostico_5 = Panel(python_3_script_5.out)

move_48 = Move(Geometry=move_47.Geometry, Motion=unit_z_19)  # -> Geometry, Transform

point_23 = Point(move_48.Geometry)
python_3_script_6 = Python3Script(
    Point=point_23,
    Orientacion=orientacion_mecanizado_5,
    Giro=giro_mecanizado_5,
    Mecanizado_Nurbs=mecanizados_3,
    Dual_Point=point_13,
    Herraje_Malla_1=parafuso_b,
    Plane_Mirror_X=yz_plane)  # -> out, Mecanizado_Out, Herraje_Out_1, Herraje_Out_2; inputs Point: Point3d, Orientacion: String, Mecanizado_Nurbs: list of Brep, Dual_Point: Point3d, Herraje_Malla_1: Mesh, Herraje_Malla_2: Mesh, Plane_Mirror_X: Plane, Plane_Mirror_Y: Plane; same code as python_3_script
mecanizados_12 = Brep(python_3_script_6.Mecanizado_Out)
parafuso_b_4 = Mesh(python_3_script_6.Herraje_Out_1)
diagnostico_6 = Panel(python_3_script_6.out)

# ---- group: Peça 9
solid_difference = SolidDifference(BrepsA=brep_2, BrepsB=flatten([mecanizados_11, mecanizados_12, mecanizados_9, mecanizados_10]))

# ---- group: Peça 12
solid_difference_2 = SolidDifference(BrepsA=brep_3, BrepsB=flatten([mecanizados_11, mecanizados_12, mecanizados_9]))

# ----
# Tarugo x0,x1
# 3BF Mecanizador V0.5
orientacion_mecanizado_10 = ValueList({"x0,x1": 1, "x1,x0": 2, "y0,y1": 3, "y1,y0": 4, "z0,z1": 5, "z1,z0": 6}, selected="z1,z0")
giro_mecanizado_10 = ValueList({"Frente": 0, "Arriba": 90, "Pesterior": 180, "Abajo": 270}, selected="Frente")
mecanizados_13 = Brep(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)
cavilha_8 = Mesh(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)
point_24 = Point(Point(-590.8767532, 0, 0))
point_25 = Point([move_39.Geometry, move_38.Geometry])
python_3_script_7 = Python3Script(
    Point=point_25,
    Orientacion=orientacion_mecanizado_10,
    Giro=giro_mecanizado_10,
    Mecanizado_Nurbs=mecanizados_13,
    Dual_Point=point_24,
    Herraje_Malla_1=cavilha_8)  # -> out, Mecanizado_Out, Herraje_Out_1, Herraje_Out_2; inputs Point: Point3d, Orientacion: String, Mecanizado_Nurbs: list of Brep, Dual_Point: Point3d, Herraje_Malla_1: Mesh, Herraje_Malla_2: Mesh, Plane_Mirror_X: Plane, Plane_Mirror_Y: Plane; same code as python_3_script
mecanizados_14 = Brep(python_3_script_7.Mecanizado_Out)
cavilha_9 = Mesh(python_3_script_7.Herraje_Out_1)
diagnostico_7 = Panel(python_3_script_7.out)

# ---- group: Reengruce Izquierdo
box_2pt_7 = Box2Pt(PointA=move_46.Geometry, PointB=move_44.Geometry, Plane=PlaneXY(0, 0, 0))

# ---- group: Reengruce derecho
mirror_4 = Mirror(Geometry=box_2pt_7, Plane=yz_plane)  # -> Geometry, Transform

# ---- group: Peca 13
solid_difference_3 = SolidDifference(BrepsA=box_2pt, BrepsB=flatten([mecanizados_8, mecanizados_14]))

# ----
# Tarugo x0,x1 UNITARIO
# 3BF Mecanizador V0.5
orientacion_mecanizado_11 = ValueList({"x0,x1": 1, "x1,x0": 2, "y0,y1": 3, "y1,y0": 4, "z0,z1": 5, "z1,z0": 6}, selected="z0,z1")
giro_mecanizado_11 = ValueList({"Frente": 0, "Arriba": 90, "Pesterior": 180, "Abajo": 270}, selected="Frente")
mecanizados_15 = Brep(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)
point_26 = Point([move_41.Geometry, move_40.Geometry])
point_27 = Point(Point(-590.8767532, 0, 0))
cavilha_10 = Mesh(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)
python_3_script_8 = Python3Script(
    Point=point_26,
    Orientacion=orientacion_mecanizado_11,
    Giro=giro_mecanizado_11,
    Mecanizado_Nurbs=mecanizados_15,
    Dual_Point=point_27,
    Herraje_Malla_1=cavilha_10)  # -> out, Mecanizado_Out, Herraje_Out_1, Herraje_Out_2; inputs Point: Point3d, Orientacion: String, Mecanizado_Nurbs: list of Brep, Dual_Point: Point3d, Herraje_Malla_1: Mesh, Herraje_Malla_2: Mesh, Plane_Mirror_X: Plane, Plane_Mirror_Y: Plane; same code as python_3_script
cavilha_11 = Mesh(python_3_script_8.Herraje_Out_1)
mecanizados_16 = Brep(python_3_script_8.Mecanizado_Out)
diagnostico_8 = Panel(python_3_script_8.out)

# ----
# Parafuso B x0,x1 Z
# 3BF Mecanizador V0.5
orientacion_mecanizado_12 = ValueList({"x0,x1": 1, "x1,x0": 2, "y0,y1": 3, "y1,y0": 4, "z0,z1": 5, "z1,z0": 6}, selected="z0,z1")
giro_mecanizado_12 = ValueList({"Frente": 0, "Arriba": 90, "Pesterior": 180, "Abajo": 270}, selected="Frente")
mecanizados_17 = Brep(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)
parafuso_b_5 = Mesh(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)
point_28 = Point([move_43.Geometry, move_42.Geometry])
point_29 = Point(Point(-653.4233076, 0, 0))
python_3_script_9 = Python3Script(
    Point=point_28,
    Orientacion=orientacion_mecanizado_12,
    Giro=giro_mecanizado_12,
    Mecanizado_Nurbs=mecanizados_17,
    Dual_Point=point_29,
    Herraje_Malla_1=parafuso_b_5)  # -> out, Mecanizado_Out, Herraje_Out_1, Herraje_Out_2; inputs Point: Point3d, Orientacion: String, Mecanizado_Nurbs: list of Brep, Dual_Point: Point3d, Herraje_Malla_1: Mesh, Herraje_Malla_2: Mesh, Plane_Mirror_X: Plane, Plane_Mirror_Y: Plane; same code as python_3_script
mecanizados_18 = Brep(python_3_script_9.Mecanizado_Out)
parafuso_b_6 = Mesh(python_3_script_9.Herraje_Out_1)
diagnostico_9 = Panel(python_3_script_9.out)

# ----
# Cantoneira Top
# 3BF Mecanizador V0.5
orientacion_mecanizado_13 = ValueList({"x0,x1": 1, "x1,x0": 2, "y0,y1": 3, "y1,y0": 4, "z0,z1": 5, "z1,z0": 6}, selected="x0,x1")
giro_mecanizado_13 = ValueList({"Frente": 0, "Arriba": 90, "Pesterior": 180, "Abajo": 270}, selected="Frente")
cantoneira_4 = Mesh(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)
parafuso_d_4 = Mesh([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])
point_30 = Point(Point(-371.4723377, 7.025354377, 20.03542941))
point_31 = Point(curve_middle_8)
python_3_script_10 = Python3Script(
    Point=point_31,
    Orientacion=orientacion_mecanizado_13,
    Giro=giro_mecanizado_13,
    Dual_Point=point_30,
    Herraje_Malla_1=cantoneira_4,
    Herraje_Malla_2=parafuso_d_4)  # -> out, Mecanizado_Out, Herraje_Out_1, Herraje_Out_2; inputs Point: Point3d, Orientacion: String, Mecanizado_Nurbs: list of Brep, Dual_Point: Point3d, Herraje_Malla_1: list of Mesh, Herraje_Malla_2: list of Mesh, Plane_Mirror_X: Plane, Plane_Mirror_Y: Plane
# ---------- python_3_script_10: Python ----------
"""
================================================================================
NOMBRE:      3BF Mecanizador
VERSIÓN:     0.7 (Multi-Tornillería & Ensamble Completo)
AUTOR:       Mario Mojica
SUITE:       3dBimFab
ENTORNO:     Rhino 8 / Grasshopper (Python 3 CPython)
DESCRIPCIÓN: Posicionamiento, orientación 3D, giro axial y generación de copias
             en espejo automáticas a través de planos de simetría (Plane_Mirror_X 
             y Plane_Mirror_Y). Soporta listas de geometrías en Herraje_Malla_2 
             para que múltiples tornillos por herraje se clonen completos.
================================================================================
"""

import Rhino.Geometry as rg
import math

# ==============================================================================
# 1. PARSEO DE GIRO AXIAL
# ==============================================================================
def parse_giro_axial(giro_val):
    if giro_val is None:
        return 0.0, "Frente (0°)"
    
    val_str = str(giro_val).strip().lower()
    
    if val_str in ["0", "0.0", "frente", "front"]:
        return 0.0, "Frente (0°)"
    elif val_str in ["90", "90.0", "posterior", "pesterior", "atras", "back"]:
        return math.radians(90.0), "Posterior (90°)"
    elif val_str in ["180", "180.0", "arriba", "up", "top"]:
        return math.radians(180.0), "Arriba (180°)"
    elif val_str in ["270", "270.0", "-90", "-90.0", "abajo", "down", "bottom"]:
        return math.radians(270.0), "Abajo (270°)"
    else:
        try:
            deg = float(val_str)
            return math.radians(deg), f"Personalizado ({deg}°)"
        except:
            return 0.0, "Frente (0°)"


# ==============================================================================
# 2. FUNCIÓN DE TRANSFORMACIÓN COMPUESTA (BASE -> DESTINO)
# ==============================================================================
def calcular_transformacion(pt_base, pt_destino, orientacion_val, giro_val):
    val_str = str(orientacion_val).strip().lower()
    
    # A. Giro axial sobre el eje X longitudinal del herraje
    angulo_rad, giro_label = parse_giro_axial(giro_val)
    if abs(angulo_rad) > 1e-6:
        rot_axial = rg.Transform.Rotation(angulo_rad, rg.Vector3d(1, 0, 0), pt_base)
    else:
        rot_axial = rg.Transform.Identity

    # B. Rotación principal según la orientación seleccionada
    if val_str in ["1", "x0,x1", "x0->x1", "x+"]:
        rot_orient = rg.Transform.Identity
        dir_label = "+X (Izquierda a Derecha)"
    elif val_str in ["2", "x1,x0", "x1->x0", "x-"]:
        rot_orient = rg.Transform.Rotation(math.pi, rg.Vector3d(0, 0, 1), pt_base)
        dir_label = "-X (Derecha a Izquierda)"
    elif val_str in ["3", "y0,y1", "y0->y1", "y+"]:
        rot_orient = rg.Transform.Rotation(math.pi / 2.0, rg.Vector3d(0, 0, 1), pt_base)
        dir_label = "+Y (Frente hacia Atrás)"
    elif val_str in ["4", "y1,y0", "y1->y0", "y-"]:
        rot_orient = rg.Transform.Rotation(-math.pi / 2.0, rg.Vector3d(0, 0, 1), pt_base)
        dir_label = "-Y (Atrás hacia el Frente)"
    elif val_str in ["5", "z0,z1", "z0->z1", "z+"]:
        rot_orient = rg.Transform.Rotation(-math.pi / 2.0, rg.Vector3d(0, 1, 0), pt_base)
        dir_label = "+Z (Abajo hacia Arriba)"
    elif val_str in ["6", "z1,z0", "z1->z0", "z-"]:
        rot_orient = rg.Transform.Rotation(math.pi / 2.0, rg.Vector3d(0, 1, 0), pt_base)
        dir_label = "-Z (Arriba hacia Abajo)"
    else:
        rot_orient = rg.Transform.Identity
        dir_label = "+X (Por defecto)"

    # C. Traslación desde pt_base hacia el punto destino
    vec_traslacion = pt_destino - pt_base
    trasl = rg.Transform.Translation(vec_traslacion)

    # Matriz total: Traslación * Rotación Orientación * Giro Axial
    xform_total = trasl * rot_orient * rot_axial
    return xform_total, dir_label, giro_label


# ==============================================================================
# 3. HELPER PARA APLICAR ESPEJO A GEOMETRÍAS (BREPS Y MESHES)
# ==============================================================================
def reflejar_geometrias(lista_breps, lista_meshes_1, lista_meshes_2, plano_espejo):
    if plano_espejo is None:
        return [], [], []
    
    xform_mirror = rg.Transform.Mirror(plano_espejo)
    
    breps_mirror = []
    m1_mirror = []
    m2_mirror = []

    for b in lista_breps:
        copia = b.DuplicateBrep() if hasattr(b, "DuplicateBrep") else b.Duplicate()
        copia.Transform(xform_mirror)
        breps_mirror.append(copia)

    for m in lista_meshes_1:
        copia = m.DuplicateMesh() if hasattr(m, "DuplicateMesh") else m.Duplicate()
        copia.Transform(xform_mirror)
        m1_mirror.append(copia)

    for m in lista_meshes_2:
        copia = m.DuplicateMesh() if hasattr(m, "DuplicateMesh") else m.Duplicate()
        copia.Transform(xform_mirror)
        m2_mirror.append(copia)

    return breps_mirror, m1_mirror, m2_mirror


def tiene_geometria(val):
    if val is None:
        return False
    if isinstance(val, list) and len(val) == 0:
        return False
    return True


# ==============================================================================
# 4. EJECUCIÓN DEL ALGORITMO PRINCIPAL
# ==============================================================================
mecanizados_base = []
herrajes_1_base = []
herrajes_2_base = []

mecanizados_out = []
herrajes_1_out = []
herrajes_2_out = []

puntos_destino = Point if isinstance(Point, list) else [Point] if Point is not None else []

hay_mecanizado = tiene_geometria(Mecanizado_Nurbs)
hay_malla_1 = tiene_geometria(Herraje_Malla_1)
hay_malla_2 = tiene_geometria(Herraje_Malla_2)

if not puntos_destino:
    print("⚠️ [3BF Mecanizador v0.7] Esperando punto(s) de inserción en 'Point'...")
elif not hay_mecanizado and not hay_malla_1 and not hay_malla_2:
    print("⚠️ [3BF Mecanizador v0.7] No se ha conectado BRep ni Mallas para orientar.")
else:
    pt_base = Dual_Point if Dual_Point is not None else rg.Point3d(0, 0, 0)
    
    dir_info = ""
    giro_info = ""

    # Normalizar prototipos como listas de geometrías
    lista_mec = Mecanizado_Nurbs if isinstance(Mecanizado_Nurbs, list) else ([Mecanizado_Nurbs] if Mecanizado_Nurbs is not None else [])
    lista_m1 = Herraje_Malla_1 if isinstance(Herraje_Malla_1, list) else ([Herraje_Malla_1] if Herraje_Malla_1 is not None else [])
    lista_m2 = Herraje_Malla_2 if isinstance(Herraje_Malla_2, list) else ([Herraje_Malla_2] if Herraje_Malla_2 is not None else [])

    # --- FASE 1: Generar elementos Base en los puntos destino ---
    for pt in puntos_destino:
        if pt is None:
            continue
        
        pt_dest = rg.Point3d(pt)
        xform, dir_info, giro_info = calcular_transformacion(pt_base, pt_dest, Orientacion, Giro)

        # 1. Mecanizado
        if hay_mecanizado:
            for geom_mec in lista_mec:
                if geom_mec is not None:
                    brep_copia = geom_mec.DuplicateBrep() if hasattr(geom_mec, "DuplicateBrep") else geom_mec.Duplicate()
                    brep_copia.Transform(xform)
                    mecanizados_base.append(brep_copia)

        # 2. Malla 1 (Cantonera)
        if hay_malla_1:
            for geom_m1 in lista_m1:
                if geom_m1 is not None:
                    m1_copia = geom_m1.DuplicateMesh() if hasattr(geom_m1, "DuplicateMesh") else geom_m1.Duplicate()
                    m1_copia.Transform(xform)
                    herrajes_1_base.append(m1_copia)

        # 3. Malla 2 (Tornillos: clona TODOS los tornillos presentes en lista_m2 para este punto)
        if hay_malla_2:
            for geom_m2 in lista_m2:
                if geom_m2 is not None:
                    m2_copia = geom_m2.DuplicateMesh() if hasattr(geom_m2, "DuplicateMesh") else geom_m2.Duplicate()
                    m2_copia.Transform(xform)
                    herrajes_2_base.append(m2_copia)

    # --- FASE 2: Aplicar Espejos (Plane_Mirror_X y Plane_Mirror_Y) ---
    mecanizados_out = list(mecanizados_base)
    herrajes_1_out = list(herrajes_1_base)
    herrajes_2_out = list(herrajes_2_base)

    # Espejo en X
    if Plane_Mirror_X is not None:
        mb_x, m1_x, m2_x = reflejar_geometrias(mecanizados_base, herrajes_1_base, herrajes_2_base, Plane_Mirror_X)
        mecanizados_out.extend(mb_x)
        herrajes_1_out.extend(m1_x)
        herrajes_2_out.extend(m2_x)

    # Espejo en Y (Aplica sobre todo el conjunto actual para permitir 4 esquinas si ambos están activos)
    if Plane_Mirror_Y is not None:
        mb_y, m1_y, m2_y = reflejar_geometrias(mecanizados_out, herrajes_1_out, herrajes_2_out, Plane_Mirror_Y)
        mecanizados_out.extend(mb_y)
        herrajes_1_out.extend(m1_y)
        herrajes_2_out.extend(m2_y)

    # Diagnóstico en la consola 'out'
    espejo_info = []
    if Plane_Mirror_X is not None: espejo_info.append("Espejo X Activo")
    if Plane_Mirror_Y is not None: espejo_info.append("Espejo Y Activo")
    if not espejo_info: espejo_info.append("Sin Espejo")

    print(f"✅ [3BF Mecanizador v0.7] {len(puntos_destino)} punto(s) origen ➔ Total generados: {len(herrajes_1_out)} cantonera(s), {len(herrajes_2_out)} tornillo(s).")
    print(f"   • Orientación : {Orientacion} [{dir_info}]")
    print(f"   • Giro Axial  : {Giro} [{giro_info}]")
    print(f"   • Simetría    : {', '.join(espejo_info)}")
    print(f"   • BReps       : {len(mecanizados_out)} generados")
    print(f"   • Cantoneras  : {len(herrajes_1_out)} generadas")
    print(f"   • Tornillos   : {len(herrajes_2_out)} generados")

# ==============================================================================
# 5. SALIDAS DE GRASSHOPPER
# ==============================================================================
Mecanizado_Out = mecanizados_out if len(mecanizados_out) > 1 else (mecanizados_out[0] if mecanizados_out else None)
Herraje_Out_1 = herrajes_1_out if len(herrajes_1_out) > 1 else (herrajes_1_out[0] if herrajes_1_out else None)
Herraje_Out_2 = herrajes_2_out if len(herrajes_2_out) > 1 else (herrajes_2_out[0] if herrajes_2_out else None)
# ---------- end python_3_script_10 ----------
cantoneira_5 = Mesh(python_3_script_10.Herraje_Out_1)
parafuso_d_5 = Mesh(python_3_script_10.Herraje_Out_2)
diagnostico_10 = Panel(python_3_script_10.out)

# ----
# Cantoneira Top
# 3BF Mecanizador V0.5
orientacion_mecanizado_14 = ValueList({"x0,x1": 1, "x1,x0": 2, "y0,y1": 3, "y1,y0": 4, "z0,z1": 5, "z1,z0": 6}, selected="x0,x1")
giro_mecanizado_14 = ValueList({"Frente": 0, "Arriba": 90, "Pesterior": 180, "Abajo": 270}, selected="Frente")
cantoneira_6 = Mesh(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)
parafuso_d_6 = Mesh([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])
point_32 = Point(Point(-371.4723377, 7.025354377, 20.03542941))
point_33 = Point([move_10.Geometry, move_11.Geometry])
python_3_script_11 = Python3Script(
    Point=point_33,
    Orientacion=orientacion_mecanizado_14,
    Giro=giro_mecanizado_14,
    Dual_Point=point_32,
    Herraje_Malla_1=cantoneira_6,
    Herraje_Malla_2=parafuso_d_6,
    Plane_Mirror_X=yz_plane)  # -> out, Mecanizado_Out, Herraje_Out_1, Herraje_Out_2; inputs Point: Point3d, Orientacion: String, Mecanizado_Nurbs: list of Brep, Dual_Point: Point3d, Herraje_Malla_1: list of Mesh, Herraje_Malla_2: list of Mesh, Plane_Mirror_X: Plane, Plane_Mirror_Y: Plane; same code as python_3_script_10
parafuso_d_7 = Mesh(python_3_script_11.Herraje_Out_2)
cantoneira_7 = Mesh(python_3_script_11.Herraje_Out_1)
diagnostico_11 = Panel(python_3_script_11.out)

stream_filter_4 = StreamFilter(Gate=expression_2, Stream2=solid_difference_2)
stream_filter_5 = StreamFilter(Gate=expression_2, Stream1=box_2pt_6, Stream2=solid_difference)

# ---- group: Peça 9 Aparência
# 3BF Materializer v0.3
# 3BF Box Mapping v1.0
# 3BF Mesh Channel Separator v2.2
rh_in_12_1_mapeado = ValueList({"Longitudinal": 0, "Atravesada": 1}, selected="Longitudinal")
python_3_script_12 = Python3Script(Brep_In=stream_filter_5)  # -> out, Pieza_1, Pieza_2, Pieza_3, Pieza_4; inputs Brep_In: list of Brep
# ---------- python_3_script_12: Python ----------
"""
=============================================================================
3BF Materializer v1.0 (Clean Face Consolidator)
Powered by 3dBimFab
=============================================================================
Desglosa cada Closed Brep de entrada preservando el 100% de sus caras NURBS
(caras A/B, cantos perimetrales y mecanizados/ranuras con trimmed loops intactos)
y las emite consolidadas e independientes por pieza física (Pieza_1 a Pieza_4).
=============================================================================
"""
import Rhino

def consolidar_caras_pieza(brep_in):
    if brep_in is None:
        return [], "Brep nulo"

    bbox = brep_in.GetBoundingBox(True)
    x0, x1 = bbox.Min.X, bbox.Max.X
    y0, y1 = bbox.Min.Y, bbox.Max.Y
    z0, z1 = bbox.Min.Z, bbox.Max.Z

    sx = max(0.1, x1 - x0)
    sy = max(0.1, y1 - y0)
    sz = max(0.1, z1 - z0)
    min_dim = min(sx, sy, sz)

    tol = max(0.2, min_dim * 0.15)
    zona_bisel = max(tol * 2.5, min_dim * 2.5)

    faces_A = []
    faces_B = []
    faces_cantos = []
    faces_mecanizados = []

    # Extraer cada cara manteniendo los cortes de ranura intactos
    for i in range(brep_in.Faces.Count):
        f = brep_in.Faces[i]
        u = (f.Domain(0).T0 + f.Domain(0).T1) * 0.5
        v = (f.Domain(1).T0 + f.Domain(1).T1) * 0.5
        pt = f.PointAt(u, v)
        n = f.NormalAt(u, v)
        n.Unitize()
        nurbs_face = f.DuplicateFace(False)

        # Tablero Vertical Lateral (Espesor en X)
        if min_dim == sx:
            if n.X > 0.85 and abs(pt.X - x1) < tol:
                faces_A.append(nurbs_face)
            elif n.X < -0.85 and abs(pt.X - x0) < tol:
                faces_B.append(nurbs_face)
            elif (abs(pt.Y - y0) < zona_bisel or abs(y1 - pt.Y) < zona_bisel or
                  abs(pt.Z - z0) < zona_bisel or abs(z1 - pt.Z) < zona_bisel):
                faces_cantos.append(nurbs_face)
            else:
                faces_mecanizados.append(nurbs_face)

        # Tablero Horizontal (Espesor en Z)
        elif min_dim == sz:
            if n.Z > 0.85 and abs(pt.Z - z1) < tol:
                faces_A.append(nurbs_face)
            elif n.Z < -0.85 and abs(pt.Z - z0) < tol:
                faces_B.append(nurbs_face)
            elif (abs(pt.Y - y0) < zona_bisel or abs(y1 - pt.Y) < zona_bisel or
                  abs(pt.X - x0) < zona_bisel or abs(x1 - pt.X) < zona_bisel):
                faces_cantos.append(nurbs_face)
            else:
                faces_mecanizados.append(nurbs_face)

        # Tablero Vertical Frontal (Espesor en Y)
        else:
            if n.Y < -0.85 and abs(pt.Y - y0) < tol:
                faces_A.append(nurbs_face)
            elif n.Y > 0.85 and abs(pt.Y - y1) < tol:
                faces_B.append(nurbs_face)
            elif (abs(pt.X - x0) < zona_bisel or abs(x1 - pt.X) < zona_bisel or
                  abs(pt.Z - z0) < zona_bisel or abs(z1 - pt.Z) < zona_bisel):
                faces_cantos.append(nurbs_face)
            else:
                faces_mecanizados.append(nurbs_face)

    # Consolidar todas las caras que componen esta pieza
    todas_las_caras = []
    todas_las_caras.extend(faces_A)
    todas_las_caras.extend(faces_B)
    todas_las_caras.extend(faces_cantos)
    todas_las_caras.extend(faces_mecanizados)

    diag = "Caras: {} (A={}, B={}, Cantos={}, Mecanizados={})".format(
        len(todas_las_caras), len(faces_A), len(faces_B),
        len(faces_cantos), len(faces_mecanizados)
    )

    return todas_las_caras, diag


# -------------------------------------------------------------
# EJECUCIÓN PRINCIPAL
# -------------------------------------------------------------
lista_breps = []
if 'Brep_In' in locals() and Brep_In is not None:
    if hasattr(Brep_In, "__iter__") and not isinstance(Brep_In, Rhino.Geometry.Brep):
        lista_breps = [b for b in Brep_In if b is not None]
    else:
        lista_breps = [Brep_In]

resultados_piezas = []
diagnosticos = []

for idx, b in enumerate(lista_breps):
    caras, d_txt = consolidar_caras_pieza(b)
    resultados_piezas.append(caras)
    diagnosticos.append("Pieza {}: {}".format(idx + 1, d_txt))

# Salidas dedicadas por pieza (Pieza_1 a Pieza_4)
Pieza_1 = resultados_piezas[0] if len(resultados_piezas) > 0 else []
Pieza_2 = resultados_piezas[1] if len(resultados_piezas) > 1 else []
Pieza_3 = resultados_piezas[2] if len(resultados_piezas) > 2 else []
Pieza_4 = resultados_piezas[3] if len(resultados_piezas) > 3 else []

# Emisión directa hacia la consola de fábrica 'Out'
print("\n".join(diagnosticos) if diagnosticos else "Sin piezas de entrada")
# ---------- end python_3_script_12 ----------
mesh_brep = MeshBrep(
    Brep=python_3_script_12.Pieza_1,
    Settings={GridMaxCount=0, GridMinCount=16, JaggedSeams=False, MaxEdgeLength=0, MinEdgeLength=0.0001, MinTolerance=0, Refine=True, RefineAngle=0, RelativeTolerance=0.65, SimplePlanes=True, Tolerance=0})
rh_in_12_2_lado_balance = ValueList({"Cara A", "Cara B", "D/D"}, selected="Cara A")
rh_in_12_3_canto_frontal = ValueList({"Canto": 0, "MDP": 1}, selected="MDP")
rh_in_12_4_canto_trasero = ValueList({"Canto": 0, "MDP": 1}, selected="MDP")
rh_in_12_5_canto_izquierdo_arriba = ValueList({"Canto": 0, "MDP": 1}, selected="Canto")
rh_in_12_6_canto_derecho_abajo = ValueList({"Canto": 0, "MDP": 1}, selected="MDP")
diagnostico_12 = Panel(python_3_script_12.out)
mesh_join = MeshJoin(Meshes=flatten(mesh_brep))
python_3_script_13 = Python3Script(M=mesh_join, B=rh_in_12_1_mapeado)  # -> a; inputs M: Mesh, B: Int32
# ---------- python_3_script_13: Python ----------
"""
3BF Box Mapping v1.0 Cohesión Total
Respeta estrictamente la cohesión y topología proveniente de Mesh Join:
- CERO SplitDisjointPieces (no divide ni rompe mallas).
- CERO Unweld destructivo (mantiene la pieza 100% compacta y unida).
- Asigna coordenadas UV calculando la orientación de cada cara.
- Garantiza veta longitudinal a lo largo de cada tablero.
"""

import Rhino

def aplicar_box_mapping_cohesion_total(mesh_in, modo_veta=0, escala_caja_mm=600.0):
    if mesh_in is None or not isinstance(mesh_in, Rhino.Geometry.Mesh):
        return mesh_in

    # Preservar la malla cohesionada intacta sin romper vértices ni caras
    mesh = mesh_in.DuplicateMesh() if hasattr(mesh_in, "DuplicateMesh") else mesh_in
    
    mesh.Normals.ComputeNormals()
    mesh.TextureCoordinates.Clear()

    # Bounding Box individual de la pieza cohesionada
    bbox = mesh.GetBoundingBox(True)
    sx = max(1.0, bbox.Max.X - bbox.Min.X)
    sy = max(1.0, bbox.Max.Y - bbox.Min.Y)
    sz = max(1.0, bbox.Max.Z - bbox.Min.Z)

    es_atravesada = False
    if isinstance(modo_veta, str):
        es_atravesada = "atravesad" in modo_veta.lower() or modo_veta in ["1", "3", "5"]
    elif isinstance(modo_veta, (int, float)):
        es_atravesada = int(modo_veta) in [1, 3, 5]

    escala = float(escala_caja_mm)

    v_count = mesh.Vertices.Count
    norm_count = mesh.Normals.Count

    for idx in range(v_count):
        v = mesh.Vertices[idx]
        n = mesh.Normals[idx] if idx < norm_count else Rhino.Geometry.Vector3f(0, 0, 1)

        lx = v.X - bbox.Min.X
        ly = v.Y - bbox.Min.Y
        lz = v.Z - bbox.Min.Z

        nx, ny, nz = abs(n.X), abs(n.Y), abs(n.Z)

        # -------------------------------------------------------------
        # CASO A: Normal en Z (Caras Superiores / Inferiores / Cantos en Z)
        # -------------------------------------------------------------
        if nz >= nx and nz >= ny:
            if sy >= sx:
                # Lateral de cajón hacia el fondo (ej: 350mm en Y vs 15mm en X)
                u = ly / escala
                v_coord = lx / escala
            else:
                # Tablero horizontal normal o canto superior de frente (largo en X)
                u = ly / escala if es_atravesada else lx / escala
                v_coord = lx / escala if es_atravesada else ly / escala

        # -------------------------------------------------------------
        # CASO B: Normal en Y (Caras Frontales / Traseras / Cantos en Y)
        # -------------------------------------------------------------
        elif ny >= nx and ny >= nz:
            if sx >= sz:
                # Frente de cajón o traviesa horizontal (ancho en X)
                u = lz / escala if es_atravesada else lx / escala
                v_coord = lx / escala if es_atravesada else lz / escala
            else:
                # Pieza vertical alta
                u = lz / escala
                v_coord = lx / escala

        # -------------------------------------------------------------
        # CASO C: Normal en X (Caras Laterales / Cantos en X)
        # -------------------------------------------------------------
        else:
            if sy >= sz:
                # Lateral de cajón (cara plana hacia el fondo en Y)
                u = lz / escala if es_atravesada else ly / escala
                v_coord = ly / escala if es_atravesada else lz / escala
            else:
                # Costado vertical
                u = ly / escala if es_atravesada else lz / escala
                v_coord = lz / escala if es_atravesada else ly / escala

        mesh.TextureCoordinates.Add(float(u), float(v_coord))

    return mesh


# Ejecución universal compatible con Item Access o List Access
if isinstance(M, list):
    resultado = [aplicar_box_mapping_cohesion_total(item, B if 'B' in locals() else 0, 600.0) for item in M if item is not None]
else:
    resultado = aplicar_box_mapping_cohesion_total(M, B if 'B' in locals() else 0, 600.0)

a = resultado
# ---------- end python_3_script_13 ----------
python_3_script_14 = Python3Script(
    M_In=python_3_script_13,
    Balance_Mode=rh_in_12_2_lado_balance,
    Canto_1=rh_in_12_3_canto_frontal,
    Canto_2=rh_in_12_4_canto_trasero,
    Canto_3=rh_in_12_5_canto_izquierdo_arriba,
    Canto_4=rh_in_12_6_canto_derecho_abajo)  # -> out, Color, Balance, MDP; inputs M_In: list
# ---------- python_3_script_14: Python ----------
"""
=============================================================================
3BF Mesh Channel Separator v2.3 (Clean & Symmetry Aware)
Powered by 3dBimFab
=============================================================================
Separa la malla consolidada y mapeada en los 3 canales de manufactura DfMA:
1. Color: Caras principales y cantos aplacados.
2. Balance: Contracaras (respetando la simetría/espejo en parejas de cajones).
3. MDP: Mecanizados/ranuras y cantos sin aplacar.
La información de diagnóstico se emite directamente por la salida estándar 'out'.
=============================================================================
"""
import Rhino
import rhinoscriptsyntax as rs

def parse_balance(val):
    s = str(val).lower().strip().replace('"', '').replace("'", "")
    if s in ["6", "d/d", "dyd", "doble", "ninguno", "ambas"] or "d/d" in s or "dyd" in s:
        return "DD"
    if s in ["5", "cara a", "a"] or (s.startswith("a") and len(s) <= 6):
        return "A"
    if s in ["4", "cara b", "b"] or (s.startswith("b") and len(s) <= 6):
        return "B"
    return "B"

def parse_canto(val):
    s = str(val).lower().strip().replace('"', '').replace("'", "")
    if s in ["0", "0.0", "canto", "true", "si", "sí", "s", "con canto"] or ("canto" in s and "sin" not in s):
        return True
    if s in ["1", "1.0", "mdp", "false", "no", "sin canto"] or "mdp" in s or "sin" in s:
        return False
    return True

def extraer_malla_universal(c):
    if c is None:
        return None
    if hasattr(c, "Faces") and hasattr(c, "Vertices"):
        return c
    val = getattr(c, "Value", c)
    if hasattr(val, "Faces") and hasattr(val, "Vertices"):
        return val
    try:
        m = rs.coercemesh(c)
        if m is not None:
            return m
    except:
        pass
    try:
        m = rs.coercemesh(val)
        if m is not None:
            return m
    except:
        pass
    return None

def aplanar_candidatos(obj):
    res = []
    if obj is None:
        return res
    if hasattr(obj, "AllData"):
        for it in obj.AllData():
            res.extend(aplanar_candidatos(it))
        return res
    if hasattr(obj, "Branches"):
        for b in obj.Branches:
            res.extend(aplanar_candidatos(b))
        return res
    if isinstance(obj, list) or (hasattr(obj, "__iter__") and not hasattr(obj, "Faces")):
        for sub in obj:
            res.extend(aplanar_candidatos(sub))
        return res
    res.append(obj)
    return res

candidatos = aplanar_candidatos(M_In if 'M_In' in locals() else None)
lista_mallas = []
for c in candidatos:
    m = extraer_malla_universal(c)
    if m is not None and hasattr(m, "Faces") and m.Faces.Count > 0:
        lista_mallas.append(m)

def crear_submalla_uv(mesh_origen, face_indices):
    if not face_indices:
        return None
    sub = Rhino.Geometry.Mesh()
    vert_map = {}
    for fi in face_indices:
        f = mesh_origen.Faces[fi]
        idx_face = [f.A, f.B, f.C]
        if f.IsQuad:
            idx_face.append(f.D)

        nuevos_idx = []
        for vi in idx_face:
            if vi not in vert_map:
                new_vi = sub.Vertices.Add(mesh_origen.Vertices[vi])
                if mesh_origen.TextureCoordinates.Count > vi:
                    sub.TextureCoordinates.Add(mesh_origen.TextureCoordinates[vi])
                if mesh_origen.Normals.Count > vi:
                    sub.Normals.Add(mesh_origen.Normals[vi])
                vert_map[vi] = new_vi
            nuevos_idx.append(vert_map[vi])

        if len(nuevos_idx) == 3:
            sub.Faces.AddFace(nuevos_idx[0], nuevos_idx[1], nuevos_idx[2])
        elif len(nuevos_idx) == 4:
            sub.Faces.AddFace(nuevos_idx[0], nuevos_idx[1], nuevos_idx[2], nuevos_idx[3])

    sub.Compact()
    return sub

def separar_malla_pieza(mesh, b_mode, c1, c2, c3, c4, mid_x=None, span_x=0.0):
    bb = mesh.GetBoundingBox(True)
    x0, x1 = bb.Min.X, bb.Max.X
    y0, y1 = bb.Min.Y, bb.Max.Y
    z0, z1 = bb.Min.Z, bb.Max.Z

    sx = max(0.1, x1 - x0)
    sy = max(0.1, y1 - y0)
    sz = max(0.1, z1 - z0)

    dims = [("X", sx), ("Y", sy), ("Z", sz)]
    dims.sort(key=lambda d: d[1])
    eje_espesor = dims[0][0]
    espesor = dims[0][1]
    tol = max(0.5, espesor * 0.25)

    faces_A_idx = []
    faces_B_idx = []
    cantos_idx = {1: [], 2: [], 3: [], 4: []}
    mecanizados_idx = []

    for fi in range(mesh.Faces.Count):
        f = mesh.Faces[fi]
        pts = [mesh.Vertices[f.A], mesh.Vertices[f.B], mesh.Vertices[f.C]]
        if f.IsQuad:
            pts.append(mesh.Vertices[f.D])

        cx = sum(p.X for p in pts) / len(pts)
        cy = sum(p.Y for p in pts) / len(pts)
        cz = sum(p.Z for p in pts) / len(pts)

        if eje_espesor == "X":
            if abs(cx - x1) < tol:
                faces_A_idx.append(fi)
            elif abs(cx - x0) < tol:
                faces_B_idx.append(fi)
            elif abs(cy - y0) < tol:
                cantos_idx[1].append(fi)
            elif abs(cy - y1) < tol:
                cantos_idx[2].append(fi)
            elif abs(cz - z1) < tol:
                cantos_idx[3].append(fi)
            elif abs(cz - z0) < tol:
                cantos_idx[4].append(fi)
            else:
                mecanizados_idx.append(fi)
        elif eje_espesor == "Z":
            if abs(cz - z1) < tol:
                faces_A_idx.append(fi)
            elif abs(cz - z0) < tol:
                faces_B_idx.append(fi)
            elif abs(cy - y0) < tol:
                cantos_idx[1].append(fi)
            elif abs(cy - y1) < tol:
                cantos_idx[2].append(fi)
            elif abs(cx - x0) < tol:
                cantos_idx[3].append(fi)
            elif abs(cx - x1) < tol:
                cantos_idx[4].append(fi)
            else:
                mecanizados_idx.append(fi)
        else:
            if abs(cy - y0) < tol:
                faces_A_idx.append(fi)
            elif abs(cy - y1) < tol:
                faces_B_idx.append(fi)
            elif abs(cx - x0) < tol:
                cantos_idx[1].append(fi)
            elif abs(cx - x1) < tol:
                cantos_idx[2].append(fi)
            elif abs(cz - z1) < tol:
                cantos_idx[3].append(fi)
            elif abs(cz - z0) < tol:
                cantos_idx[4].append(fi)
            else:
                mecanizados_idx.append(fi)

    # DETECCIÓN DE SIMETRÍA / MIRROR AUTOMÁTICA:
    # La ranura del fondo siempre mira al interior del cajón.
    # Si la ranura está en el lado opuesto (-X), es una pieza reflejada.
    es_espejo = False
    if mecanizados_idx:
        if eje_espesor == "X":
            pts_x = []
            for fi in mecanizados_idx:
                f = mesh.Faces[fi]
                pts_x.append(mesh.Vertices[f.A].X)
                pts_x.append(mesh.Vertices[f.B].X)
                pts_x.append(mesh.Vertices[f.C].X)
                if f.IsQuad: pts_x.append(mesh.Vertices[f.D].X)
            if pts_x and (sum(pts_x) / float(len(pts_x))) < (x0 + x1) * 0.5:
                es_espejo = True
        elif eje_espesor == "Y":
            pts_y = [mesh.Vertices[mesh.Faces[fi].A].Y for fi in mecanizados_idx]
            if pts_y and (sum(pts_y) / float(len(pts_y))) < (y0 + y1) * 0.5:
                es_espejo = True
        elif eje_espesor == "Z":
            pts_z = [mesh.Vertices[mesh.Faces[fi].A].Z for fi in mecanizados_idx]
            if pts_z and (sum(pts_z) / float(len(pts_z))) < (z0 + z1) * 0.5:
                es_espejo = True

    # Detección espacial universal de pares simétricos (Mirror sin mecanizados):
    if not es_espejo and mid_x is not None and span_x > 50.0 and eje_espesor == 'X':
        if (x0 + x1) * 0.5 < mid_x:
            es_espejo = True

    # Si es reflejada (espejo), invertimos las caras A y B para que el Balance quede adentro
    if es_espejo:
        f_A = faces_B_idx
        f_B = faces_A_idx
    else:
        f_A = faces_A_idx
        f_B = faces_B_idx

    color_idx = []
    balance_idx = []
    mdp_idx = []

    if b_mode == "DD":
        color_idx.extend(f_A)
        color_idx.extend(f_B)
    elif b_mode == "A":
        balance_idx.extend(f_A)
        color_idx.extend(f_B)
    elif b_mode == "B":
        color_idx.extend(f_A)
        balance_idx.extend(f_B)
    else:
        balance_idx.extend(f_A)
        balance_idx.extend(f_B)

    cantos_map = {1: c1, 2: c2, 3: c3, 4: c4}
    for num, tiene in cantos_map.items():
        if tiene:
            color_idx.extend(cantos_idx[num])
        else:
            mdp_idx.extend(cantos_idx[num])

    mdp_idx.extend(mecanizados_idx)

    m_col = crear_submalla_uv(mesh, color_idx)
    m_bal = crear_submalla_uv(mesh, balance_idx)
    m_mdp = crear_submalla_uv(mesh, mdp_idx)

    return m_col, m_bal, m_mdp

b_mode = parse_balance(Balance_Mode if 'Balance_Mode' in locals() else "Cara B")
c_1 = parse_canto(Canto_1 if 'Canto_1' in locals() else "Canto")
c_2 = parse_canto(Canto_2 if 'Canto_2' in locals() else "Canto")
c_3 = parse_canto(Canto_3 if 'Canto_3' in locals() else "Canto")
c_4 = parse_canto(Canto_4 if 'Canto_4' in locals() else "Canto")

Color = []
Balance = []
MDP = []

# Detección del centro global del par simétrico para componentes Mirror
mid_x, span_x = None, 0.0
if len(lista_mallas) >= 2:
    c_xs = [(m.GetBoundingBox(True).Min.X + m.GetBoundingBox(True).Max.X) * 0.5 for m in lista_mallas]
    mid_x = sum(c_xs) / float(len(c_xs))
    span_x = max(c_xs) - min(c_xs)

for m in lista_mallas:
    m_c, m_b, m_m = separar_malla_pieza(m, b_mode, c_1, c_2, c_3, c_4, mid_x, span_x)
    if m_c is not None: Color.append(m_c)
    if m_b is not None: Balance.append(m_b)
    if m_m is not None: MDP.append(m_m)

# Diagnóstico emitido directamente hacia la salida estándar 'out'
print(f"Procesadas {len(lista_mallas)} mallas | Color={len(Color)}, Balance={len(Balance)}, MDP={len(MDP)}")
# ---------- end python_3_script_14 ----------
diagnostico_13 = Panel(python_3_script_14.out)
rh_out_mdp_peça_9 = Geometry(python_3_script_14.MDP)
rh_out_peça_9_b = Geometry(python_3_script_14.Balance)
# 9
rh_out_peça_9 = Geometry(python_3_script_14.Color)

# ---- group: Peça 12 Aparência
# 3BF Materializer v0.3
# 3BF Box Mapping v1.0
# 3BF Mesh Channel Separator v2.2
rh_in_15_1_mapeado = ValueList({"Longitudinal": 0, "Atravesada": 1}, selected="Longitudinal")
python_3_script_15 = Python3Script(Brep_In=stream_filter_4)  # -> out, Pieza_1, Pieza_2, Pieza_3, Pieza_4; inputs Brep_In: list of Brep; same code as python_3_script_12
mesh_brep_2 = MeshBrep(
    Brep=python_3_script_15.Pieza_1,
    Settings={GridMaxCount=0, GridMinCount=16, JaggedSeams=False, MaxEdgeLength=0, MinEdgeLength=0.0001, MinTolerance=0, Refine=True, RefineAngle=0, RelativeTolerance=0.65, SimplePlanes=True, Tolerance=0})
rh_in_15_2_lado_balance = ValueList({"Cara A", "Cara B", "D/D"}, selected="Cara A")
rh_in_15_3_canto_frontal = ValueList({"Canto": 0, "MDP": 1}, selected="MDP")
rh_in_15_4_canto_trasero = ValueList({"Canto": 0, "MDP": 1}, selected="MDP")
rh_in_15_5_canto_izquierdo_arriba = ValueList({"Canto": 0, "MDP": 1}, selected="Canto")
rh_in_15_6_canto_derecho_abajo = ValueList({"Canto": 0, "MDP": 1}, selected="MDP")
diagnostico_14 = Panel(python_3_script_15.out)
mesh_join_2 = MeshJoin(Meshes=flatten(mesh_brep_2))
python_3_script_16 = Python3Script(M=mesh_join_2, B=rh_in_15_1_mapeado)  # -> a; inputs M: Mesh, B: Int32; same code as python_3_script_13
python_3_script_17 = Python3Script(
    M_In=python_3_script_16,
    Balance_Mode=rh_in_15_2_lado_balance,
    Canto_1=rh_in_15_3_canto_frontal,
    Canto_2=rh_in_15_4_canto_trasero,
    Canto_3=rh_in_15_5_canto_izquierdo_arriba,
    Canto_4=rh_in_15_6_canto_derecho_abajo)  # -> out, Color, Balance, MDP; inputs M_In: list; same code as python_3_script_14
diagnostico_15 = Panel(python_3_script_17.out)
rh_out_mdp_peça_12 = Geometry(python_3_script_17.MDP)
rh_out_peça_12_b = Geometry(python_3_script_17.Balance)
# 12
rh_out_peça_12 = Geometry(python_3_script_17.Color)

# ---- group: Peça 14 Aparência
# 3BF Materializer v0.3
# 3BF Box Mapping v1.0
# 3BF Mesh Channel Separator v2.2
rh_in_17_0_mapeado = ValueList({"Longitudinal": 0, "Atravesada": 1}, selected="Longitudinal")
python_3_script_18 = Python3Script(Brep_In=[mirror_4.Geometry, box_2pt_7])  # -> out, Pieza_1, Pieza_2, Pieza_3, Pieza_4; inputs Brep_In: list of Brep; same code as python_3_script_12
mesh_brep_3 = MeshBrep(
    Brep=python_3_script_18.Pieza_1,
    Settings={GridMaxCount=0, GridMinCount=16, JaggedSeams=False, MaxEdgeLength=0, MinEdgeLength=0.0001, MinTolerance=0, Refine=True, RefineAngle=0, RelativeTolerance=0.65, SimplePlanes=True, Tolerance=0})
mesh_brep_4 = MeshBrep(
    Brep=python_3_script_18.Pieza_2,
    Settings={GridMaxCount=0, GridMinCount=16, JaggedSeams=False, MaxEdgeLength=0, MinEdgeLength=0.0001, MinTolerance=0, Refine=True, RefineAngle=0, RelativeTolerance=0.65, SimplePlanes=True, Tolerance=0})
rh_in_17_4_canto_izquierdo_arriba = ValueList({"Canto": 0, "MDP": 1}, selected="MDP")
rh_in_17_1_lado_balance = ValueList({"Cara A", "Cara B", "D/D"}, selected="D/D")
rh_in_17_2_canto_frontal = ValueList({"Canto": 0, "MDP": 1}, selected="Canto")
rh_in_17_3_canto_trasero = ValueList({"Canto": 0, "MDP": 1}, selected="Canto")
rh_in_17_5_canto_derecho_abajo = ValueList({"Canto": 0, "MDP": 1}, selected="MDP")
diagnostico_16 = Panel(python_3_script_18.out)
mesh_join_3 = MeshJoin(Meshes=flatten(mesh_brep_3))
mesh_join_4 = MeshJoin(Meshes=flatten(mesh_brep_4))
python_3_script_19 = Python3Script(M=mesh_join_3, B=rh_in_17_0_mapeado)  # -> a; inputs M: Mesh, B: Int32; same code as python_3_script_13
python_3_script_20 = Python3Script(M=mesh_join_4, B=rh_in_17_0_mapeado)  # -> a; inputs M: Mesh, B: Int32; same code as python_3_script_13
python_3_script_21 = Python3Script(
    M_In=[python_3_script_19, python_3_script_20],
    Balance_Mode=rh_in_17_1_lado_balance,
    Canto_1=rh_in_17_2_canto_frontal,
    Canto_2=rh_in_17_3_canto_trasero,
    Canto_3=rh_in_17_4_canto_izquierdo_arriba,
    Canto_4=rh_in_17_5_canto_derecho_abajo)  # -> out, Color, Balance, MDP; inputs M_In: list
# ---------- python_3_script_21: Python ----------
"""
=============================================================================
3BF Mesh Channel Separator v2.3 (Clean & Symmetry Aware)
Powered by 3dBimFab
=============================================================================
Separa la malla consolidada y mapeada en los 3 canales de manufactura DfMA:
1. Color: Caras principales y cantos aplacados.
2. Balance: Contracaras (respetando la simetría/espejo en parejas de cajones).
3. MDP: Mecanizados/ranuras y cantos sin aplacar.
La información de diagnóstico se emite directamente por la salida estándar 'out'.
=============================================================================
"""
import Rhino
import rhinoscriptsyntax as rs

def parse_balance(val):
    s = str(val).lower().strip().replace('"', '').replace("'", "")
    if s in ["6", "d/d", "dyd", "doble", "ninguno", "ambas"] or "d/d" in s or "dyd" in s:
        return "DD"
    if s in ["5", "cara a", "a"] or (s.startswith("a") and len(s) <= 6):
        return "A"
    if s in ["4", "cara b", "b"] or (s.startswith("b") and len(s) <= 6):
        return "B"
    return "B"

def parse_canto(val):
    s = str(val).lower().strip().replace('"', '').replace("'", "")
    if s in ["0", "0.0", "canto", "true", "si", "sí", "s", "con canto"] or ("canto" in s and "sin" not in s):
        return True
    if s in ["1", "1.0", "mdp", "false", "no", "sin canto"] or "mdp" in s or "sin" in s:
        return False
    return True

def extraer_malla_universal(c):
    if c is None:
        return None
    if hasattr(c, "Faces") and hasattr(c, "Vertices"):
        return c
    val = getattr(c, "Value", c)
    if hasattr(val, "Faces") and hasattr(val, "Vertices"):
        return val
    try:
        m = rs.coercemesh(c)
        if m is not None:
            return m
    except:
        pass
    try:
        m = rs.coercemesh(val)
        if m is not None:
            return m
    except:
        pass
    return None

def aplanar_candidatos(obj):
    res = []
    if obj is None:
        return res
    if hasattr(obj, "AllData"):
        for it in obj.AllData():
            res.extend(aplanar_candidatos(it))
        return res
    if hasattr(obj, "Branches"):
        for b in obj.Branches:
            res.extend(aplanar_candidatos(b))
        return res
    if isinstance(obj, list) or (hasattr(obj, "__iter__") and not hasattr(obj, "Faces")):
        for sub in obj:
            res.extend(aplanar_candidatos(sub))
        return res
    res.append(obj)
    return res

candidatos = aplanar_candidatos(M_In if 'M_In' in locals() else None)
lista_mallas = []
for c in candidatos:
    m = extraer_malla_universal(c)
    if m is not None and hasattr(m, "Faces") and m.Faces.Count > 0:
        lista_mallas.append(m)

def crear_submalla_uv(mesh_origen, face_indices):
    if not face_indices:
        return None
    sub = Rhino.Geometry.Mesh()
    vert_map = {}
    for fi in face_indices:
        f = mesh_origen.Faces[fi]
        idx_face = [f.A, f.B, f.C]
        if f.IsQuad:
            idx_face.append(f.D)

        nuevos_idx = []
        for vi in idx_face:
            if vi not in vert_map:
                new_vi = sub.Vertices.Add(mesh_origen.Vertices[vi])
                if mesh_origen.TextureCoordinates.Count > vi:
                    sub.TextureCoordinates.Add(mesh_origen.TextureCoordinates[vi])
                if mesh_origen.Normals.Count > vi:
                    sub.Normals.Add(mesh_origen.Normals[vi])
                vert_map[vi] = new_vi
            nuevos_idx.append(vert_map[vi])

        if len(nuevos_idx) == 3:
            sub.Faces.AddFace(nuevos_idx[0], nuevos_idx[1], nuevos_idx[2])
        elif len(nuevos_idx) == 4:
            sub.Faces.AddFace(nuevos_idx[0], nuevos_idx[1], nuevos_idx[2], nuevos_idx[3])

    sub.Compact()
    return sub

def separar_malla_pieza(mesh, b_mode, c1, c2, c3, c4, mid_x=None, span_x=0.0):
    bb = mesh.GetBoundingBox(True)
    x0, x1 = bb.Min.X, bb.Max.X
    y0, y1 = bb.Min.Y, bb.Max.Y
    z0, z1 = bb.Min.Z, bb.Max.Z

    sx = max(0.1, x1 - x0)
    sy = max(0.1, y1 - y0)
    sz = max(0.1, z1 - z0)

    dims = [("X", sx), ("Y", sy), ("Z", sz)]
    dims.sort(key=lambda d: d[1])
    eje_espesor = dims[0][0]
    espesor = dims[0][1]
    tol = max(0.5, espesor * 0.25)

    faces_A_idx = []
    faces_B_idx = []
    cantos_idx = {1: [], 2: [], 3: [], 4: []}
    mecanizados_idx = []

    for fi in range(mesh.Faces.Count):
        f = mesh.Faces[fi]
        pts = [mesh.Vertices[f.A], mesh.Vertices[f.B], mesh.Vertices[f.C]]
        if f.IsQuad:
            pts.append(mesh.Vertices[f.D])

        cx = sum(p.X for p in pts) / len(pts)
        cy = sum(p.Y for p in pts) / len(pts)
        cz = sum(p.Z for p in pts) / len(pts)

        if eje_espesor == "X":
            if abs(cx - x1) < tol:
                faces_A_idx.append(fi)
            elif abs(cx - x0) < tol:
                faces_B_idx.append(fi)
            elif abs(cy - y0) < tol:
                cantos_idx[1].append(fi)
            elif abs(cy - y1) < tol:
                cantos_idx[2].append(fi)
            elif abs(cz - z1) < tol:
                cantos_idx[3].append(fi)
            elif abs(cz - z0) < tol:
                cantos_idx[4].append(fi)
            else:
                mecanizados_idx.append(fi)
        elif eje_espesor == "Z":
            if abs(cz - z1) < tol:
                faces_A_idx.append(fi)
            elif abs(cz - z0) < tol:
                faces_B_idx.append(fi)
            elif abs(cy - y0) < tol:
                cantos_idx[1].append(fi)
            elif abs(cy - y1) < tol:
                cantos_idx[2].append(fi)
            elif abs(cx - x0) < tol:
                cantos_idx[3].append(fi)
            elif abs(cx - x1) < tol:
                cantos_idx[4].append(fi)
            else:
                mecanizados_idx.append(fi)
        else:
            if abs(cy - y0) < tol:
                faces_A_idx.append(fi)
            elif abs(cy - y1) < tol:
                faces_B_idx.append(fi)
            elif abs(cx - x0) < tol:
                cantos_idx[1].append(fi)
            elif abs(cx - x1) < tol:
                cantos_idx[2].append(fi)
            elif abs(cz - z1) < tol:
                cantos_idx[3].append(fi)
            elif abs(cz - z0) < tol:
                cantos_idx[4].append(fi)
            else:
                mecanizados_idx.append(fi)

    # DETECCIÓN DE SIMETRÍA / MIRROR AUTOMÁTICA:
    # La ranura del fondo siempre mira al interior del cajón.
    # Si la ranura está en el lado opuesto (-X), es una pieza reflejada.
    es_espejo = False
    if mecanizados_idx:
        if eje_espesor == "X":
            pts_x = []
            for fi in mecanizados_idx:
                f = mesh.Faces[fi]
                pts_x.append(mesh.Vertices[f.A].X)
                pts_x.append(mesh.Vertices[f.B].X)
                pts_x.append(mesh.Vertices[f.C].X)
                if f.IsQuad: pts_x.append(mesh.Vertices[f.D].X)
            if pts_x and (sum(pts_x) / float(len(pts_x))) < (x0 + x1) * 0.5:
                es_espejo = True
        elif eje_espesor == "Y":
            pts_y = [mesh.Vertices[mesh.Faces[fi].A].Y for fi in mecanizados_idx]
            if pts_y and (sum(pts_y) / float(len(pts_y))) < (y0 + y1) * 0.5:
                es_espejo = True
        elif eje_espesor == "Z":
            pts_z = [mesh.Vertices[mesh.Faces[fi].A].Z for fi in mecanizados_idx]
            if pts_z and (sum(pts_z) / float(len(pts_z))) < (z0 + z1) * 0.5:
                es_espejo = True

    # Detección espacial de pares simétricos (Mirror sin mecanizados):
    if not es_espejo and mid_x is not None and span_x > 50.0 and eje_espesor == 'X':
        if (x0 + x1) * 0.5 < mid_x:
            es_espejo = True

    # Si es reflejada (espejo), invertimos las caras A y B para que el Balance quede adentro
    if es_espejo:
        f_A = faces_B_idx
        f_B = faces_A_idx
    else:
        f_A = faces_A_idx
        f_B = faces_B_idx

    color_idx = []
    balance_idx = []
    mdp_idx = []

    if b_mode == "DD":
        color_idx.extend(f_A)
        color_idx.extend(f_B)
    elif b_mode == "A":
        balance_idx.extend(f_A)
        color_idx.extend(f_B)
    elif b_mode == "B":
        color_idx.extend(f_A)
        balance_idx.extend(f_B)
    else:
        balance_idx.extend(f_A)
        balance_idx.extend(f_B)

    cantos_map = {1: c1, 2: c2, 3: c3, 4: c4}
    for num, tiene in cantos_map.items():
        if tiene:
            color_idx.extend(cantos_idx[num])
        else:
            mdp_idx.extend(cantos_idx[num])

    mdp_idx.extend(mecanizados_idx)

    m_col = crear_submalla_uv(mesh, color_idx)
    m_bal = crear_submalla_uv(mesh, balance_idx)
    m_mdp = crear_submalla_uv(mesh, mdp_idx)

    return m_col, m_bal, m_mdp

b_mode = parse_balance(Balance_Mode if 'Balance_Mode' in locals() else "Cara B")
c_1 = parse_canto(Canto_1 if 'Canto_1' in locals() else "Canto")
c_2 = parse_canto(Canto_2 if 'Canto_2' in locals() else "Canto")
c_3 = parse_canto(Canto_3 if 'Canto_3' in locals() else "Canto")
c_4 = parse_canto(Canto_4 if 'Canto_4' in locals() else "Canto")

Color = []
Balance = []
MDP = []

# Detección del centro global del par simétrico
mid_x, span_x = None, 0.0
if len(lista_mallas) >= 2:
    c_xs = [(m.GetBoundingBox(True).Min.X + m.GetBoundingBox(True).Max.X) * 0.5 for m in lista_mallas]
    mid_x = sum(c_xs) / float(len(c_xs))
    span_x = max(c_xs) - min(c_xs)

for m in lista_mallas:
    m_c, m_b, m_m = separar_malla_pieza(m, b_mode, c_1, c_2, c_3, c_4, mid_x, span_x)
    if m_c is not None: Color.append(m_c)
    if m_b is not None: Balance.append(m_b)
    if m_m is not None: MDP.append(m_m)

# Diagnóstico emitido directamente hacia la salida estándar 'out'
print(f"Procesadas {len(lista_mallas)} mallas | Color={len(Color)}, Balance={len(Balance)}, MDP={len(MDP)}")
# ---------- end python_3_script_21 ----------
diagnostico_17 = Panel(python_3_script_21.out)
rh_out_mdp_peça_14 = Geometry(python_3_script_21.MDP)
rh_out_peça_14_b = Geometry(python_3_script_21.Balance)
# 14
rh_out_peça_14 = Geometry(python_3_script_21.Color)

# ---- group: Peça 13 Aparência
# 3BF Materializer v0.3
# 3BF Box Mapping v1.0
# 3BF Mesh Channel Separator v2.2
rh_in_16_0_mapeado = ValueList({"Longitudinal": 0, "Atravesada": 1}, selected="Longitudinal")
python_3_script_22 = Python3Script(Brep_In=solid_difference_3)  # -> out, Pieza_1, Pieza_2, Pieza_3, Pieza_4; inputs Brep_In: list of Brep; same code as python_3_script_12
mesh_brep_5 = MeshBrep(
    Brep=python_3_script_22.Pieza_1,
    Settings={GridMaxCount=0, GridMinCount=16, JaggedSeams=False, MaxEdgeLength=0, MinEdgeLength=0.0001, MinTolerance=0, Refine=True, RefineAngle=0, RelativeTolerance=0.65, SimplePlanes=True, Tolerance=0})
rh_in_16_1_lado_balance = ValueList({"Cara A", "Cara B", "D/D"}, selected="Cara B")
rh_in_16_2_canto_frontal = ValueList({"Canto": 0, "MDP": 1}, selected="Canto")
rh_in_16_3_canto_trasero = ValueList({"Canto": 0, "MDP": 1}, selected="MDP")
rh_in_16_4_canto_izquierdo_arriba = ValueList({"Canto": 0, "MDP": 1}, selected="Canto")
rh_in_16_5_canto_derecho_abajo = ValueList({"Canto": 0, "MDP": 1}, selected="Canto")
diagnostico_18 = Panel(python_3_script_22.out)
mesh_join_5 = MeshJoin(Meshes=flatten(mesh_brep_5))
python_3_script_23 = Python3Script(M=mesh_join_5, B=rh_in_16_0_mapeado)  # -> a; inputs M: Mesh, B: Int32; same code as python_3_script_13
python_3_script_24 = Python3Script(
    M_In=python_3_script_23,
    Balance_Mode=rh_in_16_1_lado_balance,
    Canto_1=rh_in_16_2_canto_frontal,
    Canto_2=rh_in_16_3_canto_trasero,
    Canto_3=rh_in_16_4_canto_izquierdo_arriba,
    Canto_4=rh_in_16_5_canto_derecho_abajo)  # -> out, Color, Balance, MDP; inputs M_In: list; same code as python_3_script_14
diagnostico_19 = Panel(python_3_script_24.out)
rh_out_mdp_peça_13 = Geometry(python_3_script_24.MDP)
rh_out_peça_13_b = Geometry(python_3_script_24.Balance)
# 13
rh_out_peça_13 = Geometry(python_3_script_24.Color)

# ---- group: Peça 15 Aparência
# FONDOS
# 3BF Materializer v1.1 Fundos
# 3BF Box Mapping v1.0 Fondos
# 3BF Mesh Channel Separator v2.5  Fondos
rh_in_21_0_mapeado = ValueList({"Longitudinal": 0, "Atravesada": 1}, selected="Longitudinal")
rh_in_21_1_separacion = Slider(2, range=1..4)
python_3_script_25 = Python3Script(Brep_In=brep, Separacion_Mm=rh_in_21_1_separacion)  # -> out, Pieza_1, Pieza_2, Pieza_3, Pieza_4; inputs Brep_In: list of Brep, Separacion_Mm: Double
# ---------- python_3_script_25: Python ----------
"""
=============================================================================
3BF Materializer v1.1 (Clean Face Consolidator con Holgura Paramétrica de Fondos)
Powered by 3dBimFab
=============================================================================
1. Detecta y ordena los fondos de izquierda a derecha en X.
2. Aplica holgura/separación paramétrica (Separacion_Mm) en las juntas de contacto,
   preservando intactos los bordes exteriores de agarre en los laterales.
3. Desglosa cada Closed Brep resultante preservando el 100% de sus caras NURBS
   (caras A/B, cantos perimetrales) y las emite limpias por pieza física (Pieza_1 a Pieza_4).
=============================================================================
"""
import Rhino

# -------------------------------------------------------------
# 1. PARÁMETRO DE SEPARACIÓN ENTRE FONDOS (SLIDER)
# -------------------------------------------------------------
separacion = 2.0  # Valor por defecto en mm

for var_name in ['Separacion_Mm', 'Separacion', 'separacion', 'Junta_Mm', 'Holgura_Mm', 'Holgura']:
    if var_name in locals() and locals()[var_name] is not None:
        try:
            separacion = float(locals()[var_name])
            break
        except:
            pass


# -------------------------------------------------------------
# 2. FUNCIÓN DE CONSOLIDACIÓN DE CARAS NURBS
# -------------------------------------------------------------
def consolidar_caras_pieza(brep_in):
    if brep_in is None:
        return [], "Brep nulo"

    bbox = brep_in.GetBoundingBox(True)
    x0, x1 = bbox.Min.X, bbox.Max.X
    y0, y1 = bbox.Min.Y, bbox.Max.Y
    z0, z1 = bbox.Min.Z, bbox.Max.Z

    sx = max(0.1, x1 - x0)
    sy = max(0.1, y1 - y0)
    sz = max(0.1, z1 - z0)
    min_dim = min(sx, sy, sz)

    tol = max(0.2, min_dim * 0.15)
    zona_bisel = max(tol * 2.5, min_dim * 2.5)

    faces_A = []
    faces_B = []
    faces_cantos = []
    faces_mecanizados = []

    # Extraer cada cara manteniendo trimmed loops intactos
    for i in range(brep_in.Faces.Count):
        f = brep_in.Faces[i]
        u = (f.Domain(0).T0 + f.Domain(0).T1) * 0.5
        v = (f.Domain(1).T0 + f.Domain(1).T1) * 0.5
        pt = f.PointAt(u, v)
        n = f.NormalAt(u, v)
        n.Unitize()
        nurbs_face = f.DuplicateFace(False)

        # Tablero Vertical Lateral (Espesor en X)
        if min_dim == sx:
            if n.X > 0.85 and abs(pt.X - x1) < tol:
                faces_A.append(nurbs_face)
            elif n.X < -0.85 and abs(pt.X - x0) < tol:
                faces_B.append(nurbs_face)
            elif (abs(pt.Y - y0) < zona_bisel or abs(y1 - pt.Y) < zona_bisel or
                  abs(pt.Z - z0) < zona_bisel or abs(z1 - pt.Z) < zona_bisel):
                faces_cantos.append(nurbs_face)
            else:
                faces_mecanizados.append(nurbs_face)

        # Tablero Horizontal (Espesor en Z)
        elif min_dim == sz:
            if n.Z > 0.85 and abs(pt.Z - z1) < tol:
                faces_A.append(nurbs_face)
            elif n.Z < -0.85 and abs(pt.Z - z0) < tol:
                faces_B.append(nurbs_face)
            elif (abs(pt.Y - y0) < zona_bisel or abs(y1 - pt.Y) < zona_bisel or
                  abs(pt.X - x0) < zona_bisel or abs(x1 - pt.X) < zona_bisel):
                faces_cantos.append(nurbs_face)
            else:
                faces_mecanizados.append(nurbs_face)

        # Tablero Vertical Frontal/Fondo (Espesor en Y)
        else:
            if n.Y < -0.85 and abs(pt.Y - y0) < tol:
                faces_A.append(nurbs_face)
            elif n.Y > 0.85 and abs(pt.Y - y1) < tol:
                faces_B.append(nurbs_face)
            elif (abs(pt.X - x0) < zona_bisel or abs(x1 - pt.X) < zona_bisel or
                  abs(pt.Z - z0) < zona_bisel or abs(z1 - pt.Z) < zona_bisel):
                faces_cantos.append(nurbs_face)
            else:
                faces_mecanizados.append(nurbs_face)

    todas_las_caras = []
    todas_las_caras.extend(faces_A)
    todas_las_caras.extend(faces_B)
    todas_las_caras.extend(faces_cantos)
    todas_las_caras.extend(faces_mecanizados)

    diag = "Caras: {} (A={}, B={}, Cantos={}, Mec={})".format(
        len(todas_las_caras), len(faces_A), len(faces_B),
        len(faces_cantos), len(faces_mecanizados)
    )

    return todas_las_caras, diag


# -------------------------------------------------------------
# 3. RECOLECCIÓN Y ORDENAMIENTO DE BREPS (X ASCENDENTE)
# -------------------------------------------------------------
lista_breps = []
if 'Brep_In' in locals() and Brep_In is not None:
    if hasattr(Brep_In, "__iter__") and not isinstance(Brep_In, Rhino.Geometry.Brep):
        lista_breps = [b for b in Brep_In if b is not None and b.IsValid]
    else:
        if Brep_In.IsValid:
            lista_breps = [Brep_In]

# Ordenar de izquierda a derecha según el centroide X
breps_ordenados = []
for b in lista_breps:
    bb = b.GetBoundingBox(True)
    breps_ordenados.append((bb.Center.X, b))
breps_ordenados.sort(key=lambda item: item[0])
lista_breps = [item[1] for item in breps_ordenados]

num_piezas = len(lista_breps)
delta = separacion * 0.5  # Retracción simétrica por junta (ej. 2mm / 2 = 1mm)


# -------------------------------------------------------------
# 4. APLICACIÓN DE SEPARACIÓN Y PROCESAMIENTO
# -------------------------------------------------------------
resultados_piezas = []
diagnosticos = []

for idx, b in enumerate(lista_breps):
    bbox = b.GetBoundingBox(True)
    x0, x1 = bbox.Min.X, bbox.Max.X
    y0, y1 = bbox.Min.Y, bbox.Max.Y
    z0, z1 = bbox.Min.Z, bbox.Max.Z

    ancho_original = x1 - x0

    # Ajuste paramétrico de los bordes X
    if num_piezas > 1 and separacion > 0.0:
        if idx == 0:
            # Fondo 1 (Izquierdo): exterior intacto, junta derecha retrocede
            nuevo_x0 = x0
            nuevo_x1 = x1 - delta
            tipo_fondo = "Extremo Izquierdo (Ranura Izq protegida)"
        elif idx == num_piezas - 1:
            # Fondo 4 (Derecho): junta izquierda retrocede, exterior intacto
            nuevo_x0 = x0 + delta
            nuevo_x1 = x1
            tipo_fondo = "Extremo Derecho (Ranura Der protegida)"
        else:
            # Fondos 2 y 3 (Intermedios): retroceden por ambos lados
            nuevo_x0 = x0 + delta
            nuevo_x1 = x1 - delta
            tipo_fondo = "Intermedio (Holgura bilateral)"
    else:
        nuevo_x0 = x0
        nuevo_x1 = x1
        tipo_fondo = "Único"

    ancho_nuevo = nuevo_x1 - nuevo_x0

    # Reconstrucción geométrica como Brep limpio con holgura
    nuevo_box = Rhino.Geometry.BoundingBox(nuevo_x0, y0, z0, nuevo_x1, y1, z1)
    brep_ajustado = Rhino.Geometry.Brep.CreateFromBox(nuevo_box)
    if brep_ajustado is None or not brep_ajustado.IsValid:
        brep_ajustado = b  # Respaldo

    # Consolidar caras NURBS para texturizado y visualizador
    caras, d_txt = consolidar_caras_pieza(brep_ajustado)
    resultados_piezas.append(caras)

    diagnosticos.append("Pieza {} [{}]: Ancho {:.1f}mm -> {:.1f}mm | {}".format(
        idx + 1, tipo_fondo, ancho_original, ancho_nuevo, d_txt
    ))


# -------------------------------------------------------------
# 5. SALIDAS DE GRASSHOPPER
# -------------------------------------------------------------
Pieza_1 = resultados_piezas[0] if len(resultados_piezas) > 0 else []
Pieza_2 = resultados_piezas[1] if len(resultados_piezas) > 1 else []
Pieza_3 = resultados_piezas[2] if len(resultados_piezas) > 2 else []
Pieza_4 = resultados_piezas[3] if len(resultados_piezas) > 3 else []

print("Separación configurada: {:.2f} mm".format(separacion))
print("\n".join(diagnosticos) if diagnosticos else "Sin piezas de entrada")
# ---------- end python_3_script_25 ----------
mesh_brep_6 = MeshBrep(
    Brep=python_3_script_25.Pieza_3,
    Settings={GridMaxCount=0, GridMinCount=16, JaggedSeams=False, MaxEdgeLength=0, MinEdgeLength=0.0001, MinTolerance=0, Refine=True, RefineAngle=0, RelativeTolerance=0.65, SimplePlanes=True, Tolerance=0})
mesh_brep_7 = MeshBrep(
    Brep=python_3_script_25.Pieza_4,
    Settings={GridMaxCount=0, GridMinCount=16, JaggedSeams=False, MaxEdgeLength=0, MinEdgeLength=0.0001, MinTolerance=0, Refine=True, RefineAngle=0, RelativeTolerance=0.65, SimplePlanes=True, Tolerance=0})
mesh_brep_8 = MeshBrep(
    Brep=python_3_script_25.Pieza_1,
    Settings={GridMaxCount=0, GridMinCount=16, JaggedSeams=False, MaxEdgeLength=0, MinEdgeLength=0.0001, MinTolerance=0, Refine=True, RefineAngle=0, RelativeTolerance=0.65, SimplePlanes=True, Tolerance=0})
mesh_brep_9 = MeshBrep(
    Brep=python_3_script_25.Pieza_2,
    Settings={GridMaxCount=0, GridMinCount=16, JaggedSeams=False, MaxEdgeLength=0, MinEdgeLength=0.0001, MinTolerance=0, Refine=True, RefineAngle=0, RelativeTolerance=0.65, SimplePlanes=True, Tolerance=0})
rh_in_21_1_lado_color = ValueList({"Cara A", "Cara B"}, selected="Cara A")
rh_in_21_2_sustrato = ValueList({"MDF 1 Cara": "MDF 1 cara", "Doble Cara (D/D)": "DD", "MDF Crudo": "Crudo", "Con Balance": "Balance"}, selected="MDF 1 Cara")
diagnostico_20 = Panel(python_3_script_25.out)
mesh_join_6 = MeshJoin(Meshes=flatten(mesh_brep_6))
mesh_join_7 = MeshJoin(Meshes=flatten(mesh_brep_7))
mesh_join_8 = MeshJoin(Meshes=flatten(mesh_brep_8))
mesh_join_9 = MeshJoin(Meshes=flatten(mesh_brep_9))
python_3_script_26 = Python3Script(M=mesh_join_8, B=rh_in_21_0_mapeado)  # -> a; inputs M: Mesh, B: Int32
# ---------- python_3_script_26: Python ----------
"""
=============================================================================
3BF Box Mapping v1.0 Fondos (Thin Sheet MDF Specialized - Fix Salidas)
Powered by 3dBimFab
=============================================================================
Mapeado de textura UV optimizado para tableros delgados de 3 mm / 6 mm:
- Identifica automáticamente el plano dominante del fondo (XY, XZ o YZ).
- Proyecta UVs continuas a escala métrica estándar (600 mm).
- Modo de Veta (B / S):
  * 0 / "Longitudinal": La veta corre a lo largo del lado más largo del fondo.
  * 1 / "Atravesada": La veta corre a lo largo del lado transversal.
- Preserva la cohesión total de la malla sin despiece destructivo.
- Asigna explícitamente a la salida 'a' para alimentar el Linear Array.
=============================================================================
"""
import Rhino

def aplicar_box_mapping_fondo(mesh_in, modo_veta=0, escala_caja_mm=600.0):
    if mesh_in is None:
        return None

    mesh = mesh_in
    if hasattr(mesh_in, "Value"):
        mesh = mesh_in.Value

    if not isinstance(mesh, Rhino.Geometry.Mesh):
        return mesh_in

    m = mesh.DuplicateMesh() if hasattr(mesh, "DuplicateMesh") else mesh
    m.Normals.ComputeNormals()
    m.TextureCoordinates.Clear()

    bbox = m.GetBoundingBox(True)
    if not bbox.IsValid:
        return m

    sx = max(0.1, bbox.Max.X - bbox.Min.X)
    sy = max(0.1, bbox.Max.Y - bbox.Min.Y)
    sz = max(0.1, bbox.Max.Z - bbox.Min.Z)

    # Identificar el eje de espesor (mínima dimensión) y los dos lados del plano
    dims = [("X", sx), ("Y", sy), ("Z", sz)]
    dims.sort(key=lambda d: d[1])
    eje_espesor = dims[0][0]

    es_atravesada = False
    if isinstance(modo_veta, str):
        es_atravesada = "atravesad" in modo_veta.lower() or modo_veta in ["1", "3", "5"]
    elif isinstance(modo_veta, (int, float)):
        es_atravesada = int(modo_veta) in [1, 3, 5]

    escala = float(escala_caja_mm)

    v_count = m.Vertices.Count
    norm_count = m.Normals.Count

    for idx in range(v_count):
        v = m.Vertices[idx]
        n = m.Normals[idx] if idx < norm_count else Rhino.Geometry.Vector3f(0, 0, 1)

        lx = v.X - bbox.Min.X
        ly = v.Y - bbox.Min.Y
        lz = v.Z - bbox.Min.Z

        nx, ny, nz = abs(n.X), abs(n.Y), abs(n.Z)

        # -----------------------------------------------------------------
        # CASO 1: Fondo Horizontal (Espesor en Z, caras principales en XY)
        # -----------------------------------------------------------------
        if eje_espesor == "Z":
            if nz >= nx and nz >= ny:
                # Caras principales A / B
                if sx >= sy:
                    u = ly / escala if es_atravesada else lx / escala
                    v_coord = lx / escala if es_atravesada else ly / escala
                else:
                    u = lx / escala if es_atravesada else ly / escala
                    v_coord = ly / escala if es_atravesada else lx / escala
            elif ny >= nx:
                # Cantos en Y
                u = lx / escala
                v_coord = lz / escala
            else:
                # Cantos en X
                u = ly / escala
                v_coord = lz / escala

        # -----------------------------------------------------------------
        # CASO 2: Fondo Vertical Trasero (Espesor en Y, caras en XZ)
        # -----------------------------------------------------------------
        elif eje_espesor == "Y":
            if ny >= nx and ny >= nz:
                # Caras principales A / B
                if sx >= sz:
                    u = lz / escala if es_atravesada else lx / escala
                    v_coord = lx / escala if es_atravesada else lz / escala
                else:
                    u = lx / escala if es_atravesada else lz / escala
                    v_coord = lz / escala if es_atravesada else lx / escala
            elif nz >= nx:
                # Cantos en Z
                u = lx / escala
                v_coord = ly / escala
            else:
                # Cantos en X
                u = lz / escala
                v_coord = ly / escala

        # -----------------------------------------------------------------
        # CASO 3: Fondo Vertical Lateral (Espesor en X, caras en YZ)
        # -----------------------------------------------------------------
        else:
            if nx >= ny and nx >= nz:
                # Caras principales A / B
                if sy >= sz:
                    u = lz / escala if es_atravesada else ly / escala
                    v_coord = ly / escala if es_atravesada else lz / escala
                else:
                    u = ly / escala if es_atravesada else lz / escala
                    v_coord = lz / escala if es_atravesada else ly / escala
            elif nz >= ny:
                # Cantos en Z
                u = ly / escala
                v_coord = lx / escala
            else:
                # Cantos en Y
                u = lz / escala
                v_coord = lx / escala

        m.TextureCoordinates.Add(float(u), float(v_coord))

    return m

# 1. Leer Modo de Veta desde cualquiera de los nombres de entrada (B o S)
modo_s = B if 'B' in locals() else (S if 'S' in locals() else 0)

# 2. Procesar malla o lista de mallas
if isinstance(M, list):
    resultado = [aplicar_box_mapping_fondo(item, modo_s, 600.0) for item in M if item is not None]
else:
    resultado = aplicar_box_mapping_fondo(M, modo_s, 600.0)

# 3. Asignación a TODAS las posibles salidas del componente:
# 'a' es el pin oficial que conecta al Linear Array
a = resultado
M = resultado
out = resultado
# ---------- end python_3_script_26 ----------
python_3_script_27 = Python3Script(M=mesh_join_9, B=rh_in_21_0_mapeado)  # -> a; inputs M: Mesh, B: Int32; same code as python_3_script_26
python_3_script_28 = Python3Script(M=mesh_join_6, B=rh_in_21_0_mapeado)  # -> a; inputs M: Mesh, B: Int32; same code as python_3_script_26
python_3_script_29 = Python3Script(M=mesh_join_7, B=rh_in_21_0_mapeado)  # -> a; inputs M: Mesh, B: Int32; same code as python_3_script_26
python_3_script_30 = Python3Script(
    M_In=[python_3_script_26, python_3_script_27, python_3_script_28, python_3_script_29],
    Lado_Color=rh_in_21_1_lado_color,
    Material_Mode=rh_in_21_2_sustrato)  # -> out, Color, MDF; inputs M_In: list of Mesh, Lado_Color: String, Material_Mode: String
# ---------- python_3_script_30: Python ----------
# -*- coding: utf-8 -*-
"""
=============================================================================
3BF Mesh Channel Separator v2.6 Fondos (Universal UV & DfMA Aware)
Powered by 3dBimFab
=============================================================================
Entradas:
  - M_In: Mallas del fondo (Tree, List o Item). Type Hint: Mesh
  - Lado_Color: "Cara A" o "Cara B" (Value List o String).
  - Material_Mode: "MDF 1 Cara", "DD", "Crudo" (Value List o String).
Salidas:
  - out: Consola de diagnóstico.
  - Color: Caras con acabado decorativo (Tono Fondo).
  - MDF: Cantos perimetrales y reverso en MDF crudo.
=============================================================================
"""
import Rhino
import rhinoscriptsyntax as rs

def extraer_malla_universal(c):
    if c is None: return None
    if isinstance(c, Rhino.Geometry.Mesh): return c
    if hasattr(c, "Faces") and hasattr(c, "Vertices"): return c
    val = getattr(c, "Value", c)
    if isinstance(val, Rhino.Geometry.Mesh): return val
    if hasattr(val, "Faces") and hasattr(val, "Vertices"): return val
    try:
        m = rs.coercemesh(c)
        if m: return m
    except:
        pass
    return None

def aplanar_candidatos(obj):
    res = []
    if obj is None: return res
    if hasattr(obj, "AllData"):
        for item in obj.AllData():
            m = extraer_malla_universal(item)
            if m: res.append(m)
        return res
    if hasattr(obj, "Branches"):
        for branch in obj.Branches:
            for item in branch:
                m = extraer_malla_universal(item)
                if m: res.append(m)
        return res
    if isinstance(obj, (list, tuple)):
        for item in obj:
            res.extend(aplanar_candidatos(item))
        return res
    m = extraer_malla_universal(obj)
    if m: res.append(m)
    return res

def parse_lado(val):
    s = str(val).lower().strip()
    if "b" in s: return "B"
    return "A"

def parse_material(val):
    s = str(val).lower().strip()
    if "dd" in s or "doble" in s or "2 cara" in s: return "DD"
    if "crudo" in s: return "CRUDO"
    return "MDF_1_CARA"

def crear_submalla_uv(mesh_origen, face_indices):
    """Extrae las caras indicadas preservando exactamente sus coordenadas de textura UV."""
    if not face_indices:
        return None
    sub = Rhino.Geometry.Mesh()
    vert_map = {}
    for fi in face_indices:
        f = mesh_origen.Faces[fi]
        idx_face = [f.A, f.B, f.C]
        if f.IsQuad:
            idx_face.append(f.D)

        nuevos_idx = []
        for vi in idx_face:
            if vi not in vert_map:
                new_vi = sub.Vertices.Add(mesh_origen.Vertices[vi])
                if mesh_origen.TextureCoordinates.Count > vi:
                    sub.TextureCoordinates.Add(mesh_origen.TextureCoordinates[vi])
                if mesh_origen.Normals.Count > vi:
                    sub.Normals.Add(mesh_origen.Normals[vi])
                vert_map[vi] = new_vi
            nuevos_idx.append(vert_map[vi])

        if len(nuevos_idx) == 3:
            sub.Faces.AddFace(nuevos_idx[0], nuevos_idx[1], nuevos_idx[2])
        elif len(nuevos_idx) == 4:
            sub.Faces.AddFace(nuevos_idx[0], nuevos_idx[1], nuevos_idx[2], nuevos_idx[3])

    sub.Normals.ComputeNormals()
    sub.Compact()
    return sub

# 1. Normalizar Entradas
lado_sel = parse_lado(Lado_Color if 'Lado_Color' in globals() and Lado_Color else "Cara A")
modo_mat = parse_material(Material_Mode if 'Material_Mode' in globals() and Material_Mode else "MDF 1 Cara")

# 2. Desempaquetar Mallas del Fondo
mallas_fondo = aplanar_candidatos(M_In if 'M_In' in globals() else None)

out_color = []
out_mdf = []

for mesh in mallas_fondo:
    if not mesh or mesh.Faces.Count == 0:
        continue

    bb = mesh.GetBoundingBox(True)
    x0, x1 = bb.Min.X, bb.Max.X
    y0, y1 = bb.Min.Y, bb.Max.Y
    z0, z1 = bb.Min.Z, bb.Max.Z

    sx = max(0.1, x1 - x0)
    sy = max(0.1, y1 - y0)
    sz = max(0.1, z1 - z0)

    # Identificar el eje del espesor (en fondos verticales es Y)
    dims = [("X", sx), ("Y", sy), ("Z", sz)]
    dims.sort(key=lambda d: d[1])
    eje_esp = dims[0][0]
    espesor = dims[0][1]
    tol = max(0.3, espesor * 0.40)

    faces_A_idx = []
    faces_B_idx = []
    cantos_idx = []

    # Clasificar cada cara geométrica del sólido
    for fi in range(mesh.Faces.Count):
        f = mesh.Faces[fi]
        pts = [mesh.Vertices[f.A], mesh.Vertices[f.B], mesh.Vertices[f.C]]
        if f.IsQuad:
            pts.append(mesh.Vertices[f.D])

        cx = sum(p.X for p in pts) / float(len(pts))
        cy = sum(p.Y for p in pts) / float(len(pts))
        cz = sum(p.Z for p in pts) / float(len(pts))

        if eje_esp == "Y":
            # Fondos verticales traseros:
            # y1 = Cara que mira hacia el frente / interior del mueble (Cara A - VISTA)
            # y0 = Cara que mira hacia la pared / exterior trasero (Cara B - TRASERA MDF)
            if abs(cy - y1) < tol:
                faces_A_idx.append(fi)
            elif abs(cy - y0) < tol:
                faces_B_idx.append(fi)
            else:
                cantos_idx.append(fi)

        elif eje_esp == "Z":
            # Fondos horizontales de cajón:
            # z1 = Cara superior interior del cajón (Cara A - VISTA)
            # z0 = Cara inferior exterior del cajón (Cara B - MDF)
            if abs(cz - z1) < tol:
                faces_A_idx.append(fi)
            elif abs(cz - z0) < tol:
                faces_B_idx.append(fi)
            else:
                cantos_idx.append(fi)

        else: # X (Divisiones verticales o fondos laterales)
            if abs(cx - x1) < tol:
                faces_A_idx.append(fi)
            elif abs(cx - x0) < tol:
                faces_B_idx.append(fi)
            else:
                cantos_idx.append(fi)

    # 3. Lógica DfMA según Material_Mode y Lado_Color
    color_indices = []
    mdf_indices = []

    if modo_mat == "DD":
        color_indices.extend(faces_A_idx)
        color_indices.extend(faces_B_idx)
        mdf_indices.extend(cantos_idx)
    elif modo_mat == "CRUDO":
        mdf_indices.extend(faces_A_idx)
        mdf_indices.extend(faces_B_idx)
        mdf_indices.extend(cantos_idx)
    else: # MDF_1_CARA (Estándar de Fábrica)
        if lado_sel == "A":
            color_indices.extend(faces_A_idx) # Cara frontal vista en Color
            mdf_indices.extend(faces_B_idx)    # Cara trasera en MDF crudo
        else:
            color_indices.extend(faces_B_idx)
            mdf_indices.extend(faces_A_idx)
        mdf_indices.extend(cantos_idx)

    # 4. Generar las submallas UV independientes
    sub_color = crear_submalla_uv(mesh, color_indices)
    if sub_color: out_color.append(sub_color)

    sub_mdf = crear_submalla_uv(mesh, mdf_indices)
    if sub_mdf: out_mdf.append(sub_mdf)

# Asignar Salidas
Color = out_color
MDF = out_mdf

print("Fondos: {} | Material: {} | Color: Cara {} -> Color={}, MDF={}".format(
    len(mallas_fondo), modo_mat, lado_sel, len(Color), len(MDF)
))
# ---------- end python_3_script_30 ----------
diagnostico_21 = Panel(python_3_script_30.out)
rh_out_mdf_peça_15 = Geometry(python_3_script_30.MDF)
# 15 FONDOS
rh_out_peça_15 = Geometry(python_3_script_30.Color)

# ----
list_item_34 = ListItem(List=deconstruct_brep_3.Vertices, Index="1", Wrap=True)
move_49 = Move(Geometry=list_item_34, Motion=unit_y_25)  # -> Geometry, Transform
move_50 = Move(Geometry=move_49.Geometry, Motion=unit_y_26)  # -> Geometry, Transform
move_51 = Move(Geometry=move_50.Geometry, Motion=unit_z_23)  # -> Geometry, Transform
list_item_35 = ListItem(List=deconstruct_brep_3.Vertices, Index="2", Wrap=True)

# ---- group: Peca 1
box_2pt_8 = Box2Pt(PointA=move_51.Geometry, PointB=move_18.Geometry, Plane=PlaneXY(0, 0, 0))

# ----
move_52 = Move(Geometry=list_item_35, Motion=unit_y)  # -> Geometry, Transform

deconstruct_brep_10 = DeconstructBrep(Brep=box_2pt_8)  # -> Faces, Edges, Vertices
list_item_36 = ListItem(List=deconstruct_brep_10.Vertices, Index="3", Wrap=True)
vector_2pt = Vector2Pt(PointA=list_item_36, PointB=move_52.Geometry, Unitize=False)  # -> Vector, Length
move_53 = Move(Geometry=box_2pt_8, Motion=vector_2pt.Vector)  # -> Geometry, Transform
list_item_37 = ListItem(List=deconstruct_brep_10.Edges, Index="6", Wrap=True)
deconstruct_brep_11 = DeconstructBrep(Brep=move_53.Geometry)  # -> Faces, Edges, Vertices
list_item_38 = ListItem(List=deconstruct_brep_11.Edges, Index="4", Wrap=True)
divide_curve = DivideCurve(Curve=list_item_37, Count="4", Kinks=False)  # -> Points, Tangents, Parameters
divide_curve_2 = DivideCurve(Curve=list_item_37, Count="2", Kinks=False)  # -> Points, Tangents, Parameters
list_item_39 = ListItem(List=divide_curve_2.Points, Index="1", Wrap=True)
list_item_40 = ListItem(List=divide_curve.Points, Index=["6", "8"], Wrap=True)
stream_filter_6 = StreamFilter(Gate=expression_2, Stream1=list_item_39, Stream2=list_item_40)

list_item_41 = ListItem(List=deconstruct_brep_10.Vertices, Index="7", Wrap=True)
list_item_42 = ListItem(List=deconstruct_brep_10.Vertices, Index="4", Wrap=True)
line_3 = Line(StartPoint=list_item_42, EndPoint=list_item_41)
curve_middle_12 = CurveMiddle(Curve=line_3)
move_54 = Move(Geometry=curve_middle_12, Motion=unit_z)  # -> Geometry, Transform
move_55 = Move(Geometry=move_54.Geometry, Motion=unit_z_2)  # -> Geometry, Transform

deconstruct_brep_12 = DeconstructBrep(Brep=box_2pt_8)  # -> Faces, Edges, Vertices
list_item_43 = ListItem(List=deconstruct_brep_12.Edges, Index="2", Wrap=True)
curve_middle_13 = CurveMiddle(Curve=list_item_43)
move_56 = Move(Geometry=curve_middle_13, Motion=unit_x_15)  # -> Geometry, Transform

deconstruct_brep_13 = DeconstructBrep(Brep=move_53.Geometry)  # -> Faces, Edges, Vertices
list_item_44 = ListItem(List=deconstruct_brep_13.Edges, Index="2", Wrap=True)
curve_middle_14 = CurveMiddle(Curve=list_item_44)
move_57 = Move(Geometry=curve_middle_14, Motion=unit_x_16)  # -> Geometry, Transform
move_58 = Move(Geometry=move_57.Geometry, Motion=unit_z_34)  # -> Geometry, Transform
move_59 = Move(Geometry=move_58.Geometry, Motion=unit_y_34)  # -> Geometry, Transform

list_item_45 = ListItem(List=deconstruct_brep_3.Edges, Index=panel_11, Wrap=True)
move_60 = Move(Geometry=list_item_34, Motion=unit_z_35)  # -> Geometry, Transform
curve_middle_15 = CurveMiddle(Curve=list_item_45)
xz_plane = XZPlane(Origin=curve_middle_15)
move_61 = Move(Geometry=move_60.Geometry, Motion=unit_z_36)  # -> Geometry, Transform
move_62 = Move(Geometry=move_61.Geometry, Motion=unit_y_35)  # -> Geometry, Transform

point_34 = Point(stream_filter_6)
python_3_script_31 = Python3Script(
    Point=point_34,
    Orientacion=orientacion_mecanizado_3,
    Giro=giro_mecanizado_3,
    Dual_Point=point_12,
    Herraje_Malla_1=cantoneira_2,
    Herraje_Malla_2=parafuso_d_2,
    Plane_Mirror_X=xz_plane)  # -> out, Mecanizado_Out, Herraje_Out_1, Herraje_Out_2; inputs Point: Point3d, Orientacion: String, Mecanizado_Nurbs: list of Brep, Dual_Point: Point3d, Herraje_Malla_1: list of Mesh, Herraje_Malla_2: list of Mesh, Plane_Mirror_X: Plane, Plane_Mirror_Y: Plane; same code as python_3_script_10
parafuso_d_8 = Mesh(python_3_script_31.Herraje_Out_2)
cantoneira_8 = Mesh(python_3_script_31.Herraje_Out_1)
diagnostico_22 = Panel(python_3_script_31.out)

# ---- group: Peca 4
box_2pt_9 = Box2Pt(PointA=move_62.Geometry, PointB=move_19.Geometry, Plane=PlaneXY(0, 0, 0))

# ----
deconstruct_brep_14 = DeconstructBrep(Brep=box_2pt_9)  # -> Faces, Edges, Vertices
list_item_46 = ListItem(List=deconstruct_brep_14.Vertices, Index="4", Wrap=True)
move_63 = Move(Geometry=list_item_46, Motion=unit_z_38)  # -> Geometry, Transform
move_64 = Move(Geometry=move_63.Geometry, Motion=unit_y_38)  # -> Geometry, Transform
line_4 = Line(StartPoint=move_22.Geometry, EndPoint=move_64.Geometry)
length_2 = Length(Curve=line_4)
division_2 = Division(A=length_2, B=cantidad_cajones)
panel_19 = Panel(division_2)
unit_z_51 = UnitZ(Factor=panel_19)
negative_4 = Negative(Value=unit_z_51)

deconstruct_brep_15 = DeconstructBrep(Brep=box_2pt_9)  # -> Faces, Edges, Vertices

# ---- group: Peca 5
mirror_5 = Mirror(Geometry=box_2pt_9, Plane=xz_plane)  # -> Geometry, Transform

# ----
list_item_47 = ListItem(List=deconstruct_brep_15.Edges, Index="8", Wrap=True)
curve_middle_16 = CurveMiddle(Curve=list_item_47)
move_65 = Move(Geometry=curve_middle_16, Motion=unit_y_10)  # -> Geometry, Transform
move_66 = Move(Geometry=move_65.Geometry, Motion=unit_y_11)  # -> Geometry, Transform

# ----
# Porca Parafuso A x0,X1
# 3BF Mecanizador V0.7
orientacion_mecanizado_15 = ValueList({"x0,x1": 1, "x1,x0": 2, "y0,y1": 3, "y1,y0": 4, "z0,z1": 5, "z1,z0": 6}, selected="x0,x1")
giro_mecanizado_15 = ValueList({"Frente": 0, "Arriba": 90, "Pesterior": 180, "Abajo": 270}, selected="Frente")
porca_2 = Mesh(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)
mecanizados_19 = Brep([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])
parafuso_a = Mesh(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)
point_35 = Point(move_54.Geometry)
point_36 = Point(Point(-544.9468731, 5.728351127e-11, 0))
python_3_script_32 = Python3Script(
    Point=point_35,
    Orientacion=orientacion_mecanizado_15,
    Giro=giro_mecanizado_15,
    Mecanizado_Nurbs=mecanizados_19,
    Dual_Point=point_36,
    Herraje_Malla_1=parafuso_a,
    Herraje_Malla_2=porca,
    Plane_Mirror_X=yz_plane,
    Plane_Mirror_Y=xz_plane)  # -> out, Mecanizado_Out, Herraje_Out_1, Herraje_Out_2; inputs Point: list of Point3d, Orientacion: String, Mecanizado_Nurbs: list of Brep, Dual_Point: Point3d, Herraje_Malla_1: list of Mesh, Herraje_Malla_2: list of Mesh, Plane_Mirror_X: Plane, Plane_Mirror_Y: Plane; same code as python_3_script_10
mecanizados_20 = Brep(python_3_script_32.Mecanizado_Out)
parafuso_a_2 = Mesh(python_3_script_32.Herraje_Out_1)
porca_3 = Mesh(python_3_script_32.Herraje_Out_2)
diagnostico_23 = Panel(python_3_script_32.out)

# ----
# Porca Parafuso A x0,X1
# 3BF Mecanizador V0.7
orientacion_mecanizado_16 = ValueList({"x0,x1": 1, "x1,x0": 2, "y0,y1": 3, "y1,y0": 4, "z0,z1": 5, "z1,z0": 6}, selected="x0,x1")
giro_mecanizado_16 = ValueList({"Frente": 0, "Arriba": 90, "Pesterior": 180, "Abajo": 270}, selected="Abajo")
mecanizados_21 = Brep([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])
parafuso_a_3 = Mesh(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)
porca_4 = Mesh(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)
point_37 = Point(move_65.Geometry)
point_38 = Point(Point(-544.9468731, 5.728351127e-11, 0))
python_3_script_33 = Python3Script(
    Point=point_37,
    Orientacion=orientacion_mecanizado_16,
    Giro=giro_mecanizado_16,
    Mecanizado_Nurbs=mecanizados_21,
    Dual_Point=point_38,
    Herraje_Malla_1=parafuso_a_3,
    Herraje_Malla_2=porca_4,
    Plane_Mirror_X=yz_plane,
    Plane_Mirror_Y=xz_plane)  # -> out, Mecanizado_Out, Herraje_Out_1, Herraje_Out_2; inputs Point: Point3d, Orientacion: String, Mecanizado_Nurbs: list of Brep, Dual_Point: Point3d, Herraje_Malla_1: list of Mesh, Herraje_Malla_2: list of Mesh, Plane_Mirror_X: Plane, Plane_Mirror_Y: Plane; same code as python_3_script_10
mecanizados_22 = Brep(python_3_script_33.Mecanizado_Out)
parafuso_a_4 = Mesh(python_3_script_33.Herraje_Out_1)
porca_5 = Mesh(python_3_script_33.Herraje_Out_2)
diagnostico_24 = Panel(python_3_script_33.out)

# ----
# Tarugo x0,x1
# 3BF Mecanizador V0.5
orientacion_mecanizado_17 = ValueList({"x0,x1": 1, "x1,x0": 2, "y0,y1": 3, "y1,y0": 4, "z0,z1": 5, "z1,z0": 6}, selected="x0,x1")
giro_mecanizado_17 = ValueList({"Frente": 0, "Arriba": 90, "Pesterior": 180, "Abajo": 270}, selected="Frente")
mecanizados_23 = Brep(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)
cavilha_12 = Mesh(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)
point_39 = Point(Point(-590.8767532, 0, 0))
point_40 = Point([move_55.Geometry, move_66.Geometry])
python_3_script_34 = Python3Script(
    Point=point_40,
    Orientacion=orientacion_mecanizado_17,
    Giro=giro_mecanizado_17,
    Mecanizado_Nurbs=mecanizados_23,
    Dual_Point=point_39,
    Herraje_Malla_1=cavilha_12,
    Plane_Mirror_X=yz_plane,
    Plane_Mirror_Y=xz_plane)  # -> out, Mecanizado_Out, Herraje_Out_1, Herraje_Out_2; inputs Point: Point3d, Orientacion: String, Mecanizado_Nurbs: list of Brep, Dual_Point: Point3d, Herraje_Malla_1: Mesh, Herraje_Malla_2: Mesh, Plane_Mirror_X: Plane, Plane_Mirror_Y: Plane; same code as python_3_script
mecanizados_24 = Brep(python_3_script_34.Mecanizado_Out)
cavilha_13 = Mesh(python_3_script_34.Herraje_Out_1)
diagnostico_25 = Panel(python_3_script_34.out)

# ---- group: Peça 4
solid_difference_4 = SolidDifference(BrepsA=box_2pt_9, BrepsB=flatten([mecanizados_24, mecanizados_22, mecanizados_16, mecanizados_18]))

# ----
rh_out_parafuso_a = Geometry([parafuso_a_2, parafuso_a_4])
rh_out_porca = Geometry([porca_3, porca_5])

# ---- group: Peça 5
solid_difference_5 = SolidDifference(BrepsA=mirror_5.Geometry, BrepsB=flatten([mecanizados_24, mecanizados_22, mecanizados_16, mecanizados_18]))

# ---- group: Peça 4 Aparência
# 3BF Materializer v0.3
# 3BF Box Mapping v1.0
# 3BF Mesh Channel Separator v2.3
rh_in_08_0_mapeado = ValueList({"Longitudinal": 0, "Atravesada": 1}, selected="Longitudinal")
python_3_script_35 = Python3Script(Brep_In=solid_difference_5)  # -> out, Pieza_1, Pieza_2, Pieza_3, Pieza_4; inputs Brep_In: list of Brep; same code as python_3_script_12
mesh_brep_10 = MeshBrep(
    Brep=python_3_script_35.Pieza_1,
    Settings={GridMaxCount=0, GridMinCount=16, JaggedSeams=False, MaxEdgeLength=0, MinEdgeLength=0.0001, MinTolerance=0, Refine=True, RefineAngle=0, RelativeTolerance=0.65, SimplePlanes=True, Tolerance=0})
rh_in_08_1_lado_balance = ValueList({"Cara A", "Cara B", "D/D"}, selected="Cara B")
rh_in_08_2_canto_frontal = ValueList({"Canto": 0, "MDP": 1}, selected="Canto")
rh_in_08_3_canto_trasero = ValueList({"Canto": 0, "MDP": 1}, selected="MDP")
rh_in_08_4_canto_izquierdo_arriba = ValueList({"Canto": 0, "MDP": 1}, selected="MDP")
rh_in_08_5_canto_derecho_abajo = ValueList({"Canto": 0, "MDP": 1}, selected="MDP")
diagnostico_26 = Panel(python_3_script_35.out)
mesh_join_10 = MeshJoin(Meshes=flatten(mesh_brep_10))
python_3_script_36 = Python3Script(M=mesh_join_10, B=rh_in_08_0_mapeado)  # -> a; inputs M: Mesh, B: Int32; same code as python_3_script_13
python_3_script_37 = Python3Script(
    M_In=python_3_script_36,
    Balance_Mode=rh_in_08_1_lado_balance,
    Canto_1=rh_in_08_2_canto_frontal,
    Canto_2=rh_in_08_3_canto_trasero,
    Canto_3=rh_in_08_4_canto_izquierdo_arriba,
    Canto_4=rh_in_08_5_canto_derecho_abajo)  # -> out, Color, Balance, MDP; inputs M_In: list; same code as python_3_script_14
diagnostico_27 = Panel(python_3_script_37.out)
rh_out_mdp_peça_5 = Geometry(python_3_script_37.MDP)
rh_out_peça_5_b = Geometry(python_3_script_37.Balance)
# 5
rh_out_peça_5 = Geometry(python_3_script_37.Color)

# 3BF Materializer v0.3
# 3BF Box Mapping v1.0
# 3BF Mesh Channel Separator v2.3
rh_in_07_0_mapeado = ValueList({"Longitudinal": 0, "Atravesada": 1}, selected="Longitudinal")
python_3_script_38 = Python3Script(Brep_In=solid_difference_4)  # -> out, Pieza_1, Pieza_2, Pieza_3, Pieza_4; inputs Brep_In: list of Brep; same code as python_3_script_12
mesh_brep_11 = MeshBrep(
    Brep=python_3_script_38.Pieza_1,
    Settings={GridMaxCount=0, GridMinCount=16, JaggedSeams=False, MaxEdgeLength=0, MinEdgeLength=0.0001, MinTolerance=0, Refine=True, RefineAngle=0, RelativeTolerance=0.65, SimplePlanes=True, Tolerance=0})
rh_in_07_1_lado_balance = ValueList({"Cara A", "Cara B", "D/D"}, selected="Cara B")
rh_in_07_2_canto_frontal = ValueList({"Canto": 0, "MDP": 1}, selected="Canto")
rh_in_07_3_canto_trasero = ValueList({"Canto": 0, "MDP": 1}, selected="MDP")
rh_in_07_4_canto_izquierdo_arriba = ValueList({"Canto": 0, "MDP": 1}, selected="MDP")
rh_in_07_5_canto_derecho_abajo = ValueList({"Canto": 0, "MDP": 1}, selected="MDP")
diagnostico_28 = Panel(python_3_script_38.out)
mesh_join_11 = MeshJoin(Meshes=flatten(mesh_brep_11))
python_3_script_39 = Python3Script(M=mesh_join_11, B=rh_in_07_0_mapeado)  # -> a; inputs M: Mesh, B: Int32; same code as python_3_script_13
python_3_script_40 = Python3Script(
    M_In=python_3_script_39,
    Balance_Mode=rh_in_07_1_lado_balance,
    Canto_1=rh_in_07_2_canto_frontal,
    Canto_2=rh_in_07_3_canto_trasero,
    Canto_3=rh_in_07_4_canto_izquierdo_arriba,
    Canto_4=rh_in_07_5_canto_derecho_abajo)  # -> out, Color, Balance, MDP; inputs M_In: list; same code as python_3_script_14
diagnostico_29 = Panel(python_3_script_40.out)
rh_out_mdp_peça_4 = Geometry(python_3_script_40.MDP)
rh_out_peça_4_b = Geometry(python_3_script_40.Balance)
# 4
rh_out_peça_4 = Geometry(python_3_script_40.Color)

# ---- group: Peça 16 Aparência
# 3BF Materializer v0.2.1
# 3BF Box Mapping v0.4
rh_in_19_1_lado_balance = ValueList({"Cara A", "Cara B", "D/D"}, selected="Cara A")
rh_in_19_2_canto_frontal = ValueList({"Canto": 0, "MDP": 1}, selected="MDP")
rh_in_19_3_canto_trasero = ValueList({"Canto": 0, "MDP": 1}, selected="MDP")
rh_in_19_4_canto_izquierdo_arriba = ValueList({"Canto": 0, "MDP": 1}, selected="Canto")
rh_in_19_5_canto_derecho_abajo = ValueList({"Canto": 0, "MDP": 1}, selected="MDP")
rh_in_19_0_mapeado = ValueList({"Longitudinal": 0, "Atravesada": 1}, selected="Longitudinal")
python_3_script_41 = Python3Script(
    Balance_Mode=rh_in_19_1_lado_balance,
    Canto_1=rh_in_19_2_canto_frontal,
    Canto_2=rh_in_19_3_canto_trasero,
    Canto_3=rh_in_19_4_canto_izquierdo_arriba,
    Canto_4=rh_in_19_5_canto_derecho_abajo)  # -> Out, NURBS_Color, NURBS_Balance, NURBS_MDP, Info_Pieza; inputs Brep_In: Brep, Balance_Mode: String, Canto_1: String, Canto_2: String, Canto_3: String, Canto_4: String
# ---------- python_3_script_41: Python ----------
"""
3BF Materializer v0.2.1 (Estandarizado Universal)
Canto_1: Extremo 1 (Frontal / Izquierdo)
Canto_2: Extremo 2 (Trasero / Derecho)
Canto_3: SIEMPRE ARRIBA / SUPERIOR (+Z) con soporte para chaflán a 45°
Canto_4: SIEMPRE ABAJO / INFERIOR (-Z)
"""

import Rhino

def parse_balance(val):
    s = str(val).lower().strip().replace('"', '').replace("'", "")
    if s in ["6", "d/d", "dyd", "doble", "ninguno", "ambas"] or "d/d" in s or "dyd" in s:
        return "DD"
    if s in ["5", "cara a", "a"] or (s.startswith("a") and len(s) <= 6):
        return "A"
    if s in ["4", "cara b", "b"] or (s.startswith("b") and len(s) <= 6):
        return "B"
    if "ambos" in s:
        return "AMBOS"
    return "B"

def parse_canto(val):
    s = str(val).lower().strip().replace('"', '').replace("'", "")
    if s in ["0", "0.0", "canto", "true", "si", "sí", "con canto"] or ("canto" in s and "sin" not in s):
        return True # Madera / Color
    if s in ["1", "1.0", "mdp", "false", "no", "sin canto"] or "mdp" in s or "sin" in s:
        return False # Crudo / MDP
    return True

def desglosar_pieza_real_nurbs(brep_in, balance_mode="Cara B", c1="Canto", c2="Canto", c3="Canto", c4="Canto"):
    if brep_in is None:
        return [], [], [], "Brep de entrada es nulo"

    bbox = brep_in.GetBoundingBox(True)
    x0, x1 = bbox.Min.X, bbox.Max.X
    y0, y1 = bbox.Min.Y, bbox.Max.Y
    z0, z1 = bbox.Min.Z, bbox.Max.Z

    sx = max(0.1, x1 - x0)
    sy = max(0.1, y1 - y0)
    sz = max(0.1, z1 - z0)
    min_dim = min(sx, sy, sz)

    tol = max(0.2, min_dim * 0.15)
    zona_bisel = max(tol * 2.5, min_dim * 2.5)

    faces_A = []
    faces_B = []
    faces_cantos = {1: [], 2: [], 3: [], 4: []}
    faces_mecanizados = []

    for i in range(brep_in.Faces.Count):
        f = brep_in.Faces[i]
        u = (f.Domain(0).T0 + f.Domain(0).T1) * 0.5
        v = (f.Domain(1).T0 + f.Domain(1).T1) * 0.5
        pt = f.PointAt(u, v)
        n = f.NormalAt(u, v)
        n.Unitize()
        nurbs_face = f.DuplicateFace(False)

        # -------------------------------------------------------------
        # CASO 1: Tablero Horizontal (Cubiertas / Entrepaños - Espesor en Z)
        # -------------------------------------------------------------
        if min_dim == sz:
            tipo_str = "Horizontal (Cubierta/Entrepaño)"
            if n.Z > 0.85 and abs(pt.Z - z1) < tol:
                faces_A.append(nurbs_face)
            elif n.Z < -0.85 and abs(pt.Z - z0) < tol:
                faces_B.append(nurbs_face)
            elif n.Y < -0.20 and (pt.Y - y0) < zona_bisel:
                faces_cantos[1].append(nurbs_face) # Frontal
            elif n.Y > 0.20 and (y1 - pt.Y) < zona_bisel:
                faces_cantos[2].append(nurbs_face) # Trasero
            elif n.X < -0.20 and (pt.X - x0) < zona_bisel:
                faces_cantos[3].append(nurbs_face) # Izquierdo
            elif n.X > 0.20 and (x1 - pt.X) < zona_bisel:
                faces_cantos[4].append(nurbs_face) # Derecho
            else:
                faces_mecanizados.append(nurbs_face)

        # -------------------------------------------------------------
        # CASO 2: Tablero Vertical Lateral (Costados / Parales - Espesor en X)
        # -------------------------------------------------------------
        elif min_dim == sx:
            tipo_str = "Vertical Lateral (Costado/Paral)"
            if n.X > 0.85 and abs(pt.X - x1) < tol:
                faces_A.append(nurbs_face)
            elif n.X < -0.85 and abs(pt.X - x0) < tol:
                faces_B.append(nurbs_face)
            elif n.Y < -0.20 and (pt.Y - y0) < zona_bisel:
                faces_cantos[1].append(nurbs_face) # Frontal
            elif n.Y > 0.20 and (y1 - pt.Y) < zona_bisel:
                faces_cantos[2].append(nurbs_face) # Trasero
            elif n.Z > 0.20 and (z1 - pt.Z) < zona_bisel:
                faces_cantos[3].append(nurbs_face) # Superior (ARRIBA)
            elif n.Z < -0.20 and (pt.Z - z0) < zona_bisel:
                faces_cantos[4].append(nurbs_face) # Inferior (ABAJO)
            else:
                faces_mecanizados.append(nurbs_face)

        # -------------------------------------------------------------
        # CASO 3: Tablero Vertical Frontal (Frentes / Traviesas - Espesor en Y)
        # -------------------------------------------------------------
        else:
            tipo_str = "Vertical Frontal (Frente/Traviesa)"
            if n.Y < -0.85 and abs(pt.Y - y0) < tol:
                faces_A.append(nurbs_face)
            elif n.Y > 0.85 and abs(pt.Y - y1) < tol:
                faces_B.append(nurbs_face)
            # Canto 1: Lateral Izquierdo (-X)
            elif n.X < -0.20 and (pt.X - x0) < zona_bisel:
                faces_cantos[1].append(nurbs_face)
            # Canto 2: Lateral Derecho (+X)
            elif n.X > 0.20 and (x1 - pt.X) < zona_bisel:
                faces_cantos[2].append(nurbs_face)
            # Canto 3: SIEMPRE SUPERIOR / ARRIBA (+Z, plano o chaflán a 45°)
            elif n.Z > 0.20 and (z1 - pt.Z) < zona_bisel:
                faces_cantos[3].append(nurbs_face)
            # Canto 4: SIEMPRE INFERIOR / ABAJO (-Z)
            elif n.Z < -0.20 and (pt.Z - z0) < zona_bisel:
                faces_cantos[4].append(nurbs_face)
            else:
                faces_mecanizados.append(nurbs_face)

    modo_b = parse_balance(balance_mode)
    nurbs_color = []
    nurbs_balance = []
    nurbs_mdp = []

    if modo_b == "DD":
        nurbs_color.extend(faces_A)
        nurbs_color.extend(faces_B)
        diag_bal = "D/D (Ambas Caras Madera)"
    elif modo_b == "A":
        nurbs_balance.extend(faces_A)
        nurbs_color.extend(faces_B)
        diag_bal = "Balance Cara A"
    elif modo_b == "B":
        nurbs_color.extend(faces_A)
        nurbs_balance.extend(faces_B)
        diag_bal = "Balance Cara B"
    else:
        nurbs_balance.extend(faces_A)
        nurbs_balance.extend(faces_B)
        diag_bal = "Ambos Balance"

    cantos_in = {
        1: parse_canto(c1),
        2: parse_canto(c2),
        3: parse_canto(c3),
        4: parse_canto(c4)
    }

    c_color_count = 0
    for num_canto, tiene_canto in cantos_in.items():
        if tiene_canto:
            nurbs_color.extend(faces_cantos[num_canto])
            c_color_count += len(faces_cantos[num_canto])
        else:
            nurbs_mdp.extend(faces_cantos[num_canto])

    nurbs_mdp.extend(faces_mecanizados)

    diag = "{0} | {1} | Total Caras: {2} (A={3}, B={4}, Cantos={5}, Mecanizados={6}) | Breps Salida -> Color: {7}, Balance: {8}, MDP: {9}".format(
        tipo_str, diag_bal, brep_in.Faces.Count,
        len(faces_A), len(faces_B), sum(len(v) for v in faces_cantos.values()), len(faces_mecanizados),
        len(nurbs_color), len(nurbs_balance), len(nurbs_mdp)
    )

    return nurbs_color, nurbs_balance, nurbs_mdp, diag


n_col, n_bal, n_mdp, diag_txt = desglosar_pieza_real_nurbs(
    Brep_In,
    Balance_Mode if 'Balance_Mode' in locals() else "Cara B",
    Canto_1 if 'Canto_1' in locals() else "Canto",
    Canto_2 if 'Canto_2' in locals() else "Canto",
    Canto_3 if 'Canto_3' in locals() else "Canto",
    Canto_4 if 'Canto_4' in locals() else "Canto"
)

NURBS_Color = n_col
Nurbs_Color = n_col
nurbs_color = n_col
Mesh_Color = n_col

NURBS_Balance = n_bal
Nurbs_Balance = n_bal
nurbs_balance = n_bal
Mesh_Balance = n_bal

NURBS_MDP = n_mdp
Nurbs_MDP = n_mdp
nurbs_mdp = n_mdp
Mesh_MDP = n_mdp

Info_Pieza = diag_txt
# ---------- end python_3_script_41 ----------
mesh_brep_12 = MeshBrep(
    Brep=python_3_script_41.NURBS_Color,
    Settings={GridMaxCount=0, GridMinCount=16, JaggedSeams=False, MaxEdgeLength=0, MinEdgeLength=0.0001, MinTolerance=0, Refine=True, RefineAngle=0, RelativeTolerance=0.65, SimplePlanes=True, Tolerance=0})
mesh_brep_13 = MeshBrep(
    Brep=python_3_script_41.NURBS_Balance,
    Settings={GridMaxCount=0, GridMinCount=16, JaggedSeams=False, MaxEdgeLength=0, MinEdgeLength=0.0001, MinTolerance=0, Refine=True, RefineAngle=0, RelativeTolerance=0.65, SimplePlanes=True, Tolerance=0})
mesh_brep_14 = MeshBrep(
    Brep=python_3_script_41.NURBS_MDP,
    Settings={GridMaxCount=0, GridMinCount=16, JaggedSeams=False, MaxEdgeLength=0, MinEdgeLength=0.0001, MinTolerance=0, Refine=True, RefineAngle=0, RelativeTolerance=0.65, SimplePlanes=True, Tolerance=0})
diagnostico_30 = Panel(python_3_script_41.Info_Pieza)
mesh_join_12 = MeshJoin(Meshes=flatten(mesh_brep_12))
mesh_join_13 = MeshJoin(Meshes=flatten(mesh_brep_13))
mesh_join_14 = MeshJoin(Meshes=flatten(mesh_brep_14))
python_3_script_42 = Python3Script(M=mesh_join_12, B=rh_in_19_0_mapeado)  # -> a; inputs M: Mesh, B: Int32
# ---------- python_3_script_42: Python ----------
"""
3BF Box Mapping Profesional v0.4
Desglose y Mapeado DfMA Multi-Pieza:
1. Detecta y separa automáticamente piezas desconectadas fusionadas por Mesh Join.
2. Calcula el Bounding Box individual real de cada pieza (426.5 mm en lugar de 857 mm).
3. Asegura veta longitudinal en cantos superiores de laterales de cajón (hacia el fondo).
4. Emite cada pieza física por separado para que el despiece reporte la cantidad y largo exactos.
"""

import Rhino

def mapear_pieza_individual(mesh, modo_veta=0, escala_caja_mm=600.0):
    if mesh is None or not isinstance(mesh, Rhino.Geometry.Mesh):
        return mesh

    mesh.Unweld(0.0, True)
    mesh.Normals.ComputeNormals()
    mesh.TextureCoordinates.Clear()

    # Bounding Box individual y estricto de ESTA pieza sola (ej: 426.5 x 221 x 15 mm)
    bbox = mesh.GetBoundingBox(True)
    sx = max(1.0, bbox.Max.X - bbox.Min.X)
    sy = max(1.0, bbox.Max.Y - bbox.Min.Y)
    sz = max(1.0, bbox.Max.Z - bbox.Min.Z)

    es_atravesada = False
    if isinstance(modo_veta, str):
        es_atravesada = "atravesad" in modo_veta.lower() or modo_veta in ["1", "3", "5"]
    elif isinstance(modo_veta, (int, float)):
        es_atravesada = int(modo_veta) in [1, 3, 5]

    escala = float(escala_caja_mm)

    for idx in range(mesh.Vertices.Count):
        v = mesh.Vertices[idx]
        n = mesh.Normals[idx] if idx < mesh.Normals.Count else Rhino.Geometry.Vector3f(0, 0, 1)

        lx = v.X - bbox.Min.X
        ly = v.Y - bbox.Min.Y
        lz = v.Z - bbox.Min.Z

        nx, ny, nz = abs(n.X), abs(n.Y), abs(n.Z)

        # -------------------------------------------------------------
        # CASO A: Cara Superior / Inferior (Normal mirando en Z)
        # -------------------------------------------------------------
        if nz >= nx and nz >= ny:
            if sy >= sx:
                # Lateral de cajón hacia el fondo (ej: 350mm en Y vs 15mm en X)
                u = ly / escala
                v_coord = lx / escala
            else:
                # Tablero horizontal normal o canto superior de frente (largo en X)
                u = ly / escala if es_atravesada else lx / escala
                v_coord = lx / escala if es_atravesada else ly / escala

        # -------------------------------------------------------------
        # CASO B: Cara Frontal / Trasera (Normal mirando en Y)
        # -------------------------------------------------------------
        elif ny >= nx and ny >= nz:
            if sx >= sz:
                # Frente de cajón o traviesa horizontal (ancho en X)
                u = lz / escala if es_atravesada else lx / escala
                v_coord = lx / escala if es_atravesada else lz / escala
            else:
                # Pieza vertical alta
                u = lz / escala
                v_coord = lx / escala

        # -------------------------------------------------------------
        # CASO C: Cara Lateral Izquierda / Derecha (Normal mirando en X)
        # -------------------------------------------------------------
        else:
            if sy >= sz:
                # Cara plana del lateral de cajón (hacia el fondo en Y)
                u = lz / escala if es_atravesada else ly / escala
                v_coord = ly / escala if es_atravesada else lz / escala
            else:
                # Costado vertical de mueble
                u = ly / escala if es_atravesada else lz / escala
                v_coord = lz / escala if es_atravesada else ly / escala

        mesh.TextureCoordinates.Add(float(u), float(v_coord))

    return mesh


def desglosar_y_mapear(mesh_in, modo_veta=0, escala_caja_mm=600.0):
    if mesh_in is None:
        return []

    mesh = mesh_in.DuplicateMesh() if hasattr(mesh_in, "DuplicateMesh") else mesh_in
    if not isinstance(mesh, Rhino.Geometry.Mesh):
        return [mesh_in]

    # Separar piezas independientes desconectadas que vinieron agrupadas
    piezas = mesh.SplitDisjointPieces()
    if piezas is not None and len(piezas) > 1:
        resultado = []
        for p in piezas:
            mp = mapear_pieza_individual(p, modo_veta, escala_caja_mm)
            if mp is not None:
                resultado.append(mp)
        return resultado
    else:
        mp = mapear_pieza_individual(mesh, modo_veta, escala_caja_mm)
        return [mp] if mp is not None else []


# Ejecución universal compatible con Item Access o List Access
lista_salida = []

def procesar_recursivo(item):
    if item is None:
        return
    if isinstance(item, (list, tuple)):
        for sub in item:
            procesar_recursivo(sub)
    else:
        piezas = desglosar_y_mapear(item, B if 'B' in locals() else 0, 600.0)
        lista_salida.extend(piezas)

procesar_recursivo(M)
a = lista_salida
# ---------- end python_3_script_42 ----------
python_3_script_43 = Python3Script(M=mesh_join_13, B=rh_in_19_0_mapeado)  # -> a; inputs M: Mesh, B: Int32; same code as python_3_script_42
python_3_script_44 = Python3Script(M=mesh_join_14, B=rh_in_19_0_mapeado)  # -> a; inputs M: Mesh, B: Int32; same code as python_3_script_42
linear_array = LinearArray(Geometry=python_3_script_42, Direction=negative_4, Count=cantidad_cajones)  # -> Geometry, Transform
linear_array_2 = LinearArray(Geometry=python_3_script_44, Direction=negative_4, Count=cantidad_cajones)  # -> Geometry, Transform
# 16
linear_array_3 = LinearArray(Geometry=python_3_script_43, Direction=negative_4, Count=cantidad_cajones)  # -> Geometry, Transform

# ----
move_67 = Move(Geometry=list_item_46, Motion=unit_z_31)  # -> Geometry, Transform
move_68 = Move(Geometry=move_67.Geometry, Motion=unit_x_12)  # -> Geometry, Transform

yz_plane_2 = YZPlane(Origin=curve_middle_13)
box_2pt_10 = Box2Pt(PointA=move_56.Geometry, PointB=move_59.Geometry, Plane=PlaneXY(0, 0, 0))
move_69 = Move(Geometry=box_2pt_10, Motion=unit_x_17)  # -> Geometry, Transform

# ----
# Tapaluces
box_2pt_11 = Box2Pt(PointA=move_28.Geometry, PointB=move_29.Geometry, Plane=PlaneXY(0, 0, 0))
box_2pt_12 = Box2Pt(PointA=move_24.Geometry, PointB=move_29.Geometry, Plane=PlaneXY(0, 0, 0))
box_2pt_13 = Box2Pt(PointA=move_24.Geometry, PointB=move_25.Geometry, Plane=PlaneXY(0, 0, 0))
deconstruct_brep_16 = DeconstructBrep(Brep=box_2pt_11)  # -> Faces, Edges, Vertices
list_item_48 = ListItem(List=deconstruct_brep_16.Vertices, Index=0, Wrap=True)

deconstruct_brep_17 = DeconstructBrep(Brep=box_2pt_13)  # -> Faces, Edges, Vertices
list_item_49 = ListItem(List=deconstruct_brep_17.Vertices, Index="1", Wrap=True)
list_item_50 = ListItem(List=deconstruct_brep_17.Vertices, Index="0", Wrap=True)
move_70 = Move(Geometry=list_item_50, Motion=unit_y_31)  # -> Geometry, Transform
move_71 = Move(Geometry=list_item_49, Motion=unit_y_32)  # -> Geometry, Transform
move_72 = Move(Geometry=move_70.Geometry, Motion=unit_z_32)  # -> Geometry, Transform
move_73 = Move(Geometry=move_71.Geometry, Motion=unit_z_33)  # -> Geometry, Transform
move_74 = Move(Geometry=move_72.Geometry, Motion=unit_x_13)  # -> Geometry, Transform
line_5 = Line(StartPoint=move_68.Geometry, EndPoint=move_74.Geometry)
length_3 = Length(Curve=line_5)
panel_20 = Panel(length_3)
subtraction_4 = Subtraction(A=length_3, B=multiplication_2)
move_75 = Move(Geometry=move_73.Geometry, Motion=unit_x_14)  # -> Geometry, Transform
division_3 = Division(A=subtraction_4, B=cantidad_cajones)
panel_21 = Panel(division_3)
addition_4 = Addition(A=panel_21, B="1")
panel_22 = Panel(addition_4)
unit_z_52 = UnitZ(Factor=panel_22)
negative_5 = Negative(Value=unit_z_52)
move_76 = Move(Geometry=move_75.Geometry, Motion=negative_5)  # -> Geometry, Transform
move_77 = Move(Geometry=move_76.Geometry, Motion=unit_y_33)  # -> Geometry, Transform
box_2pt_14 = Box2Pt(PointA=move_74.Geometry, PointB=move_77.Geometry, Plane=PlaneXY(0, 0, 0))

deconstruct_brep_18 = DeconstructBrep(Brep=box_2pt_12)  # -> Faces, Edges, Vertices
list_item_51 = ListItem(List=deconstruct_brep_18.Vertices, Index=panel_9, Wrap=True)
list_item_52 = ListItem(List=deconstruct_brep_18.Vertices, Index="1", Wrap=True)
move_78 = Move(Geometry=list_item_51, Motion=unit_y_28)  # -> Geometry, Transform
move_79 = Move(Geometry=list_item_52, Motion=unit_y_29)  # -> Geometry, Transform
move_80 = Move(Geometry=move_78.Geometry, Motion=unit_z_29)  # -> Geometry, Transform
move_81 = Move(Geometry=move_79.Geometry, Motion=unit_z_30)  # -> Geometry, Transform
move_82 = Move(Geometry=move_80.Geometry, Motion=unit_x_10)  # -> Geometry, Transform
move_83 = Move(Geometry=move_81.Geometry, Motion=unit_x_11)  # -> Geometry, Transform
line_6 = Line(StartPoint=move_82.Geometry, EndPoint=move_68.Geometry)
length_4 = Length(Curve=line_6)
subtraction_5 = Subtraction(A=length_4, B=multiplication)
division_4 = Division(A=subtraction_5, B=cantidad_cajones)
panel_23 = Panel(division_4)
addition_5 = Addition(A=panel_23, B="1")
panel_24 = Panel(addition_5)
unit_z_53 = UnitZ(Factor=panel_24)
negative_6 = Negative(Value=unit_z_53)
move_84 = Move(Geometry=move_83.Geometry, Motion=negative_6)  # -> Geometry, Transform
move_85 = Move(Geometry=move_84.Geometry, Motion=unit_y_30)  # -> Geometry, Transform
box_2pt_15 = Box2Pt(PointA=move_82.Geometry, PointB=move_85.Geometry, Plane=PlaneXY(0, 0, 0))
stream_filter_7 = StreamFilter(Gate=expression_2, Stream1=box_2pt_15, Stream2=box_2pt_14)

vector_2pt_2 = Vector2Pt(PointA=list_item_50, PointB=list_item_48, Unitize=False)  # -> Vector, Length

# ---- group: Peca 8
stream_filter_8 = StreamFilter(Gate=expression_2, Stream1=box_2pt_12, Stream2=[box_2pt_11, box_2pt_13])

# ----
dispatch_2 = Dispatch(List=stream_filter_8, DispatchPattern=[True, False])  # -> ListA, ListB
dispatch_3 = Dispatch(List=stream_filter_8, DispatchPattern=[True, False])  # -> ListA, ListB
brep_4 = Brep(dispatch_3.ListA)
brep_5 = Brep(dispatch_3.ListB)
stream_filter_9 = StreamFilter(Gate=expression_2, Stream1=brep_4, Stream2=brep_5)
deconstruct_brep_19 = DeconstructBrep(Brep=stream_filter_9)  # -> Faces, Edges, Vertices
list_item_53 = ListItem(List=deconstruct_brep_19.Edges, Index=0, Wrap=True)
curve_middle_17 = CurveMiddle(Curve=list_item_53)
yz_plane_3 = YZPlane(Origin=curve_middle_17)

brep_6 = Brep(dispatch_2.ListA)
brep_7 = Brep(dispatch_2.ListA)

deconstruct_brep_20 = DeconstructBrep(Brep=dispatch_2.ListB)  # -> Faces, Edges, Vertices
list_item_54 = ListItem(List=deconstruct_brep_20.Edges, Index="7", Wrap=True)
list_item_55 = ListItem(List=deconstruct_brep_20.Edges, Index="5", Wrap=True)
curve_middle_18 = CurveMiddle(Curve=list_item_54)
curve_middle_19 = CurveMiddle(Curve=list_item_55)
move_86 = Move(Geometry=curve_middle_18, Motion=unit_z_10)  # -> Geometry, Transform
move_87 = Move(Geometry=curve_middle_19, Motion=unit_z_11)  # -> Geometry, Transform
move_88 = Move(Geometry=move_86.Geometry, Motion=unit_z_12)  # -> Geometry, Transform
move_89 = Move(Geometry=move_87.Geometry, Motion=unit_z_13)  # -> Geometry, Transform
deconstruct_brep_21 = DeconstructBrep(Brep=dispatch_2.ListA)  # -> Faces, Edges, Vertices
list_item_56 = ListItem(List=deconstruct_brep_21.Edges, Index="7", Wrap=True)
list_item_57 = ListItem(List=deconstruct_brep_21.Edges, Index="1", Wrap=True)
curve_middle_20 = CurveMiddle(Curve=list_item_56)
curve_middle_21 = CurveMiddle(Curve=list_item_57)
move_90 = Move(Geometry=curve_middle_20, Motion=unit_z_14)  # -> Geometry, Transform
move_91 = Move(Geometry=curve_middle_21, Motion=unit_z_15)  # -> Geometry, Transform
move_92 = Move(Geometry=move_90.Geometry, Motion=unit_z_16)  # -> Geometry, Transform
move_93 = Move(Geometry=move_91.Geometry, Motion=unit_z_17)  # -> Geometry, Transform

# ----
# Parafuso B x0,x1 UNITARIO
# 3BF Mecanizador V0.5
orientacion_mecanizado_18 = ValueList({"x0,x1": 1, "x1,x0": 2, "y0,y1": 3, "y1,y0": 4, "z0,z1": 5, "z1,z0": 6}, selected="x0,x1")
giro_mecanizado_18 = ValueList({"Frente": 0, "Arriba": 90, "Pesterior": 180, "Abajo": 270}, selected="Frente")
mecanizados_25 = Brep(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)
parafuso_b_7 = Mesh(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)
point_41 = Point(move_86.Geometry)
point_42 = Point(Point(-653.4233076, 0, 0))
python_3_script_45 = Python3Script(
    Point=point_41,
    Orientacion=orientacion_mecanizado_18,
    Giro=giro_mecanizado_18,
    Mecanizado_Nurbs=mecanizados_25,
    Dual_Point=point_42,
    Herraje_Malla_1=parafuso_b_7)  # -> out, Mecanizado_Out, Herraje_Out_1, Herraje_Out_2; inputs Point: Point3d, Orientacion: String, Mecanizado_Nurbs: list of Brep, Dual_Point: Point3d, Herraje_Malla_1: Mesh, Herraje_Malla_2: Mesh, Plane_Mirror_X: Plane, Plane_Mirror_Y: Plane; same code as python_3_script
mecanizados_26 = Brep(python_3_script_45.Mecanizado_Out)
parafuso_b_8 = Mesh(python_3_script_45.Herraje_Out_1)
diagnostico_31 = Panel(python_3_script_45.out)

# ----
# Tarugo x0,x1 UNITARIO
# 3BF Mecanizador V0.5
orientacion_mecanizado_19 = ValueList({"x0,x1": 1, "x1,x0": 2, "y0,y1": 3, "y1,y0": 4, "z0,z1": 5, "z1,z0": 6}, selected="x1,x0")
giro_mecanizado_19 = ValueList({"Frente": 0, "Arriba": 90, "Pesterior": 180, "Abajo": 270}, selected="Frente")
mecanizados_27 = Brep(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)
point_43 = Point([move_87.Geometry, move_89.Geometry])
point_44 = Point(Point(-590.8767532, 0, 0))
cavilha_14 = Mesh(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)
python_3_script_46 = Python3Script(
    Point=point_43,
    Orientacion=orientacion_mecanizado_19,
    Giro=giro_mecanizado_19,
    Mecanizado_Nurbs=mecanizados_27,
    Dual_Point=point_44,
    Herraje_Malla_1=cavilha_14)  # -> out, Mecanizado_Out, Herraje_Out_1, Herraje_Out_2; inputs Point: Point3d, Orientacion: String, Mecanizado_Nurbs: list of Brep, Dual_Point: Point3d, Herraje_Malla_1: Mesh, Herraje_Malla_2: Mesh, Plane_Mirror_X: Plane, Plane_Mirror_Y: Plane; same code as python_3_script
mecanizados_28 = Brep(python_3_script_46.Mecanizado_Out)
cavilha_15 = Mesh(python_3_script_46.Herraje_Out_1)
linear_array_4 = LinearArray(Geometry=mecanizados_28, Direction=negative_4, Count=cantidad_cajones)  # -> Geometry, Transform
diagnostico_32 = Panel(python_3_script_46.out)

# ----
# 3BF Mecanizador V0.5
# Tarugo x0,x1 UNITARIO
orientacion_mecanizado_20 = ValueList({"x0,x1": 1, "x1,x0": 2, "y0,y1": 3, "y1,y0": 4, "z0,z1": 5, "z1,z0": 6}, selected="x0,x1")
giro_mecanizado_20 = ValueList({"Frente": 0, "Arriba": 90, "Pesterior": 180, "Abajo": 270}, selected="Frente")
mecanizados_29 = Brep(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)
point_45 = Point(move_88.Geometry)
point_46 = Point(Point(-590.8767532, 0, 0))
cavilha_16 = Mesh(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)
python_3_script_47 = Python3Script(
    Point=point_45,
    Orientacion=orientacion_mecanizado_20,
    Giro=giro_mecanizado_20,
    Mecanizado_Nurbs=mecanizados_29,
    Dual_Point=point_46,
    Herraje_Malla_1=cavilha_16)  # -> out, Mecanizado_Out, Herraje_Out_1, Herraje_Out_2; inputs Point: Point3d, Orientacion: String, Mecanizado_Nurbs: list of Brep, Dual_Point: Point3d, Herraje_Malla_1: Mesh, Herraje_Malla_2: Mesh, Plane_Mirror_X: Plane, Plane_Mirror_Y: Plane; same code as python_3_script
mecanizados_30 = Brep(python_3_script_47.Mecanizado_Out)
cavilha_17 = Mesh(python_3_script_47.Herraje_Out_1)
diagnostico_33 = Panel(python_3_script_47.out)
linear_array_5 = LinearArray(Geometry=[cavilha_15, cavilha_17], Direction=negative_4, Count=cantidad_cajones)  # -> Geometry, Transform
mirror_6 = Mirror(Geometry=linear_array_5.Geometry, Plane=yz_plane)  # -> Geometry, Transform

# ---- group: Peça 8
solid_difference_6 = SolidDifference(BrepsA=dispatch_2.ListB, BrepsB=flatten([mecanizados_26, mecanizados_30, mecanizados_28]))

# ----
# Tarugo x0,x1 UNITARIO
# 3BF Mecanizador V0.5
orientacion_mecanizado_21 = ValueList({"x0,x1": 1, "x1,x0": 2, "y0,y1": 3, "y1,y0": 4, "z0,z1": 5, "z1,z0": 6}, selected="x1,x0")
giro_mecanizado_21 = ValueList({"Frente": 0, "Arriba": 90, "Pesterior": 180, "Abajo": 270}, selected="Frente")
mecanizados_31 = Brep(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)
point_47 = Point(move_91.Geometry)
point_48 = Point(Point(-590.8767532, 0, 0))
cavilha_18 = Mesh(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)
python_3_script_48 = Python3Script(
    Point=point_47,
    Orientacion=orientacion_mecanizado_21,
    Giro=giro_mecanizado_21,
    Mecanizado_Nurbs=mecanizados_31,
    Dual_Point=point_48,
    Herraje_Malla_1=cavilha_18)  # -> out, Mecanizado_Out, Herraje_Out_1, Herraje_Out_2; inputs Point: Point3d, Orientacion: String, Mecanizado_Nurbs: list of Brep, Dual_Point: Point3d, Herraje_Malla_1: Mesh, Herraje_Malla_2: Mesh, Plane_Mirror_X: Plane, Plane_Mirror_Y: Plane; same code as python_3_script
mecanizados_32 = Brep(python_3_script_48.Mecanizado_Out)
cavilha_19 = Mesh(python_3_script_48.Herraje_Out_1)
diagnostico_34 = Panel(python_3_script_48.out)

# ----
# Parafuso B x0,x1 UNITARIO
# 3BF Mecanizador V0.5
orientacion_mecanizado_22 = ValueList({"x0,x1": 1, "x1,x0": 2, "y0,y1": 3, "y1,y0": 4, "z0,z1": 5, "z1,z0": 6}, selected="x1,x0")
giro_mecanizado_22 = ValueList({"Frente": 0, "Arriba": 90, "Pesterior": 180, "Abajo": 270}, selected="Frente")
mecanizados_33 = Brep(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)
parafuso_b_9 = Mesh(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)
point_49 = Point(move_93.Geometry)
point_50 = Point(Point(-653.4233076, 0, 0))
python_3_script_49 = Python3Script(
    Point=point_49,
    Orientacion=orientacion_mecanizado_22,
    Giro=giro_mecanizado_22,
    Mecanizado_Nurbs=mecanizados_33,
    Dual_Point=point_50,
    Herraje_Malla_1=parafuso_b_9)  # -> out, Mecanizado_Out, Herraje_Out_1, Herraje_Out_2; inputs Point: Point3d, Orientacion: String, Mecanizado_Nurbs: list of Brep, Dual_Point: Point3d, Herraje_Malla_1: Mesh, Herraje_Malla_2: Mesh, Plane_Mirror_X: Plane, Plane_Mirror_Y: Plane; same code as python_3_script
mecanizados_34 = Brep(python_3_script_49.Mecanizado_Out)
parafuso_b_10 = Mesh(python_3_script_49.Herraje_Out_1)
linear_array_6 = LinearArray(Geometry=[mecanizados_34, mecanizados_32], Direction=negative_4, Count=cantidad_cajones)  # -> Geometry, Transform
linear_array_7 = LinearArray(Geometry=parafuso_b_10, Direction=negative_4, Count=cantidad_cajones)  # -> Geometry, Transform
diagnostico_35 = Panel(python_3_script_49.out)

# ---- group: Peca 11
solid_difference_7 = SolidDifference(BrepsA=dispatch_2.ListA, BrepsB=flatten([mecanizados_34, mecanizados_32]))

linear_array_8 = LinearArray(Geometry=solid_difference_7, Direction=negative_4, Count=cantidad_cajones)  # -> Geometry, Transform

# ----
linear_array_9 = LinearArray(Geometry=parafuso_b_8, Direction=negative_4, Count=cantidad_cajones)  # -> Geometry, Transform
rh_out_parafuso_b = Geometry([linear_array_9.Geometry, linear_array_7.Geometry, parafuso_b_6, parafuso_b_4, parafuso_b_3])
linear_array_10 = LinearArray(Geometry=[mecanizados_26, mecanizados_30], Direction=negative_4, Count=cantidad_cajones)  # -> Geometry, Transform

# ---- group: Peca 8
linear_array_11 = LinearArray(Geometry=solid_difference_6, Direction=negative_4, Count=cantidad_cajones)  # -> Geometry, Transform

# ---- group: Peça 8 Aparência
# 3BF Materializer v0.3
# 3BF Box Mapping v1.0
# 3BF Mesh Channel Separator v2.3
rh_in_11_0_mapeado = ValueList({"Longitudinal": 0, "Atravesada": 1}, selected="Longitudinal")
python_3_script_50 = Python3Script(Brep_In=linear_array_11.Geometry)  # -> out, Pieza_1, Pieza_2, Pieza_3, Pieza_4; inputs Brep_In: list of Brep; same code as python_3_script_12
mesh_brep_15 = MeshBrep(
    Brep=python_3_script_50.Pieza_1,
    Settings={GridMaxCount=0, GridMinCount=16, JaggedSeams=False, MaxEdgeLength=0, MinEdgeLength=0.0001, MinTolerance=0, Refine=True, RefineAngle=0, RelativeTolerance=0.65, SimplePlanes=True, Tolerance=0})
mesh_brep_16 = MeshBrep(
    Brep=python_3_script_50.Pieza_2,
    Settings={GridMaxCount=0, GridMinCount=16, JaggedSeams=False, MaxEdgeLength=0, MinEdgeLength=0.0001, MinTolerance=0, Refine=True, RefineAngle=0, RelativeTolerance=0.65, SimplePlanes=True, Tolerance=0})
mesh_brep_17 = MeshBrep(
    Brep=python_3_script_50.Pieza_3,
    Settings={GridMaxCount=0, GridMinCount=16, JaggedSeams=False, MaxEdgeLength=0, MinEdgeLength=0.0001, MinTolerance=0, Refine=True, RefineAngle=0, RelativeTolerance=0.65, SimplePlanes=True, Tolerance=0})
mesh_brep_18 = MeshBrep(
    Brep=python_3_script_50.Pieza_4,
    Settings={GridMaxCount=0, GridMinCount=16, JaggedSeams=False, MaxEdgeLength=0, MinEdgeLength=0.0001, MinTolerance=0, Refine=True, RefineAngle=0, RelativeTolerance=0.65, SimplePlanes=True, Tolerance=0})
rh_in_11_1_lado_balance = ValueList({"Cara A", "Cara B", "D/D"}, selected="D/D")
rh_in_11_2_canto_frontal = ValueList({"Canto": 0, "MDP": 1}, selected="Canto")
rh_in_11_3_canto_trasero = ValueList({"Canto": 0, "MDP": 1}, selected="Canto")
rh_in_11_4_canto_izquierdo_arriba = ValueList({"Canto": 0, "MDP": 1}, selected="Canto")
rh_in_11_5_canto_derecho_abajo = ValueList({"Canto": 0, "MDP": 1}, selected="Canto")
diagnostico_36 = Panel(python_3_script_50.out)
mesh_join_15 = MeshJoin(Meshes=flatten(mesh_brep_15))
mesh_join_16 = MeshJoin(Meshes=flatten(mesh_brep_16))
mesh_join_17 = MeshJoin(Meshes=flatten(mesh_brep_17))
mesh_join_18 = MeshJoin(Meshes=flatten(mesh_brep_18))
python_3_script_51 = Python3Script(M=mesh_join_15, B=rh_in_11_0_mapeado)  # -> a; inputs M: Mesh, B: Int32; same code as python_3_script_13
python_3_script_52 = Python3Script(M=mesh_join_16, B=rh_in_11_0_mapeado)  # -> a; inputs M: Mesh, B: Int32; same code as python_3_script_13
python_3_script_53 = Python3Script(M=mesh_join_17, B=rh_in_11_0_mapeado)  # -> a; inputs M: Mesh, B: Int32; same code as python_3_script_13
python_3_script_54 = Python3Script(M=mesh_join_18, B=rh_in_11_0_mapeado)  # -> a; inputs M: Mesh, B: Int32; same code as python_3_script_13
python_3_script_55 = Python3Script(
    M_In=[python_3_script_51, python_3_script_52, python_3_script_53, python_3_script_54],
    Balance_Mode=rh_in_11_1_lado_balance,
    Canto_1=rh_in_11_2_canto_frontal,
    Canto_2=rh_in_11_3_canto_trasero,
    Canto_3=rh_in_11_4_canto_izquierdo_arriba,
    Canto_4=rh_in_11_5_canto_derecho_abajo)  # -> out, Color, Balance, MDP; inputs M_In: list; same code as python_3_script_14
diagnostico_37 = Panel(python_3_script_55.out)
rh_out_mdp_peça_8 = Geometry(python_3_script_55.MDP)
# 8
rh_out_peça_8_b = Geometry(python_3_script_55.Balance)
rh_out_peça_8 = Geometry(python_3_script_55.Color)

# ---- group: Peça 11 Aparência
# 3BF Materializer v0.3
# 3BF Box Mapping v1.0
# 3BF Mesh Channel Separator v2.3
rh_in_14_0_mapeado = ValueList({"Longitudinal": 0, "Atravesada": 1}, selected="Longitudinal")
python_3_script_56 = Python3Script(Brep_In=linear_array_8.Geometry)  # -> out, Pieza_1, Pieza_2, Pieza_3, Pieza_4; inputs Brep_In: list of Brep; same code as python_3_script_12
mesh_brep_19 = MeshBrep(
    Brep=python_3_script_56.Pieza_1,
    Settings={GridMaxCount=0, GridMinCount=16, JaggedSeams=False, MaxEdgeLength=0, MinEdgeLength=0.0001, MinTolerance=0, Refine=True, RefineAngle=0, RelativeTolerance=0.65, SimplePlanes=True, Tolerance=0})
mesh_brep_20 = MeshBrep(
    Brep=python_3_script_56.Pieza_2,
    Settings={GridMaxCount=0, GridMinCount=16, JaggedSeams=False, MaxEdgeLength=0, MinEdgeLength=0.0001, MinTolerance=0, Refine=True, RefineAngle=0, RelativeTolerance=0.65, SimplePlanes=True, Tolerance=0})
mesh_brep_21 = MeshBrep(
    Brep=python_3_script_56.Pieza_3,
    Settings={GridMaxCount=0, GridMinCount=16, JaggedSeams=False, MaxEdgeLength=0, MinEdgeLength=0.0001, MinTolerance=0, Refine=True, RefineAngle=0, RelativeTolerance=0.65, SimplePlanes=True, Tolerance=0})
mesh_brep_22 = MeshBrep(
    Brep=python_3_script_56.Pieza_4,
    Settings={GridMaxCount=0, GridMinCount=16, JaggedSeams=False, MaxEdgeLength=0, MinEdgeLength=0.0001, MinTolerance=0, Refine=True, RefineAngle=0, RelativeTolerance=0.65, SimplePlanes=True, Tolerance=0})
rh_in_14_1_lado_balance = ValueList({"Cara A", "Cara B", "D/D"}, selected="Cara B")
rh_in_14_2_canto_frontal = ValueList({"Canto": 0, "MDP": 1}, selected="MDP")
rh_in_14_3_canto_trasero = ValueList({"Canto": 0, "MDP": 1}, selected="MDP")
rh_in_14_4_canto_izquierdo_arriba = ValueList({"Canto": 0, "MDP": 1}, selected="Canto")
rh_in_14_5_canto_derecho_abajo = ValueList({"Canto": 0, "MDP": 1}, selected="MDP")
diagnostico_38 = Panel(python_3_script_56.out)
mesh_join_19 = MeshJoin(Meshes=flatten(mesh_brep_19))
mesh_join_20 = MeshJoin(Meshes=flatten(mesh_brep_20))
mesh_join_21 = MeshJoin(Meshes=flatten(mesh_brep_21))
mesh_join_22 = MeshJoin(Meshes=flatten(mesh_brep_22))
python_3_script_57 = Python3Script(M=mesh_join_19, B=rh_in_14_0_mapeado)  # -> a; inputs M: Mesh, B: Int32; same code as python_3_script_13
python_3_script_58 = Python3Script(M=mesh_join_20, B=rh_in_14_0_mapeado)  # -> a; inputs M: Mesh, B: Int32; same code as python_3_script_13
python_3_script_59 = Python3Script(M=mesh_join_21, B=rh_in_14_0_mapeado)  # -> a; inputs M: Mesh, B: Int32; same code as python_3_script_13
python_3_script_60 = Python3Script(M=mesh_join_22, B=rh_in_14_0_mapeado)  # -> a; inputs M: Mesh, B: Int32; same code as python_3_script_13
python_3_script_61 = Python3Script(
    M_In=[python_3_script_57, python_3_script_58, python_3_script_59, python_3_script_60],
    Balance_Mode=rh_in_14_1_lado_balance,
    Canto_1=rh_in_14_2_canto_frontal,
    Canto_2=rh_in_14_3_canto_trasero,
    Canto_3=rh_in_14_4_canto_izquierdo_arriba,
    Canto_4=rh_in_14_5_canto_derecho_abajo)  # -> out, Color, Balance, MDP; inputs M_In: list
# ---------- python_3_script_61: Python ----------
"""
=============================================================================
3BF Mesh Channel Separator v2.5 (Normal-Shielded & Pure Faces)
Powered by 3dBimFab
=============================================================================
Separa la malla consolidada y mapeada en los 3 canales de manufactura DfMA:
1. Color: Caras principales y cantos aplacados (blindado contra bordes).
2. Balance: Contracara plana pura (respetando simetría en cajones X).
3. MDP: Mecanizados/ranuras y cantos sin aplacar.
=============================================================================
"""
import Rhino
import rhinoscriptsyntax as rs

def parse_balance(val):
    s = str(val).lower().strip().replace('"', '').replace("'", "")
    if s in ["6", "d/d", "dyd", "doble", "ninguno", "ambas"] or "d/d" in s or "dyd" in s:
        return "DD"
    if s in ["5", "cara a", "a"] or (s.startswith("a") and len(s) <= 6):
        return "A"
    if s in ["4", "cara b", "b"] or (s.startswith("b") and len(s) <= 6):
        return "B"
    return "B"

def parse_canto(val):
    s = str(val).lower().strip().replace('"', '').replace("'", "")
    if s in ["0", "0.0", "canto", "true", "si", "sí", "s", "con canto"] or ("canto" in s and "sin" not in s):
        return True
    if s in ["1", "1.0", "mdp", "false", "no", "sin canto"] or "mdp" in s or "sin" in s:
        return False
    return True

def extraer_malla_universal(c):
    if c is None:
        return None
    if hasattr(c, "Faces") and hasattr(c, "Vertices"):
        return c
    val = getattr(c, "Value", c)
    if hasattr(val, "Faces") and hasattr(val, "Vertices"):
        return val
    try:
        m = rs.coercemesh(c)
        if m is not None:
            return m
    except:
        pass
    try:
        m = rs.coercemesh(val)
        if m is not None:
            return m
    except:
        pass
    return None

def aplanar_candidatos(obj):
    res = []
    if obj is None:
        return res
    if hasattr(obj, "AllData"):
        for it in obj.AllData():
            res.extend(aplanar_candidatos(it))
        return res
    if hasattr(obj, "Branches"):
        for b in obj.Branches:
            res.extend(aplanar_candidatos(b))
        return res
    if isinstance(obj, list) or (hasattr(obj, "__iter__") and not hasattr(obj, "Faces")):
        for sub in obj:
            res.extend(aplanar_candidatos(sub))
        return res
    res.append(obj)
    return res

candidatos = aplanar_candidatos(M_In if 'M_In' in locals() else None)
lista_mallas = []
for c in candidatos:
    m = extraer_malla_universal(c)
    if m is not None and hasattr(m, "Faces") and m.Faces.Count > 0:
        lista_mallas.append(m)

def crear_submalla_uv(mesh_origen, face_indices):
    if not face_indices:
        return None
    sub = Rhino.Geometry.Mesh()
    vert_map = {}
    for fi in face_indices:
        f = mesh_origen.Faces[fi]
        idx_face = [f.A, f.B, f.C]
        if f.IsQuad:
            idx_face.append(f.D)

        nuevos_idx = []
        for vi in idx_face:
            if vi not in vert_map:
                new_vi = sub.Vertices.Add(mesh_origen.Vertices[vi])
                if mesh_origen.TextureCoordinates.Count > vi:
                    sub.TextureCoordinates.Add(mesh_origen.TextureCoordinates[vi])
                if mesh_origen.Normals.Count > vi:
                    sub.Normals.Add(mesh_origen.Normals[vi])
                vert_map[vi] = new_vi
            nuevos_idx.append(vert_map[vi])

        if len(nuevos_idx) == 3:
            sub.Faces.AddFace(nuevos_idx[0], nuevos_idx[1], nuevos_idx[2])
        elif len(nuevos_idx) == 4:
            sub.Faces.AddFace(nuevos_idx[0], nuevos_idx[1], nuevos_idx[2], nuevos_idx[3])

    sub.Compact()
    return sub

def separar_malla_pieza(mesh, b_mode, c1, c2, c3, c4, mid_x=None, span_x=0.0):
    bb = mesh.GetBoundingBox(True)
    x0, x1 = bb.Min.X, bb.Max.X
    y0, y1 = bb.Min.Y, bb.Max.Y
    z0, z1 = bb.Min.Z, bb.Max.Z

    sx = max(0.1, x1 - x0)
    sy = max(0.1, y1 - y0)
    sz = max(0.1, z1 - z0)

    dims = [("X", sx), ("Y", sy), ("Z", sz)]
    dims.sort(key=lambda d: d[1])
    eje_espesor = dims[0][0]
    espesor = dims[0][1]
    tol = max(0.5, espesor * 0.25)

    faces_A_idx = []
    faces_B_idx = []
    cantos_idx = {1: [], 2: [], 3: [], 4: []}
    mecanizados_idx = []

    for fi in range(mesh.Faces.Count):
        f = mesh.Faces[fi]
        pts = [mesh.Vertices[f.A], mesh.Vertices[f.B], mesh.Vertices[f.C]]
        if f.IsQuad:
            pts.append(mesh.Vertices[f.D])

        cx = sum(p.X for p in pts) / len(pts)
        cy = sum(p.Y for p in pts) / len(pts)
        cz = sum(p.Z for p in pts) / len(pts)

        # Cálculo del vector normal de la cara
        pA, pB, pC = pts[0], pts[1], pts[2]
        ux, uy, uz = pB.X - pA.X, pB.Y - pA.Y, pB.Z - pA.Z
        vx, vy, vz = pC.X - pA.X, pC.Y - pA.Y, pC.Z - pA.Z
        nx = uy * vz - uz * vy
        ny = uz * vx - ux * vz
        nz = ux * vy - uy * vx
        nl = (nx * nx + ny * ny + nz * nz) ** 0.5
        if nl > 1e-6:
            nx /= nl
            ny /= nl
            nz /= nl
        else:
            nx, ny, nz = 0.0, 0.0, 0.0

        # Clasificación estricta (Vector Normal + Cota espacial):
        # Cara A y Cara B EXIGEN normal orientada en el eje del espesor (|n| > 0.5).
        # Ningún triángulo de borde lateral o canto puede entrar en Cara A ni Cara B.
        if eje_espesor == "Z":
            if nz > 0.5 and abs(cz - z1) < tol:
                faces_A_idx.append(fi)
            elif nz < -0.5 and abs(cz - z0) < tol:
                faces_B_idx.append(fi)
            elif abs(cy - y0) < tol or ny < -0.7:
                cantos_idx[1].append(fi)
            elif abs(cy - y1) < tol or ny > 0.7:
                cantos_idx[2].append(fi)
            elif abs(cx - x0) < tol or nx < -0.7:
                cantos_idx[3].append(fi)
            elif abs(cx - x1) < tol or nx > 0.7:
                cantos_idx[4].append(fi)
            else:
                mecanizados_idx.append(fi)
        elif eje_espesor == "X":
            if nx > 0.5 and abs(cx - x1) < tol:
                faces_A_idx.append(fi)
            elif nx < -0.5 and abs(cx - x0) < tol:
                faces_B_idx.append(fi)
            elif abs(cy - y0) < tol or ny < -0.7:
                cantos_idx[1].append(fi)
            elif abs(cy - y1) < tol or ny > 0.7:
                cantos_idx[2].append(fi)
            elif abs(cz - z1) < tol or nz > 0.7:
                cantos_idx[3].append(fi)
            elif abs(cz - z0) < tol or nz < -0.7:
                cantos_idx[4].append(fi)
            else:
                mecanizados_idx.append(fi)
        else: # eje_espesor == "Y"
            if ny < -0.5 and abs(cy - y0) < tol:
                faces_A_idx.append(fi)
            elif ny > 0.5 and abs(cy - y1) < tol:
                faces_B_idx.append(fi)
            elif abs(cx - x0) < tol or nx < -0.7:
                cantos_idx[1].append(fi)
            elif abs(cx - x1) < tol or nx > 0.7:
                cantos_idx[2].append(fi)
            elif abs(cz - z1) < tol or nz > 0.7:
                cantos_idx[3].append(fi)
            elif abs(cz - z0) < tol or nz < -0.7:
                cantos_idx[4].append(fi)
            else:
                mecanizados_idx.append(fi)

    # DETECCIÓN DE SIMETRÍA / MIRROR AUTOMÁTICA:
    # Solo aplica en eje_espesor == "X" (laterales de cajones)
    es_espejo = False
    if mecanizados_idx and eje_espesor == "X":
        pts_x = []
        for fi in mecanizados_idx:
            f = mesh.Faces[fi]
            pts_x.append(mesh.Vertices[f.A].X)
            pts_x.append(mesh.Vertices[f.B].X)
            pts_x.append(mesh.Vertices[f.C].X)
            if f.IsQuad: pts_x.append(mesh.Vertices[f.D].X)
        if pts_x and (sum(pts_x) / float(len(pts_x))) < (x0 + x1) * 0.5:
            es_espejo = True

    # Detección espacial universal de pares simétricos (Mirror sin mecanizados):
    if not es_espejo and mid_x is not None and span_x > 50.0 and eje_espesor == 'X':
        if (x0 + x1) * 0.5 < mid_x:
            es_espejo = True

    # Si es reflejada (espejo en X), invertimos las caras A y B para que el Balance quede adentro
    if es_espejo:
        f_A = faces_B_idx
        f_B = faces_A_idx
    else:
        f_A = faces_A_idx
        f_B = faces_B_idx

    color_idx = []
    balance_idx = []
    mdp_idx = []

    if b_mode == "DD":
        color_idx.extend(f_A)
        color_idx.extend(f_B)
    elif b_mode == "A":
        balance_idx.extend(f_A)
        color_idx.extend(f_B)
    elif b_mode == "B":
        color_idx.extend(f_A)
        balance_idx.extend(f_B)
    else:
        balance_idx.extend(f_A)
        balance_idx.extend(f_B)

    cantos_map = {1: c1, 2: c2, 3: c3, 4: c4}
    for num, tiene in cantos_map.items():
        if tiene:
            color_idx.extend(cantos_idx[num])
        else:
            mdp_idx.extend(cantos_idx[num])

    mdp_idx.extend(mecanizados_idx)

    m_col = crear_submalla_uv(mesh, color_idx)
    m_bal = crear_submalla_uv(mesh, balance_idx)
    m_mdp = crear_submalla_uv(mesh, mdp_idx)

    return m_col, m_bal, m_mdp

b_mode = parse_balance(Balance_Mode if 'Balance_Mode' in locals() else "Cara B")
c_1 = parse_canto(Canto_1 if 'Canto_1' in locals() else "Canto")
c_2 = parse_canto(Canto_2 if 'Canto_2' in locals() else "Canto")
c_3 = parse_canto(Canto_3 if 'Canto_3' in locals() else "Canto")
c_4 = parse_canto(Canto_4 if 'Canto_4' in locals() else "Canto")

Color = []
Balance = []
MDP = []

# Detección del centro global del par simétrico para componentes Mirror
mid_x, span_x = None, 0.0
if len(lista_mallas) >= 2:
    c_xs = [(m.GetBoundingBox(True).Min.X + m.GetBoundingBox(True).Max.X) * 0.5 for m in lista_mallas]
    mid_x = sum(c_xs) / float(len(c_xs))
    span_x = max(c_xs) - min(c_xs)

for m in lista_mallas:
    m_c, m_b, m_m = separar_malla_pieza(m, b_mode, c_1, c_2, c_3, c_4, mid_x, span_x)
    if m_c is not None: Color.append(m_c)
    if m_b is not None: Balance.append(m_b)
    if m_m is not None: MDP.append(m_m)

# Diagnóstico emitido directamente hacia la salida estándar 'out'
print(f"Procesadas {len(lista_mallas)} mallas | Color={len(Color)}, Balance={len(Balance)}, MDP={len(MDP)}")
# ---------- end python_3_script_61 ----------
diagnostico_39 = Panel(python_3_script_61.out)
rh_out_mdp_peça_11 = Geometry(python_3_script_61.MDP)
rh_out_peça_11_b = Geometry(python_3_script_61.Balance)
# 11
rh_out_peça_11 = Geometry(python_3_script_61.Color)

# ----
deconstruct_brep_22 = DeconstructBrep(Brep=stream_filter_7)  # -> Faces, Edges, Vertices
list_item_58 = ListItem(List=deconstruct_brep_22.Vertices, Index="3", Wrap=True)
move_94 = Move(Geometry=list_item_58, Motion=unit_x_18)  # -> Geometry, Transform
move_95 = Move(Geometry=move_94.Geometry, Motion=unit_z_43)  # -> Geometry, Transform
move_96 = Move(Geometry=move_95.Geometry, Motion=unit_z_44)  # -> Geometry, Transform
move_97 = Move(Geometry=move_96.Geometry, Motion=unit_x_19)  # -> Geometry, Transform
move_98 = Move(Geometry=move_97.Geometry, Motion=unit_y_43)  # -> Geometry, Transform
box_2pt_16 = Box2Pt(PointA=move_95.Geometry, PointB=move_98.Geometry, Plane=PlaneXY(0, 0, 0))
deconstruct_brep_23 = DeconstructBrep(Brep=box_2pt_16)  # -> Faces, Edges, Vertices
list_item_59 = ListItem(List=deconstruct_brep_23.Edges, Index="1", Wrap=True)
curve_middle_22 = CurveMiddle(Curve=list_item_59)
vector_2pt_3 = Vector2Pt(PointA=list_item_50, PointB=list_item_48, Unitize=False)  # -> Vector, Length
xz_plane_2 = XZPlane(Origin=curve_middle_22)

deconstruct_brep_24 = DeconstructBrep(Brep=box_2pt_16)  # -> Faces, Edges, Vertices
list_item_60 = ListItem(List=deconstruct_brep_24.Edges, Index=panel_8, Wrap=True)
curve_middle_23 = CurveMiddle(Curve=list_item_60)
move_99 = Move(Geometry=curve_middle_23, Motion=unit_z_26)  # -> Geometry, Transform
move_100 = Move(Geometry=move_99.Geometry, Motion=unit_y_27)  # -> Geometry, Transform
xz_plane_3 = XZPlane(Origin=move_100.Geometry)
cylinder = Cylinder(Base=xz_plane_3, Radius="2.5", Length="-27")
area_2 = Area(Geometry=box_2pt_16)  # -> Area, Centroid
xz_plane_4 = XZPlane(Origin=area_2.Centroid)

cap_holes = CapHoles(Brep=cylinder)
move_101 = Move(Geometry=cap_holes, Motion=negative)  # -> Geometry, Transform
mirror_7 = Mirror(Geometry=[cap_holes, move_101.Geometry], Plane=xz_plane_4)  # -> Geometry, Transform

dispatch_4 = Dispatch(List=mirror_7.Geometry, DispatchPattern=[True, False])  # -> ListA, ListB
deconstruct_brep_25 = DeconstructBrep(Brep=dispatch_4.ListA)  # -> Faces, Edges, Vertices
list_item_61 = ListItem(List=deconstruct_brep_25.Faces, Index="2", Wrap=True)
area_3 = Area(Geometry=list_item_61)  # -> Area, Centroid
move_102 = Move(Geometry=area_3.Centroid, Motion=unit_z_6)  # -> Geometry, Transform
move_103 = Move(Geometry=move_102.Geometry, Motion=unit_y_5)  # -> Geometry, Transform

# ---- group: Ranuras Laterales (continued)
deconstruct_brep_26 = DeconstructBrep(Brep=box_2pt_16)  # -> Faces, Edges, Vertices
deconstruct_brep_27 = DeconstructBrep(Brep=box_2pt_16)  # -> Faces, Edges, Vertices
list_item_62 = ListItem(List=deconstruct_brep_27.Vertices, Index="3", Wrap=True)
list_item_63 = ListItem(List=deconstruct_brep_26.Vertices, Index="0", Wrap=True)
move_104 = Move(Geometry=list_item_63, Motion=unit_z_28)  # -> Geometry, Transform
move_105 = Move(Geometry=move_104.Geometry, Motion=unit_x_9)  # -> Geometry, Transform
mirror_8 = Mirror(Geometry=move_105.Geometry, Plane=yz_plane_3)  # -> Geometry, Transform

# ----
move_106 = Move(Geometry=list_item_63, Motion=unit_z_3)  # -> Geometry, Transform
move_107 = Move(Geometry=move_106.Geometry, Motion=unit_z_5)  # -> Geometry, Transform
move_108 = Move(Geometry=move_107.Geometry, Motion=unit_x_3)  # -> Geometry, Transform
move_109 = Move(Geometry=move_107.Geometry, Motion=unit_y_6)  # -> Geometry, Transform
mirror_9 = Mirror(Geometry=move_109.Geometry, Plane=yz_plane_3)  # -> Geometry, Transform

point_51 = Point(move_103.Geometry)
python_3_script_62 = Python3Script(
    Point=point_51,
    Orientacion=orientacion_mecanizado_4,
    Giro=giro_mecanizado_4,
    Mecanizado_Nurbs=mecanizado,
    Dual_Point=point,
    Herraje_Malla_1=clavo_h)  # -> out, Mecanizado_Out, Herraje_Out_1, Herraje_Out_2; inputs Point: Point3d, Orientacion: String, Mecanizado_Nurbs: list of Brep, Dual_Point: Point3d, Herraje_Malla_1: Mesh, Herraje_Malla_2: Mesh, Plane_Mirror_X: Plane, Plane_Mirror_Y: Plane; same code as python_3_script
mecanizados_35 = Brep(python_3_script_62.Mecanizado_Out)
clavo_h_2 = Mesh(python_3_script_62.Herraje_Out_1)
diagnostico_40 = Panel(python_3_script_62.out)
linear_array_12 = LinearArray(Geometry=clavo_h_2, Direction=negative_4, Count=cantidad_cajones)  # -> Geometry, Transform
linear_array_13 = LinearArray(Geometry=mecanizados_35, Direction=negative_4, Count=cantidad_cajones)  # -> Geometry, Transform

deconstruct_brep_28 = DeconstructBrep(Brep=stream_filter_7)  # -> Faces, Edges, Vertices
list_item_64 = ListItem(List=deconstruct_brep_28.Vertices, Index=panel_15, Wrap=True)
move_110 = Move(Geometry=list_item_64, Motion=unit_y_46)  # -> Geometry, Transform
deconstruct_brep_29 = DeconstructBrep(Brep=stream_filter_7)  # -> Faces, Edges, Vertices
list_item_65 = ListItem(List=deconstruct_brep_29.Vertices, Index="3", Wrap=True)
move_111 = Move(Geometry=list_item_64, Motion=unit_z_47)  # -> Geometry, Transform
list_item_66 = ListItem(List=deconstruct_brep_29.Vertices, Index="2", Wrap=True)
move_112 = Move(Geometry=list_item_65, Motion=unit_z_48)  # -> Geometry, Transform
move_113 = Move(Geometry=list_item_66, Motion=unit_z_49)  # -> Geometry, Transform
line_7 = Line(StartPoint=list_item_64, EndPoint=move_110.Geometry)
line_8 = Line(StartPoint=move_111.Geometry, EndPoint=list_item_64)
line_9 = Line(StartPoint=move_111.Geometry, EndPoint=move_110.Geometry)
line_10 = Line(StartPoint=list_item_64, EndPoint=move_110.Geometry)
line_11 = Line(StartPoint=move_111.Geometry, EndPoint=list_item_64)
line_12 = Line(StartPoint=move_111.Geometry, EndPoint=move_110.Geometry)
move_114 = Move(Geometry=move_112.Geometry, Motion=unit_x_20)  # -> Geometry, Transform
line_13 = Line(StartPoint=move_82.Geometry, EndPoint=move_83.Geometry)
line_14 = Line(StartPoint=move_74.Geometry, EndPoint=move_75.Geometry)
move_115 = Move(Geometry=move_113.Geometry, Motion=unit_x_21)  # -> Geometry, Transform
join_curves = JoinCurves(Curves=[line_7, line_8, line_9], Preserve=False)
join_curves_2 = JoinCurves(Curves=[line_10, line_11, line_12], Preserve=False)
length_5 = Length(Curve=line_13)
length_6 = Length(Curve=line_14)
unit_x_25 = UnitX(Factor=length_5)
unit_x_26 = UnitX(Factor=length_6)
move_116 = Move(Geometry=move_115.Geometry, Motion=unit_y_47)  # -> Geometry, Transform
extrude = Extrude(Base=join_curves, Direction=unit_x_25)
extrude_2 = Extrude(Base=join_curves_2, Direction=unit_x_26)
stream_filter_10 = StreamFilter(Gate=expression_2, Stream1=extrude, Stream2=extrude_2)
vector_2pt_4 = Vector2Pt(PointA=list_item_50, PointB=list_item_48, Unitize=False)  # -> Vector, Length

# ----
# Patas
vector_2pt_5 = Vector2Pt(PointA=point_2, PointB=move_50.Geometry, Unitize=False)  # -> Vector, Length
vector_2pt_6 = Vector2Pt(PointA=point_2, PointB=move_50.Geometry, Unitize=False)  # -> Vector, Length
move_117 = Move(Geometry=mesh, Motion=vector_2pt_5.Vector)  # -> Geometry, Transform
move_118 = Move(Geometry=parafuso_d, Motion=vector_2pt_6.Vector)  # -> Geometry, Transform
mirror_10 = Mirror(Geometry=move_117.Geometry, Plane=yz_plane_2)  # -> Geometry, Transform
mirror_11 = Mirror(Geometry=move_118.Geometry, Plane=yz_plane_2)  # -> Geometry, Transform

# ---- group: Operaciones Frente Cajon
box_2pt_17 = Box2Pt(PointA=move_114.Geometry, PointB=move_116.Geometry, Plane=PlaneXY(0, 0, 0))
cap_holes_2 = CapHoles(Brep=stream_filter_10)

# ----
# Tampa
# 3BF Mecanizador V0.5
deconstruct_brep_30 = DeconstructBrep(Brep=mecanizados_22)  # -> Faces, Edges, Vertices
deconstruct_brep_31 = DeconstructBrep(Brep=mecanizados_20)  # -> Faces, Edges, Vertices
list_item_67 = ListItem(List=deconstruct_brep_30.Edges, Index="6", Wrap=True)
list_item_68 = ListItem(List=deconstruct_brep_31.Edges, Index="6", Wrap=True)
list_item_69 = ListItem(List=mecanizados_12, Index="0", Wrap=True)
deconstruct_brep_32 = DeconstructBrep(Brep=list_item_67)  # -> Faces, flatten(Edges), Vertices
deconstruct_brep_33 = DeconstructBrep(Brep=list_item_68)  # -> Faces, flatten(Edges), Vertices
deconstruct_brep_34 = DeconstructBrep(Brep=list_item_69)  # -> Faces, Edges, Vertices
list_item_70 = ListItem(List=deconstruct_brep_34.Faces, Index="1", Wrap=True)
orientacion_mecanizado_23 = ValueList({"x0,x1": 1, "x1,x0": 2, "y0,y1": 3, "y1,y0": 4, "z0,z1": 5, "z1,z0": 6}, selected="x0,x1")
giro_mecanizado_23 = ValueList({"Frente": 0, "Arriba": 90, "Pesterior": 180, "Abajo": 270}, selected="Frente")
point_52 = Point(Point(-1027.122877, 0, 5))
tampa = Mesh(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)

list_item_71 = ListItem(List=deconstruct_brep_33.Edges, Index="5", Wrap=True)
list_item_72 = ListItem(List=deconstruct_brep_32.Edges, Index="5", Wrap=True)
area_4 = Area(Geometry=list_item_71)  # -> Area, flatten(Centroid)
area_5 = Area(Geometry=list_item_70)  # -> Area, Centroid
area_6 = Area(Geometry=list_item_72)  # -> Area, flatten(Centroid)
point_53 = Point(area_4.Centroid)
point_54 = Point(area_6.Centroid)

point_55 = Point([point_53, area_5.Centroid, point_54])
python_3_script_63 = Python3Script(
    Point=point_55,
    Orientacion=orientacion_mecanizado_23,
    Giro=giro_mecanizado_23,
    Dual_Point=point_52,
    Herraje_Malla_1=tampa,
    Plane_Mirror_X=yz_plane)  # -> out, Mecanizado_Out, Herraje_Out_1, Herraje_Out_2; inputs Point: list of Point3d, Orientacion: String, Mecanizado_Nurbs: list of Brep, Dual_Point: Point3d, Herraje_Malla_1: list of Mesh, Herraje_Malla_2: list of Mesh, Plane_Mirror_X: Plane, Plane_Mirror_Y: Plane; same code as python_3_script_10
tampa_2 = Mesh(python_3_script_63.Herraje_Out_1)
diagnostico_41 = Panel(python_3_script_63.out)

rh_out_tampa = Mesh(tampa_2)

# ----
# Posterior de Cajon
deconstruct_brep_35 = DeconstructBrep(Brep=box_2pt_16)  # -> Faces, Edges, Vertices
list_item_73 = ListItem(List=deconstruct_brep_35.Vertices, Index="7", Wrap=True)
mirror_12 = Mirror(Geometry=list_item_62, Plane=yz_plane_3)  # -> Geometry, Transform
unit_y_50 = UnitY(Factor="12")
move_119 = Move(Geometry=list_item_73, Motion=unit_y_50)  # -> Geometry, Transform
box_2pt_18 = Box2Pt(PointA=move_119.Geometry, PointB=mirror_12.Geometry, Plane=PlaneXY(0, 0, 0))
area_7 = Area(Geometry=box_2pt_18)  # -> Area, Centroid
yz_plane_4 = YZPlane(Origin=area_7.Centroid)
deconstruct_brep_36 = DeconstructBrep(Brep=box_2pt_18)  # -> Faces, Edges, Vertices
deconstruct_brep_37 = DeconstructBrep(Brep=box_2pt_18)  # -> Faces, Edges, Vertices
unit_z_54 = UnitZ(Factor="16.5")
list_item_74 = ListItem(List=deconstruct_brep_37.Vertices, Index="0", Wrap=True)
unit_z_55 = UnitZ(Factor="12.5")
list_item_75 = ListItem(List=deconstruct_brep_36.Vertices, Index="1", Wrap=True)
unit_y_51 = UnitY(Factor="6")
move_120 = Move(Geometry=list_item_75, Motion=unit_z_54)  # -> Geometry, Transform
move_121 = Move(Geometry=list_item_74, Motion=unit_z_55)  # -> Geometry, Transform
move_122 = Move(Geometry=move_120.Geometry, Motion=unit_y_51)  # -> Geometry, Transform
box_2pt_19 = Box2Pt(PointA=move_121.Geometry, PointB=move_122.Geometry, Plane=PlaneXY(0, 0, 0))
deconstruct_brep_38 = DeconstructBrep(Brep=box_2pt_19)  # -> Faces, Edges, Vertices
list_item_76 = ListItem(List=deconstruct_brep_38.Edges, Index="0", Wrap=True)
vector_2pt_7 = Vector2Pt(PointA=list_item_50, PointB=list_item_48, Unitize=False)  # -> Vector, Length
curve_middle_24 = CurveMiddle(Curve=list_item_76)

# ---- group: Ranuras Laterales (continued)
unit_z_56 = UnitZ(Factor="12.5")
move_123 = Move(Geometry=list_item_62, Motion=unit_z_56)  # -> Geometry, Transform
move_124 = Move(Geometry=move_123.Geometry, Motion=unit_x_8)  # -> Geometry, Transform
box_2pt_20 = Box2Pt(PointA=move_124.Geometry, PointB=mirror_8.Geometry, Plane=PlaneXY(0, 0, 0))

# ----
deconstruct_brep_39 = DeconstructBrep(Brep=box_2pt_20)  # -> Faces, Edges, Vertices
list_item_77 = ListItem(List=deconstruct_brep_39.Vertices, Index="6", Wrap=True)
# Fondo de Cajon
list_item_78 = ListItem(List=deconstruct_brep_39.Vertices, Index="0", Wrap=True)
move_125 = Move(Geometry=list_item_77, Motion=unit_y_2)  # -> Geometry, Transform

mirror_13 = Mirror(Geometry=[cap_holes, move_101.Geometry], Plane=yz_plane_4)  # -> Geometry, Transform

move_126 = Move(Geometry=move_125.Geometry, Motion=unit_x_2)  # -> Geometry, Transform
move_127 = Move(Geometry=list_item_78, Motion=unit_x)  # -> Geometry, Transform
move_128 = Move(Geometry=move_123.Geometry, Motion=unit_x_3)  # -> Geometry, Transform
move_129 = Move(Geometry=move_126.Geometry, Motion=unit_z_4)  # -> Geometry, Transform
move_130 = Move(Geometry=move_127.Geometry, Motion=unit_y_3)  # -> Geometry, Transform
move_131 = Move(Geometry=move_128.Geometry, Motion=unit_y_4)  # -> Geometry, Transform
box_2pt_21 = Box2Pt(PointA=move_130.Geometry, PointB=move_129.Geometry, Plane=PlaneXY(0, 0, 0))
move_132 = Move(Geometry=box_2pt_21, Motion=vector_2pt_2.Vector)  # -> Geometry, Transform

# ---- group: Fondo de cajon
box_2pt_22 = Box2Pt(PointA=move_131.Geometry, PointB=mirror_9.Geometry, Plane=PlaneXY(0, 0, 0))

# ----
move_133 = Move(Geometry=box_2pt_22, Motion=Vector(0, 0, 10))  # -> Geometry, Transform
stream_filter_11 = StreamFilter(Gate=expression_2, Stream1=box_2pt_21, Stream2=[move_132.Geometry, box_2pt_21])
mirror_14 = Mirror(Geometry=linear_array_13.Geometry, Plane=yz_plane_4)  # -> Geometry, Transform

mirror_15 = Mirror(Geometry=linear_array_12.Geometry, Plane=yz_plane_4)  # -> Geometry, Transform
mirror_16 = Mirror(Geometry=[mirror_14.Geometry, linear_array_13.Geometry], Plane=yz_plane_2)  # -> Geometry, Transform
mirror_17 = Mirror(Geometry=[mirror_15.Geometry, linear_array_12.Geometry], Plane=yz_plane_2)  # -> Geometry, Transform
stream_filter_12 = StreamFilter(
    Gate=expression_2,
    Stream1=mirror_15.Geometry,
    Stream2=[linear_array_12.Geometry, mirror_15.Geometry, mirror_17.Geometry])

rh_out_clavo_h = Mesh(stream_filter_12)

# ---- group: Operaciones Frente Cajon (continued)
brep_8 = Brep([mirror_7.Geometry, move_101.Geometry, cap_holes, mirror_13.Geometry])

# ---- group: Lateral de cajon IZQ
solid_difference_8 = SolidDifference(BrepsA=box_2pt_16, BrepsB=flatten([brep_8, box_2pt_20]))

# ---- group: Lateral de cajon Der
mirror_18 = Mirror(Geometry=solid_difference_8, Plane=yz_plane_3)  # -> Geometry, Transform

# ---- group: Frente
solid_difference_9 = SolidDifference(BrepsA=stream_filter_7, BrepsB=flatten([cap_holes_2, box_2pt_17, brep_8]))

# ----
move_134 = Move(Geometry=[solid_difference_8, mirror_18.Geometry], Motion=vector_2pt_3.Vector)  # -> Geometry, Transform
stream_filter_13 = StreamFilter(
    Gate=expression_2,
    Stream1=[solid_difference_8, mirror_18.Geometry],
    Stream2=[move_134.Geometry, solid_difference_8, mirror_18.Geometry])

move_135 = Move(Geometry=solid_difference_9, Motion=vector_2pt_4.Vector)  # -> Geometry, Transform
stream_filter_14 = StreamFilter(Gate=expression_2, Stream1=solid_difference_9, Stream2=[solid_difference_9, move_135.Geometry])
move_136 = Move(Geometry=stream_filter_14, Motion=unit_y_48)  # -> Geometry, Transform

# ----
# Tarugos Cajon
deconstruct_brep_40 = DeconstructBrep(Brep=cap_holes)  # -> Faces, Edges, Vertices
list_item_79 = ListItem(List=deconstruct_brep_40.Edges, Index="0", Wrap=True)
area_8 = Area(Geometry=list_item_79)  # -> Area, Centroid
vector_2pt_8 = Vector2Pt(PointA=point_3, PointB=area_8.Centroid, Unitize=False)  # -> Vector, Length
unit_z_57 = UnitZ(Factor=rh_in_02_1_ritmo)
move_137 = Move(Geometry=cavilha, Motion=vector_2pt_8.Vector)  # -> Geometry, Transform
negative_7 = Negative(Value=unit_z_57)
move_138 = Move(Geometry=move_137.Geometry, Motion=negative_7)  # -> Geometry, Transform
mirror_19 = Mirror(Geometry=[move_138.Geometry, move_137.Geometry], Plane=xz_plane_4)  # -> Geometry, Transform
mirror_20 = Mirror(Geometry=[mirror_19.Geometry, move_138.Geometry, move_137.Geometry], Plane=yz_plane_4)  # -> Geometry, Transform
vector_2pt_9 = Vector2Pt(PointA=list_item_50, PointB=list_item_48, Unitize=False)  # -> Vector, Length
move_139 = Move(Geometry=[mirror_20.Geometry, mirror_19.Geometry, move_137.Geometry, move_138.Geometry], Motion=vector_2pt_9.Vector)  # -> Geometry, Transform
relay = Relay([mirror_19.Geometry, mirror_20.Geometry, move_138.Geometry, move_139.Geometry, move_137.Geometry])
linear_array_14 = LinearArray(Geometry=relay, Direction=negative_4, Count=cantidad_cajones)  # -> Geometry, Transform

# ----
# Cantonera y Tornillo de Cantonera
deconstruct_brep_41 = DeconstructBrep(Brep=box_2pt_16)  # -> Faces, Edges, Vertices
list_item_80 = ListItem(List=deconstruct_brep_41.Edges, Index="9", Wrap=True)
curve_middle_25 = CurveMiddle(Curve=list_item_80)
vector_2pt_10 = Vector2Pt(PointA=point_4, PointB=curve_middle_25, Unitize=False)  # -> Vector, Length
vector_2pt_11 = Vector2Pt(PointA=point_4, PointB=curve_middle_25, Unitize=False)  # -> Vector, Length
move_140 = Move(Geometry=cantoneira, Motion=vector_2pt_10.Vector)  # -> Geometry, Transform
move_141 = Move(Geometry=parafuso_e, Motion=vector_2pt_11.Vector)  # -> Geometry, Transform
mirror_21 = Mirror(Geometry=move_140.Geometry, Plane=yz_plane_4)  # -> Geometry, Transform
mirror_22 = Mirror(Geometry=move_141.Geometry, Plane=yz_plane_4)  # -> Geometry, Transform
vector_2pt_12 = Vector2Pt(PointA=list_item_50, PointB=list_item_48, Unitize=False)  # -> Vector, Length
vector_2pt_13 = Vector2Pt(PointA=list_item_50, PointB=list_item_48, Unitize=False)  # -> Vector, Length
move_142 = Move(Geometry=[mirror_21.Geometry, move_140.Geometry], Motion=vector_2pt_12.Vector)  # -> Geometry, Transform
move_143 = Move(Geometry=[mirror_22.Geometry, move_141.Geometry], Motion=vector_2pt_13.Vector)  # -> Geometry, Transform
linear_array_15 = LinearArray(Geometry=[move_142.Geometry, mirror_21.Geometry, move_140.Geometry], Direction=negative_4, Count=cantidad_cajones)  # -> Geometry, Transform
linear_array_16 = LinearArray(Geometry=[move_143.Geometry, mirror_22.Geometry, move_141.Geometry], Direction=negative_4, Count=cantidad_cajones)  # -> Geometry, Transform

# ----
# 3BF Mecanizador V0.5
# Correderas
orientacion_mecanizado_24 = ValueList({"x0,x1": 1, "x1,x0": 2, "y0,y1": 3, "y1,y0": 4, "z0,z1": 5, "z1,z0": 6}, selected="x0,x1")
giro_mecanizado_24 = ValueList({"Frente": 0, "Arriba": 90, "Pesterior": 180, "Abajo": 270}, selected="Frente")
corredeça = Mesh(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)
corredeça_2 = Mesh(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)
corredeça_3 = Mesh(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)
corredeça_4 = Mesh(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)
mecanizados_36 = Brep([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])
corredeça_5 = Mesh([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])
point_56 = Point(Point(-420, 0, 0))
point_57 = Point(list_item_58)
parafuso_e_3 = Mesh([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])
python_3_script_64 = Python3Script(
    Point=point_57,
    Orientacion=orientacion_mecanizado_24,
    Giro=giro_mecanizado_24,
    Mecanizado_Nurbs=mecanizados_36,
    Dual_Point=point_56,
    Herraje_Malla_1=[corredeça, corredeça_2, corredeça_3, corredeça_4],
    Herraje_Malla_2=parafuso_e_3,
    Plane_Mirror_X=yz_plane_4)  # -> out, Mecanizado_Out, Herraje_Out_1, Herraje_Out_2; inputs Point: Point3d, Orientacion: String, Mecanizado_Nurbs: list of Brep, Dual_Point: Point3d, Herraje_Malla_1: list of Mesh, Herraje_Malla_2: list of Mesh, Plane_Mirror_X: Plane, Plane_Mirror_Y: Plane; same code as python_3_script_10
corredeça_6 = Mesh(python_3_script_64.Herraje_Out_1)
parafuso_e_4 = Mesh(python_3_script_64.Herraje_Out_2)
linear_array_17 = LinearArray(Geometry=parafuso_e_4, Direction=negative_4, Count=cantidad_cajones)  # -> Geometry, Transform
linear_array_18 = LinearArray(Geometry=corredeça_6, Direction=negative_4, Count=cantidad_cajones)  # -> Geometry, Transform
unit_y_52 = UnitY(Factor="8")
unit_y_53 = UnitY(Factor="8")
mirror_23 = Mirror(Geometry=linear_array_18.Geometry, Plane=yz_plane)  # -> Geometry, Transform
diagnostico_42 = Panel(python_3_script_64.out)
mirror_24 = Mirror(Geometry=linear_array_17.Geometry, Plane=yz_plane)  # -> Geometry, Transform
move_144 = Move(Geometry=mirror_23.Geometry, Motion=unit_y_52)  # -> Geometry, Transform
move_145 = Move(Geometry=mirror_24.Geometry, Motion=unit_y_53)  # -> Geometry, Transform

rh_out_parafuso_e = Geometry([linear_array_16.Geometry, parafuso_e_2, linear_array_17.Geometry, move_145.Geometry])
mecanizados_37 = Brep(python_3_script_64.Mecanizado_Out)
linear_array_19 = LinearArray(Geometry=mecanizados_37, Direction=negative_4, Count=cantidad_cajones)  # -> Geometry, Transform
point_58 = Point(curve_middle_24)
mirror_25 = Mirror(Geometry=linear_array_19.Geometry, Plane=yz_plane)  # -> Geometry, Transform
move_146 = Move(Geometry=mirror_25.Geometry, Motion=unit_y_16)  # -> Geometry, Transform

# ---- group: Peça 6
solid_difference_10 = SolidDifference(
    BrepsA=box_2pt_3,
    BrepsB=flatten([mecanizados_20, mecanizados_28, mecanizados_16, mecanizados_18, linear_array_4.Geometry, mecanizados_14, mecanizados_9, linear_array_19.Geometry, move_146.Geometry, mecanizados_10]))

# ---- group: Peça 10
solid_difference_11 = SolidDifference(
    BrepsA=mirror_3.Geometry,
    BrepsB=flatten([mecanizados_20, mecanizados_24, mecanizados_22, mecanizados_7, linear_array_6.Geometry, mecanizados_12, mecanizados_11, mecanizados_8, linear_array_19.Geometry, move_146.Geometry]))

# ---- group: Peça 7
solid_difference_12 = SolidDifference(
    BrepsA=box_2pt_2,
    BrepsB=flatten([mecanizados_20, mecanizados_24, mecanizados_22, mecanizados_26, mecanizados_30, mecanizados_7, linear_array_10.Geometry, mecanizados_8, mecanizados_12, mecanizados_11, linear_array_19.Geometry, move_146.Geometry]))

# ----
rh_out_corrediça = Geometry([move_144.Geometry, linear_array_18.Geometry])

# ---- group: Peça 18 Aparência
# FONDOS
# 3BF Materializer v0.3
# 3BF Box Mapping v1.0 Fondos
# 3BF Mesh Channel Separator v2.4  Fondos
rh_in_21_0_mapeado_2 = ValueList({"Longitudinal": 0, "Atravesada": 1}, selected="Longitudinal")
python_3_script_65 = Python3Script(Brep_In=stream_filter_11)  # -> out, Pieza_1, Pieza_2, Pieza_3, Pieza_4; inputs Brep_In: list of Brep; same code as python_3_script_12
mesh_brep_23 = MeshBrep(
    Brep=python_3_script_65.Pieza_2,
    Settings={GridMaxCount=0, GridMinCount=16, JaggedSeams=False, MaxEdgeLength=0, MinEdgeLength=0.0001, MinTolerance=0, Refine=True, RefineAngle=0, RelativeTolerance=0.65, SimplePlanes=True, Tolerance=0})
mesh_brep_24 = MeshBrep(
    Brep=python_3_script_65.Pieza_1,
    Settings={GridMaxCount=0, GridMinCount=16, JaggedSeams=False, MaxEdgeLength=0, MinEdgeLength=0.0001, MinTolerance=0, Refine=True, RefineAngle=0, RelativeTolerance=0.65, SimplePlanes=True, Tolerance=0})
diagnostico_43 = Panel(python_3_script_65.out)
rh_in_21_1_lado_color_2 = ValueList({"Cara A", "Cara B"}, selected="Cara A")
rh_in_21_2_sustrato_2 = ValueList({"MDF 1 Cara": "MDF 1 cara", "Doble Cara (D/D)": "DD", "MDF Crudo": "Crudo", "Con Balance": "Balance"}, selected="MDF 1 Cara")
mesh_join_23 = MeshJoin(Meshes=flatten(mesh_brep_23))
mesh_join_24 = MeshJoin(Meshes=flatten(mesh_brep_24))
python_3_script_66 = Python3Script(M=mesh_join_24, B=rh_in_21_0_mapeado_2)  # -> a; inputs M: Mesh, B: Int32; same code as python_3_script_26
python_3_script_67 = Python3Script(M=mesh_join_23, B=rh_in_21_0_mapeado_2)  # -> a; inputs M: Mesh, B: Int32; same code as python_3_script_26
linear_array_20 = LinearArray(Geometry=python_3_script_66, Direction=negative_4, Count=cantidad_cajones)  # -> Geometry, Transform
linear_array_21 = LinearArray(Geometry=python_3_script_67, Direction=negative_4, Count=cantidad_cajones)  # -> Geometry, Transform
python_3_script_68 = Python3Script(
    M_In=[linear_array_20.Geometry, linear_array_21.Geometry],
    Lado_Color=rh_in_21_1_lado_color_2,
    Material_Mode=rh_in_21_2_sustrato_2)  # -> out, Color, Balance, MDF; inputs M_In: list of Mesh, Lado_Color: String, Material_Mode: String
# ---------- python_3_script_68: Python ----------
"""
=============================================================================
3BF Mesh Channel Separator v2.4 Fondos (Submesh UV & DfMA Aware)
Powered by 3dBimFab
=============================================================================
Entradas:
  - M_In: Mallas del fondo (Tree, List o Item). Type Hint: Mesh
  - Lado_Color: "Cara A" o "Cara B" (Value List).
  - Material_Mode: "MDF 1 Cara", "DD", "Crudo", "Balance" (Value List).
Salidas:
  - out: Consola de diagnóstico.
  - Color: Caras con acabado decorativo (Tono Fondo).
  - Balance: Contracara técnica (si aplica).
  - MDF: Cantos perimetrales y reverso en MDF crudo.
=============================================================================
"""
import Rhino
import rhinoscriptsyntax as rs

def extraer_malla_universal(c):
    if c is None: return None
    if isinstance(c, Rhino.Geometry.Mesh): return c
    if hasattr(c, "Faces") and hasattr(c, "Vertices"): return c
    val = getattr(c, "Value", c)
    if isinstance(val, Rhino.Geometry.Mesh): return val
    if hasattr(val, "Faces") and hasattr(val, "Vertices"): return val
    try:
        m = rs.coercemesh(c)
        if m: return m
    except:
        pass
    return None

def aplanar_candidatos(obj):
    res = []
    if obj is None: return res
    if hasattr(obj, "AllData"):
        for item in obj.AllData():
            m = extraer_malla_universal(item)
            if m: res.append(m)
        return res
    if hasattr(obj, "Branches"):
        for branch in obj.Branches:
            for item in branch:
                m = extraer_malla_universal(item)
                if m: res.append(m)
        return res
    if isinstance(obj, (list, tuple)):
        for item in obj:
            res.extend(aplanar_candidatos(item))
        return res
    m = extraer_malla_universal(obj)
    if m: res.append(m)
    return res

def parse_lado(val):
    s = str(val).lower().strip()
    if "b" in s: return "B"
    return "A"

def parse_material(val):
    s = str(val).lower().strip()
    if "dd" in s or "doble" in s or "2 cara" in s: return "DD"
    if "crudo" in s: return "CRUDO"
    if "balance" in s: return "BALANCE"
    return "MDF_1_CARA"

def crear_submalla_uv(mesh_origen, face_indices):
    """Extrae las caras indicadas preservando exactamente sus coordenadas de textura UV."""
    if not face_indices:
        return None
    sub = Rhino.Geometry.Mesh()
    vert_map = {}
    for fi in face_indices:
        f = mesh_origen.Faces[fi]
        idx_face = [f.A, f.B, f.C]
        if f.IsQuad:
            idx_face.append(f.D)

        nuevos_idx = []
        for vi in idx_face:
            if vi not in vert_map:
                new_vi = sub.Vertices.Add(mesh_origen.Vertices[vi])
                if mesh_origen.TextureCoordinates.Count > vi:
                    sub.TextureCoordinates.Add(mesh_origen.TextureCoordinates[vi])
                if mesh_origen.Normals.Count > vi:
                    sub.Normals.Add(mesh_origen.Normals[vi])
                vert_map[vi] = new_vi
            nuevos_idx.append(vert_map[vi])

        if len(nuevos_idx) == 3:
            sub.Faces.AddFace(nuevos_idx[0], nuevos_idx[1], nuevos_idx[2])
        elif len(nuevos_idx) == 4:
            sub.Faces.AddFace(nuevos_idx[0], nuevos_idx[1], nuevos_idx[2], nuevos_idx[3])

    sub.Normals.ComputeNormals()
    sub.Compact()
    return sub

# 1. Normalizar Entradas
lado_sel = parse_lado(Lado_Color if 'Lado_Color' in globals() and Lado_Color else "Cara A")
modo_mat = parse_material(Material_Mode if 'Material_Mode' in globals() and Material_Mode else "MDF 1 Cara")

# 2. Desempaquetar Mallas del Fondo
mallas_fondo = aplanar_candidatos(M_In if 'M_In' in globals() else None)

out_color = []
out_balance = []
out_mdf = []

for mesh in mallas_fondo:
    if not mesh or mesh.Faces.Count == 0:
        continue

    bb = mesh.GetBoundingBox(True)
    x0, x1 = bb.Min.X, bb.Max.X
    y0, y1 = bb.Min.Y, bb.Max.Y
    z0, z1 = bb.Min.Z, bb.Max.Z

    sx = max(0.1, x1 - x0)
    sy = max(0.1, y1 - y0)
    sz = max(0.1, z1 - z0)

    # Identificar el eje del espesor (en fondos casi siempre es Z)
    dims = [("X", sx), ("Y", sy), ("Z", sz)]
    dims.sort(key=lambda d: d[1])
    eje_esp = dims[0][0]
    espesor = dims[0][1]
    tol = max(0.3, espesor * 0.35)

    faces_A_idx = []
    faces_B_idx = []
    cantos_idx = []

    # Clasificar cada cara geométrica del sólido
    for fi in range(mesh.Faces.Count):
        f = mesh.Faces[fi]
        pts = [mesh.Vertices[f.A], mesh.Vertices[f.B], mesh.Vertices[f.C]]
        if f.IsQuad:
            pts.append(mesh.Vertices[f.D])

        cx = sum(p.X for p in pts) / len(pts)
        cy = sum(p.Y for p in pts) / len(pts)
        cz = sum(p.Z for p in pts) / len(pts)

        if eje_esp == "Z":
            if abs(cz - z1) < tol:
                faces_A_idx.append(fi)
            elif abs(cz - z0) < tol:
                faces_B_idx.append(fi)
            else:
                cantos_idx.append(fi)
        elif eje_esp == "Y":
            if abs(cy - y0) < tol:
                faces_A_idx.append(fi)
            elif abs(cy - y1) < tol:
                faces_B_idx.append(fi)
            else:
                cantos_idx.append(fi)
        else: # X
            if abs(cx - x1) < tol:
                faces_A_idx.append(fi)
            elif abs(cx - x0) < tol:
                faces_B_idx.append(fi)
            else:
                cantos_idx.append(fi)

    # 3. Lógica DfMA según Material_Mode y Lado_Color
    color_indices = []
    balance_indices = []
    mdf_indices = []

    if modo_mat == "DD":
        color_indices.extend(faces_A_idx)
        color_indices.extend(faces_B_idx)
        mdf_indices.extend(cantos_idx)
    elif modo_mat == "CRUDO":
        mdf_indices.extend(faces_A_idx)
        mdf_indices.extend(faces_B_idx)
        mdf_indices.extend(cantos_idx)
    elif modo_mat == "BALANCE":
        if lado_sel == "A":
            color_indices.extend(faces_A_idx)
            balance_indices.extend(faces_B_idx)
        else:
            color_indices.extend(faces_B_idx)
            balance_indices.extend(faces_A_idx)
        mdf_indices.extend(cantos_idx)
    else: # MDF_1_CARA (Estándar de Fábrica)
        if lado_sel == "A":
            color_indices.extend(faces_A_idx)
            mdf_indices.extend(faces_B_idx)
        else:
            color_indices.extend(faces_B_idx)
            mdf_indices.extend(faces_A_idx)
        mdf_indices.extend(cantos_idx)

    # 4. Generar las submallas UV independientes
    sub_color = crear_submalla_uv(mesh, color_indices)
    if sub_color: out_color.append(sub_color)

    sub_balance = crear_submalla_uv(mesh, balance_indices)
    if sub_balance: out_balance.append(sub_balance)

    sub_mdf = crear_submalla_uv(mesh, mdf_indices)
    if sub_mdf: out_mdf.append(sub_mdf)

# Asignar Salidas
Color = out_color
Balance = out_balance
MDF = out_mdf

print("Fondos: {} | Material: {} | Color: Cara {} -> Color={}, Balance={}, MDF={}".format(
    len(mallas_fondo), modo_mat, lado_sel, len(Color), len(Balance), len(MDF)
))
# ---------- end python_3_script_68 ----------
diagnostico_44 = Panel(python_3_script_68.out)
rh_out_mdf_peça_18 = Geometry(python_3_script_68.MDF)
rh_out_peça_18_b = Geometry(python_3_script_68.Balance)
# 18
rh_out_peça_18 = Geometry(python_3_script_68.Color)

# ---- group: Peça 17 Aparência
# 3BF Materializer v0.3
# 3BF Box Mapping v1.0
# 3BF Mesh Channel Separator v2.2
rh_in_20_0_mapeado = ValueList({"Longitudinal": 0, "Atravesada": 1}, selected="Longitudinal")
python_3_script_69 = Python3Script(Brep_In=stream_filter_13)  # -> out, Pieza_1, Pieza_2, Pieza_3, Pieza_4; inputs Brep_In: list of Brep; same code as python_3_script_12
mesh_brep_25 = MeshBrep(
    Brep=python_3_script_69.Pieza_1,
    Settings={GridMaxCount=0, GridMinCount=16, JaggedSeams=False, MaxEdgeLength=0, MinEdgeLength=0.0001, MinTolerance=0, Refine=True, RefineAngle=0, RelativeTolerance=0.65, SimplePlanes=True, Tolerance=0})
mesh_brep_26 = MeshBrep(
    Brep=python_3_script_69.Pieza_2,
    Settings={GridMaxCount=0, GridMinCount=16, JaggedSeams=False, MaxEdgeLength=0, MinEdgeLength=0.0001, MinTolerance=0, Refine=True, RefineAngle=0, RelativeTolerance=0.65, SimplePlanes=True, Tolerance=0})
mesh_brep_27 = MeshBrep(
    Brep=python_3_script_69.Pieza_3,
    Settings={GridMaxCount=0, GridMinCount=16, JaggedSeams=False, MaxEdgeLength=0, MinEdgeLength=0.0001, MinTolerance=0, Refine=True, RefineAngle=0, RelativeTolerance=0.65, SimplePlanes=True, Tolerance=0})
mesh_brep_28 = MeshBrep(
    Brep=python_3_script_69.Pieza_4,
    Settings={GridMaxCount=0, GridMinCount=16, JaggedSeams=False, MaxEdgeLength=0, MinEdgeLength=0.0001, MinTolerance=0, Refine=True, RefineAngle=0, RelativeTolerance=0.65, SimplePlanes=True, Tolerance=0})
rh_in_20_1_lado_balance = ValueList({"Cara A", "Cara B", "D/D"}, selected="Cara B")
rh_in_20_2_canto_frontal = ValueList({"Canto": 0, "MDP": 1}, selected="MDP")
rh_in_20_3_canto_trasero = ValueList({"Canto": 0, "MDP": 1}, selected="MDP")
rh_in_20_4_canto_izquierdo_arriba = ValueList({"Canto": 0, "MDP": 1}, selected="Canto")
rh_in_20_5_canto_derecho_abajo = ValueList({"Canto": 0, "MDP": 1}, selected="MDP")
diagnostico_45 = Panel(python_3_script_69.out)
mesh_join_25 = MeshJoin(Meshes=flatten(mesh_brep_25))
mesh_join_26 = MeshJoin(Meshes=flatten(mesh_brep_26))
mesh_join_27 = MeshJoin(Meshes=flatten(mesh_brep_27))
mesh_join_28 = MeshJoin(Meshes=flatten(mesh_brep_28))
python_3_script_70 = Python3Script(M=mesh_join_25, B=rh_in_20_0_mapeado)  # -> a; inputs M: Mesh, B: Int32; same code as python_3_script_13
python_3_script_71 = Python3Script(M=mesh_join_26, B=rh_in_20_0_mapeado)  # -> a; inputs M: Mesh, B: Int32; same code as python_3_script_13
python_3_script_72 = Python3Script(M=mesh_join_27, B=rh_in_20_0_mapeado)  # -> a; inputs M: Mesh, B: Int32; same code as python_3_script_13
python_3_script_73 = Python3Script(M=mesh_join_28, B=rh_in_20_0_mapeado)  # -> a; inputs M: Mesh, B: Int32; same code as python_3_script_13
linear_array_22 = LinearArray(
    Geometry=[python_3_script_70, python_3_script_71, python_3_script_72, python_3_script_73],
    Direction=negative_4,
    Count=cantidad_cajones)  # -> Geometry, Transform
python_3_script_74 = Python3Script(
    M_In=linear_array_22.Geometry,
    Balance_Mode=rh_in_20_1_lado_balance,
    Canto_1=rh_in_20_2_canto_frontal,
    Canto_2=rh_in_20_3_canto_trasero,
    Canto_3=rh_in_20_4_canto_izquierdo_arriba,
    Canto_4=rh_in_20_5_canto_derecho_abajo)  # -> out, Color, Balance, MDP; inputs M_In: list; same code as python_3_script_14
diagnostico_46 = Panel(python_3_script_74.out)
# RH_OUT:Descripciones: Peça 1 = Zocalo Frontal
# Peça 2 = Travezaño Entre Zocalos
# Peça 3 = Zocalo Posterior
# Peça 4 = Refuerzo Inferior Frontal
# Peça 5 = Refuerzo Inferior Posterior
# Peça 6 = Paral Central
# Peça 7 = Costado Izquierdo
# Peça 8 = Tapaluz Izquierdo
# Peça 9 = Refuerzo Posterior Izquierdo
# Peça 10 = Costado Derecho
# Peça 11 = Tapaluz Derecho
# Peça 12 = Refuerzo Posterior Derecho
# Peça 13 = Cubierta Superior
# Peça 14 = Reengrueses Laterales
# Peça 15 = Espaldar
# Peça 16 = Posterior de Cajon
# Peça 17 = Lateral de Cajon
# Peça 18 = Fondo de Cajon
# Peça 19 = Frente de Cajon
rh_out_mdp_peça_17 = Geometry(python_3_script_74.MDP)
rh_out_peça_17_b = Geometry(python_3_script_74.Balance)
# 17
rh_out_peça_17 = Geometry(python_3_script_74.Color)

# ---- group: Peça 7 Aparência
# 3BF Materializer v0.1
rh_in_10_1_lado_balance = ValueList({"Cara A", "Cara B", "D/D"}, selected="D/D")
rh_in_10_2_canto_frontal = ValueList({"Canto": 0, "MDP": 1}, selected="Canto")
rh_in_10_3_canto_trasero = ValueList({"Canto": 0, "MDP": 1}, selected="MDP")
rh_in_10_4canto_izquierdo_arriba = ValueList({"Canto": 0, "MDP": 1}, selected="MDP")
rh_in_10_5_canto_derecho_abajo = ValueList({"Canto": 0, "MDP": 1}, selected="MDP")
rh_in_10_0_mapeado = ValueList({"Longitudinal": 1, "Atravesada": 0}, selected="Longitudinal")
python_3_script_75 = Python3Script(
    Brep_In=solid_difference_12,
    Balance_Mode=rh_in_10_1_lado_balance,
    Canto_1=rh_in_10_2_canto_frontal,
    Canto_2=rh_in_10_3_canto_trasero,
    Canto_3=rh_in_10_4canto_izquierdo_arriba,
    Canto_4=rh_in_10_5_canto_derecho_abajo)  # -> Out, NURBS_Color, NURBS_Balance, NURBS_MDP, Info_Pieza; inputs Brep_In: Brep, Balance_Mode: String, Canto_1: String, Canto_2: String, Canto_3: String, Canto_4: String
# ---------- python_3_script_75: Python ----------
import Rhino

def parse_balance(val):
    s = str(val).lower().strip().replace('"', '').replace("'", "")
    if s in ["6", "d/d", "dyd", "doble", "ninguno", "ambas"] or "d/d" in s or "dyd" in s:
        return "DD"
    if s in ["5", "cara a", "a"] or (s.startswith("a") and len(s) <= 6):
        return "A"
    if s in ["4", "cara b", "b"] or (s.startswith("b") and len(s) <= 6):
        return "B"
    if "ambos" in s:
        return "AMBOS"
    return "B"

def parse_canto(val):
    s = str(val).lower().strip().replace('"', '').replace("'", "")
    if s in ["0", "0.0", "canto", "true", "si", "sí", "con canto"] or ("canto" in s and "sin" not in s):
        return True # Madera / Color
    if s in ["1", "1.0", "mdp", "false", "no", "sin canto"] or "mdp" in s or "sin" in s:
        return False # Crudo / MDP
    return True

def desglosar_pieza_real_nurbs(brep_in, balance_mode="Cara B", c1="Canto", c2="Canto", c3="Canto", c4="Canto"):
    if brep_in is None:
        return [], [], [], "Brep de entrada es nulo"

    # 1. Medir BoundingBox de la envolvente exterior
    bbox = brep_in.GetBoundingBox(True)
    x0, x1 = bbox.Min.X, bbox.Max.X
    y0, y1 = bbox.Min.Y, bbox.Max.Y
    z0, z1 = bbox.Min.Z, bbox.Max.Z

    sx = max(0.1, x1 - x0)
    sy = max(0.1, y1 - y0)
    sz = max(0.1, z1 - z0)
    min_dim = min(sx, sy, sz)

    # Tolerancia geométrica para detectar planos exteriores
    tol = max(0.2, min_dim * 0.15)

    faces_A = []
    faces_B = []
    faces_cantos = {1: [], 2: [], 3: [], 4: []}
    faces_mecanizados = []

    # 2. Clasificar cada cara real de la pieza
    for i in range(brep_in.Faces.Count):
        f = brep_in.Faces[i]
        u = f.Domain(0).Mid
        v = f.Domain(1).Mid
        pt = f.PointAt(u, v)
        n = f.NormalAt(u, v)
        n.Unitize()
        nurbs_face = f.DuplicateFace(False)

        # -------------------------------------------------------------
        # CASO 1: Tablero Horizontal (Cubiertas / Entrepaños - Espesor en Z)
        # -------------------------------------------------------------
        if min_dim == sz:
            tipo_str = "Horizontal (Cubierta)"
            # Cara A (+Z exterior)
            if n.Z > 0.8 and abs(pt.Z - z1) < tol:
                faces_A.append(nurbs_face)
            # Cara B (-Z exterior)
            elif n.Z < -0.8 and abs(pt.Z - z0) < tol:
                faces_B.append(nurbs_face)
            # Canto 1: Frontal (-Y exterior)
            elif n.Y < -0.8 and abs(pt.Y - y0) < tol:
                faces_cantos[1].append(nurbs_face)
            # Canto 2: Trasero (+Y exterior)
            elif n.Y > 0.8 and abs(pt.Y - y1) < tol:
                faces_cantos[2].append(nurbs_face)
            # Canto 3: Izquierdo (-X exterior)
            elif n.X < -0.8 and abs(pt.X - x0) < tol:
                faces_cantos[3].append(nurbs_face)
            # Canto 4: Derecho (+X exterior)
            elif n.X > 0.8 and abs(pt.X - x1) < tol:
                faces_cantos[4].append(nurbs_face)
            else:
                # Perforaciones, brocas, avellanados, cajas minifix
                faces_mecanizados.append(nurbs_face)

        # -------------------------------------------------------------
        # CASO 2: Tablero Vertical Lateral (Costados - Espesor en X)
        # -------------------------------------------------------------
        elif min_dim == sx:
            tipo_str = "Vertical Lateral (Costado)"
            if n.X > 0.8 and abs(pt.X - x1) < tol:
                faces_A.append(nurbs_face)
            elif n.X < -0.8 and abs(pt.X - x0) < tol:
                faces_B.append(nurbs_face)
            elif n.Y < -0.8 and abs(pt.Y - y0) < tol:
                faces_cantos[1].append(nurbs_face) # Frontal
            elif n.Y > 0.8 and abs(pt.Y - y1) < tol:
                faces_cantos[2].append(nurbs_face) # Trasero
            elif n.Z > 0.8 and abs(pt.Z - z1) < tol:
                faces_cantos[3].append(nurbs_face) # Superior
            elif n.Z < -0.8 and abs(pt.Z - z0) < tol:
                faces_cantos[4].append(nurbs_face) # Inferior
            else:
                faces_mecanizados.append(nurbs_face)

        # -------------------------------------------------------------
        # CASO 3: Tablero Vertical Frontal (Frentes / Puertas - Espesor en Y)
        # -------------------------------------------------------------
        else:
            tipo_str = "Vertical Frontal (Frente / Puerta)"
            if n.Y < -0.8 and abs(pt.Y - y0) < tol:
                faces_A.append(nurbs_face)
            elif n.Y > 0.8 and abs(pt.Y - y1) < tol:
                faces_B.append(nurbs_face)
            elif n.Z > 0.8 and abs(pt.Z - z1) < tol:
                faces_cantos[1].append(nurbs_face) # Superior
            elif n.Z < -0.8 and abs(pt.Z - z0) < tol:
                faces_cantos[2].append(nurbs_face) # Inferior
            elif n.X < -0.8 and abs(pt.X - x0) < tol:
                faces_cantos[3].append(nurbs_face) # Izquierdo
            elif n.X > 0.8 and abs(pt.X - x1) < tol:
                faces_cantos[4].append(nurbs_face) # Derecho
            else:
                faces_mecanizados.append(nurbs_face)

    # 3. Asignación de Caras Principales según Balance
    modo_b = parse_balance(balance_mode)
    nurbs_color = []
    nurbs_balance = []
    nurbs_mdp = []

    if modo_b == "DD": # Doble Decorativo (ambas a Color)
        nurbs_color.extend(faces_A)
        nurbs_color.extend(faces_B)
        diag_bal = "D/D (Ambas Caras Madera)"
    elif modo_b == "A": # Balance en Cara A
        nurbs_balance.extend(faces_A)
        nurbs_color.extend(faces_B)
        diag_bal = "Balance Cara A"
    elif modo_b == "B": # Balance en Cara B
        nurbs_color.extend(faces_A)
        nurbs_balance.extend(faces_B)
        diag_bal = "Balance Cara B"
    else:
        nurbs_balance.extend(faces_A)
        nurbs_balance.extend(faces_B)
        diag_bal = "Ambos Balance"

    # 4. Asignación de Cantos (1: Frontal, 2: Trasero, 3: Izquierdo, 4: Derecho)
    cantos_in = {
        1: parse_canto(c1),
        2: parse_canto(c2),
        3: parse_canto(c3),
        4: parse_canto(c4)
    }

    c_color_count = 0
    for num_canto, tiene_canto in cantos_in.items():
        if tiene_canto:
            nurbs_color.extend(faces_cantos[num_canto])
            c_color_count += len(faces_cantos[num_canto])
        else:
            nurbs_mdp.extend(faces_cantos[num_canto])

    # 5. INYECCIÓN CRÍTICA: Todos los Mecanizados van SIEMPRE a MDP
    nurbs_mdp.extend(faces_mecanizados)

    diag = "{0} | {1} | Total Caras: {2} (A={3}, B={4}, Cantos={5}, Mecanizados={6}) | Breps Salida -> Color: {7}, Balance: {8}, MDP: {9}".format(
        tipo_str, diag_bal, brep_in.Faces.Count,
        len(faces_A), len(faces_B), sum(len(v) for v in faces_cantos.values()), len(faces_mecanizados),
        len(nurbs_color), len(nurbs_balance), len(nurbs_mdp)
    )

    return nurbs_color, nurbs_balance, nurbs_mdp, diag


# Ejecución
n_col, n_bal, n_mdp, diag_txt = desglosar_pieza_real_nurbs(
    Brep_In,
    Balance_Mode if 'Balance_Mode' in locals() else "Cara B",
    Canto_1 if 'Canto_1' in locals() else "Canto",
    Canto_2 if 'Canto_2' in locals() else "Canto",
    Canto_3 if 'Canto_3' in locals() else "Canto",
    Canto_4 if 'Canto_4' in locals() else "Canto"
)

# Salidas multinombre
NURBS_Color = n_col
Nurbs_Color = n_col
nurbs_color = n_col
Mesh_Color = n_col

NURBS_Balance = n_bal
Nurbs_Balance = n_bal
nurbs_balance = n_bal
Mesh_Balance = n_bal

NURBS_MDP = n_mdp
Nurbs_MDP = n_mdp
nurbs_mdp = n_mdp
Mesh_MDP = n_mdp

Info_Pieza = diag_txt
info_pieza = diag_txt
# ---------- end python_3_script_75 ----------
mesh_brep_29 = MeshBrep(
    Brep=python_3_script_75.NURBS_Color,
    Settings={GridMaxCount=0, GridMinCount=16, JaggedSeams=False, MaxEdgeLength=0, MinEdgeLength=0.0001, MinTolerance=0, Refine=True, RefineAngle=0, RelativeTolerance=0.65, SimplePlanes=True, Tolerance=0})
mesh_brep_30 = MeshBrep(
    Brep=python_3_script_75.NURBS_Balance,
    Settings={GridMaxCount=0, GridMinCount=16, JaggedSeams=False, MaxEdgeLength=0, MinEdgeLength=0.0001, MinTolerance=0, Refine=True, RefineAngle=0, RelativeTolerance=0.65, SimplePlanes=True, Tolerance=0})
mesh_brep_31 = MeshBrep(
    Brep=python_3_script_75.NURBS_MDP,
    Settings={GridMaxCount=0, GridMinCount=16, JaggedSeams=False, MaxEdgeLength=0, MinEdgeLength=0.0001, MinTolerance=0, Refine=True, RefineAngle=0, RelativeTolerance=0.65, SimplePlanes=True, Tolerance=0})
diagnostico_47 = Panel(python_3_script_75.Info_Pieza)
mesh_join_29 = MeshJoin(Meshes=flatten(mesh_brep_29))
mesh_join_30 = MeshJoin(Meshes=flatten(mesh_brep_30))
mesh_join_31 = MeshJoin(Meshes=flatten(mesh_brep_31))
python_3_script_76 = Python3Script(M=mesh_join_29, B=rh_in_10_0_mapeado)  # -> a; inputs M: Mesh, B: Int32
# ---------- python_3_script_76: Python ----------
import Rhino

def aplicar_box_mapping_profesional(mesh_in, modo_veta=0, escala_caja_mm=600.0):
    if mesh_in is None:
        return None
        
    mesh = mesh_in.DuplicateMesh() if hasattr(mesh_in, "DuplicateMesh") else mesh_in
    if not isinstance(mesh, Rhino.Geometry.Mesh):
        return mesh_in

    # 1. Desoldar aristas vivas para separar las 6 caras
    mesh.Unweld(0.0, True)
    mesh.Normals.ComputeNormals()
    mesh.TextureCoordinates.Clear()

    # 2. Medir BoundingBox real de la pieza en mm
    bbox = mesh.GetBoundingBox(True)
    sx = max(1.0, bbox.Max.X - bbox.Min.X)
    sy = max(1.0, bbox.Max.Y - bbox.Min.Y)
    sz = max(1.0, bbox.Max.Z - bbox.Min.Z)

    # Identificar el espesor (menor dimensión, ej: 15 mm)
    min_dim = min(sx, sy, sz)

    # 3. Detectar si la cara principal es Atravesada (1) o Longitudinal (0)
    es_atravesada = False
    if isinstance(modo_veta, str):
        es_atravesada = "atravesad" in modo_veta.lower() or modo_veta in ["1", "3", "5"]
    elif isinstance(modo_veta, (int, float)):
        es_atravesada = int(modo_veta) in [1, 3, 5]

    escala = float(escala_caja_mm)

    # 4. Asignar UVs: Las caras rotan con el selector, los 4 cantos SIEMPRE corren a lo largo del borde
    for idx in range(mesh.Vertices.Count):
        v = mesh.Vertices[idx]
        n = mesh.Normals[idx] if idx < mesh.Normals.Count else Rhino.Geometry.Vector3f(0, 0, 1)
        
        lx = v.X - bbox.Min.X
        ly = v.Y - bbox.Min.Y
        lz = v.Z - bbox.Min.Z
        
        nx, ny, nz = abs(n.X), abs(n.Y), abs(n.Z)

        # -------------------------------------------------------------
        # CASO 1: Tablero Horizontal (Cubiertas, Entrepaños - Espesor en Z)
        # -------------------------------------------------------------
        if min_dim == sz:
            if nz >= nx and nz >= ny:
                # Caras Principales (Superior / Inferior) -> Responde a Longitudinal / Atravesada
                u = ly / escala if es_atravesada else lx / escala
                v_coord = lx / escala if es_atravesada else ly / escala
            elif ny >= nx and ny >= nz:
                # Canto Frontal / Trasero -> Veta corre a lo largo del ancho X
                u = lx / escala
                v_coord = lz / escala
            else:
                # Canto Lateral Izq / Der -> Veta corre a lo largo de la profundidad Y
                u = ly / escala
                v_coord = lz / escala

        # -------------------------------------------------------------
        # CASO 2: Tablero Vertical Lateral (Costados, Laterales - Espesor en X)
        # -------------------------------------------------------------
        elif min_dim == sx:
            if nx >= ny and nx >= nz:
                # Caras Principales (Caras exteriores e interiores)
                u = lz / escala if es_atravesada else ly / escala
                v_coord = ly / escala if es_atravesada else lz / escala
            elif ny >= nx and ny >= nz:
                # Canto Frontal / Trasero -> Veta corre a lo largo de la altura Z
                u = lz / escala
                v_coord = lx / escala
            else:
                # Canto Superior / Inferior -> Veta corre a lo largo de la profundidad Y
                u = ly / escala
                v_coord = lx / escala

        # -------------------------------------------------------------
        # CASO 3: Tablero Vertical Frontal (Frentes de Cajón, Tapa Luz, Puertas - Espesor en Y)
        # -------------------------------------------------------------
        else:
            if ny >= nx and ny >= nz:
                # Caras Principales (Frente y Trasera) -> Responde a Longitudinal / Atravesada
                u = lz / escala if es_atravesada else lx / escala
                v_coord = lx / escala if es_atravesada else lz / escala
            elif nz >= nx and nz >= ny:
                # Canto Superior / Inferior -> Veta corre a lo largo del ancho X
                u = lx / escala
                v_coord = ly / escala
            else:
                # Canto Lateral Izq / Der -> Veta corre a lo largo de la altura Z
                u = lz / escala
                v_coord = ly / escala

        mesh.TextureCoordinates.Add(float(u), float(v_coord))
        
    return mesh


if isinstance(M, list):
    resultado = [aplicar_box_mapping_profesional(item, B, 600.0) for item in M if item is not None]
else:
    resultado = aplicar_box_mapping_profesional(M, B, 600.0)

a = resultado
# ---------- end python_3_script_76 ----------
python_3_script_77 = Python3Script(M=mesh_join_30, B=rh_in_10_0_mapeado)  # -> a; inputs M: Mesh, B: Int32; same code as python_3_script_76
python_3_script_78 = Python3Script(M=mesh_join_31, B=rh_in_10_0_mapeado)  # -> a; inputs M: Mesh, B: Int32; same code as python_3_script_76
rh_out_mdp_peça_7 = Geometry(python_3_script_78)
rh_out_peça_7_b = Geometry(python_3_script_77)
# 7
rh_out_peça_7 = Geometry(python_3_script_76)

# ---- group: Peça 19 Aparência
# 3BF Materializer v0.2
# 3BF Box Mapping  v1.0
rh_in_22_1_lado_balance = ValueList({"Cara A", "Cara B", "D/D"}, selected="Cara B")
rh_in_22_2_canto_frontal = ValueList({"Canto": 0, "MDP": 1}, selected="Canto")
rh_in_22_3_canto_trasero = ValueList({"Canto": 0, "MDP": 1}, selected="Canto")
rh_in_22_4canto_izquierdo_arriba = ValueList({"Canto": 0, "MDP": 1}, selected="Canto")
rh_in_22_5_canto_derecho_abajo = ValueList({"Canto": 0, "MDP": 1}, selected="Canto")
rh_in_22_0_mapeado = ValueList({"Longitudinal": 0, "Atravesada": 1}, selected="Longitudinal")
python_3_script_79 = Python3Script(
    Brep_In=move_136.Geometry,
    Balance_Mode=rh_in_22_1_lado_balance,
    Canto_1=rh_in_22_2_canto_frontal,
    Canto_2=rh_in_22_3_canto_trasero,
    Canto_3=rh_in_22_4canto_izquierdo_arriba,
    Canto_4=rh_in_22_5_canto_derecho_abajo)  # -> Out, NURBS_Color, NURBS_Balance, NURBS_MDP, Info_Pieza; inputs Brep_In: Brep, Balance_Mode: String, Canto_1: String, Canto_2: String, Canto_3: String, Canto_4: String
# ---------- python_3_script_79: Python ----------
"""
3BF Materializer v0.2
Motor DfMA de Desglose de Caras Paramétricas para Manufactura Digital
Soporta: Caras Planas Ortogonales, Chaflanes/Biseles a 45° (Tiradores Integrados) y Mecanizados CNC
Autor: Mario Mojica & Antigravity
"""

import Rhino

def parse_balance(val):
    s = str(val).lower().strip().replace('"', '').replace("'", "")
    if s in ["6", "d/d", "dyd", "doble", "ninguno", "ambas"] or "d/d" in s or "dyd" in s:
        return "DD"
    if s in ["5", "cara a", "a"] or (s.startswith("a") and len(s) <= 6):
        return "A"
    if s in ["4", "cara b", "b"] or (s.startswith("b") and len(s) <= 6):
        return "B"
    if "ambos" in s:
        return "AMBOS"
    return "B"

def parse_canto(val):
    s = str(val).lower().strip().replace('"', '').replace("'", "")
    if s in ["0", "0.0", "canto", "true", "si", "sí", "con canto"] or ("canto" in s and "sin" not in s):
        return True # Madera / Color
    if s in ["1", "1.0", "mdp", "false", "no", "sin canto"] or "mdp" in s or "sin" in s:
        return False # Crudo / MDP
    return True

def desglosar_pieza_real_nurbs(brep_in, balance_mode="Cara B", c1="Canto", c2="Canto", c3="Canto", c4="Canto"):
    if brep_in is None:
        return [], [], [], "Brep de entrada es nulo"

    # 1. Medir BoundingBox de la envolvente exterior
    bbox = brep_in.GetBoundingBox(True)
    x0, x1 = bbox.Min.X, bbox.Max.X
    y0, y1 = bbox.Min.Y, bbox.Max.Y
    z0, z1 = bbox.Min.Z, bbox.Max.Z

    sx = max(0.1, x1 - x0)
    sy = max(0.1, y1 - y0)
    sz = max(0.1, z1 - z0)
    min_dim = min(sx, sy, sz)

    # Tolerancia para planos principales y zona de influencia de biseles/chaflanes
    tol = max(0.2, min_dim * 0.15)
    zona_bisel = max(tol * 2.5, min_dim * 2.5)

    faces_A = []
    faces_B = []
    faces_cantos = {1: [], 2: [], 3: [], 4: []}
    faces_mecanizados = []

    # 2. Clasificar cada cara real de la pieza
    for i in range(brep_in.Faces.Count):
        f = brep_in.Faces[i]
        u = (f.Domain(0).T0 + f.Domain(0).T1) * 0.5
        v = (f.Domain(1).T0 + f.Domain(1).T1) * 0.5
        pt = f.PointAt(u, v)
        n = f.NormalAt(u, v)
        n.Unitize()
        nurbs_face = f.DuplicateFace(False)

        # -------------------------------------------------------------
        # CASO 1: Tablero Horizontal (Cubiertas / Entrepaños - Espesor en Z)
        # -------------------------------------------------------------
        if min_dim == sz:
            tipo_str = "Horizontal (Cubierta/Entrepaño)"
            # Cara A (+Z exterior)
            if n.Z > 0.85 and abs(pt.Z - z1) < tol:
                faces_A.append(nurbs_face)
            # Cara B (-Z exterior)
            elif n.Z < -0.85 and abs(pt.Z - z0) < tol:
                faces_B.append(nurbs_face)
            # Canto 1: Frontal (-Y exterior, plano o chaflán)
            elif n.Y < -0.20 and (pt.Y - y0) < zona_bisel:
                faces_cantos[1].append(nurbs_face)
            # Canto 2: Trasero (+Y exterior, plano o chaflán)
            elif n.Y > 0.20 and (y1 - pt.Y) < zona_bisel:
                faces_cantos[2].append(nurbs_face)
            # Canto 3: Izquierdo (-X exterior, plano o chaflán)
            elif n.X < -0.20 and (pt.X - x0) < zona_bisel:
                faces_cantos[3].append(nurbs_face)
            # Canto 4: Derecho (+X exterior, plano o chaflán)
            elif n.X > 0.20 and (x1 - pt.X) < zona_bisel:
                faces_cantos[4].append(nurbs_face)
            else:
                faces_mecanizados.append(nurbs_face)

        # -------------------------------------------------------------
        # CASO 2: Tablero Vertical Lateral (Costados / Parales - Espesor en X)
        # -------------------------------------------------------------
        elif min_dim == sx:
            tipo_str = "Vertical Lateral (Costado/Paral)"
            # Cara A (+X exterior)
            if n.X > 0.85 and abs(pt.X - x1) < tol:
                faces_A.append(nurbs_face)
            # Cara B (-X exterior)
            elif n.X < -0.85 and abs(pt.X - x0) < tol:
                faces_B.append(nurbs_face)
            # Canto 1: Frontal (-Y exterior, plano o chaflán)
            elif n.Y < -0.20 and (pt.Y - y0) < zona_bisel:
                faces_cantos[1].append(nurbs_face)
            # Canto 2: Trasero (+Y exterior, plano o chaflán)
            elif n.Y > 0.20 and (y1 - pt.Y) < zona_bisel:
                faces_cantos[2].append(nurbs_face)
            # Canto 3: Superior (+Z exterior, plano o chaflán)
            elif n.Z > 0.20 and (z1 - pt.Z) < zona_bisel:
                faces_cantos[3].append(nurbs_face)
            # Canto 4: Inferior (-Z exterior, plano o chaflán)
            elif n.Z < -0.20 and (pt.Z - z0) < zona_bisel:
                faces_cantos[4].append(nurbs_face)
            else:
                faces_mecanizados.append(nurbs_face)

        # -------------------------------------------------------------
        # CASO 3: Tablero Vertical Frontal (Frentes / Puertas - Espesor en Y)
        # -------------------------------------------------------------
        else:
            tipo_str = "Vertical Frontal (Frente / Puerta)"
            # Cara A Frontal Delantera (-Y exterior visible)
            if n.Y < -0.85 and abs(pt.Y - y0) < tol:
                faces_A.append(nurbs_face)
            # Cara B Trasera (+Y interior)
            elif n.Y > 0.85 and abs(pt.Y - y1) < tol:
                faces_B.append(nurbs_face)
            # Canto 1: Superior (Plano Y Bisel/Tirador Diagonal a 45° en la zona alta)
            elif n.Z > 0.20 and (z1 - pt.Z) < zona_bisel:
                faces_cantos[1].append(nurbs_face)
            # Canto 2: Inferior (Plano o Bisel en la zona baja)
            elif n.Z < -0.20 and (pt.Z - z0) < zona_bisel:
                faces_cantos[2].append(nurbs_face)
            # Canto 3: Izquierdo (Plano o Bisel en lateral izquierdo)
            elif n.X < -0.20 and (pt.X - x0) < zona_bisel:
                faces_cantos[3].append(nurbs_face)
            # Canto 4: Derecho (Plano o Bisel en lateral derecho)
            elif n.X > 0.20 and (x1 - pt.X) < zona_bisel:
                faces_cantos[4].append(nurbs_face)
            else:
                # Perforaciones cilíndricas, cajas de minifix y ranuras de fondo
                faces_mecanizados.append(nurbs_face)

    # 3. Asignación de Caras Principales según Balance
    modo_b = parse_balance(balance_mode)
    nurbs_color = []
    nurbs_balance = []
    nurbs_mdp = []

    if modo_b == "DD": # Doble Decorativo (ambas a Color)
        nurbs_color.extend(faces_A)
        nurbs_color.extend(faces_B)
        diag_bal = "D/D (Ambas Caras Madera)"
    elif modo_b == "A": # Balance en Cara A
        nurbs_balance.extend(faces_A)
        nurbs_color.extend(faces_B)
        diag_bal = "Balance Cara A"
    elif modo_b == "B": # Balance en Cara B
        nurbs_color.extend(faces_A)
        nurbs_balance.extend(faces_B)
        diag_bal = "Balance Cara B"
    else:
        nurbs_balance.extend(faces_A)
        nurbs_balance.extend(faces_B)
        diag_bal = "Ambos Balance"

    # 4. Asignación de Cantos (1: Canto 1, 2: Canto 2, 3: Canto 3, 4: Canto 4)
    cantos_in = {
        1: parse_canto(c1),
        2: parse_canto(c2),
        3: parse_canto(c3),
        4: parse_canto(c4)
    }

    c_color_count = 0
    for num_canto, tiene_canto in cantos_in.items():
        if tiene_canto:
            nurbs_color.extend(faces_cantos[num_canto])
            c_color_count += len(faces_cantos[num_canto])
        else:
            nurbs_mdp.extend(faces_cantos[num_canto])

    # 5. INYECCIÓN DfMA: Mecanizados internos (taladros, ranuras) van SIEMPRE a MDP
    nurbs_mdp.extend(faces_mecanizados)

    diag = "{0} | {1} | Total Caras: {2} (A={3}, B={4}, Cantos={5}, Mecanizados={6}) | Breps Salida -> Color: {7}, Balance: {8}, MDP: {9}".format(
        tipo_str, diag_bal, brep_in.Faces.Count,
        len(faces_A), len(faces_B), sum(len(v) for v in faces_cantos.values()), len(faces_mecanizados),
        len(nurbs_color), len(nurbs_balance), len(nurbs_mdp)
    )

    return nurbs_color, nurbs_balance, nurbs_mdp, diag


# Ejecución
n_col, n_bal, n_mdp, diag_txt = desglosar_pieza_real_nurbs(
    Brep_In,
    Balance_Mode if 'Balance_Mode' in locals() else "Cara B",
    Canto_1 if 'Canto_1' in locals() else "Canto",
    Canto_2 if 'Canto_2' in locals() else "Canto",
    Canto_3 if 'Canto_3' in locals() else "Canto",
    Canto_4 if 'Canto_4' in locals() else "Canto"
)

# Salidas multinombre
NURBS_Color = n_col
Nurbs_Color = n_col
nurbs_color = n_col
Mesh_Color = n_col

NURBS_Balance = n_bal
Nurbs_Balance = n_bal
nurbs_balance = n_bal
Mesh_Balance = n_bal

NURBS_MDP = n_mdp
Nurbs_MDP = n_mdp
nurbs_mdp = n_mdp
Mesh_MDP = n_mdp

Info_Pieza = diag_txt
# ---------- end python_3_script_79 ----------
diagnostico_48 = Panel(python_3_script_79.Info_Pieza)
split_tree = SplitTree(Data=python_3_script_79.NURBS_Balance, Masks=flatten("{*;0}"))  # -> Positive, Negative
split_tree_2 = SplitTree(Data=python_3_script_79.NURBS_Color, Masks=flatten("{*;0}"))  # -> Positive, Negative
split_tree_3 = SplitTree(Data=python_3_script_79.NURBS_MDP, Masks=flatten("{*;0}"))  # -> Positive, Negative
mesh_brep_32 = MeshBrep(
    Brep=split_tree_2.Positive,
    Settings={GridMaxCount=0, GridMinCount=16, JaggedSeams=False, MaxEdgeLength=0, MinEdgeLength=0.0001, MinTolerance=0, Refine=True, RefineAngle=0, RelativeTolerance=0.65, SimplePlanes=True, Tolerance=0})
mesh_brep_33 = MeshBrep(
    Brep=split_tree_2.Negative,
    Settings={GridMaxCount=0, GridMinCount=16, JaggedSeams=False, MaxEdgeLength=0, MinEdgeLength=0.0001, MinTolerance=0, Refine=True, RefineAngle=0, RelativeTolerance=0.65, SimplePlanes=True, Tolerance=0})
mesh_brep_34 = MeshBrep(
    Brep=split_tree.Positive,
    Settings={GridMaxCount=0, GridMinCount=16, JaggedSeams=False, MaxEdgeLength=0, MinEdgeLength=0.0001, MinTolerance=0, Refine=True, RefineAngle=0, RelativeTolerance=0.65, SimplePlanes=True, Tolerance=0})
mesh_brep_35 = MeshBrep(
    Brep=split_tree.Negative,
    Settings={GridMaxCount=0, GridMinCount=16, JaggedSeams=False, MaxEdgeLength=0, MinEdgeLength=0.0001, MinTolerance=0, Refine=True, RefineAngle=0, RelativeTolerance=0.65, SimplePlanes=True, Tolerance=0})
mesh_brep_36 = MeshBrep(
    Brep=split_tree_3.Positive,
    Settings={GridMaxCount=0, GridMinCount=16, JaggedSeams=False, MaxEdgeLength=0, MinEdgeLength=0.0001, MinTolerance=0, Refine=True, RefineAngle=0, RelativeTolerance=0.65, SimplePlanes=True, Tolerance=0})
mesh_brep_37 = MeshBrep(
    Brep=split_tree_3.Negative,
    Settings={GridMaxCount=0, GridMinCount=16, JaggedSeams=False, MaxEdgeLength=0, MinEdgeLength=0.0001, MinTolerance=0, Refine=True, RefineAngle=0, RelativeTolerance=0.65, SimplePlanes=True, Tolerance=0})
mesh_join_32 = MeshJoin(Meshes=flatten(mesh_brep_32))
mesh_join_33 = MeshJoin(Meshes=flatten(mesh_brep_33))
mesh_join_34 = MeshJoin(Meshes=flatten(mesh_brep_34))
mesh_join_35 = MeshJoin(Meshes=flatten(mesh_brep_35))
mesh_join_36 = MeshJoin(Meshes=flatten(mesh_brep_36))
mesh_join_37 = MeshJoin(Meshes=flatten(mesh_brep_37))
python_3_script_80 = Python3Script(M=mesh_join_32, B=rh_in_22_0_mapeado)  # -> a; inputs M: Mesh, B: Int32; same code as python_3_script_13
python_3_script_81 = Python3Script(M=mesh_join_33, B=rh_in_22_0_mapeado)  # -> a; inputs M: Mesh, B: Int32; same code as python_3_script_13
python_3_script_82 = Python3Script(M=mesh_join_34, B=rh_in_22_0_mapeado)  # -> a; inputs M: Mesh, B: Int32; same code as python_3_script_13
python_3_script_83 = Python3Script(M=mesh_join_35, B=rh_in_22_0_mapeado)  # -> a; inputs M: Mesh, B: Int32; same code as python_3_script_13
python_3_script_84 = Python3Script(M=mesh_join_36, B=rh_in_22_0_mapeado)  # -> a; inputs M: Mesh, B: Int32; same code as python_3_script_13
python_3_script_85 = Python3Script(M=mesh_join_37, B=rh_in_22_0_mapeado)  # -> a; inputs M: Mesh, B: Int32; same code as python_3_script_13
linear_array_23 = LinearArray(Geometry=[python_3_script_84, python_3_script_85], Direction=negative_4, Count=cantidad_cajones)  # -> Geometry, Transform
linear_array_24 = LinearArray(Geometry=[python_3_script_82, python_3_script_83], Direction=negative_4, Count=cantidad_cajones)  # -> Geometry, Transform
linear_array_25 = LinearArray(Geometry=[python_3_script_80, python_3_script_81], Direction=negative_4, Count=cantidad_cajones)  # -> Geometry, Transform
rh_out_peça_19_b = Geometry(linear_array_24.Geometry)
rh_out_mdp_peça_19 = Geometry(linear_array_23.Geometry)
# 19
rh_out_peça_19 = Geometry(linear_array_25.Geometry)

# ---- group: Peça 6 Aparência
# 3BF Materializer v0.2.1
rh_in_09_4_canto_izquierdo_arriba = ValueList({"Canto": 0, "MDP": 1}, selected="MDP")
rh_in_09_1_lado_balance = ValueList({"Cara A", "Cara B", "D/D"}, selected="D/D")
rh_in_09_2_canto_frontal = ValueList({"Canto": 0, "MDP": 1}, selected="Canto")
rh_in_09_3_canto_trasero = ValueList({"Canto": 0, "MDP": 1}, selected="MDP")
rh_in_09_5_canto_derecho_abajo = ValueList({"Canto": 0, "MDP": 1}, selected="MDP")
rh_in_09_0_mapeado = ValueList({"Longitudinal": 1, "Atravesada": 0}, selected="Longitudinal")
python_3_script_86 = Python3Script(
    Brep_In=solid_difference_10,
    Balance_Mode=rh_in_09_1_lado_balance,
    Canto_1=rh_in_09_2_canto_frontal,
    Canto_2=rh_in_09_3_canto_trasero,
    Canto_3=rh_in_09_4_canto_izquierdo_arriba,
    Canto_4=rh_in_09_5_canto_derecho_abajo)  # -> Out, NURBS_Color, NURBS_Balance, NURBS_MDP, Info_Pieza; inputs Brep_In: Brep, Balance_Mode: String, Canto_1: String, Canto_2: String, Canto_3: String, Canto_4: String; same code as python_3_script_41
mesh_brep_38 = MeshBrep(
    Brep=python_3_script_86.NURBS_Color,
    Settings={GridMaxCount=0, GridMinCount=16, JaggedSeams=False, MaxEdgeLength=0, MinEdgeLength=0.0001, MinTolerance=0, Refine=True, RefineAngle=0, RelativeTolerance=0.65, SimplePlanes=True, Tolerance=0})
mesh_brep_39 = MeshBrep(
    Brep=python_3_script_86.NURBS_Balance,
    Settings={GridMaxCount=0, GridMinCount=16, JaggedSeams=False, MaxEdgeLength=0, MinEdgeLength=0.0001, MinTolerance=0, Refine=True, RefineAngle=0, RelativeTolerance=0.65, SimplePlanes=True, Tolerance=0})
mesh_brep_40 = MeshBrep(
    Brep=python_3_script_86.NURBS_MDP,
    Settings={GridMaxCount=0, GridMinCount=16, JaggedSeams=False, MaxEdgeLength=0, MinEdgeLength=0.0001, MinTolerance=0, Refine=True, RefineAngle=0, RelativeTolerance=0.65, SimplePlanes=True, Tolerance=0})
diagnostico_49 = Panel(python_3_script_86.Info_Pieza)
mesh_join_38 = MeshJoin(Meshes=flatten(mesh_brep_38))
mesh_join_39 = MeshJoin(Meshes=flatten(mesh_brep_39))
mesh_join_40 = MeshJoin(Meshes=flatten(mesh_brep_40))
python_3_script_87 = Python3Script(M=mesh_join_38, B=rh_in_09_0_mapeado)  # -> a; inputs M: Mesh, B: Int32; same code as python_3_script_76
python_3_script_88 = Python3Script(M=mesh_join_39, B=rh_in_09_0_mapeado)  # -> a; inputs M: Mesh, B: Int32; same code as python_3_script_76
python_3_script_89 = Python3Script(M=mesh_join_40, B=rh_in_09_0_mapeado)  # -> a; inputs M: Mesh, B: Int32; same code as python_3_script_76
rh_out_mdp_peça_6 = Geometry(python_3_script_89)
rh_out_peça_6_b = Geometry(python_3_script_88)
# 6
rh_out_peça_6 = Geometry(python_3_script_87)

# ---- group: Peça 10 Aparência
# 3BF Materializer v0.1
rh_in_13_1_lado_balance = ValueList({"Cara A", "Cara B", "D/D"}, selected="D/D")
rh_in_13_2_canto_frontal = ValueList({"Canto": 0, "MDP": 1}, selected="Canto")
rh_in_13_3_canto_trasero = ValueList({"Canto": 0, "MDP": 1}, selected="MDP")
rh_in_13_4canto_izquierdo_arriba = ValueList({"Canto": 0, "MDP": 1}, selected="MDP")
rh_in_13_5_canto_derecho_abajo = ValueList({"Canto": 0, "MDP": 1}, selected="MDP")
rh_in_13_0_mapeado = ValueList({"Longitudinal": 1, "Atravesada": 0}, selected="Longitudinal")
python_3_script_90 = Python3Script(
    Brep_In=solid_difference_11,
    Balance_Mode=rh_in_13_1_lado_balance,
    Canto_1=rh_in_13_2_canto_frontal,
    Canto_2=rh_in_13_3_canto_trasero,
    Canto_3=rh_in_13_4canto_izquierdo_arriba,
    Canto_4=rh_in_13_5_canto_derecho_abajo)  # -> Out, NURBS_Color, NURBS_Balance, NURBS_MDP, Info_Pieza; inputs Brep_In: Brep, Balance_Mode: String, Canto_1: String, Canto_2: String, Canto_3: String, Canto_4: String; same code as python_3_script_75
mesh_brep_41 = MeshBrep(
    Brep=python_3_script_90.NURBS_Color,
    Settings={GridMaxCount=0, GridMinCount=16, JaggedSeams=False, MaxEdgeLength=0, MinEdgeLength=0.0001, MinTolerance=0, Refine=True, RefineAngle=0, RelativeTolerance=0.65, SimplePlanes=True, Tolerance=0})
mesh_brep_42 = MeshBrep(
    Brep=python_3_script_90.NURBS_Balance,
    Settings={GridMaxCount=0, GridMinCount=16, JaggedSeams=False, MaxEdgeLength=0, MinEdgeLength=0.0001, MinTolerance=0, Refine=True, RefineAngle=0, RelativeTolerance=0.65, SimplePlanes=True, Tolerance=0})
mesh_brep_43 = MeshBrep(
    Brep=python_3_script_90.NURBS_MDP,
    Settings={GridMaxCount=0, GridMinCount=16, JaggedSeams=False, MaxEdgeLength=0, MinEdgeLength=0.0001, MinTolerance=0, Refine=True, RefineAngle=0, RelativeTolerance=0.65, SimplePlanes=True, Tolerance=0})
diagnostico_50 = Panel(python_3_script_90.Info_Pieza)
mesh_join_41 = MeshJoin(Meshes=flatten(mesh_brep_41))
mesh_join_42 = MeshJoin(Meshes=flatten(mesh_brep_42))
mesh_join_43 = MeshJoin(Meshes=flatten(mesh_brep_43))
python_3_script_91 = Python3Script(M=mesh_join_41, B=rh_in_13_0_mapeado)  # -> a; inputs M: Mesh, B: Int32; same code as python_3_script_76
python_3_script_92 = Python3Script(M=mesh_join_42, B=rh_in_13_0_mapeado)  # -> a; inputs M: Mesh, B: Int32; same code as python_3_script_76
python_3_script_93 = Python3Script(M=mesh_join_43, B=rh_in_13_0_mapeado)  # -> a; inputs M: Mesh, B: Int32; same code as python_3_script_76
rh_out_peça_10_b = Geometry(python_3_script_92)
# 10
rh_out_peça_10 = Geometry(python_3_script_91)
rh_out_mdp_peça_10 = Geometry(python_3_script_93)

# ----
# Tarugo x0,x1
# 3BF Mecanizador V0.5
orientacion_mecanizado_25 = ValueList({"x0,x1": 1, "x1,x0": 2, "y0,y1": 3, "y1,y0": 4, "z0,z1": 5, "z1,z0": 6}, selected="y0,y1")
giro_mecanizado_25 = ValueList({"Frente": 0, "Arriba": 90, "Pesterior": 180, "Abajo": 270}, selected="Frente")
mecanizados_38 = Brep(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)
point_59 = Point(Point(-590.8767532, 0, 0))
cavilha_20 = Mesh(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)

mirror_26 = Mirror(Geometry=brep_8, Plane=yz_plane_3)  # -> Geometry, Transform

# ---- group: Posterior
solid_difference_13 = SolidDifference(
    BrepsA=box_2pt_18,
    BrepsB=flatten([brep_8, box_2pt_19, mirror_26.Geometry, mirror_14.Geometry, linear_array_13.Geometry, mirror_16.Geometry]))

# ----
move_147 = Move(Geometry=solid_difference_13, Motion=vector_2pt_7.Vector)  # -> Geometry, Transform
stream_filter_15 = StreamFilter(Gate=expression_2, Stream1=solid_difference_13, Stream2=[move_147.Geometry, solid_difference_13])

# ---- group: Peça 17 Aparência
# 3BF Materializer v0.3
# 3BF Box Mapping v1.0
# 3BF Mesh Channel Separator v2.2
rh_in_19_0_mapeado_2 = ValueList({"Longitudinal": 0, "Atravesada": 1}, selected="Longitudinal")
python_3_script_94 = Python3Script(Brep_In=stream_filter_15)  # -> out, Pieza_1, Pieza_2, Pieza_3, Pieza_4; inputs Brep_In: list of Brep; same code as python_3_script_12
mesh_brep_44 = MeshBrep(
    Brep=python_3_script_94.Pieza_1,
    Settings={GridMaxCount=0, GridMinCount=16, JaggedSeams=False, MaxEdgeLength=0, MinEdgeLength=0.0001, MinTolerance=0, Refine=True, RefineAngle=0, RelativeTolerance=0.65, SimplePlanes=True, Tolerance=0})
mesh_brep_45 = MeshBrep(
    Brep=python_3_script_94.Pieza_2,
    Settings={GridMaxCount=0, GridMinCount=16, JaggedSeams=False, MaxEdgeLength=0, MinEdgeLength=0.0001, MinTolerance=0, Refine=True, RefineAngle=0, RelativeTolerance=0.65, SimplePlanes=True, Tolerance=0})
mesh_brep_46 = MeshBrep(
    Brep=python_3_script_94.Pieza_3,
    Settings={GridMaxCount=0, GridMinCount=16, JaggedSeams=False, MaxEdgeLength=0, MinEdgeLength=0.0001, MinTolerance=0, Refine=True, RefineAngle=0, RelativeTolerance=0.65, SimplePlanes=True, Tolerance=0})
mesh_brep_47 = MeshBrep(
    Brep=python_3_script_94.Pieza_4,
    Settings={GridMaxCount=0, GridMinCount=16, JaggedSeams=False, MaxEdgeLength=0, MinEdgeLength=0.0001, MinTolerance=0, Refine=True, RefineAngle=0, RelativeTolerance=0.65, SimplePlanes=True, Tolerance=0})
rh_in_19_1_lado_balance_2 = ValueList({"Cara A", "Cara B", "D/D"}, selected="Cara A")
rh_in_19_2_canto_frontal_2 = ValueList({"Canto": 0, "MDP": 1}, selected="MDP")
rh_in_19_3_canto_trasero_2 = ValueList({"Canto": 0, "MDP": 1}, selected="MDP")
rh_in_19_4_canto_izquierdo_arriba_2 = ValueList({"Canto": 0, "MDP": 1}, selected="Canto")
rh_in_19_5_canto_derecho_abajo_2 = ValueList({"Canto": 0, "MDP": 1}, selected="MDP")
diagnostico_51 = Panel(python_3_script_94.out)
mesh_join_44 = MeshJoin(Meshes=flatten(mesh_brep_44))
mesh_join_45 = MeshJoin(Meshes=flatten(mesh_brep_45))
mesh_join_46 = MeshJoin(Meshes=flatten(mesh_brep_46))
mesh_join_47 = MeshJoin(Meshes=flatten(mesh_brep_47))
python_3_script_95 = Python3Script(M=mesh_join_44, B=rh_in_19_0_mapeado_2)  # -> a; inputs M: Mesh, B: Int32; same code as python_3_script_13
python_3_script_96 = Python3Script(M=mesh_join_45, B=rh_in_19_0_mapeado_2)  # -> a; inputs M: Mesh, B: Int32; same code as python_3_script_13
python_3_script_97 = Python3Script(M=mesh_join_46, B=rh_in_19_0_mapeado_2)  # -> a; inputs M: Mesh, B: Int32; same code as python_3_script_13
python_3_script_98 = Python3Script(M=mesh_join_47, B=rh_in_19_0_mapeado_2)  # -> a; inputs M: Mesh, B: Int32; same code as python_3_script_13
linear_array_26 = LinearArray(
    Geometry=[python_3_script_95, python_3_script_96, python_3_script_97, python_3_script_98],
    Direction=negative_4,
    Count=cantidad_cajones)  # -> Geometry, Transform
python_3_script_99 = Python3Script(
    M_In=linear_array_26.Geometry,
    Balance_Mode=rh_in_19_1_lado_balance_2,
    Canto_1=rh_in_19_2_canto_frontal_2,
    Canto_2=rh_in_19_3_canto_trasero_2,
    Canto_3=rh_in_19_4_canto_izquierdo_arriba_2,
    Canto_4=rh_in_19_5_canto_derecho_abajo_2)  # -> out, Color, Balance, MDP; inputs M_In: list; same code as python_3_script_14
diagnostico_52 = Panel(python_3_script_99.out)
rh_out_mdp_peça_16 = Geometry(python_3_script_99.MDP)
# 17
rh_out_peça_16 = Geometry(python_3_script_99.Color)
rh_out_peça_16_b = Geometry(python_3_script_99.Balance)

# ----
# 3BF Mecanizador V0.5
# Suporte
orientacion_mecanizado_26 = ValueList({"x0,x1": 1, "x1,x0": 2, "y0,y1": 3, "y1,y0": 4, "z0,z1": 5, "z1,z0": 6}, selected="x0,x1")
giro_mecanizado_26 = ValueList({"Frente": 0, "Arriba": 90, "Pesterior": 180, "Abajo": 270}, selected="Frente")
python_3_script_100 = Python3Script(
    Point=point_58,
    Orientacion=orientacion_mecanizado_26,
    Giro=giro_mecanizado_26,
    Dual_Point=point_5,
    Herraje_Malla_1=suporte,
    Herraje_Malla_2=parafuso_f,
    Plane_Mirror_X=xz_plane_2)  # -> out, Mecanizado_Out, Herraje_Out_1, Herraje_Out_2; inputs Point: Point3d, Orientacion: String, Mecanizado_Nurbs: list of Brep, Dual_Point: Point3d, Herraje_Malla_1: Mesh, Herraje_Malla_2: Mesh, Plane_Mirror_X: Plane, Plane_Mirror_Y: Plane; same code as python_3_script
suporte_2 = Mesh(python_3_script_100.Herraje_Out_1)
diagnostico_53 = Panel(python_3_script_100.out)
linear_array_27 = LinearArray(Geometry=suporte_2, Direction=negative_4, Count=cantidad_cajones)  # -> Geometry, Transform
mirror_27 = Mirror(Geometry=linear_array_27.Geometry, Plane=yz_plane_2)  # -> Geometry, Transform
stream_filter_16 = StreamFilter(Gate=expression_2, Stream1=linear_array_27.Geometry, Stream2=[linear_array_27.Geometry, mirror_27.Geometry])

parafuso_f_2 = Mesh(python_3_script_100.Herraje_Out_2)

linear_array_28 = LinearArray(Geometry=parafuso_f_2, Direction=negative_4, Count=cantidad_cajones)  # -> Geometry, Transform
mirror_28 = Mirror(Geometry=linear_array_28.Geometry, Plane=yz_plane_2)  # -> Geometry, Transform
stream_filter_17 = StreamFilter(Gate=expression_2, Stream1=linear_array_28.Geometry, Stream2=[linear_array_28.Geometry, mirror_28.Geometry])

rh_out_suporte = Mesh(stream_filter_16)
rh_out_parafuso_f = Mesh(stream_filter_17)

# ---- group: Peça 2 Aparência
# 3BF Materializer v0.3
# 3BF Box Mapping v1.0
# 3BF Mesh Channel Separator v2.4.4
rh_in_05_1_mapeado = ValueList({"Longitudinal": 0, "Atravesada": 1}, selected="Longitudinal")
rh_in_05_0_posicion_pata = ValueList({"1": 0, "2": 1}, selected="2")
rh_in_05_2_lado_balance = ValueList({"Cara A", "Cara B", "D/D"}, selected="Cara A")
rh_in_05_3_canto_frontal = ValueList({"Canto": 0, "MDP": 1}, selected="MDP")
rh_in_05_4_canto_trasero = ValueList({"Canto": 0, "MDP": 1}, selected="MDP")
rh_in_05_5_canto_izquierdo_arriba = ValueList({"Canto": 0, "MDP": 1}, selected="MDP")
rh_in_05_6_canto_derecho_abajo = ValueList({"Canto": 0, "MDP": 1}, selected="MDP")

# ----
stream_filter_18 = StreamFilter(Gate=rh_in_05_0_posicion_pata, Stream0=box_2pt_10, Stream1=move_69.Geometry)

# ---- group: Peca 2
stream_filter_19 = StreamFilter(Gate=expression_2, Stream2=stream_filter_18)

# ----
area_9 = Area(Geometry=stream_filter_19)  # -> Area, Centroid
deconstruct_brep_42 = DeconstructBrep(Brep=stream_filter_19)  # -> Faces, Edges, Vertices
brep_9 = Brep(stream_filter_19)
list_item_81 = ListItem(List=deconstruct_brep_42.Edges, Index="4", Wrap=True)
list_item_82 = ListItem(List=deconstruct_brep_42.Vertices, Index="1", Wrap=True)
curve_middle_26 = CurveMiddle(Curve=list_item_81)
move_148 = Move(Geometry=curve_middle_26, Motion=unit_z_41)  # -> Geometry, Transform
move_149 = Move(Geometry=move_148.Geometry, Motion=unit_z_42)  # -> Geometry, Transform

xz_plane_5 = XZPlane(Origin=area_9.Centroid)
list_item_83 = ListItem(List=deconstruct_brep_42.Edges, Index="8", Wrap=True)
curve_middle_27 = CurveMiddle(Curve=list_item_83)

point_60 = Point(curve_middle_27)
python_3_script_101 = Python3Script(
    Point=point_60,
    Orientacion=orientacion_mecanizado_7,
    Giro=giro_mecanizado_7,
    Dual_Point=point_15,
    Herraje_Malla_1=cantoneira_3,
    Herraje_Malla_2=parafuso_d_3,
    Plane_Mirror_Y=xz_plane_5)  # -> out, Mecanizado_Out, Herraje_Out_1, Herraje_Out_2; inputs Point: Point3d, Orientacion: String, Mecanizado_Nurbs: list of Brep, Dual_Point: Point3d, Herraje_Malla_1: list of Mesh, Herraje_Malla_2: list of Mesh, Plane_Mirror_X: Plane, Plane_Mirror_Y: Plane; same code as python_3_script_10
parafuso_d_9 = Mesh(python_3_script_101.Herraje_Out_2)
cantoneira_9 = Mesh(python_3_script_101.Herraje_Out_1)
diagnostico_54 = Panel(python_3_script_101.out)

rh_out_cantoneira = Geometry([linear_array_15.Geometry, cantoneira_7, cantoneira_5, cantoneira_9, cantoneira_8])

vector_2pt_14 = Vector2Pt(PointA=point_2, PointB=list_item_82, Unitize=False)  # -> Vector, Length
vector_2pt_15 = Vector2Pt(PointA=point_2, PointB=list_item_82, Unitize=False)  # -> Vector, Length
move_150 = Move(Geometry=mesh, Motion=vector_2pt_14.Vector)  # -> Geometry, Transform
move_151 = Move(Geometry=parafuso_d, Motion=vector_2pt_15.Vector)  # -> Geometry, Transform
mirror_29 = Mirror(Geometry=[mirror_10.Geometry, move_150.Geometry, move_117.Geometry], Plane=xz_plane)  # -> Geometry, Transform
mirror_30 = Mirror(Geometry=[move_118.Geometry, mirror_11.Geometry, move_151.Geometry], Plane=xz_plane)  # -> Geometry, Transform
parafuso_d_10 = Mesh([mirror_30.Geometry, mirror_11.Geometry, move_151.Geometry, move_118.Geometry])
rh_out_pes = Geometry([mirror_10.Geometry, mirror_29.Geometry, move_117.Geometry, move_150.Geometry])

rh_out_parafuso_d = Geometry([parafuso_d_10, parafuso_d_7, parafuso_d_5, parafuso_d_9, parafuso_d_8])

point_61 = Point([move_148.Geometry, move_149.Geometry])
python_3_script_102 = Python3Script(
    Point=point_61,
    Orientacion=orientacion_mecanizado_25,
    Giro=giro_mecanizado_25,
    Mecanizado_Nurbs=mecanizados_38,
    Dual_Point=point_59,
    Herraje_Malla_1=cavilha_20,
    Plane_Mirror_Y=xz_plane)  # -> out, Mecanizado_Out, Herraje_Out_1, Herraje_Out_2; inputs Point: Point3d, Orientacion: String, Mecanizado_Nurbs: list of Brep, Dual_Point: Point3d, Herraje_Malla_1: Mesh, Herraje_Malla_2: Mesh, Plane_Mirror_X: Plane, Plane_Mirror_Y: Plane; same code as python_3_script
mecanizados_39 = Brep(python_3_script_102.Mecanizado_Out)
cavilha_21 = Mesh(python_3_script_102.Herraje_Out_1)
diagnostico_55 = Panel(python_3_script_102.out)

rh_out_cavilha = Geometry([linear_array_14.Geometry, cavilha_13, cavilha_21, mirror_6.Geometry, linear_array_5.Geometry, cavilha_11, cavilha_5, cavilha_9, cavilha_7, cavilha_6])

# ---- group: Nurbs_Peça 3
solid_difference_14 = SolidDifference(BrepsA=move_53.Geometry, BrepsB=flatten([mecanizados_39, mecanizados_24, mecanizados_20]))

# ---- group: Nurbs_Peça 1
solid_difference_15 = SolidDifference(BrepsA=box_2pt_8, BrepsB=flatten([mecanizados_39, mecanizados_24, mecanizados_20]))

# ---- group: Peça 2
solid_difference_16 = SolidDifference(BrepsA=brep_9, BrepsB=flatten(mecanizados_39))

# ---- group: Peça 3 Aparência
# 3BF Materializer v0.3
# 3BF Box Mapping v1.0
# 3BF Mesh Channel Separator v2.2
rh_in_06_0_mapeado = ValueList({"Longitudinal": 0, "Atravesada": 1}, selected="Longitudinal")
python_3_script_103 = Python3Script(Brep_In=solid_difference_14)  # -> out, Pieza_1, Pieza_2, Pieza_3, Pieza_4; inputs Brep_In: list of Brep; same code as python_3_script_12
mesh_brep_48 = MeshBrep(
    Brep=python_3_script_103.Pieza_1,
    Settings={GridMaxCount=0, GridMinCount=16, JaggedSeams=False, MaxEdgeLength=0, MinEdgeLength=0.0001, MinTolerance=0, Refine=True, RefineAngle=0, RelativeTolerance=0.65, SimplePlanes=True, Tolerance=0})
rh_in_06_1_lado_balance = ValueList({"Cara A", "Cara B", "D/D"}, selected="Cara A")
rh_in_06_2_canto_frontal = ValueList({"Canto": 0, "MDP": 1}, selected="Canto")
rh_in_06_3_canto_trasero = ValueList({"Canto": 0, "MDP": 1}, selected="MDP")
rh_in_06_4_canto_izquierdo_arriba = ValueList({"Canto": 0, "MDP": 1}, selected="MDP")
rh_in_06_5_canto_derecho_abajo = ValueList({"Canto": 0, "MDP": 1}, selected="MDP")
diagnostico_56 = Panel(python_3_script_103.out)
mesh_join_48 = MeshJoin(Meshes=flatten(mesh_brep_48))
python_3_script_104 = Python3Script(M=mesh_join_48, B=rh_in_06_0_mapeado)  # -> a; inputs M: Mesh, B: Int32; same code as python_3_script_13
python_3_script_105 = Python3Script(
    M_In=python_3_script_104,
    Balance_Mode=rh_in_06_1_lado_balance,
    Canto_1=rh_in_06_2_canto_frontal,
    Canto_2=rh_in_06_3_canto_trasero,
    Canto_3=rh_in_06_4_canto_izquierdo_arriba,
    Canto_4=rh_in_06_5_canto_derecho_abajo)  # -> out, Color, Balance, MDP; inputs M_In: list; same code as python_3_script_14
diagnostico_57 = Panel(python_3_script_105.out)
rh_out_mdp_peça_3 = Geometry(python_3_script_105.MDP)
rh_out_peça_3_b = Geometry(python_3_script_105.Balance)
# 3
rh_out_peça_3 = Geometry(python_3_script_105.Color)

# ---- group: Peça 2 Aparência (continued)
python_3_script_106 = Python3Script(Brep_In=solid_difference_16)  # -> out, Pieza_1, Pieza_2, Pieza_3, Pieza_4; inputs Brep_In: list of Brep; same code as python_3_script_12
mesh_brep_49 = MeshBrep(
    Brep=python_3_script_106.Pieza_1,
    Settings={GridMaxCount=0, GridMinCount=16, JaggedSeams=False, MaxEdgeLength=0, MinEdgeLength=0.0001, MinTolerance=0, Refine=True, RefineAngle=0, RelativeTolerance=0.65, SimplePlanes=True, Tolerance=0})
diagnostico_58 = Panel(python_3_script_106.out)
mesh_join_49 = MeshJoin(Meshes=flatten(mesh_brep_49))
python_3_script_107 = Python3Script(M=mesh_join_49, B=rh_in_05_1_mapeado)  # -> a; inputs M: Mesh, B: Int32; same code as python_3_script_13
python_3_script_108 = Python3Script(
    M_In=python_3_script_107,
    Balance_Mode=rh_in_05_2_lado_balance,
    Canto_1=rh_in_05_3_canto_frontal,
    Canto_2=rh_in_05_4_canto_trasero,
    Canto_3=rh_in_05_5_canto_izquierdo_arriba,
    Canto_4=rh_in_05_6_canto_derecho_abajo)  # -> out, Color, Balance, MDP; inputs M_In: list of Mesh
# ---------- python_3_script_108: Python ----------
# -*- coding: utf-8 -*-
"""
=============================================================================
3BF Mesh Channel Separator v2.4.4 (Tolerancia Estricta Anti-Mecanizados)
Powered by 3dBimFab
=============================================================================
"""

import Rhino.Geometry as rg

def unwrap_mesh(obj):
    """Extrae un Rhino.Geometry.Mesh nativo de cualquier tipo o contenedor GH."""
    if obj is None:
        return None
    if hasattr(obj, "Value"):
        obj = obj.Value
    if isinstance(obj, rg.Mesh):
        return obj
    return None

def extract_submesh(src_mesh, face_indices):
    """Extrae un submesh preservando UVs y Normales."""
    if not face_indices or src_mesh is None:
        return None
    sub = rg.Mesh()
    v_map = {}
    has_uv = (src_mesh.TextureCoordinates.Count == src_mesh.Vertices.Count)
    has_normals = (src_mesh.Normals.Count == src_mesh.Vertices.Count)
    for fi in face_indices:
        face = src_mesh.Faces[fi]
        v_candidates = [face.A, face.B, face.C]
        if face.IsQuad:
            v_candidates.append(face.D)
        new_v = []
        for vi in v_candidates:
            if vi not in v_map:
                idx = sub.Vertices.Add(src_mesh.Vertices[vi])
                v_map[vi] = idx
                if has_uv:
                    sub.TextureCoordinates.Add(src_mesh.TextureCoordinates[vi])
                if has_normals:
                    sub.Normals.Add(src_mesh.Normals[vi])
            new_v.append(v_map[vi])
        if len(new_v) == 3:
            sub.Faces.AddFace(new_v[0], new_v[1], new_v[2])
        elif len(new_v) == 4:
            sub.Faces.AddFace(new_v[0], new_v[1], new_v[2], new_v[3])
    sub.Normals.ComputeNormals()
    sub.Compact()
    return sub

Color = None
Balance = None
MDP = None
diag_msgs = []

def log(msg):
    diag_msgs.append(str(msg))

try:
    raw_m = globals().get('M_In', None)
    mesh = None
    
    if isinstance(raw_m, (list, tuple)):
        valid_meshes = []
        for item in raw_m:
            m_native = unwrap_mesh(item)
            if m_native and m_native.Faces.Count > 0:
                valid_meshes.append(m_native)
        if len(valid_meshes) == 1:
            mesh = valid_meshes[0]
        elif len(valid_meshes) > 1:
            mesh = rg.Mesh()
            for m in valid_meshes:
                mesh.Append(m)
    else:
        mesh = unwrap_mesh(raw_m)

    if mesh is None or mesh.Faces.Count == 0:
        raise Exception("No se pudo obtener una malla válida (M_In está vacío o no es Mesh).")

    mode = str(Balance_Mode) if 'Balance_Mode' in globals() and Balance_Mode else "Cara B"
    c1 = str(Canto_1) if 'Canto_1' in globals() and Canto_1 else "MDP"
    c2 = str(Canto_2) if 'Canto_2' in globals() and Canto_2 else "MDP"
    c3 = str(Canto_3) if 'Canto_3' in globals() and Canto_3 else "MDP"
    c4 = str(Canto_4) if 'Canto_4' in globals() and Canto_4 else "MDP"

    bbox = mesh.GetBoundingBox(True)
    sx = bbox.Max.X - bbox.Min.X
    sy = bbox.Max.Y - bbox.Min.Y
    sz = bbox.Max.Z - bbox.Min.Z

    dims = [("X", sx, bbox.Min.X, bbox.Max.X),
            ("Y", sy, bbox.Min.Y, bbox.Max.Y),
            ("Z", sz, bbox.Min.Z, bbox.Max.Z)]
    dims.sort(key=lambda d: d[1])

    eje_esp = dims[0][0]
    esp_val = dims[0][1]
    min_esp = dims[0][2]
    max_esp = dims[0][3]

    ejes_cantos = [dims[1], dims[2]]
    ejes_cantos.sort(key=lambda d: d[0])
    eje_u = ejes_cantos[0]
    eje_v = ejes_cantos[1]

    mesh.FaceNormals.ComputeFaceNormals()

    # TOLERANCIA ESTRICTA:
    # Las caras exteriores del tablero plano están a menos de 0.25 mm del BoundingBox.
    # Cualquier perforación a 2 o 3 mm queda automáticamente excluida de Cara A y Cara B.
    tol_esp = 0.25  # mm
    tol_u = 0.35    # mm
    tol_v = 0.35    # mm

    faces_A = []
    faces_B = []
    faces_canto_1 = []
    faces_canto_2 = []
    faces_canto_3 = []
    faces_canto_4 = []
    faces_resto = []

    for fi in range(mesh.Faces.Count):
        face = mesh.Faces[fi]
        pts = [mesh.Vertices[face.A], mesh.Vertices[face.B], mesh.Vertices[face.C]]
        if face.IsQuad:
            pts.append(mesh.Vertices[face.D])

        cx = sum(p.X for p in pts) / float(len(pts))
        cy = sum(p.Y for p in pts) / float(len(pts))
        cz = sum(p.Z for p in pts) / float(len(pts))

        c_dict = {"X": cx, "Y": cy, "Z": cz}
        c_esp = c_dict[eje_esp]
        c_u = c_dict[eje_u[0]]
        c_v = c_dict[eje_v[0]]

        fn = mesh.FaceNormals[fi]
        n_len = fn.Length
        if n_len > 1e-6:
            norm = rg.Vector3d(fn.X / n_len, fn.Y / n_len, fn.Z / n_len)
        else:
            norm = rg.Vector3d(0, 0, 1)

        n_dict = {"X": norm.X, "Y": norm.Y, "Z": norm.Z}
        n_esp = n_dict[eje_esp]
        n_u = n_dict[eje_u[0]]
        n_v = n_dict[eje_v[0]]

        # 1. CARAS PRINCIPALES EXTERIORES (Normal paralela y estricta en el plano exterior)
        if abs(n_esp) >= 0.70:
            if abs(c_esp - max_esp) <= tol_esp:
                faces_A.append(fi)
                continue
            elif abs(c_esp - min_esp) <= tol_esp:
                faces_B.append(fi)
                continue

        # 2. CANTOS EXTERIORES (Normal perpendicular al espesor y estricta en el borde)
        if abs(n_esp) < 0.35:
            if abs(c_u - eje_u[3]) <= tol_u and n_u > 0.4:
                faces_canto_1.append(fi)
                continue
            elif abs(c_u - eje_u[2]) <= tol_u and n_u < -0.4:
                faces_canto_2.append(fi)
                continue
            elif abs(c_v - eje_v[3]) <= tol_v and n_v > 0.4:
                faces_canto_3.append(fi)
                continue
            elif abs(c_v - eje_v[2]) <= tol_v and n_v < -0.4:
                faces_canto_4.append(fi)
                continue

        # 3. INTERIORES Y MECANIZADOS (Fondos de orificios, cavidades, paredes internas)
        faces_resto.append(fi)

    log("Clasificación estricta: CaraA={}, CaraB={}, C1={}, C2={}, C3={}, C4={}, Mecanizados={}".format(
        len(faces_A), len(faces_B), len(faces_canto_1), len(faces_canto_2),
        len(faces_canto_3), len(faces_canto_4), len(faces_resto)
    ))

    idx_color = []
    idx_balance = []
    idx_mdp = []

    if mode == "Ambas":
        idx_balance.extend(faces_A)
    else:
        idx_color.extend(faces_A)

    if mode in ["Cara B", "Ambas"]:
        idx_balance.extend(faces_B)
    else:
        idx_color.extend(faces_B)

    cantos_cfg = [(faces_canto_1, c1), (faces_canto_2, c2), (faces_canto_3, c3), (faces_canto_4, c4)]
    for f_list, dest in cantos_cfg:
        if dest == "Color":
            idx_color.extend(f_list)
        elif dest == "Balance":
            idx_balance.extend(f_list)
        else:
            idx_mdp.extend(f_list)

    # Mecanizados (orificios de minifix, tarugos, ranuras) van SIEMPRE al canal MDP
    idx_mdp.extend(faces_resto)

    Color = extract_submesh(mesh, idx_color)
    Balance = extract_submesh(mesh, idx_balance)
    MDP = extract_submesh(mesh, idx_mdp)

    log("Canales generados: Color={}, Balance={}, MDP={}".format(
        Color.Faces.Count if Color else 0,
        Balance.Faces.Count if Balance else 0,
        MDP.Faces.Count if MDP else 0
    ))

except Exception as e:
    log("ERROR: {}".format(str(e)))

out = "\n".join(diag_msgs)
print(out)
# ---------- end python_3_script_108 ----------
diagnostico_59 = Panel(python_3_script_108.out)
# Posicionador Borde Inferior
rh_out_mdp_peça_2 = Geometry(python_3_script_108.MDP)
# Posicionador Borde Superior
rh_out_peça_2_b = Geometry(python_3_script_108.Balance)
# 2
rh_out_peça_2 = Geometry(python_3_script_108.Color)

# ---- group: Peça 1 Aparência
# 3BF Materializer v0.1
rh_in_03_1_lado_balance = ValueList({"Cara A", "Cara B", "D/D"}, selected="D/D")
rh_in_03_2_canto_frontal = ValueList({"Canto": 0, "MDP": 1}, selected="MDP")
rh_in_03_3_canto_trasero = ValueList({"Canto": 0, "MDP": 1}, selected="MDP")
rh_in_03_4canto_izquierdo_arriba = ValueList({"Canto": 0, "MDP": 1}, selected="MDP")
rh_in_03_5_canto_derecho_abajo = ValueList({"Canto": 0, "MDP": 1}, selected="MDP")
rh_in_03_0_mapeado = ValueList({"Longitudinal": 0, "Atravesada": 1}, selected="Longitudinal")
python_3_script_109 = Python3Script(
    Brep_In=solid_difference_15,
    Balance_Mode=rh_in_03_1_lado_balance,
    Canto_1=rh_in_03_2_canto_frontal,
    Canto_2=rh_in_03_3_canto_trasero,
    Canto_3=rh_in_03_4canto_izquierdo_arriba,
    Canto_4=rh_in_03_5_canto_derecho_abajo)  # -> Out, NURBS_Color, NURBS_Balance, NURBS_MDP, Info_Pieza; inputs Brep_In: Brep, Balance_Mode: String, Canto_1: String, Canto_2: String, Canto_3: String, Canto_4: String; same code as python_3_script_75
mesh_brep_50 = MeshBrep(
    Brep=python_3_script_109.NURBS_Color,
    Settings={GridMaxCount=0, GridMinCount=16, JaggedSeams=False, MaxEdgeLength=0, MinEdgeLength=0.0001, MinTolerance=0, Refine=True, RefineAngle=0, RelativeTolerance=0.65, SimplePlanes=True, Tolerance=0})
mesh_brep_51 = MeshBrep(
    Brep=python_3_script_109.NURBS_Balance,
    Settings={GridMaxCount=0, GridMinCount=16, JaggedSeams=False, MaxEdgeLength=0, MinEdgeLength=0.0001, MinTolerance=0, Refine=True, RefineAngle=0, RelativeTolerance=0.65, SimplePlanes=True, Tolerance=0})
mesh_brep_52 = MeshBrep(
    Brep=python_3_script_109.NURBS_MDP,
    Settings={GridMaxCount=0, GridMinCount=16, JaggedSeams=False, MaxEdgeLength=0, MinEdgeLength=0.0001, MinTolerance=0, Refine=True, RefineAngle=0, RelativeTolerance=0.65, SimplePlanes=True, Tolerance=0})
diagnostico_60 = Panel(python_3_script_109.Info_Pieza)
mesh_join_50 = MeshJoin(Meshes=flatten(mesh_brep_50))
mesh_join_51 = MeshJoin(Meshes=flatten(mesh_brep_51))
mesh_join_52 = MeshJoin(Meshes=flatten(mesh_brep_52))
python_3_script_110 = Python3Script(M=mesh_join_50, B=rh_in_03_0_mapeado)  # -> a; inputs M: Mesh, B: Int32; same code as python_3_script_76
python_3_script_111 = Python3Script(M=mesh_join_51, B=rh_in_03_0_mapeado)  # -> a; inputs M: Mesh, B: Int32; same code as python_3_script_76
python_3_script_112 = Python3Script(M=mesh_join_52, B=rh_in_03_0_mapeado)  # -> a; inputs M: Mesh, B: Int32; same code as python_3_script_76
# 1
rh_out_peça_1 = Geometry(python_3_script_110)
rh_out_mdp_peça_1 = Geometry(python_3_script_112)

# ---- group: Peça 1 Aparência / RH_OUT:Peça 1 B
rh_out_peça_10_b_2 = Geometry(python_3_script_111)
