# Grasshopper definition Hib_C_Ravenna.ghx (Grasshopper 1.0.8)
# plug-ins: Pufferfish

# ----
# ============================================================
#            INSTRUCTIVO: HERRAJES HÍBRIDOS (3BF)
# ============================================================
# 
# 1. CARGAR MALLAS
# • Introduce en el componente "Mesh" inicial todas las mallas
#   revueltas de los diferentes herrajes (sin internalizar).
# 
# 2. FLUJO AL PYTHON
# • Conecta el "Mesh" al nodo "Guid".
# • Conecta el "Guid" a la entrada [M] del componente Python.
# • Por [out] (panel amarillo) saldrán los nombres con su ID.
# 
# 3. CONEXIÓN E INTERNALIZACIÓN
# • Conecta la salida [Mallas] al componente de geometría
#   "RH_OUT:Herrajes".
# • Clic derecho en "RH_OUT:Herrajes" -> "Internalise data".
#   (Se desconectará automáticamente: significa que ya tiene
#   toda la información en su interior).
# 
# 4. GUARDAR
# • Guarda el archivo (.ghx). 3dBimFab ya leerá los herrajes
#   con sus nombres y cantidades exactas.
# ============================================================
mesh = Mesh([<mesh referenced from the Rhino model> x48])
guid = Guid(mesh)
python_3_script = Python3Script(M=guid)  # -> out, Mallas; inputs M: list
# ---------- python_3_script: Python ----------
"""
==============================================================================
3BF DfMA Herrajes Híbridos - Inyector de UserStrings
==============================================================================
Nombre:        3bf_hardware_injector.py
Versión:       v1.0.0
Autor:         Mario Mojica
Ecosistema:    3dBimFab (3BF)
Fecha:         Octubre 2026

DESCRIPCIÓN:
    Extrae mallas de herrajes referenciadas desde el documento activo de Rhino
    a través de sus identificadores GUID, captura el nombre real asignado a cada 
    objeto en Rhino (Name) y lo inyecta permanentemente como metadato 
    UserString ("Name") en la geometría OpenNURBS de la malla.
    
    Esto permite congelar/internalizar los herrajes dentro de un nodo 
    'RH_OUT:Herrajes' para que RhinoCompute y el worker 3BF reconozcan 
    automáticamente los nombres de herrajes (patas, tornillos, cantoneras, etc.)
    en modo headless sin requerir el archivo 3dm abierto.

ENTRADAS:
    M (List Access): Lista de GUIDs provenientes del contenedor 'Guid' de GH.

SALIDAS:
    Mallas: Lista de mallas con UserString "Name" inyectado.
    out:    Reporte diagnóstico de nombres y conteos detectados.
==============================================================================
"""

import Rhino
import System

mallas_list = []
log = []

if M:
    for item in M:
        # Extraer el Guid nativo (.NET System.Guid)
        guid_str = str(getattr(item, 'Value', item))
        try:
            guid_val = System.Guid(guid_str)
        except Exception:
            continue
        
        # Localizar el objeto en el documento activo de Rhino
        rh_obj = Rhino.RhinoDoc.ActiveDoc.Objects.FindId(guid_val)
        if rh_obj is not None:
            nombre = rh_obj.Name if rh_obj.Name else "Herraje"
            geom = rh_obj.Geometry
            
            # Si es Mesh, duplicar e inyectar el UserString
            if isinstance(geom, Rhino.Geometry.Mesh):
                m_copy = geom.DuplicateMesh()
                m_copy.SetUserString("Name", nombre)
                mallas_list.append(m_copy)
                log.append("{}: {}".format(nombre, guid_val))

# Salidas de Grasshopper
Mallas = mallas_list
print("=== 3BF Herrajes: {} procesados ===".format(len(mallas_list)))
for l in log:
    print(l)
# ---------- end python_3_script ----------
panel = Panel(python_3_script.out)
rh_out_herrajes = Geometry([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])

point = Point(Point(-2021.437777, 13, 50))
vector_2pt = Vector2Pt(PointA=point, Unitize=False)  # -> Vector, Length
move = Move(Motion=vector_2pt.Vector)  # -> Geometry, Transform
brep = Brep(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)
brep_2 = Brep([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])
brep_3 = Brep([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])
brep_4 = Brep(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)
brep_5 = Brep([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])
brep_6 = Brep(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)
brep_7 = Brep([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])
brep_8 = Brep([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])
brep_9 = Brep([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])

# ----
# Materializer 2.0
python_3_script_2 = Python3Script()  # -> Out, NURBS_Color, NURBS_Balance, NURBS_MDP; inputs Brep_In: Brep, Balance_Mode: String, Canto_1: String, Canto_2: String, Canto_3: String, Canto_4: String
# ---------- python_3_script_2: Python ----------
"""
=============================================================================
PROYECTO:      3dBimFab
COMPONENTE:    3dBimFab - Desglosador DfMA de Pieza Real NURBS (Materializer)
VERSIÓN:       2.0 Cohesión Nativa
DESCRIPCIÓN:   Clasifica geométricamente las caras de un Brep sólido en:
               - Caras Principales (A / B) según modo de balance (D/D, A, B).
               - Cantos perimetrales (1 a 4) según presencia de tapacanto.
               - Mecanizados internos y perforaciones (asignados a MDP).
               Canaliza el reporte de auditoría directamente por la salida 'out'.
=============================================================================
"""

import Rhino

def parse_balance(val):
    s = str(val).lower().strip().replace('"', '').replace("'", "")
    if s in ["6", "d/d", "dyd", "doble", "ninguno", "ambas"] or "d/d" in s or "dyd" in s:
        return "DD"
    if s in ["5", "cara a", "a"] or (s.startswith("a") and len(s) <= 6):
        return "A"
    if s in ["4", "cara b", "b"] or (s.startswith("b") and len(s) <= 6):
        return "B"
    if "ambos" in s:
        return "AMBOS"
    return "B"

def parse_canto(val):
    s = str(val).lower().strip().replace('"', '').replace("'", "")
    if s in ["0", "0.0", "canto", "true", "si", "sí", "con canto"] or ("canto" in s and "sin" not in s):
        return True # Madera / Color
    if s in ["1", "1.0", "mdp", "false", "no", "sin canto"] or "mdp" in s or "sin" in s:
        return False # Crudo / MDP
    return True

def desglosar_pieza_real_nurbs(brep_in, balance_mode="Cara B", c1="Canto", c2="Canto", c3="Canto", c4="Canto"):
    if brep_in is None:
        return [], [], [], "Aviso: Brep de entrada es nulo"

    # 1. Medir BoundingBox de la envolvente exterior
    bbox = brep_in.GetBoundingBox(True)
    x0, x1 = bbox.Min.X, bbox.Max.X
    y0, y1 = bbox.Min.Y, bbox.Max.Y
    z0, z1 = bbox.Min.Z, bbox.Max.Z

    sx = max(0.1, x1 - x0)
    sy = max(0.1, y1 - y0)
    sz = max(0.1, z1 - z0)
    min_dim = min(sx, sy, sz)

    # Tolerancia geométrica para detectar planos exteriores
    tol = max(0.2, min_dim * 0.15)

    faces_A = []
    faces_B = []
    faces_cantos = {1: [], 2: [], 3: [], 4: []}
    faces_mecanizados = []

    # 2. Clasificar cada cara real de la pieza
    for i in range(brep_in.Faces.Count):
        f = brep_in.Faces[i]
        u = f.Domain(0).Mid
        v = f.Domain(1).Mid
        pt = f.PointAt(u, v)
        n = f.NormalAt(u, v)
        n.Unitize()
        nurbs_face = f.DuplicateFace(False)

        # -------------------------------------------------------------
        # CASO 1: Tablero Horizontal (Cubiertas / Entrepaños - Espesor en Z)
        # -------------------------------------------------------------
        if min_dim == sz:
            tipo_str = "Horizontal (Cubierta/Entrepaño)"
            # Cara A (+Z exterior)
            if n.Z > 0.8 and abs(pt.Z - z1) < tol:
                faces_A.append(nurbs_face)
            # Cara B (-Z exterior)
            elif n.Z < -0.8 and abs(pt.Z - z0) < tol:
                faces_B.append(nurbs_face)
            # Canto 1: Frontal (-Y exterior)
            elif n.Y < -0.8 and abs(pt.Y - y0) < tol:
                faces_cantos[1].append(nurbs_face)
            # Canto 2: Trasero (+Y exterior)
            elif n.Y > 0.8 and abs(pt.Y - y1) < tol:
                faces_cantos[2].append(nurbs_face)
            # Canto 3: Izquierdo (-X exterior)
            elif n.X < -0.8 and abs(pt.X - x0) < tol:
                faces_cantos[3].append(nurbs_face)
            # Canto 4: Derecho (+X exterior)
            elif n.X > 0.8 and abs(pt.X - x1) < tol:
                faces_cantos[4].append(nurbs_face)
            else:
                faces_mecanizados.append(nurbs_face)

        # -------------------------------------------------------------
        # CASO 2: Tablero Vertical Lateral (Costados - Espesor en X)
        # -------------------------------------------------------------
        elif min_dim == sx:
            tipo_str = "Vertical Lateral (Costado)"
            if n.X > 0.8 and abs(pt.X - x1) < tol:
                faces_A.append(nurbs_face)
            elif n.X < -0.8 and abs(pt.X - x0) < tol:
                faces_B.append(nurbs_face)
            elif n.Y < -0.8 and abs(pt.Y - y0) < tol:
                faces_cantos[1].append(nurbs_face) # Frontal
            elif n.Y > 0.8 and abs(pt.Y - y1) < tol:
                faces_cantos[2].append(nurbs_face) # Trasero
            elif n.Z > 0.8 and abs(pt.Z - z1) < tol:
                faces_cantos[3].append(nurbs_face) # Superior
            elif n.Z < -0.8 and abs(pt.Z - z0) < tol:
                faces_cantos[4].append(nurbs_face) # Inferior
            else:
                faces_mecanizados.append(nurbs_face)

        # -------------------------------------------------------------
        # CASO 3: Tablero Vertical Frontal (Frentes / Puertas - Espesor en Y)
        # -------------------------------------------------------------
        else:
            tipo_str = "Vertical Frontal (Frente/Puerta)"
            if n.Y < -0.8 and abs(pt.Y - y0) < tol:
                faces_A.append(nurbs_face)
            elif n.Y > 0.8 and abs(pt.Y - y1) < tol:
                faces_B.append(nurbs_face)
            elif n.Z > 0.8 and abs(pt.Z - z1) < tol:
                faces_cantos[1].append(nurbs_face) # Superior
            elif n.Z < -0.8 and abs(pt.Z - z0) < tol:
                faces_cantos[2].append(nurbs_face) # Inferior
            elif n.X < -0.8 and abs(pt.X - x0) < tol:
                faces_cantos[3].append(nurbs_face) # Izquierdo
            elif n.X > 0.8 and abs(pt.X - x1) < tol:
                faces_cantos[4].append(nurbs_face) # Derecho
            else:
                faces_mecanizados.append(nurbs_face)

    # 3. Asignación de Caras Principales según Balance
    modo_b = parse_balance(balance_mode)
    nurbs_color = []
    nurbs_balance = []
    nurbs_mdp = []

    if modo_b == "DD":
        nurbs_color.extend(faces_A)
        nurbs_color.extend(faces_B)
        diag_bal = "D/D (Doble Cara Madera)"
    elif modo_b == "A":
        nurbs_balance.extend(faces_A)
        nurbs_color.extend(faces_B)
        diag_bal = "Balance en Cara A"
    elif modo_b == "B":
        nurbs_color.extend(faces_A)
        nurbs_balance.extend(faces_B)
        diag_bal = "Balance en Cara B"
    else:
        nurbs_balance.extend(faces_A)
        nurbs_balance.extend(faces_B)
        diag_bal = "Ambas Caras Balance"

    # 4. Asignación de Cantos (1: Frontal, 2: Trasero, 3: Izquierdo, 4: Derecho)
    cantos_in = {
        1: parse_canto(c1),
        2: parse_canto(c2),
        3: parse_canto(c3),
        4: parse_canto(c4)
    }

    for num_canto, tiene_canto in cantos_in.items():
        if tiene_canto:
            nurbs_color.extend(faces_cantos[num_canto])
        else:
            nurbs_mdp.extend(faces_cantos[num_canto])

    # 5. INYECCIÓN CRÍTICA: Todos los Mecanizados van SIEMPRE a MDP
    nurbs_mdp.extend(faces_mecanizados)

    diag = "{0} | {1} | Total Caras: {2} (A={3}, B={4}, Cantos={5}, Mecanizados={6}) | Breps Salida -> Color: {7}, Balance: {8}, MDP: {9}".format(
        tipo_str, diag_bal, brep_in.Faces.Count,
        len(faces_A), len(faces_B), sum(len(v) for v in faces_cantos.values()), len(faces_mecanizados),
        len(nurbs_color), len(nurbs_balance), len(nurbs_mdp)
    )

    return nurbs_color, nurbs_balance, nurbs_mdp, diag


# Ejecución principal
n_col, n_bal, n_mdp, diag_txt = desglosar_pieza_real_nurbs(
    Brep_In,
    Balance_Mode if 'Balance_Mode' in locals() else "Cara B",
    Canto_1 if 'Canto_1' in locals() else "Canto",
    Canto_2 if 'Canto_2' in locals() else "Canto",
    Canto_3 if 'Canto_3' in locals() else "Canto",
    Canto_4 if 'Canto_4' in locals() else "Canto"
)

# Salida natural de consola Grasshopper
print(diag_txt)

# Salidas geométricas oficiales
NURBS_Color = n_col
Nurbs_Color = n_col
Mesh_Color = n_col

NURBS_Balance = n_bal
Nurbs_Balance = n_bal
Mesh_Balance = n_bal

NURBS_MDP = n_mdp
Nurbs_MDP = n_mdp
Mesh_MDP = n_mdp
# ---------- end python_3_script_2 ----------

# ----
# Materializer 3.0
python_3_script_3 = Python3Script()  # -> Out, NURBS_Color, NURBS_Balance, NURBS_MDP; inputs Brep_In: Brep, Balance_Mode: String, Canto_1: String, Canto_2: String, Canto_3: String, Canto_4: String
# ---------- python_3_script_3: Python ----------
"""
=============================================================================
PROYECTO:      3dBimFab
COMPONENTE:    3dBimFab - Desglosador DfMA de Pieza Real NURBS (Materializer)
VERSIÓN:       3.0 Cohesión Nativa & Cantos con Chaflán / Bocelado
DESCRIPCIÓN:   Clasifica geométricamente las caras de un Brep sólido en:
               - Caras Principales (A / B) según balance (D/D, A, B, Ambos).
               - Cantos Perimetrales (1 a 4), integrando chaflanes a 45°,
                 uñeros gola, biseles y bocelados curvos al canto respectivo.
               - Mecanizados internos, ranuras y perforaciones (siempre a MDP).
=============================================================================
"""

import Rhino

def parse_balance(val):
    s = str(val).lower().strip().replace('"', '').replace("'", "")
    if s in ["6", "d/d", "dyd", "doble", "ninguno", "ambas"] or "d/d" in s or "dyd" in s:
        return "DD"
    if s in ["5", "cara a", "a"] or (s.startswith("a") and len(s) <= 6):
        return "A"
    if s in ["4", "cara b", "b"] or (s.startswith("b") and len(s) <= 6):
        return "B"
    if "ambos" in s:
        return "AMBOS"
    return "B"

def parse_canto(val):
    s = str(val).lower().strip().replace('"', '').replace("'", "")
    if s in ["0", "0.0", "canto", "true", "si", "sí", "con canto"] or ("canto" in s and "sin" not in s):
        return True # Madera / Color
    if s in ["1", "1.0", "mdp", "false", "no", "sin canto"] or "mdp" in s or "sin" in s:
        return False # Crudo / MDP
    return True

def desglosar_pieza_real_nurbs(brep_in, balance_mode="Cara B", c1="Canto", c2="Canto", c3="Canto", c4="Canto"):
    if brep_in is None:
        return [], [], [], "Aviso: Brep de entrada es nulo"

    # 1. Medir BoundingBox de la envolvente exterior
    bbox = brep_in.GetBoundingBox(True)
    x0, x1 = bbox.Min.X, bbox.Max.X
    y0, y1 = bbox.Min.Y, bbox.Max.Y
    z0, z1 = bbox.Min.Z, bbox.Max.Z

    sx = max(0.1, x1 - x0)
    sy = max(0.1, y1 - y0)
    sz = max(0.1, z1 - z0)
    min_dim = min(sx, sy, sz)

    # Tolerancia geométrica para planos principales y zona de influencia de chaflanes
    tol = max(0.2, min_dim * 0.15)
    zona_bisel = max(tol * 2.5, min_dim * 2.2)

    faces_A = []
    faces_B = []
    faces_cantos = {1: [], 2: [], 3: [], 4: []}
    faces_mecanizados = []

    # 2. Clasificar cada cara real del Brep
    for i in range(brep_in.Faces.Count):
        f = brep_in.Faces[i]
        u = (f.Domain(0).T0 + f.Domain(0).T1) * 0.5
        v = (f.Domain(1).T0 + f.Domain(1).T1) * 0.5
        pt = f.PointAt(u, v)
        n = f.NormalAt(u, v)
        n.Unitize()
        nurbs_face = f.DuplicateFace(False)

        # -----------------------------------------------------------------
        # CASO 1: Tablero Horizontal (Cubiertas / Entrepaños - Espesor en Z)
        # -----------------------------------------------------------------
        if min_dim == sz:
            tipo_str = "Horizontal (Cubierta/Entrepaño)"
            # Cara A (+Z exterior plano)
            if n.Z > 0.85 and abs(pt.Z - z1) < tol:
                faces_A.append(nurbs_face)
            # Cara B (-Z exterior plano)
            elif n.Z < -0.85 and abs(pt.Z - z0) < tol:
                faces_B.append(nurbs_face)
            # Canto 1: Frontal (-Y exterior, plano o chaflán)
            elif n.Y < -0.20 and (pt.Y - y0) < zona_bisel:
                faces_cantos[1].append(nurbs_face)
            # Canto 2: Trasero (+Y exterior, plano o chaflán)
            elif n.Y > 0.20 and (y1 - pt.Y) < zona_bisel:
                faces_cantos[2].append(nurbs_face)
            # Canto 3: Izquierdo (-X exterior, plano o chaflán)
            elif n.X < -0.20 and (pt.X - x0) < zona_bisel:
                faces_cantos[3].append(nurbs_face)
            # Canto 4: Derecho (+X exterior, plano o chaflán)
            elif n.X > 0.20 and (x1 - pt.X) < zona_bisel:
                faces_cantos[4].append(nurbs_face)
            else:
                faces_mecanizados.append(nurbs_face)

        # -----------------------------------------------------------------
        # CASO 2: Tablero Vertical Lateral (Costados - Espesor en X)
        # -----------------------------------------------------------------
        elif min_dim == sx:
            tipo_str = "Vertical Lateral (Costado)"
            # Cara A (+X exterior)
            if n.X > 0.85 and abs(pt.X - x1) < tol:
                faces_A.append(nurbs_face)
            # Cara B (-X exterior)
            elif n.X < -0.85 and abs(pt.X - x0) < tol:
                faces_B.append(nurbs_face)
            # Canto 1: Frontal (-Y exterior, plano o chaflán)
            elif n.Y < -0.20 and (pt.Y - y0) < zona_bisel:
                faces_cantos[1].append(nurbs_face)
            # Canto 2: Trasero (+Y exterior, plano o chaflán)
            elif n.Y > 0.20 and (y1 - pt.Y) < zona_bisel:
                faces_cantos[2].append(nurbs_face)
            # Canto 3: Superior (+Z exterior, plano o chaflán)
            elif n.Z > 0.20 and (z1 - pt.Z) < zona_bisel:
                faces_cantos[3].append(nurbs_face)
            # Canto 4: Inferior (-Z exterior, plano o chaflán)
            elif n.Z < -0.20 and (pt.Z - z0) < zona_bisel:
                faces_cantos[4].append(nurbs_face)
            else:
                faces_mecanizados.append(nurbs_face)

        # -----------------------------------------------------------------
        # CASO 3: Tablero Vertical Frontal (Frentes de Cajón / Puertas - Espesor en Y)
        # -----------------------------------------------------------------
        else:
            tipo_str = "Vertical Frontal (Frente/Puerta)"
            # Cara A: Frontal Exterior Visible (-Y plano)
            if n.Y < -0.85 and abs(pt.Y - y0) < tol:
                faces_A.append(nurbs_face)
            # Cara B: Trasera Interior (+Y plano)
            elif n.Y > 0.85 and abs(pt.Y - y1) < tol:
                faces_B.append(nurbs_face)
            # Canto 1: Superior (Plano Y Chaflán/Uñero a 45° en la zona superior)
            elif n.Z > 0.20 and (z1 - pt.Z) < zona_bisel:
                faces_cantos[1].append(nurbs_face)
            # Canto 2: Inferior (Plano o Chaflán en la zona inferior)
            elif n.Z < -0.20 and (pt.Z - z0) < zona_bisel:
                faces_cantos[2].append(nurbs_face)
            # Canto 3: Izquierdo (Plano o Chaflán lateral izquierdo)
            elif n.X < -0.20 and (pt.X - x0) < zona_bisel:
                faces_cantos[3].append(nurbs_face)
            # Canto 4: Derecho (Plano o Chaflán lateral derecho)
            elif n.X > 0.20 and (x1 - pt.X) < zona_bisel:
                faces_cantos[4].append(nurbs_face)
            else:
                faces_mecanizados.append(nurbs_face)

    # 3. Asignación de Caras Principales según Balance
    modo_b = parse_balance(balance_mode)
    nurbs_color = []
    nurbs_balance = []
    nurbs_mdp = []

    if modo_b == "DD":
        nurbs_color.extend(faces_A)
        nurbs_color.extend(faces_B)
        diag_bal = "D/D (Doble Cara Madera)"
    elif modo_b == "A":
        nurbs_balance.extend(faces_A)
        nurbs_color.extend(faces_B)
        diag_bal = "Balance en Cara A"
    elif modo_b == "B":
        nurbs_color.extend(faces_A)
        nurbs_balance.extend(faces_B)
        diag_bal = "Balance en Cara B"
    else:
        nurbs_balance.extend(faces_A)
        nurbs_balance.extend(faces_B)
        diag_bal = "Ambas Caras Balance"

    # 4. Asignación de Cantos (1: Canto 1, 2: Canto 2, 3: Canto 3, 4: Canto 4)
    cantos_in = {
        1: parse_canto(c1),
        2: parse_canto(c2),
        3: parse_canto(c3),
        4: parse_canto(c4)
    }

    for num_canto, tiene_canto in cantos_in.items():
        if tiene_canto:
            nurbs_color.extend(faces_cantos[num_canto])
        else:
            nurbs_mdp.extend(faces_cantos[num_canto])

    # 5. Todos los Mecanizados y Cajeados van SIEMPRE a MDP
    nurbs_mdp.extend(faces_mecanizados)

    diag = "{0} | {1} | Total Caras: {2} (A={3}, B={4}, Cantos={5}, Mec={6}) | Breps Salida -> Color: {7}, Balance: {8}, MDP: {9}".format(
        tipo_str, diag_bal, brep_in.Faces.Count,
        len(faces_A), len(faces_B), sum(len(v) for v in faces_cantos.values()), len(faces_mecanizados),
        len(nurbs_color), len(nurbs_balance), len(nurbs_mdp)
    )

    return nurbs_color, nurbs_balance, nurbs_mdp, diag


# Ejecución
n_col, n_bal, n_mdp, diag_txt = desglosar_pieza_real_nurbs(
    Brep_In,
    Balance_Mode if 'Balance_Mode' in locals() else "Cara B",
    Canto_1 if 'Canto_1' in locals() else "Canto",
    Canto_2 if 'Canto_2' in locals() else "Canto",
    Canto_3 if 'Canto_3' in locals() else "Canto",
    Canto_4 if 'Canto_4' in locals() else "Canto"
)

# Salidas de consola
print(diag_txt)

# Salidas geométricas oficiales multinombre (para Grasshopper / Hops / Python Worker)
NURBS_Color = n_col
Nurbs_Color = n_col
Mesh_Color = n_col

NURBS_Balance = n_bal
Nurbs_Balance = n_bal
Mesh_Balance = n_bal

NURBS_MDP = n_mdp
Nurbs_MDP = n_mdp
Mesh_MDP = n_mdp

Info_Pieza = diag_txt
# ---------- end python_3_script_3 ----------

# ----
# Materializer 3.2
python_3_script_4 = Python3Script()  # -> Out, NURBS_Color, NURBS_Balance, NURBS_MDP; inputs Brep_In: Brep, Balance_Mode: String, Canto_1: String, Canto_2: String, Canto_3: String, Canto_4: String
# ---------- python_3_script_4: Python ----------
"""
=============================================================================
PROYECTO:      3dBimFab
COMPONENTE:    3dBimFab - Desglosador DfMA de Pieza Real NURBS (Materializer)
VERSIÓN:       3.2 Pureza DfMA (Exclusión Total de Barrenos & Salida Out)
DESCRIPCIÓN:   Clasifica geométricamente las caras de un Brep sólido en:
               - Caras Principales (A / B) según balance.
               - Cantos Perimetrales (1 a 4) planos exteriores o chaflanes a 45°.
               - Mecanizados (cilindros y fondos planos de barrenos -> siempre a MDP).
               - Emite reporte de auditoría por la salida 'Out'.
=============================================================================
"""

import Rhino

def parse_balance(val):
    s = str(val).lower().strip().replace('"', '').replace("'", "")
    if s in ["6", "d/d", "dyd", "doble", "ninguno", "ambas"] or "d/d" in s or "dyd" in s:
        return "DD"
    if s in ["5", "cara a", "a"] or (s.startswith("a") and len(s) <= 6):
        return "A"
    if s in ["4", "cara b", "b"] or (s.startswith("b") and len(s) <= 6):
        return "B"
    if "ambos" in s:
        return "AMBOS"
    return "B"

def parse_canto(val):
    s = str(val).lower().strip().replace('"', '').replace("'", "")
    if s in ["0", "0.0", "canto", "true", "si", "sí", "con canto"] or ("canto" in s and "sin" not in s):
        return True # Madera / Color
    if s in ["1", "1.0", "mdp", "false", "no", "sin canto"] or "mdp" in s or "sin" in s:
        return False # Crudo / MDP
    return True

def desglosar_pieza_real_nurbs(brep_in, balance_mode="Cara B", c1="Canto", c2="Canto", c3="Canto", c4="Canto"):
    if brep_in is None:
        return [], [], [], "Aviso: Brep de entrada es nulo"

    # 1. Medir BoundingBox de la envolvente exterior
    bbox = brep_in.GetBoundingBox(True)
    x0, x1 = bbox.Min.X, bbox.Max.X
    y0, y1 = bbox.Min.Y, bbox.Max.Y
    z0, z1 = bbox.Min.Z, bbox.Max.Z

    sx = max(0.1, x1 - x0)
    sy = max(0.1, y1 - y0)
    sz = max(0.1, z1 - z0)
    min_dim = min(sx, sy, sz)

    # Tolerancias geométricas
    tol = max(0.2, min_dim * 0.15)
    zona_bisel = max(tol * 2.5, min_dim * 2.2)

    faces_A = []
    faces_B = []
    faces_cantos = {1: [], 2: [], 3: [], 4: []}
    faces_mecanizados = []

    # 2. Clasificar cada cara real del Brep
    for i in range(brep_in.Faces.Count):
        f = brep_in.Faces[i]
        nurbs_face = f.DuplicateFace(False)

        # 🛡️ BLINDAJE 1: Cilindros y superficies curvas son mecanizados
        if not f.IsPlanar():
            faces_mecanizados.append(nurbs_face)
            continue

        u = (f.Domain(0).T0 + f.Domain(0).T1) * 0.5
        v = (f.Domain(1).T0 + f.Domain(1).T1) * 0.5
        pt = f.PointAt(u, v)
        n = f.NormalAt(u, v)
        n.Unitize()

        # -----------------------------------------------------------------
        # CASO 1: Tablero Horizontal (Cubiertas / Entrepaños - Espesor en Z)
        # -----------------------------------------------------------------
        if min_dim == sz:
            tipo_str = "Horizontal (Cubierta/Entrepaño)"
            if n.Z > 0.85 and abs(pt.Z - z1) < tol:
                faces_A.append(nurbs_face)
            elif n.Z < -0.85 and abs(pt.Z - z0) < tol:
                faces_B.append(nurbs_face)
            # Canto 1: Frontal (-Y)
            elif (n.Y < -0.85 and abs(pt.Y - y0) < tol) or (-0.85 < n.Y < -0.30 and (pt.Y - y0) < zona_bisel and abs(pt.Z - ((z0+z1)*0.5)) < (sz * 0.6)):
                faces_cantos[1].append(nurbs_face)
            # Canto 2: Trasero (+Y)
            elif (n.Y > 0.85 and abs(pt.Y - y1) < tol) or (0.30 < n.Y < 0.85 and (y1 - pt.Y) < zona_bisel and abs(pt.Z - ((z0+z1)*0.5)) < (sz * 0.6)):
                faces_cantos[2].append(nurbs_face)
            # Canto 3: Izquierdo (-X)
            elif (n.X < -0.85 and abs(pt.X - x0) < tol) or (-0.85 < n.X < -0.30 and (pt.X - x0) < zona_bisel and abs(pt.Z - ((z0+z1)*0.5)) < (sz * 0.6)):
                faces_cantos[3].append(nurbs_face)
            # Canto 4: Derecho (+X)
            elif (n.X > 0.85 and abs(pt.X - x1) < tol) or (0.30 < n.X < 0.85 and (x1 - pt.X) < zona_bisel and abs(pt.Z - ((z0+z1)*0.5)) < (sz * 0.6)):
                faces_cantos[4].append(nurbs_face)
            else:
                faces_mecanizados.append(nurbs_face)

        # -----------------------------------------------------------------
        # CASO 2: Tablero Vertical Lateral (Costados - Espesor en X)
        # -----------------------------------------------------------------
        elif min_dim == sx:
            tipo_str = "Vertical Lateral (Costado)"
            if n.X > 0.85 and abs(pt.X - x1) < tol:
                faces_A.append(nurbs_face)
            elif n.X < -0.85 and abs(pt.X - x0) < tol:
                faces_B.append(nurbs_face)
            # Canto 1: Frontal (-Y)
            elif (n.Y < -0.85 and abs(pt.Y - y0) < tol) or (-0.85 < n.Y < -0.30 and (pt.Y - y0) < zona_bisel and abs(pt.X - ((x0+x1)*0.5)) < (sx * 0.6)):
                faces_cantos[1].append(nurbs_face)
            # Canto 2: Trasero (+Y)
            elif (n.Y > 0.85 and abs(pt.Y - y1) < tol) or (0.30 < n.Y < 0.85 and (y1 - pt.Y) < zona_bisel and abs(pt.X - ((x0+x1)*0.5)) < (sx * 0.6)):
                faces_cantos[2].append(nurbs_face)
            # Canto 3: Superior (+Z)
            elif (n.Z > 0.85 and abs(pt.Z - z1) < tol) or (0.30 < n.Z < 0.85 and (z1 - pt.Z) < zona_bisel and abs(pt.X - ((x0+x1)*0.5)) < (sx * 0.6)):
                faces_cantos[3].append(nurbs_face)
            # Canto 4: Inferior (-Z)
            elif (n.Z < -0.85 and abs(pt.Z - z0) < tol) or (-0.85 < n.Z < -0.30 and (pt.Z - z0) < zona_bisel and abs(pt.X - ((x0+x1)*0.5)) < (sx * 0.6)):
                faces_cantos[4].append(nurbs_face)
            else:
                faces_mecanizados.append(nurbs_face)

        # -----------------------------------------------------------------
        # CASO 3: Tablero Vertical Frontal (Frentes / Puertas / Travesaños - Espesor en Y)
        # -----------------------------------------------------------------
        else:
            tipo_str = "Vertical Frontal (Frente/Puerta/Travesaño)"
            if n.Y < -0.85 and abs(pt.Y - y0) < tol:
                faces_A.append(nurbs_face)
            elif n.Y > 0.85 and abs(pt.Y - y1) < tol:
                faces_B.append(nurbs_face)
            # Canto 1: Superior (+Z) - Plano exterior O Chaflán inclinado a 45°
            elif (n.Z > 0.85 and abs(pt.Z - z1) < tol) or (0.30 < n.Z < 0.85 and (z1 - pt.Z) < zona_bisel and abs(pt.Y - ((y0+y1)*0.5)) < (sy * 0.6)):
                faces_cantos[1].append(nurbs_face)
            # Canto 2: Inferior (-Z) - Plano exterior O Chaflán inclinado a 45°
            elif (n.Z < -0.85 and abs(pt.Z - z0) < tol) or (-0.85 < n.Z < -0.30 and (pt.Z - z0) < zona_bisel and abs(pt.Y - ((y0+y1)*0.5)) < (sy * 0.6)):
                faces_cantos[2].append(nurbs_face)
            # Canto 3: Izquierdo (-X) - Plano exterior O Chaflán inclinado a 45° (Fondos de barreno quedan descartados)
            elif (n.X < -0.85 and abs(pt.X - x0) < tol) or (-0.85 < n.X < -0.30 and (pt.X - x0) < zona_bisel and abs(pt.Y - ((y0+y1)*0.5)) < (sy * 0.6)):
                faces_cantos[3].append(nurbs_face)
            # Canto 4: Derecho (+X) - Plano exterior O Chaflán inclinado a 45° (Fondos de barreno quedan descartados)
            elif (n.X > 0.85 and abs(pt.X - x1) < tol) or (0.30 < n.X < 0.85 and (x1 - pt.X) < zona_bisel and abs(pt.Y - ((y0+y1)*0.5)) < (sy * 0.6)):
                faces_cantos[4].append(nurbs_face)
            else:
                # 🛡️ Fondos planos de barreno a profundidad > tol caen obligatoriamente aquí
                faces_mecanizados.append(nurbs_face)

    # 3. Asignación de Caras Principales según Balance
    modo_b = parse_balance(balance_mode)
    nurbs_color = []
    nurbs_balance = []
    nurbs_mdp = []

    if modo_b == "DD":
        nurbs_color.extend(faces_A)
        nurbs_color.extend(faces_B)
        diag_bal = "D/D (Doble Cara Madera)"
    elif modo_b == "A":
        nurbs_balance.extend(faces_A)
        nurbs_color.extend(faces_B)
        diag_bal = "Balance en Cara A"
    elif modo_b == "B":
        nurbs_color.extend(faces_A)
        nurbs_balance.extend(faces_B)
        diag_bal = "Balance en Cara B"
    else:
        nurbs_balance.extend(faces_A)
        nurbs_balance.extend(faces_B)
        diag_bal = "Ambas Caras Balance"

    # 4. Asignación de Cantos
    cantos_in = {
        1: parse_canto(c1),
        2: parse_canto(c2),
        3: parse_canto(c3),
        4: parse_canto(c4)
    }

    for num_canto, tiene_canto in cantos_in.items():
        if tiene_canto:
            nurbs_color.extend(faces_cantos[num_canto])
        else:
            nurbs_mdp.extend(faces_cantos[num_canto])

    # 5. Todos los mecanizados, fondos y barrenos van SIEMPRE a MDP
    nurbs_mdp.extend(faces_mecanizados)

    diag = "{0} | {1} | Total Caras: {2} (A={3}, B={4}, Cantos={5}, Mec={6}) | Salida -> Color: {7}, Balance: {8}, MDP: {9}".format(
        tipo_str, diag_bal, brep_in.Faces.Count,
        len(faces_A), len(faces_B), sum(len(v) for v in faces_cantos.values()), len(faces_mecanizados),
        len(nurbs_color), len(nurbs_balance), len(nurbs_mdp)
    )

    return nurbs_color, nurbs_balance, nurbs_mdp, diag

# Ejecución
n_col, n_bal, n_mdp, diag_txt = desglosar_pieza_real_nurbs(
    Brep_In,
    Balance_Mode if 'Balance_Mode' in locals() else "Cara B",
    Canto_1 if 'Canto_1' in locals() else "Canto",
    Canto_2 if 'Canto_2' in locals() else "Canto",
    Canto_3 if 'Canto_3' in locals() else "Canto",
    Canto_4 if 'Canto_4' in locals() else "Canto"
)

# Salidas de Geometría
NURBS_Color = n_col
NURBS_Balance = n_bal
NURBS_MDP = n_mdp

# Salidas de Diagnóstico (compatibilidad total con Out, out, a, Info_Pieza)
Out = diag_txt
out = diag_txt
a = diag_txt
Info_Pieza = diag_txt
print(diag_txt)
# ---------- end python_3_script_4 ----------

brep_10 = Brep(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)
brep_11 = Brep([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])
brep_12 = Brep(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)
brep_13 = Brep(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)

box_mapping_v1_0 = Python3Script()  # -> a; inputs M: Mesh, B: Int32; disabled
# ---------- box_mapping_v1_0: Python ----------
"""
=============================================================================
PROYECTO:      3dBimFab
COMPONENTE:    3dBimFab - Box Mapping UV Métrico Cohesivo (600mm)
VERSIÓN:       v3.8 - DfMA Anatómico Granular & Cantos Siempre Longitudinales
AUTOR:         Mario Mojica & Gamma (3dBimFab Digital Manufacturing Engine)
DESCRIPCIÓN:   Mapeado métrico de 600 mm para piezas de taller y sólidos DWG:
               - La imagen tiene su veta de izquierda a derecha (Eje U).
               - Descompone mallas unidas (SplitDisjointPieces) para medir
                 las dimensiones físicas reales de cada pieza individual.
               - En Laterales de Cajón (sy > sz): veta corre a lo largo del cajón (Y).
               - En Costados de Mueble (sz >= sy): veta corre en altura vertical (Z).
               - En Cubiertas y Frentes: veta corre longitudinal a lo largo de X.
               - Cantos perimetrales: SIEMPRE longitudinales a su propio filo.
=============================================================================
"""

import Rhino

def extraer_valor_b(val):
    if val is None:
        return False
    while isinstance(val, (list, tuple)) and len(val) > 0:
        val = val[0]
    if hasattr(val, "Value"):
        val = val.Value
    
    s = str(val).lower().strip().replace('"', '').replace("'", "")
    return "atravesad" in s or s in ["1", "1.0", "true", "si", "sí", "3", "5"]

def _mapear_mesh_simple(mesh_in, modo_veta, escala_caja_mm=600.0):
    if mesh_in is None:
        return mesh_in

    mesh = mesh_in.DuplicateMesh() if hasattr(mesh_in, "DuplicateMesh") else mesh_in
    mesh.Normals.ComputeNormals()
    mesh.TextureCoordinates.Clear()

    bbox = mesh.GetBoundingBox(True)
    sx = max(0.001, bbox.Max.X - bbox.Min.X)
    sy = max(0.001, bbox.Max.Y - bbox.Min.Y)
    sz = max(0.001, bbox.Max.Z - bbox.Min.Z)

    min_dim = min(sx, sy, sz)
    es_atravesada = extraer_valor_b(modo_veta)
    escala = float(escala_caja_mm)

    for idx in range(mesh.Vertices.Count):
        v = mesh.Vertices[idx]
        n = mesh.Normals[idx] if idx < mesh.Normals.Count else Rhino.Geometry.Vector3f(0, 0, 1)

        lx = v.X - bbox.Min.X
        ly = v.Y - bbox.Min.Y
        lz = v.Z - bbox.Min.Z

        nx, ny, nz = abs(n.X), abs(n.Y), abs(n.Z)

        # -------------------------------------------------------------
        # CASO 1: Tablero Horizontal (Cubiertas, Entrepaños - Espesor en Z)
        # -------------------------------------------------------------
        if min_dim == sz:
            if nz >= nx and nz >= ny:
                # Cara principal (plano XY)
                u = ly / escala if es_atravesada else lx / escala
                v_coord = lx / escala if es_atravesada else ly / escala
            elif ny >= nx and ny >= nz:
                # Cantos frontal y trasero (en Y): veta longitudinal al filo (en X)
                u = lx / escala
                v_coord = lz / escala
            else:
                # Cantos laterales (en X): veta longitudinal al filo (en Y)
                u = ly / escala
                v_coord = lz / escala

        # -------------------------------------------------------------
        # CASO 2: Tablero Vertical Lateral (Costados / Laterales Cajón - Espesor en X)
        # -------------------------------------------------------------
        elif min_dim == sx:
            if nx >= ny and nx >= nz:
                # Cara principal (plano YZ)
                if sz >= sy:
                    # Costado de Mueble (alto en Z): Longitudinal corre en Z
                    u = ly / escala if es_atravesada else lz / escala
                    v_coord = lz / escala if es_atravesada else ly / escala
                else:
                    # Lateral de Cajón (largo en Y): Longitudinal corre a lo largo del cajón (Y)
                    u = lz / escala if es_atravesada else ly / escala
                    v_coord = ly / escala if es_atravesada else lz / escala
            elif nz >= nx and nz >= ny:
                # Cantos superior e inferior (en Z): veta siempre longitudinal al filo (en Y)
                u = ly / escala
                v_coord = lx / escala
            else:
                # Cantos frontal y trasero (en Y): veta siempre longitudinal al filo (en Z)
                u = lz / escala
                v_coord = lx / escala

        # -------------------------------------------------------------
        # CASO 3: Tablero Vertical Frontal (Frentes, Zócalos - Espesor en Y)
        # -------------------------------------------------------------
        else:
            if ny >= nx and ny >= nz:
                # Cara principal (plano XZ): Longitudinal corre horizontal en X
                u = lz / escala if es_atravesada else lx / escala
                v_coord = lx / escala if es_atravesada else lz / escala
            elif nz >= nx and nz >= ny:
                # Cantos superior e inferior (en Z): veta longitudinal al filo (en X)
                u = lx / escala
                v_coord = ly / escala
            else:
                # Cantos laterales (en X): veta longitudinal al filo (en Z)
                u = lz / escala
                v_coord = ly / escala

        mesh.TextureCoordinates.Add(float(u), float(v_coord))

    return mesh

def aplicar_box_mapping_profesional(mesh_in, modo_veta=0, escala_caja_mm=600.0):
    if mesh_in is None or not isinstance(mesh_in, Rhino.Geometry.Mesh):
        return mesh_in

    if hasattr(mesh_in, "SplitDisjointPieces"):
        piezas = mesh_in.SplitDisjointPieces()
    else:
        piezas = [mesh_in]

    if len(piezas) > 1:
        mesh_out = Rhino.Geometry.Mesh()
        for p in piezas:
            p_mapped = _mapear_mesh_simple(p, modo_veta, escala_caja_mm)
            mesh_out.Append(p_mapped)
        return mesh_out
    else:
        return _mapear_mesh_simple(mesh_in, modo_veta, escala_caja_mm)

# =============================================================================
# INYECCIÓN Y EJECUCIÓN (Compatible con List Access en B)
# =============================================================================
val_b = B if 'B' in locals() and B is not None else 0

if isinstance(M, list):
    a = [aplicar_box_mapping_profesional(item, val_b, 600.0) for item in M if item is not None]
else:
    a = aplicar_box_mapping_profesional(M, val_b, 600.0)
# ---------- end box_mapping_v1_0 ----------
mesh_channel_separator_v2_4_4 = Python3Script()  # -> out, Color, Balance, MDP; inputs M_In: list of Mesh; disabled
# ---------- mesh_channel_separator_v2_4_4: Python ----------
# -*- coding: utf-8 -*-
"""
=============================================================================
3BF Mesh Channel Separator v2.4.4 (Tolerancia Estricta Anti-Mecanizados)
Powered by 3dBimFab
=============================================================================
"""

import Rhino.Geometry as rg

def unwrap_mesh(obj):
    """Extrae un Rhino.Geometry.Mesh nativo de cualquier tipo o contenedor GH."""
    if obj is None:
        return None
    if hasattr(obj, "Value"):
        obj = obj.Value
    if isinstance(obj, rg.Mesh):
        return obj
    return None

def extract_submesh(src_mesh, face_indices):
    """Extrae un submesh preservando UVs y Normales."""
    if not face_indices or src_mesh is None:
        return None
    sub = rg.Mesh()
    v_map = {}
    has_uv = (src_mesh.TextureCoordinates.Count == src_mesh.Vertices.Count)
    has_normals = (src_mesh.Normals.Count == src_mesh.Vertices.Count)
    for fi in face_indices:
        face = src_mesh.Faces[fi]
        v_candidates = [face.A, face.B, face.C]
        if face.IsQuad:
            v_candidates.append(face.D)
        new_v = []
        for vi in v_candidates:
            if vi not in v_map:
                idx = sub.Vertices.Add(src_mesh.Vertices[vi])
                v_map[vi] = idx
                if has_uv:
                    sub.TextureCoordinates.Add(src_mesh.TextureCoordinates[vi])
                if has_normals:
                    sub.Normals.Add(src_mesh.Normals[vi])
            new_v.append(v_map[vi])
        if len(new_v) == 3:
            sub.Faces.AddFace(new_v[0], new_v[1], new_v[2])
        elif len(new_v) == 4:
            sub.Faces.AddFace(new_v[0], new_v[1], new_v[2], new_v[3])
    sub.Normals.ComputeNormals()
    sub.Compact()
    return sub

Color = None
Balance = None
MDP = None
diag_msgs = []

def log(msg):
    diag_msgs.append(str(msg))

try:
    raw_m = globals().get('M_In', None)
    mesh = None
    
    if isinstance(raw_m, (list, tuple)):
        valid_meshes = []
        for item in raw_m:
            m_native = unwrap_mesh(item)
            if m_native and m_native.Faces.Count > 0:
                valid_meshes.append(m_native)
        if len(valid_meshes) == 1:
            mesh = valid_meshes[0]
        elif len(valid_meshes) > 1:
            mesh = rg.Mesh()
            for m in valid_meshes:
                mesh.Append(m)
    else:
        mesh = unwrap_mesh(raw_m)

    if mesh is None or mesh.Faces.Count == 0:
        raise Exception("No se pudo obtener una malla válida (M_In está vacío o no es Mesh).")

    mode = str(Balance_Mode) if 'Balance_Mode' in globals() and Balance_Mode else "Cara B"
    c1 = str(Canto_1) if 'Canto_1' in globals() and Canto_1 else "MDP"
    c2 = str(Canto_2) if 'Canto_2' in globals() and Canto_2 else "MDP"
    c3 = str(Canto_3) if 'Canto_3' in globals() and Canto_3 else "MDP"
    c4 = str(Canto_4) if 'Canto_4' in globals() and Canto_4 else "MDP"

    bbox = mesh.GetBoundingBox(True)
    sx = bbox.Max.X - bbox.Min.X
    sy = bbox.Max.Y - bbox.Min.Y
    sz = bbox.Max.Z - bbox.Min.Z

    dims = [("X", sx, bbox.Min.X, bbox.Max.X),
            ("Y", sy, bbox.Min.Y, bbox.Max.Y),
            ("Z", sz, bbox.Min.Z, bbox.Max.Z)]
    dims.sort(key=lambda d: d[1])

    eje_esp = dims[0][0]
    esp_val = dims[0][1]
    min_esp = dims[0][2]
    max_esp = dims[0][3]

    ejes_cantos = [dims[1], dims[2]]
    ejes_cantos.sort(key=lambda d: d[0])
    eje_u = ejes_cantos[0]
    eje_v = ejes_cantos[1]

    mesh.FaceNormals.ComputeFaceNormals()

    # TOLERANCIA ESTRICTA:
    # Las caras exteriores del tablero plano están a menos de 0.25 mm del BoundingBox.
    # Cualquier perforación a 2 o 3 mm queda automáticamente excluida de Cara A y Cara B.
    tol_esp = 0.25  # mm
    tol_u = 0.35    # mm
    tol_v = 0.35    # mm

    faces_A = []
    faces_B = []
    faces_canto_1 = []
    faces_canto_2 = []
    faces_canto_3 = []
    faces_canto_4 = []
    faces_resto = []

    for fi in range(mesh.Faces.Count):
        face = mesh.Faces[fi]
        pts = [mesh.Vertices[face.A], mesh.Vertices[face.B], mesh.Vertices[face.C]]
        if face.IsQuad:
            pts.append(mesh.Vertices[face.D])

        cx = sum(p.X for p in pts) / float(len(pts))
        cy = sum(p.Y for p in pts) / float(len(pts))
        cz = sum(p.Z for p in pts) / float(len(pts))

        c_dict = {"X": cx, "Y": cy, "Z": cz}
        c_esp = c_dict[eje_esp]
        c_u = c_dict[eje_u[0]]
        c_v = c_dict[eje_v[0]]

        fn = mesh.FaceNormals[fi]
        n_len = fn.Length
        if n_len > 1e-6:
            norm = rg.Vector3d(fn.X / n_len, fn.Y / n_len, fn.Z / n_len)
        else:
            norm = rg.Vector3d(0, 0, 1)

        n_dict = {"X": norm.X, "Y": norm.Y, "Z": norm.Z}
        n_esp = n_dict[eje_esp]
        n_u = n_dict[eje_u[0]]
        n_v = n_dict[eje_v[0]]

        # 1. CARAS PRINCIPALES EXTERIORES (Normal paralela y estricta en el plano exterior)
        if abs(n_esp) >= 0.70:
            if abs(c_esp - max_esp) <= tol_esp:
                faces_A.append(fi)
                continue
            elif abs(c_esp - min_esp) <= tol_esp:
                faces_B.append(fi)
                continue

        # 2. CANTOS EXTERIORES (Normal perpendicular al espesor y estricta en el borde)
        if abs(n_esp) < 0.35:
            if abs(c_u - eje_u[3]) <= tol_u and n_u > 0.4:
                faces_canto_1.append(fi)
                continue
            elif abs(c_u - eje_u[2]) <= tol_u and n_u < -0.4:
                faces_canto_2.append(fi)
                continue
            elif abs(c_v - eje_v[3]) <= tol_v and n_v > 0.4:
                faces_canto_3.append(fi)
                continue
            elif abs(c_v - eje_v[2]) <= tol_v and n_v < -0.4:
                faces_canto_4.append(fi)
                continue

        # 3. INTERIORES Y MECANIZADOS (Fondos de orificios, cavidades, paredes internas)
        faces_resto.append(fi)

    log("Clasificación estricta: CaraA={}, CaraB={}, C1={}, C2={}, C3={}, C4={}, Mecanizados={}".format(
        len(faces_A), len(faces_B), len(faces_canto_1), len(faces_canto_2),
        len(faces_canto_3), len(faces_canto_4), len(faces_resto)
    ))

    idx_color = []
    idx_balance = []
    idx_mdp = []

    if mode == "Ambas":
        idx_balance.extend(faces_A)
    else:
        idx_color.extend(faces_A)

    if mode in ["Cara B", "Ambas"]:
        idx_balance.extend(faces_B)
    else:
        idx_color.extend(faces_B)

    cantos_cfg = [(faces_canto_1, c1), (faces_canto_2, c2), (faces_canto_3, c3), (faces_canto_4, c4)]
    for f_list, dest in cantos_cfg:
        if dest == "Color":
            idx_color.extend(f_list)
        elif dest == "Balance":
            idx_balance.extend(f_list)
        else:
            idx_mdp.extend(f_list)

    # Mecanizados (orificios de minifix, tarugos, ranuras) van SIEMPRE al canal MDP
    idx_mdp.extend(faces_resto)

    Color = extract_submesh(mesh, idx_color)
    Balance = extract_submesh(mesh, idx_balance)
    MDP = extract_submesh(mesh, idx_mdp)

    log("Canales generados: Color={}, Balance={}, MDP={}".format(
        Color.Faces.Count if Color else 0,
        Balance.Faces.Count if Balance else 0,
        MDP.Faces.Count if MDP else 0
    ))

except Exception as e:
    log("ERROR: {}".format(str(e)))

out = "\n".join(diag_msgs)
print(out)
# ---------- end mesh_channel_separator_v2_4_4 ----------
materializer_v1_0 = Python3Script()  # -> out, Pieza_1, Pieza_2, Pieza_3, Pieza_4; inputs Brep_In: list of Brep; disabled
# ---------- materializer_v1_0: Python ----------
"""
=============================================================================
3BF Materializer v1.0 (Clean Face Consolidator)
Powered by 3dBimFab
=============================================================================
Desglosa cada Closed Brep de entrada preservando el 100% de sus caras NURBS
(caras A/B, cantos perimetrales y mecanizados/ranuras con trimmed loops intactos)
y las emite consolidadas e independientes por pieza física (Pieza_1 a Pieza_4).
=============================================================================
"""
import Rhino

def consolidar_caras_pieza(brep_in):
    if brep_in is None:
        return [], "Brep nulo"

    bbox = brep_in.GetBoundingBox(True)
    x0, x1 = bbox.Min.X, bbox.Max.X
    y0, y1 = bbox.Min.Y, bbox.Max.Y
    z0, z1 = bbox.Min.Z, bbox.Max.Z

    sx = max(0.1, x1 - x0)
    sy = max(0.1, y1 - y0)
    sz = max(0.1, z1 - z0)
    min_dim = min(sx, sy, sz)

    tol = max(0.2, min_dim * 0.15)
    zona_bisel = max(tol * 2.5, min_dim * 2.5)

    faces_A = []
    faces_B = []
    faces_cantos = []
    faces_mecanizados = []

    # Extraer cada cara manteniendo los cortes de ranura intactos
    for i in range(brep_in.Faces.Count):
        f = brep_in.Faces[i]
        u = (f.Domain(0).T0 + f.Domain(0).T1) * 0.5
        v = (f.Domain(1).T0 + f.Domain(1).T1) * 0.5
        pt = f.PointAt(u, v)
        n = f.NormalAt(u, v)
        n.Unitize()
        nurbs_face = f.DuplicateFace(False)

        # Tablero Vertical Lateral (Espesor en X)
        if min_dim == sx:
            if n.X > 0.85 and abs(pt.X - x1) < tol:
                faces_A.append(nurbs_face)
            elif n.X < -0.85 and abs(pt.X - x0) < tol:
                faces_B.append(nurbs_face)
            elif (abs(pt.Y - y0) < zona_bisel or abs(y1 - pt.Y) < zona_bisel or
                  abs(pt.Z - z0) < zona_bisel or abs(z1 - pt.Z) < zona_bisel):
                faces_cantos.append(nurbs_face)
            else:
                faces_mecanizados.append(nurbs_face)

        # Tablero Horizontal (Espesor en Z)
        elif min_dim == sz:
            if n.Z > 0.85 and abs(pt.Z - z1) < tol:
                faces_A.append(nurbs_face)
            elif n.Z < -0.85 and abs(pt.Z - z0) < tol:
                faces_B.append(nurbs_face)
            elif (abs(pt.Y - y0) < zona_bisel or abs(y1 - pt.Y) < zona_bisel or
                  abs(pt.X - x0) < zona_bisel or abs(x1 - pt.X) < zona_bisel):
                faces_cantos.append(nurbs_face)
            else:
                faces_mecanizados.append(nurbs_face)

        # Tablero Vertical Frontal (Espesor en Y)
        else:
            if n.Y < -0.85 and abs(pt.Y - y0) < tol:
                faces_A.append(nurbs_face)
            elif n.Y > 0.85 and abs(pt.Y - y1) < tol:
                faces_B.append(nurbs_face)
            elif (abs(pt.X - x0) < zona_bisel or abs(x1 - pt.X) < zona_bisel or
                  abs(pt.Z - z0) < zona_bisel or abs(z1 - pt.Z) < zona_bisel):
                faces_cantos.append(nurbs_face)
            else:
                faces_mecanizados.append(nurbs_face)

    # Consolidar todas las caras que componen esta pieza
    todas_las_caras = []
    todas_las_caras.extend(faces_A)
    todas_las_caras.extend(faces_B)
    todas_las_caras.extend(faces_cantos)
    todas_las_caras.extend(faces_mecanizados)

    diag = "Caras: {} (A={}, B={}, Cantos={}, Mecanizados={})".format(
        len(todas_las_caras), len(faces_A), len(faces_B),
        len(faces_cantos), len(faces_mecanizados)
    )

    return todas_las_caras, diag


# -------------------------------------------------------------
# EJECUCIÓN PRINCIPAL
# -------------------------------------------------------------
lista_breps = []
if 'Brep_In' in locals() and Brep_In is not None:
    if hasattr(Brep_In, "__iter__") and not isinstance(Brep_In, Rhino.Geometry.Brep):
        lista_breps = [b for b in Brep_In if b is not None]
    else:
        lista_breps = [Brep_In]

resultados_piezas = []
diagnosticos = []

for idx, b in enumerate(lista_breps):
    caras, d_txt = consolidar_caras_pieza(b)
    resultados_piezas.append(caras)
    diagnosticos.append("Pieza {}: {}".format(idx + 1, d_txt))

# Salidas dedicadas por pieza (Pieza_1 a Pieza_4)
Pieza_1 = resultados_piezas[0] if len(resultados_piezas) > 0 else []
Pieza_2 = resultados_piezas[1] if len(resultados_piezas) > 1 else []
Pieza_3 = resultados_piezas[2] if len(resultados_piezas) > 2 else []
Pieza_4 = resultados_piezas[3] if len(resultados_piezas) > 3 else []

# Emisión directa hacia la consola de fábrica 'Out'
print("\n".join(diagnosticos) if diagnosticos else "Sin piezas de entrada")
# ---------- end materializer_v1_0 ----------
box_mapping_v1_0_fondos = Python3Script()  # -> a; inputs M: Mesh, B: Int32; disabled; same code as box_mapping_v1_0
rh_in_21_1_separacion = Slider(2, range=1..4)  # disabled
rh_in_21_1_lado_color = ValueList({"Cara A", "Cara B"}, selected="Cara A")  # disabled
rh_in_21_2_sustrato = ValueList({"MDF 1 Cara": "MDF 1 cara", "Doble Cara (D/D)": "DD", "MDF Crudo": "Crudo", "Con Balance": "Balance"}, selected="MDF 1 Cara")  # disabled
materializer_v1_1_fondos = Python3Script(Separacion_Mm=rh_in_21_1_separacion)  # -> out, Pieza_1, Pieza_2, Pieza_3, Pieza_4; inputs Brep_In: list of Brep, Separacion_Mm: Double; disabled
# ---------- materializer_v1_1_fondos: Python ----------
"""
=============================================================================
3BF Materializer v1.1 (Clean Face Consolidator con Holgura Paramétrica de Fondos)
Powered by 3dBimFab
=============================================================================
1. Detecta y ordena los fondos de izquierda a derecha en X.
2. Aplica holgura/separación paramétrica (Separacion_Mm) en las juntas de contacto,
   preservando intactos los bordes exteriores de agarre en los laterales.
3. Desglosa cada Closed Brep resultante preservando el 100% de sus caras NURBS
   (caras A/B, cantos perimetrales) y las emite limpias por pieza física (Pieza_1 a Pieza_4).
=============================================================================
"""
import Rhino

# -------------------------------------------------------------
# 1. PARÁMETRO DE SEPARACIÓN ENTRE FONDOS (SLIDER)
# -------------------------------------------------------------
separacion = 2.0  # Valor por defecto en mm

for var_name in ['Separacion_Mm', 'Separacion', 'separacion', 'Junta_Mm', 'Holgura_Mm', 'Holgura']:
    if var_name in locals() and locals()[var_name] is not None:
        try:
            separacion = float(locals()[var_name])
            break
        except:
            pass


# -------------------------------------------------------------
# 2. FUNCIÓN DE CONSOLIDACIÓN DE CARAS NURBS
# -------------------------------------------------------------
def consolidar_caras_pieza(brep_in):
    if brep_in is None:
        return [], "Brep nulo"

    bbox = brep_in.GetBoundingBox(True)
    x0, x1 = bbox.Min.X, bbox.Max.X
    y0, y1 = bbox.Min.Y, bbox.Max.Y
    z0, z1 = bbox.Min.Z, bbox.Max.Z

    sx = max(0.1, x1 - x0)
    sy = max(0.1, y1 - y0)
    sz = max(0.1, z1 - z0)
    min_dim = min(sx, sy, sz)

    tol = max(0.2, min_dim * 0.15)
    zona_bisel = max(tol * 2.5, min_dim * 2.5)

    faces_A = []
    faces_B = []
    faces_cantos = []
    faces_mecanizados = []

    # Extraer cada cara manteniendo trimmed loops intactos
    for i in range(brep_in.Faces.Count):
        f = brep_in.Faces[i]
        u = (f.Domain(0).T0 + f.Domain(0).T1) * 0.5
        v = (f.Domain(1).T0 + f.Domain(1).T1) * 0.5
        pt = f.PointAt(u, v)
        n = f.NormalAt(u, v)
        n.Unitize()
        nurbs_face = f.DuplicateFace(False)

        # Tablero Vertical Lateral (Espesor en X)
        if min_dim == sx:
            if n.X > 0.85 and abs(pt.X - x1) < tol:
                faces_A.append(nurbs_face)
            elif n.X < -0.85 and abs(pt.X - x0) < tol:
                faces_B.append(nurbs_face)
            elif (abs(pt.Y - y0) < zona_bisel or abs(y1 - pt.Y) < zona_bisel or
                  abs(pt.Z - z0) < zona_bisel or abs(z1 - pt.Z) < zona_bisel):
                faces_cantos.append(nurbs_face)
            else:
                faces_mecanizados.append(nurbs_face)

        # Tablero Horizontal (Espesor en Z)
        elif min_dim == sz:
            if n.Z > 0.85 and abs(pt.Z - z1) < tol:
                faces_A.append(nurbs_face)
            elif n.Z < -0.85 and abs(pt.Z - z0) < tol:
                faces_B.append(nurbs_face)
            elif (abs(pt.Y - y0) < zona_bisel or abs(y1 - pt.Y) < zona_bisel or
                  abs(pt.X - x0) < zona_bisel or abs(x1 - pt.X) < zona_bisel):
                faces_cantos.append(nurbs_face)
            else:
                faces_mecanizados.append(nurbs_face)

        # Tablero Vertical Frontal/Fondo (Espesor en Y)
        else:
            if n.Y < -0.85 and abs(pt.Y - y0) < tol:
                faces_A.append(nurbs_face)
            elif n.Y > 0.85 and abs(pt.Y - y1) < tol:
                faces_B.append(nurbs_face)
            elif (abs(pt.X - x0) < zona_bisel or abs(x1 - pt.X) < zona_bisel or
                  abs(pt.Z - z0) < zona_bisel or abs(z1 - pt.Z) < zona_bisel):
                faces_cantos.append(nurbs_face)
            else:
                faces_mecanizados.append(nurbs_face)

    todas_las_caras = []
    todas_las_caras.extend(faces_A)
    todas_las_caras.extend(faces_B)
    todas_las_caras.extend(faces_cantos)
    todas_las_caras.extend(faces_mecanizados)

    diag = "Caras: {} (A={}, B={}, Cantos={}, Mec={})".format(
        len(todas_las_caras), len(faces_A), len(faces_B),
        len(faces_cantos), len(faces_mecanizados)
    )

    return todas_las_caras, diag


# -------------------------------------------------------------
# 3. RECOLECCIÓN Y ORDENAMIENTO DE BREPS (X ASCENDENTE)
# -------------------------------------------------------------
lista_breps = []
if 'Brep_In' in locals() and Brep_In is not None:
    if hasattr(Brep_In, "__iter__") and not isinstance(Brep_In, Rhino.Geometry.Brep):
        lista_breps = [b for b in Brep_In if b is not None and b.IsValid]
    else:
        if Brep_In.IsValid:
            lista_breps = [Brep_In]

# Ordenar de izquierda a derecha según el centroide X
breps_ordenados = []
for b in lista_breps:
    bb = b.GetBoundingBox(True)
    breps_ordenados.append((bb.Center.X, b))
breps_ordenados.sort(key=lambda item: item[0])
lista_breps = [item[1] for item in breps_ordenados]

num_piezas = len(lista_breps)
delta = separacion * 0.5  # Retracción simétrica por junta (ej. 2mm / 2 = 1mm)


# -------------------------------------------------------------
# 4. APLICACIÓN DE SEPARACIÓN Y PROCESAMIENTO
# -------------------------------------------------------------
resultados_piezas = []
diagnosticos = []

for idx, b in enumerate(lista_breps):
    bbox = b.GetBoundingBox(True)
    x0, x1 = bbox.Min.X, bbox.Max.X
    y0, y1 = bbox.Min.Y, bbox.Max.Y
    z0, z1 = bbox.Min.Z, bbox.Max.Z

    ancho_original = x1 - x0

    # Ajuste paramétrico de los bordes X
    if num_piezas > 1 and separacion > 0.0:
        if idx == 0:
            # Fondo 1 (Izquierdo): exterior intacto, junta derecha retrocede
            nuevo_x0 = x0
            nuevo_x1 = x1 - delta
            tipo_fondo = "Extremo Izquierdo (Ranura Izq protegida)"
        elif idx == num_piezas - 1:
            # Fondo 4 (Derecho): junta izquierda retrocede, exterior intacto
            nuevo_x0 = x0 + delta
            nuevo_x1 = x1
            tipo_fondo = "Extremo Derecho (Ranura Der protegida)"
        else:
            # Fondos 2 y 3 (Intermedios): retroceden por ambos lados
            nuevo_x0 = x0 + delta
            nuevo_x1 = x1 - delta
            tipo_fondo = "Intermedio (Holgura bilateral)"
    else:
        nuevo_x0 = x0
        nuevo_x1 = x1
        tipo_fondo = "Único"

    ancho_nuevo = nuevo_x1 - nuevo_x0

    # Reconstrucción geométrica como Brep limpio con holgura
    nuevo_box = Rhino.Geometry.BoundingBox(nuevo_x0, y0, z0, nuevo_x1, y1, z1)
    brep_ajustado = Rhino.Geometry.Brep.CreateFromBox(nuevo_box)
    if brep_ajustado is None or not brep_ajustado.IsValid:
        brep_ajustado = b  # Respaldo

    # Consolidar caras NURBS para texturizado y visualizador
    caras, d_txt = consolidar_caras_pieza(brep_ajustado)
    resultados_piezas.append(caras)

    diagnosticos.append("Pieza {} [{}]: Ancho {:.1f}mm -> {:.1f}mm | {}".format(
        idx + 1, tipo_fondo, ancho_original, ancho_nuevo, d_txt
    ))


# -------------------------------------------------------------
# 5. SALIDAS DE GRASSHOPPER
# -------------------------------------------------------------
Pieza_1 = resultados_piezas[0] if len(resultados_piezas) > 0 else []
Pieza_2 = resultados_piezas[1] if len(resultados_piezas) > 1 else []
Pieza_3 = resultados_piezas[2] if len(resultados_piezas) > 2 else []
Pieza_4 = resultados_piezas[3] if len(resultados_piezas) > 3 else []

print("Separación configurada: {:.2f} mm".format(separacion))
print("\n".join(diagnosticos) if diagnosticos else "Sin piezas de entrada")
# ---------- end materializer_v1_1_fondos ----------
mesh_channel_separator_v2_6_fondos = Python3Script(Lado_Color=rh_in_21_1_lado_color, Material_Mode=rh_in_21_2_sustrato)  # -> out, Color, MDF; inputs M_In: list of Mesh, Lado_Color: String, Material_Mode: String; disabled
# ---------- mesh_channel_separator_v2_6_fondos: Python ----------
# -*- coding: utf-8 -*-
"""
=============================================================================
3BF Mesh Channel Separator v2.6 Fondos (Universal UV & DfMA Aware)
Powered by 3dBimFab
=============================================================================
Entradas:
  - M_In: Mallas del fondo (Tree, List o Item). Type Hint: Mesh
  - Lado_Color: "Cara A" o "Cara B" (Value List o String).
  - Material_Mode: "MDF 1 Cara", "DD", "Crudo" (Value List o String).
Salidas:
  - out: Consola de diagnóstico.
  - Color: Caras con acabado decorativo (Tono Fondo).
  - MDF: Cantos perimetrales y reverso en MDF crudo.
=============================================================================
"""
import Rhino
import rhinoscriptsyntax as rs

def extraer_malla_universal(c):
    if c is None: return None
    if isinstance(c, Rhino.Geometry.Mesh): return c
    if hasattr(c, "Faces") and hasattr(c, "Vertices"): return c
    val = getattr(c, "Value", c)
    if isinstance(val, Rhino.Geometry.Mesh): return val
    if hasattr(val, "Faces") and hasattr(val, "Vertices"): return val
    try:
        m = rs.coercemesh(c)
        if m: return m
    except:
        pass
    return None

def aplanar_candidatos(obj):
    res = []
    if obj is None: return res
    if hasattr(obj, "AllData"):
        for item in obj.AllData():
            m = extraer_malla_universal(item)
            if m: res.append(m)
        return res
    if hasattr(obj, "Branches"):
        for branch in obj.Branches:
            for item in branch:
                m = extraer_malla_universal(item)
                if m: res.append(m)
        return res
    if isinstance(obj, (list, tuple)):
        for item in obj:
            res.extend(aplanar_candidatos(item))
        return res
    m = extraer_malla_universal(obj)
    if m: res.append(m)
    return res

def parse_lado(val):
    s = str(val).lower().strip()
    if "b" in s: return "B"
    return "A"

def parse_material(val):
    s = str(val).lower().strip()
    if "dd" in s or "doble" in s or "2 cara" in s: return "DD"
    if "crudo" in s: return "CRUDO"
    return "MDF_1_CARA"

def crear_submalla_uv(mesh_origen, face_indices):
    """Extrae las caras indicadas preservando exactamente sus coordenadas de textura UV."""
    if not face_indices:
        return None
    sub = Rhino.Geometry.Mesh()
    vert_map = {}
    for fi in face_indices:
        f = mesh_origen.Faces[fi]
        idx_face = [f.A, f.B, f.C]
        if f.IsQuad:
            idx_face.append(f.D)

        nuevos_idx = []
        for vi in idx_face:
            if vi not in vert_map:
                new_vi = sub.Vertices.Add(mesh_origen.Vertices[vi])
                if mesh_origen.TextureCoordinates.Count > vi:
                    sub.TextureCoordinates.Add(mesh_origen.TextureCoordinates[vi])
                if mesh_origen.Normals.Count > vi:
                    sub.Normals.Add(mesh_origen.Normals[vi])
                vert_map[vi] = new_vi
            nuevos_idx.append(vert_map[vi])

        if len(nuevos_idx) == 3:
            sub.Faces.AddFace(nuevos_idx[0], nuevos_idx[1], nuevos_idx[2])
        elif len(nuevos_idx) == 4:
            sub.Faces.AddFace(nuevos_idx[0], nuevos_idx[1], nuevos_idx[2], nuevos_idx[3])

    sub.Normals.ComputeNormals()
    sub.Compact()
    return sub

# 1. Normalizar Entradas
lado_sel = parse_lado(Lado_Color if 'Lado_Color' in globals() and Lado_Color else "Cara A")
modo_mat = parse_material(Material_Mode if 'Material_Mode' in globals() and Material_Mode else "MDF 1 Cara")

# 2. Desempaquetar Mallas del Fondo
mallas_fondo = aplanar_candidatos(M_In if 'M_In' in globals() else None)

out_color = []
out_mdf = []

for mesh in mallas_fondo:
    if not mesh or mesh.Faces.Count == 0:
        continue

    bb = mesh.GetBoundingBox(True)
    x0, x1 = bb.Min.X, bb.Max.X
    y0, y1 = bb.Min.Y, bb.Max.Y
    z0, z1 = bb.Min.Z, bb.Max.Z

    sx = max(0.1, x1 - x0)
    sy = max(0.1, y1 - y0)
    sz = max(0.1, z1 - z0)

    # Identificar el eje del espesor (en fondos verticales es Y)
    dims = [("X", sx), ("Y", sy), ("Z", sz)]
    dims.sort(key=lambda d: d[1])
    eje_esp = dims[0][0]
    espesor = dims[0][1]
    tol = max(0.3, espesor * 0.40)

    faces_A_idx = []
    faces_B_idx = []
    cantos_idx = []

    # Clasificar cada cara geométrica del sólido
    for fi in range(mesh.Faces.Count):
        f = mesh.Faces[fi]
        pts = [mesh.Vertices[f.A], mesh.Vertices[f.B], mesh.Vertices[f.C]]
        if f.IsQuad:
            pts.append(mesh.Vertices[f.D])

        cx = sum(p.X for p in pts) / float(len(pts))
        cy = sum(p.Y for p in pts) / float(len(pts))
        cz = sum(p.Z for p in pts) / float(len(pts))

        if eje_esp == "Y":
            # Fondos verticales traseros:
            # y1 = Cara que mira hacia el frente / interior del mueble (Cara A - VISTA)
            # y0 = Cara que mira hacia la pared / exterior trasero (Cara B - TRASERA MDF)
            if abs(cy - y1) < tol:
                faces_A_idx.append(fi)
            elif abs(cy - y0) < tol:
                faces_B_idx.append(fi)
            else:
                cantos_idx.append(fi)

        elif eje_esp == "Z":
            # Fondos horizontales de cajón:
            # z1 = Cara superior interior del cajón (Cara A - VISTA)
            # z0 = Cara inferior exterior del cajón (Cara B - MDF)
            if abs(cz - z1) < tol:
                faces_A_idx.append(fi)
            elif abs(cz - z0) < tol:
                faces_B_idx.append(fi)
            else:
                cantos_idx.append(fi)

        else: # X (Divisiones verticales o fondos laterales)
            if abs(cx - x1) < tol:
                faces_A_idx.append(fi)
            elif abs(cx - x0) < tol:
                faces_B_idx.append(fi)
            else:
                cantos_idx.append(fi)

    # 3. Lógica DfMA según Material_Mode y Lado_Color
    color_indices = []
    mdf_indices = []

    if modo_mat == "DD":
        color_indices.extend(faces_A_idx)
        color_indices.extend(faces_B_idx)
        mdf_indices.extend(cantos_idx)
    elif modo_mat == "CRUDO":
        mdf_indices.extend(faces_A_idx)
        mdf_indices.extend(faces_B_idx)
        mdf_indices.extend(cantos_idx)
    else: # MDF_1_CARA (Estándar de Fábrica)
        if lado_sel == "A":
            color_indices.extend(faces_A_idx) # Cara frontal vista en Color
            mdf_indices.extend(faces_B_idx)    # Cara trasera en MDF crudo
        else:
            color_indices.extend(faces_B_idx)
            mdf_indices.extend(faces_A_idx)
        mdf_indices.extend(cantos_idx)

    # 4. Generar las submallas UV independientes
    sub_color = crear_submalla_uv(mesh, color_indices)
    if sub_color: out_color.append(sub_color)

    sub_mdf = crear_submalla_uv(mesh, mdf_indices)
    if sub_mdf: out_mdf.append(sub_mdf)

# Asignar Salidas
Color = out_color
MDF = out_mdf

print("Fondos: {} | Material: {} | Color: Cara {} -> Color={}, MDF={}".format(
    len(mallas_fondo), modo_mat, lado_sel, len(Color), len(MDF)
))
# ---------- end mesh_channel_separator_v2_6_fondos ----------

# ---- group: Antiguo
materializer_v0_2_chaflan = Python3Script()  # -> Out, NURBS_Color, NURBS_Balance, NURBS_MDP, Info_Pieza; inputs Brep_In: Brep, Balance_Mode: String, Canto_1: String, Canto_2: String, Canto_3: String, Canto_4: String; disabled
# ---------- materializer_v0_2_chaflan: Python ----------
"""
3BF Materializer v0.2
Motor DfMA de Desglose de Caras Paramétricas para Manufactura Digital
Soporta: Caras Planas Ortogonales, Chaflanes/Biseles a 45° (Tiradores Integrados) y Mecanizados CNC
Autor: Mario Mojica & Antigravity
"""

import Rhino

def parse_balance(val):
    s = str(val).lower().strip().replace('"', '').replace("'", "")
    if s in ["6", "d/d", "dyd", "doble", "ninguno", "ambas"] or "d/d" in s or "dyd" in s:
        return "DD"
    if s in ["5", "cara a", "a"] or (s.startswith("a") and len(s) <= 6):
        return "A"
    if s in ["4", "cara b", "b"] or (s.startswith("b") and len(s) <= 6):
        return "B"
    if "ambos" in s:
        return "AMBOS"
    return "B"

def parse_canto(val):
    s = str(val).lower().strip().replace('"', '').replace("'", "")
    if s in ["0", "0.0", "canto", "true", "si", "sí", "con canto"] or ("canto" in s and "sin" not in s):
        return True # Madera / Color
    if s in ["1", "1.0", "mdp", "false", "no", "sin canto"] or "mdp" in s or "sin" in s:
        return False # Crudo / MDP
    return True

def desglosar_pieza_real_nurbs(brep_in, balance_mode="Cara B", c1="Canto", c2="Canto", c3="Canto", c4="Canto"):
    if brep_in is None:
        return [], [], [], "Brep de entrada es nulo"

    # 1. Medir BoundingBox de la envolvente exterior
    bbox = brep_in.GetBoundingBox(True)
    x0, x1 = bbox.Min.X, bbox.Max.X
    y0, y1 = bbox.Min.Y, bbox.Max.Y
    z0, z1 = bbox.Min.Z, bbox.Max.Z

    sx = max(0.1, x1 - x0)
    sy = max(0.1, y1 - y0)
    sz = max(0.1, z1 - z0)
    min_dim = min(sx, sy, sz)

    # Tolerancia para planos principales y zona de influencia de biseles/chaflanes
    tol = max(0.2, min_dim * 0.15)
    zona_bisel = max(tol * 2.5, min_dim * 2.5)

    faces_A = []
    faces_B = []
    faces_cantos = {1: [], 2: [], 3: [], 4: []}
    faces_mecanizados = []

    # 2. Clasificar cada cara real de la pieza
    for i in range(brep_in.Faces.Count):
        f = brep_in.Faces[i]
        u = (f.Domain(0).T0 + f.Domain(0).T1) * 0.5
        v = (f.Domain(1).T0 + f.Domain(1).T1) * 0.5
        pt = f.PointAt(u, v)
        n = f.NormalAt(u, v)
        n.Unitize()
        nurbs_face = f.DuplicateFace(False)

        # -------------------------------------------------------------
        # CASO 1: Tablero Horizontal (Cubiertas / Entrepaños - Espesor en Z)
        # -------------------------------------------------------------
        if min_dim == sz:
            tipo_str = "Horizontal (Cubierta/Entrepaño)"
            # Cara A (+Z exterior)
            if n.Z > 0.85 and abs(pt.Z - z1) < tol:
                faces_A.append(nurbs_face)
            # Cara B (-Z exterior)
            elif n.Z < -0.85 and abs(pt.Z - z0) < tol:
                faces_B.append(nurbs_face)
            # Canto 1: Frontal (-Y exterior, plano o chaflán)
            elif n.Y < -0.20 and (pt.Y - y0) < zona_bisel:
                faces_cantos[1].append(nurbs_face)
            # Canto 2: Trasero (+Y exterior, plano o chaflán)
            elif n.Y > 0.20 and (y1 - pt.Y) < zona_bisel:
                faces_cantos[2].append(nurbs_face)
            # Canto 3: Izquierdo (-X exterior, plano o chaflán)
            elif n.X < -0.20 and (pt.X - x0) < zona_bisel:
                faces_cantos[3].append(nurbs_face)
            # Canto 4: Derecho (+X exterior, plano o chaflán)
            elif n.X > 0.20 and (x1 - pt.X) < zona_bisel:
                faces_cantos[4].append(nurbs_face)
            else:
                faces_mecanizados.append(nurbs_face)

        # -------------------------------------------------------------
        # CASO 2: Tablero Vertical Lateral (Costados / Parales - Espesor en X)
        # -------------------------------------------------------------
        elif min_dim == sx:
            tipo_str = "Vertical Lateral (Costado/Paral)"
            # Cara A (+X exterior)
            if n.X > 0.85 and abs(pt.X - x1) < tol:
                faces_A.append(nurbs_face)
            # Cara B (-X exterior)
            elif n.X < -0.85 and abs(pt.X - x0) < tol:
                faces_B.append(nurbs_face)
            # Canto 1: Frontal (-Y exterior, plano o chaflán)
            elif n.Y < -0.20 and (pt.Y - y0) < zona_bisel:
                faces_cantos[1].append(nurbs_face)
            # Canto 2: Trasero (+Y exterior, plano o chaflán)
            elif n.Y > 0.20 and (y1 - pt.Y) < zona_bisel:
                faces_cantos[2].append(nurbs_face)
            # Canto 3: Superior (+Z exterior, plano o chaflán)
            elif n.Z > 0.20 and (z1 - pt.Z) < zona_bisel:
                faces_cantos[3].append(nurbs_face)
            # Canto 4: Inferior (-Z exterior, plano o chaflán)
            elif n.Z < -0.20 and (pt.Z - z0) < zona_bisel:
                faces_cantos[4].append(nurbs_face)
            else:
                faces_mecanizados.append(nurbs_face)

        # -------------------------------------------------------------
        # CASO 3: Tablero Vertical Frontal (Frentes / Puertas - Espesor en Y)
        # -------------------------------------------------------------
        else:
            tipo_str = "Vertical Frontal (Frente / Puerta)"
            # Cara A Frontal Delantera (-Y exterior visible)
            if n.Y < -0.85 and abs(pt.Y - y0) < tol:
                faces_A.append(nurbs_face)
            # Cara B Trasera (+Y interior)
            elif n.Y > 0.85 and abs(pt.Y - y1) < tol:
                faces_B.append(nurbs_face)
            # Canto 1: Superior (Plano Y Bisel/Tirador Diagonal a 45° en la zona alta)
            elif n.Z > 0.20 and (z1 - pt.Z) < zona_bisel:
                faces_cantos[1].append(nurbs_face)
            # Canto 2: Inferior (Plano o Bisel en la zona baja)
            elif n.Z < -0.20 and (pt.Z - z0) < zona_bisel:
                faces_cantos[2].append(nurbs_face)
            # Canto 3: Izquierdo (Plano o Bisel en lateral izquierdo)
            elif n.X < -0.20 and (pt.X - x0) < zona_bisel:
                faces_cantos[3].append(nurbs_face)
            # Canto 4: Derecho (Plano o Bisel en lateral derecho)
            elif n.X > 0.20 and (x1 - pt.X) < zona_bisel:
                faces_cantos[4].append(nurbs_face)
            else:
                # Perforaciones cilíndricas, cajas de minifix y ranuras de fondo
                faces_mecanizados.append(nurbs_face)

    # 3. Asignación de Caras Principales según Balance
    modo_b = parse_balance(balance_mode)
    nurbs_color = []
    nurbs_balance = []
    nurbs_mdp = []

    if modo_b == "DD": # Doble Decorativo (ambas a Color)
        nurbs_color.extend(faces_A)
        nurbs_color.extend(faces_B)
        diag_bal = "D/D (Ambas Caras Madera)"
    elif modo_b == "A": # Balance en Cara A
        nurbs_balance.extend(faces_A)
        nurbs_color.extend(faces_B)
        diag_bal = "Balance Cara A"
    elif modo_b == "B": # Balance en Cara B
        nurbs_color.extend(faces_A)
        nurbs_balance.extend(faces_B)
        diag_bal = "Balance Cara B"
    else:
        nurbs_balance.extend(faces_A)
        nurbs_balance.extend(faces_B)
        diag_bal = "Ambos Balance"

    # 4. Asignación de Cantos (1: Canto 1, 2: Canto 2, 3: Canto 3, 4: Canto 4)
    cantos_in = {
        1: parse_canto(c1),
        2: parse_canto(c2),
        3: parse_canto(c3),
        4: parse_canto(c4)
    }

    c_color_count = 0
    for num_canto, tiene_canto in cantos_in.items():
        if tiene_canto:
            nurbs_color.extend(faces_cantos[num_canto])
            c_color_count += len(faces_cantos[num_canto])
        else:
            nurbs_mdp.extend(faces_cantos[num_canto])

    # 5. INYECCIÓN DfMA: Mecanizados internos (taladros, ranuras) van SIEMPRE a MDP
    nurbs_mdp.extend(faces_mecanizados)

    diag = "{0} | {1} | Total Caras: {2} (A={3}, B={4}, Cantos={5}, Mecanizados={6}) | Breps Salida -> Color: {7}, Balance: {8}, MDP: {9}".format(
        tipo_str, diag_bal, brep_in.Faces.Count,
        len(faces_A), len(faces_B), sum(len(v) for v in faces_cantos.values()), len(faces_mecanizados),
        len(nurbs_color), len(nurbs_balance), len(nurbs_mdp)
    )

    return nurbs_color, nurbs_balance, nurbs_mdp, diag


# Ejecución
n_col, n_bal, n_mdp, diag_txt = desglosar_pieza_real_nurbs(
    Brep_In,
    Balance_Mode if 'Balance_Mode' in locals() else "Cara B",
    Canto_1 if 'Canto_1' in locals() else "Canto",
    Canto_2 if 'Canto_2' in locals() else "Canto",
    Canto_3 if 'Canto_3' in locals() else "Canto",
    Canto_4 if 'Canto_4' in locals() else "Canto"
)

# Salidas multinombre
NURBS_Color = n_col
Nurbs_Color = n_col
nurbs_color = n_col
Mesh_Color = n_col

NURBS_Balance = n_bal
Nurbs_Balance = n_bal
nurbs_balance = n_bal
Mesh_Balance = n_bal

NURBS_MDP = n_mdp
Nurbs_MDP = n_mdp
nurbs_mdp = n_mdp
Mesh_MDP = n_mdp

Info_Pieza = diag_txt
# ---------- end materializer_v0_2_chaflan ----------

# ----
brep_14 = Brep(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)
brep_15 = Brep(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)
brep_16 = Brep(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)
brep_17 = Brep(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)
brep_18 = Brep(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)
brep_19 = Brep(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)
brep_20 = Brep(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)

# ---- group: Zocalo Frontal
rh_in_03_1_lado_balance = ValueList({"Cara A", "Cara B", "D/D"}, selected="Cara B")
rh_in_03_2_canto_frontal = ValueList({"Canto": 0, "MDP": 1}, selected="MDP")
rh_in_03_3_canto_trasero = ValueList({"Canto": 0, "MDP": 1}, selected="MDP")
rh_in_03_4canto_izquierdo_arriba = ValueList({"Canto": 0, "MDP": 1}, selected="MDP")
rh_in_03_5_canto_derecho_abajo = ValueList({"Canto": 0, "MDP": 1}, selected="MDP")
segmentacion = ValueList({"Triángulos": 0, "Quads y triángulos (mixto)": 1, "Sólo quads si es posible": 2}, selected="Sólo quads si es posible")
rh_in_03_0_mapeado = ValueList({"Longitudinal": 0, "Atravesada": 1}, selected="Longitudinal")

# Materializer 3.4
python_3_script_5 = Python3Script(
    Brep_In=brep,
    Balance_Mode=rh_in_03_1_lado_balance,
    Canto_1=rh_in_03_2_canto_frontal,
    Canto_2=rh_in_03_3_canto_trasero,
    Canto_3=rh_in_03_4canto_izquierdo_arriba,
    Canto_4=rh_in_03_5_canto_derecho_abajo)  # -> Out, NURBS_Color, NURBS_Balance, NURBS_MDP; inputs Brep_In: list of Brep, Balance_Mode: String, Canto_1: String, Canto_2: String, Canto_3: String, Canto_4: String
# ---------- python_3_script_5: Python ----------
"""
=============================================================================
PROYECTO:      3dBimFab
COMPONENTE:    3dBimFab - Desglosador DfMA de Pieza Real NURBS (Materializer)
VERSIÓN:       3.4 DfMA Inteligencia Total (Simetría Dual + Cierre de Ranuras)
AUTOR:         Mario Mojica & Gamma (3dBimFab Digital Manufacturing Engine)
DESCRIPCIÓN:   Clasifica geométricamente las caras de piezas NURBS / Breps en:
               - Caras Principales (A = Exterior / B = Interior) con auto-detección
                 de simetría (por centroide relativo Xmid y por presencia de ranura).
               - Cantos Perimetrales (1 a 4) planos o chaflanes a 45°.
               - Mecanizados y Ranuras (SIEMPRE a MDP, sin descartar ninguna cara).
               - 100% compatible con Item Access o List Access en Grasshopper.
=============================================================================
"""

import Rhino

def parse_balance(val):
    s = str(val).lower().strip().replace('"', '').replace("'", "")
    if s in ["6", "d/d", "dyd", "doble", "ninguno", "ambas"] or "d/d" in s or "dyd" in s:
        return "DD"
    if s in ["5", "cara a", "a"] or (s.startswith("a") and len(s) <= 6):
        return "A"
    if s in ["4", "cara b", "b"] or (s.startswith("b") and len(s) <= 6):
        return "B"
    if "ambos" in s:
        return "AMBOS"
    return "B"

def parse_canto(val):
    s = str(val).lower().strip().replace('"', '').replace("'", "")
    if s in ["0", "0.0", "canto", "true", "si", "sí", "con canto"] or ("canto" in s and "sin" not in s):
        return True # Madera / Color
    if s in ["1", "1.0", "mdp", "false", "no", "sin canto"] or "mdp" in s or "sin" in s:
        return False # Crudo / MDP
    return True

def clasificar_brep_individual(brep_in, balance_mode="Cara B", c1="Canto", c2="Canto", c3="Canto", c4="Canto", is_left=None):
    if brep_in is None:
        return [], [], [], "Aviso: Brep nulo"

    bbox = brep_in.GetBoundingBox(True)
    x0, x1 = bbox.Min.X, bbox.Max.X
    y0, y1 = bbox.Min.Y, bbox.Max.Y
    z0, z1 = bbox.Min.Z, bbox.Max.Z

    sx = max(0.1, x1 - x0)
    sy = max(0.1, y1 - y0)
    sz = max(0.1, z1 - z0)
    min_dim = min(sx, sy, sz)

    # Tolerancia geométrica adaptativa (invariante a escala metros/milímetros)
    tol = max(0.0002, min_dim * 0.15)
    zona_bisel = min_dim * 2.2

    # Detección anatómica de simetría si is_left no vino definido externamente
    if is_left is None and min_dim == sx:
        count_x0 = 0
        count_x1 = 0
        for i in range(brep_in.Faces.Count):
            f = brep_in.Faces[i]
            if f.IsPlanar():
                u = (f.Domain(0).T0 + f.Domain(0).T1) * 0.5
                v = (f.Domain(1).T0 + f.Domain(1).T1) * 0.5
                pt = f.PointAt(u, v)
                n = f.NormalAt(u, v)
                n.Unitize()
                if n.X < -0.85 and abs(pt.X - x0) < tol:
                    count_x0 += 1
                elif n.X > 0.85 and abs(pt.X - x1) < tol:
                    count_x1 += 1
        
        # En un lateral de cajón, el lado interior tiene al menos 2 caras por la ranura (arriba y abajo)
        # mientras que el lado exterior es 1 sola cara continua.
        if count_x1 > count_x0:
            # Más caras en +X (ranura interior hacia +X) -> Lateral Izquierdo
            is_left = True
        elif count_x0 > count_x1:
            # Más caras en -X (ranura interior hacia -X) -> Lateral Derecho
            is_left = False
        else:
            xc = (x0 + x1) * 0.5
            is_left = (xc < 0)

    faces_A = []
    faces_B = []
    faces_cantos = {1: [], 2: [], 3: [], 4: []}
    faces_mecanizados = []

    for i in range(brep_in.Faces.Count):
        f = brep_in.Faces[i]
        nurbs_face = f.DuplicateFace(False)

        if not f.IsPlanar():
            faces_mecanizados.append(nurbs_face)
            continue

        u = (f.Domain(0).T0 + f.Domain(0).T1) * 0.5
        v = (f.Domain(1).T0 + f.Domain(1).T1) * 0.5
        pt = f.PointAt(u, v)
        n = f.NormalAt(u, v)
        n.Unitize()

        # -----------------------------------------------------------------
        # CASO 1: Tablero Horizontal (Cubiertas / Entrepaños / Fondos cajón - Espesor en Z)
        # -----------------------------------------------------------------
        if min_dim == sz:
            tipo_str = "Horizontal (Cubierta/Entrepaño/Fondo)"
            if n.Z > 0.85 and abs(pt.Z - z1) < tol:
                faces_A.append(nurbs_face)
            elif n.Z < -0.85 and abs(pt.Z - z0) < tol:
                faces_B.append(nurbs_face)
            # Canto 1: Frontal (-Y)
            elif (n.Y < -0.85 and abs(pt.Y - y0) < tol) or (-0.85 < n.Y < -0.30 and (pt.Y - y0) < zona_bisel and abs(pt.Z - ((z0+z1)*0.5)) < (sz * 0.6)):
                faces_cantos[1].append(nurbs_face)
            # Canto 2: Trasero (+Y)
            elif (n.Y > 0.85 and abs(pt.Y - y1) < tol) or (0.30 < n.Y < 0.85 and (y1 - pt.Y) < zona_bisel and abs(pt.Z - ((z0+z1)*0.5)) < (sz * 0.6)):
                faces_cantos[2].append(nurbs_face)
            # Canto 3: Izquierdo (-X)
            elif (n.X < -0.85 and abs(pt.X - x0) < tol) or (-0.85 < n.X < -0.30 and (pt.X - x0) < zona_bisel and abs(pt.Z - ((z0+z1)*0.5)) < (sz * 0.6)):
                faces_cantos[3].append(nurbs_face)
            # Canto 4: Derecho (+X)
            elif (n.X > 0.85 and abs(pt.X - x1) < tol) or (0.30 < n.X < 0.85 and (x1 - pt.X) < zona_bisel and abs(pt.Z - ((z0+z1)*0.5)) < (sz * 0.6)):
                faces_cantos[4].append(nurbs_face)
            else:
                faces_mecanizados.append(nurbs_face)

        # -----------------------------------------------------------------
        # CASO 2: Tablero Vertical Lateral (Costados / Laterales Cajón - Espesor en X)
        # -----------------------------------------------------------------
        elif min_dim == sx:
            tipo_str = "Vertical Lateral (Costado/Lateral Cajón {})".format("IZQ" if is_left else "DER")
            
            # Detectar caras límites exteriores en x0 (-X) y x1 (+X)
            # En un lateral con ranura, la cara interior está dividida por la ranura (>= 2 caras)
            # y la cara exterior es una sola cara continua (1 cara).
            faces_x0 = []
            faces_x1 = []
            
            # Cantos y mecanizados se van clasificando
            for f_idx in range(brep_in.Faces.Count):
                f_cur = brep_in.Faces[f_idx]
                n_face = f_cur.DuplicateFace(False)
                if not f_cur.IsPlanar():
                    faces_mecanizados.append(n_face)
                    continue
                u = (f_cur.Domain(0).T0 + f_cur.Domain(0).T1) * 0.5
                v = (f_cur.Domain(1).T0 + f_cur.Domain(1).T1) * 0.5
                pt = f_cur.PointAt(u, v)
                n = f_cur.NormalAt(u, v)
                n.Unitize()
                
                if n.X < -0.85 and abs(pt.X - x0) < tol:
                    faces_x0.append(n_face)
                elif n.X > 0.85 and abs(pt.X - x1) < tol:
                    faces_x1.append(n_face)
                elif (n.Y < -0.85 and abs(pt.Y - y0) < tol) or (-0.85 < n.Y < -0.30 and (pt.Y - y0) < zona_bisel and abs(pt.X - ((x0+x1)*0.5)) < (sx * 0.6)):
                    faces_cantos[1].append(n_face)
                elif (n.Y > 0.85 and abs(pt.Y - y1) < tol) or (0.30 < n.Y < 0.85 and (y1 - pt.Y) < zona_bisel and abs(pt.X - ((x0+x1)*0.5)) < (sx * 0.6)):
                    faces_cantos[2].append(n_face)
                elif (n.Z > 0.85 and abs(pt.Z - z1) < tol) or (0.30 < n.Z < 0.85 and (z1 - pt.Z) < zona_bisel and abs(pt.X - ((x0+x1)*0.5)) < (sx * 0.6)):
                    faces_cantos[3].append(n_face)
                elif (n.Z < -0.85 and abs(pt.Z - z0) < tol) or (-0.85 < n.Z < -0.30 and (pt.Z - z0) < zona_bisel and abs(pt.X - ((x0+x1)*0.5)) < (sx * 0.6)):
                    faces_cantos[4].append(n_face)
                else:
                    faces_mecanizados.append(n_face)
            
            # Asignación DfMA infalible:
            # Cara B = Siempre Interior (con ranura)
            # Cara A = Siempre Exterior (lisa continua)
            if len(faces_x1) > len(faces_x0):
                # Interior está en +X (Lateral Izquierdo)
                faces_A.extend(faces_x0)
                faces_B.extend(faces_x1)
            elif len(faces_x0) > len(faces_x1):
                # Interior está en -X (Lateral Derecho)
                faces_A.extend(faces_x1)
                faces_B.extend(faces_x0)
            else:
                # Si son iguales (sin ranura), usar is_left
                if is_left:
                    faces_A.extend(faces_x0)
                    faces_B.extend(faces_x1)
                else:
                    faces_A.extend(faces_x1)
                    faces_B.extend(faces_x0)
            
            # Saltamos el bucle individual ya que procesamos todas las caras de este Brep
            break

        # -----------------------------------------------------------------
        # CASO 3: Tablero Vertical Frontal (Frentes / Traseras Cajón / Puertas / Zócalos - Espesor en Y)
        # -----------------------------------------------------------------
        else:
            tipo_str = "Vertical Frontal (Frente/Trasera/Puerta)"
            if n.Y < -0.85 and abs(pt.Y - y0) < tol:
                faces_A.append(nurbs_face)
            elif n.Y > 0.85 and abs(pt.Y - y1) < tol:
                faces_B.append(nurbs_face)
            # Canto 1: Superior (+Z)
            elif (n.Z > 0.85 and abs(pt.Z - z1) < tol) or (0.30 < n.Z < 0.85 and (z1 - pt.Z) < zona_bisel and abs(pt.Y - ((y0+y1)*0.5)) < (sy * 0.6)):
                faces_cantos[1].append(nurbs_face)
            # Canto 2: Inferior (-Z)
            elif (n.Z < -0.85 and abs(pt.Z - z0) < tol) or (-0.85 < n.Z < -0.30 and (pt.Z - z0) < zona_bisel and abs(pt.Y - ((y0+y1)*0.5)) < (sy * 0.6)):
                faces_cantos[2].append(nurbs_face)
            # Canto 3: Izquierdo (-X)
            elif (n.X < -0.85 and abs(pt.X - x0) < tol) or (-0.85 < n.X < -0.30 and (pt.X - x0) < zona_bisel and abs(pt.Y - ((y0+y1)*0.5)) < (sy * 0.6)):
                faces_cantos[3].append(nurbs_face)
            # Canto 4: Derecho (+X)
            elif (n.X > 0.85 and abs(pt.X - x1) < tol) or (0.30 < n.X < 0.85 and (x1 - pt.X) < zona_bisel and abs(pt.Y - ((y0+y1)*0.5)) < (sy * 0.6)):
                faces_cantos[4].append(nurbs_face)
            else:
                faces_mecanizados.append(nurbs_face)

    # 3. Asignación de Caras Principales según Balance
    modo_b = parse_balance(balance_mode)
    nurbs_color = []
    nurbs_balance = []
    nurbs_mdp = []

    if modo_b == "DD":
        nurbs_color.extend(faces_A)
        nurbs_color.extend(faces_B)
        diag_bal = "D/D (Doble Cara Madera)"
    elif modo_b == "A":
        nurbs_balance.extend(faces_A)
        nurbs_color.extend(faces_B)
        diag_bal = "Balance en Cara A (Exterior)"
    elif modo_b == "B":
        nurbs_color.extend(faces_A)
        nurbs_balance.extend(faces_B)
        diag_bal = "Balance en Cara B (Interior)"
    else:
        nurbs_balance.extend(faces_A)
        nurbs_balance.extend(faces_B)
        diag_bal = "Ambas Caras Balance"

    # 4. Asignación de Cantos
    cantos_in = {
        1: parse_canto(c1),
        2: parse_canto(c2),
        3: parse_canto(c3),
        4: parse_canto(c4)
    }

    for num_canto, tiene_canto in cantos_in.items():
        if tiene_canto:
            nurbs_color.extend(faces_cantos[num_canto])
        else:
            nurbs_mdp.extend(faces_cantos[num_canto])

    # 5. Mecanizados y barrenos siempre van a MDP
    nurbs_mdp.extend(faces_mecanizados)

    diag = "{0} | {1} | Caras: {2} (A={3}, B={4}, Cantos={5}, Mec={6})".format(
        tipo_str, diag_bal, brep_in.Faces.Count,
        len(faces_A), len(faces_B), sum(len(v) for v in faces_cantos.values()), len(faces_mecanizados)
    )

    return nurbs_color, nurbs_balance, nurbs_mdp, diag

def ejecutar_materializer_dfma(brep_input, b_mode, c1, c2, c3, c4):
    if brep_input is None:
        return [], [], [], "Brep nulo"

    if hasattr(brep_input, "__iter__") and not hasattr(brep_input, "Faces"):
        breps = [b for b in brep_input if b is not None]
    else:
        breps = [brep_input]

    if not breps:
        return [], [], [], "Lista de Breps vacía"

    is_left_flags = [None] * len(breps)
    if len(breps) > 1:
        bboxes = []
        for b in breps:
            bb = b.GetBoundingBox(True)
            bboxes.append({
                "xc": (bb.Min.X + bb.Max.X) * 0.5,
                "yc": (bb.Min.Y + bb.Max.Y) * 0.5,
                "zc": (bb.Min.Z + bb.Max.Z) * 0.5,
                "sx": bb.Max.X - bb.Min.X,
                "sy": bb.Max.Y - bb.Min.Y,
                "sz": bb.Max.Z - bb.Min.Z
            })

        # Calcular X_min y X_max global del grupo de laterales (funciona en metros y milímetros)
        xs = [info["xc"] for info in bboxes if min(info["sx"], info["sy"], info["sz"]) == info["sx"]]
        if len(xs) >= 2 and (max(xs) - min(xs)) > 0.05:
            mid_x_global = (min(xs) + max(xs)) * 0.5
            for i, info in enumerate(bboxes):
                if min(info["sx"], info["sy"], info["sz"]) == info["sx"]:
                    is_left_flags[i] = (info["xc"] < mid_x_global)

    all_col = []
    all_bal = []
    all_mdp = []
    diag_lines = []

    for idx, b in enumerate(breps):
        flag = is_left_flags[idx]
        col, bal, mdp, diag = clasificar_brep_individual(b, b_mode, c1, c2, c3, c4, is_left=flag)
        all_col.extend(col)
        all_bal.extend(bal)
        all_mdp.extend(mdp)
        diag_lines.append("P{0}: {1}".format(idx+1, diag))

    res_diag = " | ".join(diag_lines) if len(diag_lines) <= 3 else "{0} piezas procesadas DfMA. {1}".format(len(breps), diag_lines[0])
    return all_col, all_bal, all_mdp, res_diag

# =============================================================================
# EJECUCIÓN GRASSHOPPER
# =============================================================================
_b_mode = Balance_Mode if 'Balance_Mode' in locals() and Balance_Mode is not None else "Cara B"
_c1 = Canto_1 if 'Canto_1' in locals() and Canto_1 is not None else "Canto"
_c2 = Canto_2 if 'Canto_2' in locals() and Canto_2 is not None else "Canto"
_c3 = Canto_3 if 'Canto_3' in locals() and Canto_3 is not None else "Canto"
_c4 = Canto_4 if 'Canto_4' in locals() and Canto_4 is not None else "Canto"

NURBS_Color, NURBS_Balance, NURBS_MDP, Out = ejecutar_materializer_dfma(
    Brep_In, _b_mode, _c1, _c2, _c3, _c4
)

out = Out
a = Out
Info_Pieza = Out
print(Out)
# ---------- end python_3_script_5 ----------
# ---- group: Frente de Cajon
rh_in_02_1_lado_balance = ValueList({"Cara A", "Cara B", "D/D"}, selected="Cara B")
rh_in_02_2_canto_frontal = ValueList({"Canto": 0, "MDP": 1}, selected="MDP")
rh_in_02_3_canto_trasero = ValueList({"Canto": 0, "MDP": 1}, selected="MDP")
rh_in_02_4canto_izquierdo_arriba = ValueList({"Canto": 0, "MDP": 1}, selected="MDP")
rh_in_02_5_canto_derecho_abajo = ValueList({"Canto": 0, "MDP": 1}, selected="MDP")
segmentacion_2 = ValueList({"Triángulos": 0, "Quads y triángulos (mixto)": 1, "Sólo quads si es posible": 2}, selected="Sólo quads si es posible")
rh_in_02_0_mapeado = ValueList({"Longitudinal": 0, "Atravesada": 1}, selected="Longitudinal")

# Materializer 3.4
python_3_script_6 = Python3Script(
    Brep_In=brep_2,
    Balance_Mode=rh_in_02_1_lado_balance,
    Canto_1=rh_in_02_2_canto_frontal,
    Canto_2=rh_in_02_3_canto_trasero,
    Canto_3=rh_in_02_4canto_izquierdo_arriba,
    Canto_4=rh_in_02_5_canto_derecho_abajo)  # -> Out, NURBS_Color, NURBS_Balance, NURBS_MDP; inputs Brep_In: list of Brep, Balance_Mode: String, Canto_1: String, Canto_2: String, Canto_3: String, Canto_4: String; same code as python_3_script_5

# ---- group: Cubierta Superior
rh_in_08_1_lado_balance = ValueList({"Cara A", "Cara B", "D/D"}, selected="Cara B")
rh_in_08_2_canto_frontal = ValueList({"Canto": 0, "MDP": 1}, selected="MDP")
rh_in_08_4canto_izquierdo_arriba = ValueList({"Canto": 0, "MDP": 1}, selected="MDP")
rh_in_08_5_canto_derecho_abajo = ValueList({"Canto": 0, "MDP": 1}, selected="MDP")
rh_in_08_3_canto_trasero = ValueList({"Canto": 0, "MDP": 1}, selected="MDP")
segmentacion_3 = ValueList({"Triángulos": 0, "Quads y triángulos (mixto)": 1, "Sólo quads si es posible": 2}, selected="Sólo quads si es posible")
rh_in_08_0_mapeado = ValueList({"Longitudinal": 0, "Atravesada": 1}, selected="Longitudinal")

# Materializer 3.4
python_3_script_7 = Python3Script(
    Brep_In=brep_6,
    Balance_Mode=rh_in_08_1_lado_balance,
    Canto_1=rh_in_08_2_canto_frontal,
    Canto_2=rh_in_08_3_canto_trasero,
    Canto_3=rh_in_08_4canto_izquierdo_arriba,
    Canto_4=rh_in_08_5_canto_derecho_abajo)  # -> Out, NURBS_Color, NURBS_Balance, NURBS_MDP; inputs Brep_In: list of Brep, Balance_Mode: String, Canto_1: String, Canto_2: String, Canto_3: String, Canto_4: String; same code as python_3_script_5

# ---- group: Fondos de Cajon
rh_in_09_1_lado_balance = ValueList({"Cara A", "Cara B", "D/D"}, selected="Cara B")
rh_in_09_2_canto_frontal = ValueList({"Canto": 0, "MDP": 1}, selected="MDP")
rh_in_09_4canto_izquierdo_arriba = ValueList({"Canto": 0, "MDP": 1}, selected="MDP")
rh_in_09_5_canto_derecho_abajo = ValueList({"Canto": 0, "MDP": 1}, selected="MDP")
rh_in_09_3_canto_trasero = ValueList({"Canto": 0, "MDP": 1}, selected="MDP")
segmentacion_4 = ValueList({"Triángulos": 0, "Quads y triángulos (mixto)": 1, "Sólo quads si es posible": 2}, selected="Sólo quads si es posible")
rh_in_09_0_mapeado = ValueList({"Longitudinal": 0, "Atravesada": 1}, selected="Longitudinal")

# Materializer 3.4
python_3_script_8 = Python3Script(
    Brep_In=brep_3,
    Balance_Mode=rh_in_09_1_lado_balance,
    Canto_1=rh_in_09_2_canto_frontal,
    Canto_2=rh_in_09_3_canto_trasero,
    Canto_3=rh_in_09_4canto_izquierdo_arriba,
    Canto_4=rh_in_09_5_canto_derecho_abajo)  # -> Out, NURBS_Color, NURBS_Balance, NURBS_MDP; inputs Brep_In: list of Brep, Balance_Mode: String, Canto_1: String, Canto_2: String, Canto_3: String, Canto_4: String; same code as python_3_script_5

# ---- group: Costado Derecho
rh_in_05_1_lado_balance = ValueList({"Cara A", "Cara B", "D/D"}, selected="Cara B")
rh_in_05_2_canto_frontal = ValueList({"Canto": 0, "MDP": 1}, selected="MDP")
rh_in_05_4canto_izquierdo_arriba = ValueList({"Canto": 0, "MDP": 1}, selected="MDP")
rh_in_05_5_canto_derecho_abajo = ValueList({"Canto": 0, "MDP": 1}, selected="MDP")
rh_in_05_3_canto_trasero = ValueList({"Canto": 0, "MDP": 1}, selected="MDP")
segmentacion_5 = ValueList({"Triángulos": 0, "Quads y triángulos (mixto)": 1, "Sólo quads si es posible": 2}, selected="Sólo quads si es posible")
rh_in_05_0_mapeado = ValueList({"Longitudinal": 0, "Atravesada": 1}, selected="Longitudinal")

# Materializer 3.4
python_3_script_9 = Python3Script(
    Brep_In=brep_4,
    Balance_Mode=rh_in_05_1_lado_balance,
    Canto_1=rh_in_05_2_canto_frontal,
    Canto_2=rh_in_05_3_canto_trasero,
    Canto_3=rh_in_05_4canto_izquierdo_arriba,
    Canto_4=rh_in_05_5_canto_derecho_abajo)  # -> Out, NURBS_Color, NURBS_Balance, NURBS_MDP; inputs Brep_In: list of Brep, Balance_Mode: String, Canto_1: String, Canto_2: String, Canto_3: String, Canto_4: String; same code as python_3_script_5

# ---- group: Espaldares
rh_in_10_1_lado_balance = ValueList({"Cara A", "Cara B", "D/D"}, selected="Cara B")
rh_in_10_2_canto_frontal = ValueList({"Canto": 0, "MDP": 1}, selected="MDP")
rh_in_10_4canto_izquierdo_arriba = ValueList({"Canto": 0, "MDP": 1}, selected="MDP")
rh_in_10_5_canto_derecho_abajo = ValueList({"Canto": 0, "MDP": 1}, selected="MDP")
rh_in_10_3_canto_trasero = ValueList({"Canto": 0, "MDP": 1}, selected="MDP")
segmentacion_6 = ValueList({"Triángulos": 0, "Quads y triángulos (mixto)": 1, "Sólo quads si es posible": 2}, selected="Sólo quads si es posible")
rh_in_10_0_mapeado = ValueList({"Longitudinal": 0, "Atravesada": 1}, selected="Longitudinal")

# Materializer 3.4
python_3_script_10 = Python3Script(
    Brep_In=brep_7,
    Balance_Mode=rh_in_10_1_lado_balance,
    Canto_1=rh_in_10_2_canto_frontal,
    Canto_2=rh_in_10_3_canto_trasero,
    Canto_3=rh_in_10_4canto_izquierdo_arriba,
    Canto_4=rh_in_10_5_canto_derecho_abajo)  # -> Out, NURBS_Color, NURBS_Balance, NURBS_MDP; inputs Brep_In: list of Brep, Balance_Mode: String, Canto_1: String, Canto_2: String, Canto_3: String, Canto_4: String; same code as python_3_script_5

# ---- group: Tapaluces IZ
rh_in_04_1_lado_balance = ValueList({"Cara A", "Cara B", "D/D"}, selected="Cara B")
rh_in_04_2_canto_frontal = ValueList({"Canto": 0, "MDP": 1}, selected="MDP")
rh_in_04_3_canto_trasero = ValueList({"Canto": 0, "MDP": 1}, selected="MDP")
rh_in_04_4canto_izquierdo_arriba = ValueList({"Canto": 0, "MDP": 1}, selected="MDP")
rh_in_04_5_canto_derecho_abajo = ValueList({"Canto": 0, "MDP": 1}, selected="MDP")
segmentacion_7 = ValueList({"Triángulos": 0, "Quads y triángulos (mixto)": 1, "Sólo quads si es posible": 2}, selected="Sólo quads si es posible")
rh_in_04_0_mapeado = ValueList({"Longitudinal": 0, "Atravesada": 1}, selected="Longitudinal")

# Materializer 3.4
python_3_script_11 = Python3Script(
    Brep_In=brep_8,
    Balance_Mode=rh_in_04_1_lado_balance,
    Canto_1=rh_in_04_2_canto_frontal,
    Canto_2=rh_in_04_3_canto_trasero,
    Canto_3=rh_in_04_4canto_izquierdo_arriba,
    Canto_4=rh_in_04_5_canto_derecho_abajo)  # -> Out, NURBS_Color, NURBS_Balance, NURBS_MDP; inputs Brep_In: list of Brep, Balance_Mode: String, Canto_1: String, Canto_2: String, Canto_3: String, Canto_4: String; same code as python_3_script_5

# ---- group: Posterior de Cajon
rh_in_07_1_lado_balance = ValueList({"Cara A", "Cara B", "D/D"}, selected="Cara B")
rh_in_07_2_canto_frontal = ValueList({"Canto": 0, "MDP": 1}, selected="MDP")
rh_in_07_4canto_izquierdo_arriba = ValueList({"Canto": 0, "MDP": 1}, selected="MDP")
rh_in_07_5_canto_derecho_abajo = ValueList({"Canto": 0, "MDP": 1}, selected="MDP")
rh_in_07_3_canto_trasero = ValueList({"Canto": 0, "MDP": 1}, selected="MDP")
segmentacion_8 = ValueList({"Triángulos": 0, "Quads y triángulos (mixto)": 1, "Sólo quads si es posible": 2}, selected="Sólo quads si es posible")
rh_in_07_0_mapeado = ValueList({"Longitudinal": 0, "Atravesada": 1}, selected="Longitudinal")

# Materializer 3.4
python_3_script_12 = Python3Script(
    Brep_In=brep_5,
    Balance_Mode=rh_in_07_1_lado_balance,
    Canto_1=rh_in_07_2_canto_frontal,
    Canto_2=rh_in_07_3_canto_trasero,
    Canto_3=rh_in_07_4canto_izquierdo_arriba,
    Canto_4=rh_in_07_5_canto_derecho_abajo)  # -> Out, NURBS_Color, NURBS_Balance, NURBS_MDP; inputs Brep_In: list of Brep, Balance_Mode: String, Canto_1: String, Canto_2: String, Canto_3: String, Canto_4: String; same code as python_3_script_5

# ---- group: Laterales de Cajon
rh_in_06_1_lado_balance = ValueList({"Cara A", "Cara B", "D/D"}, selected="Cara B")
rh_in_06_2_canto_frontal = ValueList({"Canto": 0, "MDP": 1}, selected="MDP")
rh_in_06_4canto_izquierdo_arriba = ValueList({"Canto": 0, "MDP": 1}, selected="MDP")
rh_in_06_5_canto_derecho_abajo = ValueList({"Canto": 0, "MDP": 1}, selected="MDP")
rh_in_06_3_canto_trasero = ValueList({"Canto": 0, "MDP": 1}, selected="MDP")
segmentacion_9 = ValueList({"Triángulos": 0, "Quads y triángulos (mixto)": 1, "Sólo quads si es posible": 2}, selected="Sólo quads si es posible")
rh_in_06_0_mapeado = ValueList({"Longitudinal": 0, "Atravesada": 1}, selected="Longitudinal")

# Materializer 3.4
python_3_script_13 = Python3Script(
    Brep_In=brep_9,
    Balance_Mode=rh_in_06_1_lado_balance,
    Canto_1=rh_in_06_2_canto_frontal,
    Canto_2=rh_in_06_3_canto_trasero,
    Canto_3=rh_in_06_4canto_izquierdo_arriba,
    Canto_4=rh_in_06_5_canto_derecho_abajo)  # -> Out, NURBS_Color, NURBS_Balance, NURBS_MDP; inputs Brep_In: list of Brep, Balance_Mode: String, Canto_1: String, Canto_2: String, Canto_3: String, Canto_4: String; same code as python_3_script_5

# ---- group: Zocalo Frontal (continued)
diagnostico = Panel(python_3_script_5.Out)
mesh_brep = MeshBrep(
    Brep=python_3_script_5.NURBS_Color,
    Settings={GridMaxCount=0, GridMinCount=16, JaggedSeams=False, MaxEdgeLength=0, MinEdgeLength=0.0001, MinTolerance=0, Refine=True, RefineAngle=0, RelativeTolerance=0.65, SimplePlanes=True, Tolerance=0})
mesh_brep_2 = MeshBrep(
    Brep=python_3_script_5.NURBS_Balance,
    Settings={GridMaxCount=0, GridMinCount=16, JaggedSeams=False, MaxEdgeLength=0, MinEdgeLength=0.0001, MinTolerance=0, Refine=True, RefineAngle=0, RelativeTolerance=0.65, SimplePlanes=True, Tolerance=0})
mesh_brep_3 = MeshBrep(
    Brep=python_3_script_5.NURBS_MDP,
    Settings={GridMaxCount=0, GridMinCount=16, JaggedSeams=False, MaxEdgeLength=0, MinEdgeLength=0.0001, MinTolerance=0, Refine=True, RefineAngle=0, RelativeTolerance=0.65, SimplePlanes=True, Tolerance=0})
mesh_join = MeshJoin(Meshes=flatten(mesh_brep))
mesh_join_2 = MeshJoin(Meshes=flatten(mesh_brep_2))
mesh_join_3 = MeshJoin(Meshes=flatten(mesh_brep_3))
reduce_mesh = ReduceMesh(Mesh=mesh_join_3, FaceCount=20, Accuracy=1, FaceType=segmentacion, Distort=Toggle(False), Normalize=Toggle(True))  # -> Reduced, CountDifference
panel_2 = Panel(reduce_mesh.CountDifference)
python_3_script_14 = Python3Script(M=reduce_mesh.Reduced, B=rh_in_03_0_mapeado)  # -> a; inputs M: Mesh, B: list of Int32; same code as box_mapping_v1_0
python_3_script_15 = Python3Script(M=mesh_join_2, B=rh_in_03_0_mapeado)  # -> a; inputs M: Mesh, B: list of Int32; same code as box_mapping_v1_0
rh_out_mdp_zocalo_frontal = Geometry(python_3_script_14)
rh_out_zocalo_frontal_b = Geometry(python_3_script_15)

# ----
# Box Mapping 3.8
python_3_script_16 = Python3Script(M=mesh_join, B=rh_in_03_0_mapeado)  # -> a; inputs M: Mesh, B: list of Int32; same code as box_mapping_v1_0

# ---- group: Zocalo Frontal (continued)
rh_out_zocalo_frontal = Geometry(python_3_script_16)

# ---- group: Frente de Cajon (continued)
diagnostico_2 = Panel(python_3_script_6.Out)
mesh_brep_4 = MeshBrep(
    Brep=python_3_script_6.NURBS_Color,
    Settings={GridMaxCount=0, GridMinCount=16, JaggedSeams=False, MaxEdgeLength=0, MinEdgeLength=0.0001, MinTolerance=0, Refine=True, RefineAngle=0, RelativeTolerance=0.65, SimplePlanes=True, Tolerance=0})
mesh_brep_5 = MeshBrep(
    Brep=python_3_script_6.NURBS_Balance,
    Settings={GridMaxCount=0, GridMinCount=16, JaggedSeams=False, MaxEdgeLength=0, MinEdgeLength=0.0001, MinTolerance=0, Refine=True, RefineAngle=0, RelativeTolerance=0.65, SimplePlanes=True, Tolerance=0})
mesh_brep_6 = MeshBrep(
    Brep=python_3_script_6.NURBS_MDP,
    Settings={GridMaxCount=0, GridMinCount=16, JaggedSeams=False, MaxEdgeLength=0, MinEdgeLength=0.0001, MinTolerance=0, Refine=True, RefineAngle=0, RelativeTolerance=0.65, SimplePlanes=True, Tolerance=0})
mesh_join_4 = MeshJoin(Meshes=flatten(mesh_brep_4))
mesh_join_5 = MeshJoin(Meshes=flatten(mesh_brep_5))
mesh_join_6 = MeshJoin(Meshes=flatten(mesh_brep_6))
reduce_mesh_2 = ReduceMesh(Mesh=mesh_join_6, FaceCount=20, Accuracy=1, FaceType=segmentacion_2, Distort=Toggle(False), Normalize=Toggle(True))  # -> Reduced, CountDifference
panel_3 = Panel(reduce_mesh_2.CountDifference)
python_3_script_17 = Python3Script(M=reduce_mesh_2.Reduced, B=rh_in_02_0_mapeado)  # -> a; inputs M: Mesh, B: list of Int32; same code as box_mapping_v1_0
python_3_script_18 = Python3Script(M=mesh_join_5, B=rh_in_02_0_mapeado)  # -> a; inputs M: Mesh, B: list of Int32; same code as box_mapping_v1_0
rh_out_mdp_frente_de_cajon = Geometry(python_3_script_17)
rh_out_frente_de_cajon_b = Geometry(python_3_script_18)

# ----
# Box Mapping 3.8
python_3_script_19 = Python3Script(M=mesh_join_4, B=rh_in_02_0_mapeado)  # -> a; inputs M: Mesh, B: list of Int32; same code as box_mapping_v1_0

# ---- group: Frente de Cajon (continued)
rh_out_frente_de_cajon = Geometry(python_3_script_19)

# ---- group: Costado Derecho (continued)
diagnostico_3 = Panel(python_3_script_9.Out)
mesh_brep_7 = MeshBrep(
    Brep=python_3_script_9.NURBS_Color,
    Settings={GridMaxCount=0, GridMinCount=16, JaggedSeams=False, MaxEdgeLength=0, MinEdgeLength=0.0001, MinTolerance=0, Refine=True, RefineAngle=0, RelativeTolerance=0.65, SimplePlanes=True, Tolerance=0})
mesh_brep_8 = MeshBrep(
    Brep=python_3_script_9.NURBS_Balance,
    Settings={GridMaxCount=0, GridMinCount=16, JaggedSeams=False, MaxEdgeLength=0, MinEdgeLength=0.0001, MinTolerance=0, Refine=True, RefineAngle=0, RelativeTolerance=0.65, SimplePlanes=True, Tolerance=0})
mesh_brep_9 = MeshBrep(
    Brep=python_3_script_9.NURBS_MDP,
    Settings={GridMaxCount=0, GridMinCount=16, JaggedSeams=False, MaxEdgeLength=0, MinEdgeLength=0.0001, MinTolerance=0, Refine=True, RefineAngle=0, RelativeTolerance=0.65, SimplePlanes=True, Tolerance=0})
mesh_join_7 = MeshJoin(Meshes=flatten(mesh_brep_7))
mesh_join_8 = MeshJoin(Meshes=flatten(mesh_brep_8))
mesh_join_9 = MeshJoin(Meshes=flatten(mesh_brep_9))
reduce_mesh_3 = ReduceMesh(Mesh=mesh_join_9, FaceCount=20, Accuracy=1, FaceType=segmentacion_5, Distort=Toggle(False), Normalize=Toggle(True))  # -> Reduced, CountDifference
panel_4 = Panel(reduce_mesh_3.CountDifference)
python_3_script_20 = Python3Script(M=reduce_mesh_3.Reduced, B=rh_in_05_0_mapeado)  # -> a; inputs M: Mesh, B: list of Int32; same code as box_mapping_v1_0
python_3_script_21 = Python3Script(M=mesh_join_8, B=rh_in_05_0_mapeado)  # -> a; inputs M: Mesh, B: list of Int32; same code as box_mapping_v1_0
rh_out_mdp_costado_derecho = Geometry(python_3_script_20)
rh_out_costado_derecho_b = Geometry(python_3_script_21)

# ----
# Box Mapping 3.8
python_3_script_22 = Python3Script(M=mesh_join_7, B=rh_in_05_0_mapeado)  # -> a; inputs M: Mesh, B: list of Int32; same code as box_mapping_v1_0

# ---- group: Costado Derecho (continued)
rh_out_costado_derecho = Geometry(python_3_script_22)

# ---- group: Cubierta Superior (continued)
diagnostico_4 = Panel(python_3_script_7.Out)
mesh_brep_10 = MeshBrep(
    Brep=python_3_script_7.NURBS_Color,
    Settings={GridMaxCount=0, GridMinCount=16, JaggedSeams=False, MaxEdgeLength=0, MinEdgeLength=0.0001, MinTolerance=0, Refine=True, RefineAngle=0, RelativeTolerance=0.65, SimplePlanes=True, Tolerance=0})
mesh_brep_11 = MeshBrep(
    Brep=python_3_script_7.NURBS_Balance,
    Settings={GridMaxCount=0, GridMinCount=16, JaggedSeams=False, MaxEdgeLength=0, MinEdgeLength=0.0001, MinTolerance=0, Refine=True, RefineAngle=0, RelativeTolerance=0.65, SimplePlanes=True, Tolerance=0})
mesh_brep_12 = MeshBrep(
    Brep=python_3_script_7.NURBS_MDP,
    Settings={GridMaxCount=0, GridMinCount=16, JaggedSeams=False, MaxEdgeLength=0, MinEdgeLength=0.0001, MinTolerance=0, Refine=True, RefineAngle=0, RelativeTolerance=0.65, SimplePlanes=True, Tolerance=0})
mesh_join_10 = MeshJoin(Meshes=flatten(mesh_brep_10))
mesh_join_11 = MeshJoin(Meshes=flatten(mesh_brep_11))
mesh_join_12 = MeshJoin(Meshes=flatten(mesh_brep_12))
reduce_mesh_4 = ReduceMesh(Mesh=mesh_join_12, FaceCount=20, Accuracy=1, FaceType=segmentacion_3, Distort=Toggle(False), Normalize=Toggle(True))  # -> Reduced, CountDifference
panel_5 = Panel(reduce_mesh_4.CountDifference)
python_3_script_23 = Python3Script(M=reduce_mesh_4.Reduced, B=rh_in_08_0_mapeado)  # -> a; inputs M: Mesh, B: list of Int32; same code as box_mapping_v1_0
python_3_script_24 = Python3Script(M=mesh_join_11, B=rh_in_08_0_mapeado)  # -> a; inputs M: Mesh, B: list of Int32; same code as box_mapping_v1_0
rh_out_mdp_cubierta_superior = Geometry(python_3_script_23)
rh_out_cubierta_superior_b = Geometry(python_3_script_24)

# Box Mapping 3.8
python_3_script_25 = Python3Script(M=mesh_join_10, B=rh_in_08_0_mapeado)  # -> a; inputs M: Mesh, B: list of Int32; same code as box_mapping_v1_0

rh_out_cubierta_superior = Geometry(python_3_script_25)

# ---- group: Fondos de Cajon (continued)
diagnostico_5 = Panel(python_3_script_8.Out)
mesh_brep_13 = MeshBrep(
    Brep=python_3_script_8.NURBS_Color,
    Settings={GridMaxCount=0, GridMinCount=16, JaggedSeams=False, MaxEdgeLength=0, MinEdgeLength=0.0001, MinTolerance=0, Refine=True, RefineAngle=0, RelativeTolerance=0.65, SimplePlanes=True, Tolerance=0})
mesh_brep_14 = MeshBrep(
    Brep=python_3_script_8.NURBS_Balance,
    Settings={GridMaxCount=0, GridMinCount=16, JaggedSeams=False, MaxEdgeLength=0, MinEdgeLength=0.0001, MinTolerance=0, Refine=True, RefineAngle=0, RelativeTolerance=0.65, SimplePlanes=True, Tolerance=0})
mesh_brep_15 = MeshBrep(
    Brep=python_3_script_8.NURBS_MDP,
    Settings={GridMaxCount=0, GridMinCount=16, JaggedSeams=False, MaxEdgeLength=0, MinEdgeLength=0.0001, MinTolerance=0, Refine=True, RefineAngle=0, RelativeTolerance=0.65, SimplePlanes=True, Tolerance=0})
mesh_join_13 = MeshJoin(Meshes=flatten(mesh_brep_13))
mesh_join_14 = MeshJoin(Meshes=flatten(mesh_brep_14))
mesh_join_15 = MeshJoin(Meshes=flatten(mesh_brep_15))
reduce_mesh_5 = ReduceMesh(Mesh=mesh_join_15, FaceCount=20, Accuracy=1, FaceType=segmentacion_4, Distort=Toggle(False), Normalize=Toggle(True))  # -> Reduced, CountDifference
panel_6 = Panel(reduce_mesh_5.CountDifference)
python_3_script_26 = Python3Script(M=mesh_join_14, B=rh_in_09_0_mapeado)  # -> a; inputs M: Mesh, B: list of Int32; same code as box_mapping_v1_0
python_3_script_27 = Python3Script(M=reduce_mesh_5.Reduced, B=rh_in_09_0_mapeado)  # -> a; inputs M: Mesh, B: list of Int32; same code as box_mapping_v1_0
rh_out_mdf_fondos_de_cajon = Geometry(python_3_script_27)
rh_out_fondos_de_cajon_b = Geometry(python_3_script_26)

# Box Mapping 3.8
python_3_script_28 = Python3Script(M=mesh_join_13, B=rh_in_09_0_mapeado)  # -> a; inputs M: Mesh, B: list of Int32; same code as box_mapping_v1_0

rh_out_fondos_de_cajon = Geometry(python_3_script_28)

# ---- group: Tapaluces IZ (continued)
diagnostico_6 = Panel(python_3_script_11.Out)
mesh_brep_16 = MeshBrep(
    Brep=python_3_script_11.NURBS_Color,
    Settings={GridMaxCount=0, GridMinCount=16, JaggedSeams=False, MaxEdgeLength=0, MinEdgeLength=0.0001, MinTolerance=0, Refine=True, RefineAngle=0, RelativeTolerance=0.65, SimplePlanes=True, Tolerance=0})
mesh_brep_17 = MeshBrep(
    Brep=python_3_script_11.NURBS_Balance,
    Settings={GridMaxCount=0, GridMinCount=16, JaggedSeams=False, MaxEdgeLength=0, MinEdgeLength=0.0001, MinTolerance=0, Refine=True, RefineAngle=0, RelativeTolerance=0.65, SimplePlanes=True, Tolerance=0})
mesh_brep_18 = MeshBrep(
    Brep=python_3_script_11.NURBS_MDP,
    Settings={GridMaxCount=0, GridMinCount=16, JaggedSeams=False, MaxEdgeLength=0, MinEdgeLength=0.0001, MinTolerance=0, Refine=True, RefineAngle=0, RelativeTolerance=0.65, SimplePlanes=True, Tolerance=0})
mesh_join_16 = MeshJoin(Meshes=flatten(mesh_brep_16))
mesh_join_17 = MeshJoin(Meshes=flatten(mesh_brep_17))
mesh_join_18 = MeshJoin(Meshes=flatten(mesh_brep_18))
reduce_mesh_6 = ReduceMesh(Mesh=mesh_join_18, FaceCount=20, Accuracy=1, FaceType=segmentacion_7, Distort=Toggle(False), Normalize=Toggle(True))  # -> Reduced, CountDifference
panel_7 = Panel(reduce_mesh_6.CountDifference)
python_3_script_29 = Python3Script(M=reduce_mesh_6.Reduced, B=rh_in_04_0_mapeado)  # -> a; inputs M: Mesh, B: list of Int32; same code as box_mapping_v1_0
python_3_script_30 = Python3Script(M=mesh_join_17, B=rh_in_04_0_mapeado)  # -> a; inputs M: Mesh, B: list of Int32; same code as box_mapping_v1_0
rh_out_mdp_tapaluz = Geometry(python_3_script_29)
rh_out_tapaluz_b = Geometry(python_3_script_30)

# ----
# Box Mapping 3.8
python_3_script_31 = Python3Script(M=mesh_join_16, B=rh_in_04_0_mapeado)  # -> a; inputs M: Mesh, B: list of Int32; same code as box_mapping_v1_0

# ---- group: Tapaluces IZ (continued)
rh_out_tapaluz = Geometry(python_3_script_31)

# ---- group: Espaldares (continued)
diagnostico_7 = Panel(python_3_script_10.Out)
mesh_brep_19 = MeshBrep(
    Brep=python_3_script_10.NURBS_Color,
    Settings={GridMaxCount=0, GridMinCount=16, JaggedSeams=False, MaxEdgeLength=0, MinEdgeLength=0.0001, MinTolerance=0, Refine=True, RefineAngle=0, RelativeTolerance=0.65, SimplePlanes=True, Tolerance=0})
mesh_brep_20 = MeshBrep(
    Brep=python_3_script_10.NURBS_Balance,
    Settings={GridMaxCount=0, GridMinCount=16, JaggedSeams=False, MaxEdgeLength=0, MinEdgeLength=0.0001, MinTolerance=0, Refine=True, RefineAngle=0, RelativeTolerance=0.65, SimplePlanes=True, Tolerance=0})
mesh_brep_21 = MeshBrep(
    Brep=python_3_script_10.NURBS_MDP,
    Settings={GridMaxCount=0, GridMinCount=16, JaggedSeams=False, MaxEdgeLength=0, MinEdgeLength=0.0001, MinTolerance=0, Refine=True, RefineAngle=0, RelativeTolerance=0.65, SimplePlanes=True, Tolerance=0})
mesh_join_19 = MeshJoin(Meshes=flatten(mesh_brep_19))
mesh_join_20 = MeshJoin(Meshes=flatten(mesh_brep_20))
mesh_join_21 = MeshJoin(Meshes=flatten(mesh_brep_21))
reduce_mesh_7 = ReduceMesh(Mesh=mesh_join_21, FaceCount=20, Accuracy=1, FaceType=segmentacion_6, Distort=Toggle(False), Normalize=Toggle(True))  # -> Reduced, CountDifference
panel_8 = Panel(reduce_mesh_7.CountDifference)
python_3_script_32 = Python3Script(M=mesh_join_20, B=rh_in_10_0_mapeado)  # -> a; inputs M: Mesh, B: list of Int32; same code as box_mapping_v1_0
python_3_script_33 = Python3Script(M=reduce_mesh_7.Reduced, B=rh_in_10_0_mapeado)  # -> a; inputs M: Mesh, B: list of Int32; same code as box_mapping_v1_0
rh_out_mdf_espaldares = Geometry(python_3_script_33)
rh_out_espaldares_b = Geometry(python_3_script_32)

# Box Mapping 3.8
python_3_script_34 = Python3Script(M=mesh_join_19, B=rh_in_10_0_mapeado)  # -> a; inputs M: Mesh, B: list of Int32; same code as box_mapping_v1_0

rh_out_espaldares = Geometry(python_3_script_34)

# ---- group: Posterior de Cajon (continued)
diagnostico_8 = Panel(python_3_script_12.Out)
mesh_brep_22 = MeshBrep(
    Brep=python_3_script_12.NURBS_Color,
    Settings={GridMaxCount=0, GridMinCount=16, JaggedSeams=False, MaxEdgeLength=0, MinEdgeLength=0.0001, MinTolerance=0, Refine=True, RefineAngle=0, RelativeTolerance=0.65, SimplePlanes=True, Tolerance=0})
mesh_brep_23 = MeshBrep(
    Brep=python_3_script_12.NURBS_Balance,
    Settings={GridMaxCount=0, GridMinCount=16, JaggedSeams=False, MaxEdgeLength=0, MinEdgeLength=0.0001, MinTolerance=0, Refine=True, RefineAngle=0, RelativeTolerance=0.65, SimplePlanes=True, Tolerance=0})
mesh_brep_24 = MeshBrep(
    Brep=python_3_script_12.NURBS_MDP,
    Settings={GridMaxCount=0, GridMinCount=16, JaggedSeams=False, MaxEdgeLength=0, MinEdgeLength=0.0001, MinTolerance=0, Refine=True, RefineAngle=0, RelativeTolerance=0.65, SimplePlanes=True, Tolerance=0})
mesh_join_22 = MeshJoin(Meshes=flatten(mesh_brep_22))
mesh_join_23 = MeshJoin(Meshes=flatten(mesh_brep_23))
mesh_join_24 = MeshJoin(Meshes=flatten(mesh_brep_24))
reduce_mesh_8 = ReduceMesh(Mesh=mesh_join_24, FaceCount=20, Accuracy=1, FaceType=segmentacion_8, Distort=Toggle(False), Normalize=Toggle(True))  # -> Reduced, CountDifference
panel_9 = Panel(reduce_mesh_8.CountDifference)
python_3_script_35 = Python3Script(M=reduce_mesh_8.Reduced, B=rh_in_07_0_mapeado)  # -> a; inputs M: Mesh, B: list of Int32; same code as box_mapping_v1_0
python_3_script_36 = Python3Script(M=mesh_join_23, B=rh_in_07_0_mapeado)  # -> a; inputs M: Mesh, B: list of Int32; same code as box_mapping_v1_0
rh_out_mdp_posterior_de_cajon = Geometry(python_3_script_35)
rh_out_posterior_de_cajon_b = Geometry(python_3_script_36)

# Box Mapping 3.8
python_3_script_37 = Python3Script(M=mesh_join_22, B=rh_in_07_0_mapeado)  # -> a; inputs M: Mesh, B: list of Int32; same code as box_mapping_v1_0

rh_out_posterior_de_cajon = Geometry(python_3_script_37)

# ---- group: Laterales de Cajon (continued)
diagnostico_9 = Panel(python_3_script_13.Out)
mesh_brep_25 = MeshBrep(
    Brep=python_3_script_13.NURBS_Color,
    Settings={GridMaxCount=0, GridMinCount=16, JaggedSeams=False, MaxEdgeLength=0, MinEdgeLength=0.0001, MinTolerance=0, Refine=True, RefineAngle=0, RelativeTolerance=0.65, SimplePlanes=True, Tolerance=0})
mesh_brep_26 = MeshBrep(
    Brep=python_3_script_13.NURBS_Balance,
    Settings={GridMaxCount=0, GridMinCount=16, JaggedSeams=False, MaxEdgeLength=0, MinEdgeLength=0.0001, MinTolerance=0, Refine=True, RefineAngle=0, RelativeTolerance=0.65, SimplePlanes=True, Tolerance=0})
mesh_brep_27 = MeshBrep(
    Brep=python_3_script_13.NURBS_MDP,
    Settings={GridMaxCount=0, GridMinCount=16, JaggedSeams=False, MaxEdgeLength=0, MinEdgeLength=0.0001, MinTolerance=0, Refine=True, RefineAngle=0, RelativeTolerance=0.65, SimplePlanes=True, Tolerance=0})
mesh_join_25 = MeshJoin(Meshes=flatten(mesh_brep_25))
mesh_join_26 = MeshJoin(Meshes=flatten(mesh_brep_26))
mesh_join_27 = MeshJoin(Meshes=flatten(mesh_brep_27))
reduce_mesh_9 = ReduceMesh(Mesh=mesh_join_27, FaceCount=20, Accuracy=1, FaceType=segmentacion_9, Distort=Toggle(False), Normalize=Toggle(True))  # -> Reduced, CountDifference
panel_10 = Panel(reduce_mesh_9.CountDifference)
python_3_script_38 = Python3Script(M=reduce_mesh_9.Reduced, B=rh_in_06_0_mapeado)  # -> a; inputs M: Mesh, B: list of Int32; same code as box_mapping_v1_0
python_3_script_39 = Python3Script(M=mesh_join_26, B=rh_in_06_0_mapeado)  # -> a; inputs M: Mesh, B: list of Int32; same code as box_mapping_v1_0
rh_out_mdp_laterales_de_cajon = Geometry(python_3_script_38)
rh_out_laterales_de_cajon_b = Geometry(python_3_script_39)

# Box Mapping 3.8
python_3_script_40 = Python3Script(M=mesh_join_25, B=rh_in_06_0_mapeado)  # -> a; inputs M: Mesh, B: list of Int32; same code as box_mapping_v1_0

rh_out_laterales_de_cajon = Geometry(python_3_script_40)

# ---- group: Zocalo Posterior
rh_in_14_1_lado_balance = ValueList({"Cara A", "Cara B", "D/D"}, selected="Cara B")
rh_in_14_2_canto_frontal = ValueList({"Canto": 0, "MDP": 1}, selected="MDP")
rh_in_14_3_canto_trasero = ValueList({"Canto": 0, "MDP": 1}, selected="MDP")
rh_in_14_4canto_izquierdo_arriba = ValueList({"Canto": 0, "MDP": 1}, selected="MDP")
rh_in_14_5_canto_derecho_abajo = ValueList({"Canto": 0, "MDP": 1}, selected="MDP")
segmentacion_10 = ValueList({"Triángulos": 0, "Quads y triángulos (mixto)": 1, "Sólo quads si es posible": 2}, selected="Sólo quads si es posible")
rh_in_14_0_mapeado = ValueList({"Longitudinal": 0, "Atravesada": 1}, selected="Longitudinal")

# Materializer 3.4
python_3_script_41 = Python3Script(
    Brep_In=brep_10,
    Balance_Mode=rh_in_14_1_lado_balance,
    Canto_1=rh_in_14_2_canto_frontal,
    Canto_2=rh_in_14_3_canto_trasero,
    Canto_3=rh_in_14_4canto_izquierdo_arriba,
    Canto_4=rh_in_14_5_canto_derecho_abajo)  # -> Out, NURBS_Color, NURBS_Balance, NURBS_MDP; inputs Brep_In: list of Brep, Balance_Mode: String, Canto_1: String, Canto_2: String, Canto_3: String, Canto_4: String; same code as python_3_script_5

# ---- group: Tapaluces Der
rh_in_11_1_lado_balance = ValueList({"Cara A", "Cara B", "D/D"}, selected="Cara B")
rh_in_11_2_canto_frontal = ValueList({"Canto": 0, "MDP": 1}, selected="MDP")
rh_in_11_3_canto_trasero = ValueList({"Canto": 0, "MDP": 1}, selected="MDP")
rh_in_11_4canto_izquierdo_arriba = ValueList({"Canto": 0, "MDP": 1}, selected="MDP")
rh_in_11_5_canto_derecho_abajo = ValueList({"Canto": 0, "MDP": 1}, selected="MDP")
segmentacion_11 = ValueList({"Triángulos": 0, "Quads y triángulos (mixto)": 1, "Sólo quads si es posible": 2}, selected="Sólo quads si es posible")
rh_in_11_0_mapeado = ValueList({"Longitudinal": 0, "Atravesada": 1}, selected="Longitudinal")

# Materializer 3.4
python_3_script_42 = Python3Script(
    Brep_In=brep_11,
    Balance_Mode=rh_in_11_1_lado_balance,
    Canto_1=rh_in_11_2_canto_frontal,
    Canto_2=rh_in_11_3_canto_trasero,
    Canto_3=rh_in_11_4canto_izquierdo_arriba,
    Canto_4=rh_in_11_5_canto_derecho_abajo)  # -> Out, NURBS_Color, NURBS_Balance, NURBS_MDP; inputs Brep_In: list of Brep, Balance_Mode: String, Canto_1: String, Canto_2: String, Canto_3: String, Canto_4: String; same code as python_3_script_5

# ---- group: Costado Izquierdo
rh_in_12_1_lado_balance = ValueList({"Cara A", "Cara B", "D/D"}, selected="Cara B")
rh_in_12_2_canto_frontal = ValueList({"Canto": 0, "MDP": 1}, selected="MDP")
rh_in_12_4canto_izquierdo_arriba = ValueList({"Canto": 0, "MDP": 1}, selected="MDP")
rh_in_12_5_canto_derecho_abajo = ValueList({"Canto": 0, "MDP": 1}, selected="MDP")
rh_in_12_3_canto_trasero = ValueList({"Canto": 0, "MDP": 1}, selected="MDP")
segmentacion_12 = ValueList({"Triángulos": 0, "Quads y triángulos (mixto)": 1, "Sólo quads si es posible": 2}, selected="Sólo quads si es posible")
rh_in_12_0_mapeado = ValueList({"Longitudinal": 0, "Atravesada": 1}, selected="Longitudinal")

# Materializer 3.4
python_3_script_43 = Python3Script(
    Brep_In=brep_12,
    Balance_Mode=rh_in_12_1_lado_balance,
    Canto_1=rh_in_12_2_canto_frontal,
    Canto_2=rh_in_12_3_canto_trasero,
    Canto_3=rh_in_12_4canto_izquierdo_arriba,
    Canto_4=rh_in_12_5_canto_derecho_abajo)  # -> Out, NURBS_Color, NURBS_Balance, NURBS_MDP; inputs Brep_In: list of Brep, Balance_Mode: String, Canto_1: String, Canto_2: String, Canto_3: String, Canto_4: String; same code as python_3_script_5

# ---- group: Paral Central
rh_in_13_1_lado_balance = ValueList({"Cara A", "Cara B", "D/D"}, selected="Cara B")
rh_in_13_2_canto_frontal = ValueList({"Canto": 0, "MDP": 1}, selected="MDP")
rh_in_13_4canto_izquierdo_arriba = ValueList({"Canto": 0, "MDP": 1}, selected="MDP")
rh_in_13_5_canto_derecho_abajo = ValueList({"Canto": 0, "MDP": 1}, selected="MDP")
rh_in_13_3_canto_trasero = ValueList({"Canto": 0, "MDP": 1}, selected="MDP")
segmentacion_13 = ValueList({"Triángulos": 0, "Quads y triángulos (mixto)": 1, "Sólo quads si es posible": 2}, selected="Sólo quads si es posible")
rh_in_13_0_mapeado = ValueList({"Longitudinal": 0, "Atravesada": 1}, selected="Longitudinal")

# Materializer 3.4
python_3_script_44 = Python3Script(
    Brep_In=brep_13,
    Balance_Mode=rh_in_13_1_lado_balance,
    Canto_1=rh_in_13_2_canto_frontal,
    Canto_2=rh_in_13_3_canto_trasero,
    Canto_3=rh_in_13_4canto_izquierdo_arriba,
    Canto_4=rh_in_13_5_canto_derecho_abajo)  # -> Out, NURBS_Color, NURBS_Balance, NURBS_MDP; inputs Brep_In: list of Brep, Balance_Mode: String, Canto_1: String, Canto_2: String, Canto_3: String, Canto_4: String; same code as python_3_script_5

# ---- group: Zocalo Posterior (continued)
diagnostico_10 = Panel(python_3_script_41.Out)
mesh_brep_28 = MeshBrep(
    Brep=python_3_script_41.NURBS_Color,
    Settings={GridMaxCount=0, GridMinCount=16, JaggedSeams=False, MaxEdgeLength=0, MinEdgeLength=0.0001, MinTolerance=0, Refine=True, RefineAngle=0, RelativeTolerance=0.65, SimplePlanes=True, Tolerance=0})
mesh_brep_29 = MeshBrep(
    Brep=python_3_script_41.NURBS_Balance,
    Settings={GridMaxCount=0, GridMinCount=16, JaggedSeams=False, MaxEdgeLength=0, MinEdgeLength=0.0001, MinTolerance=0, Refine=True, RefineAngle=0, RelativeTolerance=0.65, SimplePlanes=True, Tolerance=0})
mesh_brep_30 = MeshBrep(
    Brep=python_3_script_41.NURBS_MDP,
    Settings={GridMaxCount=0, GridMinCount=16, JaggedSeams=False, MaxEdgeLength=0, MinEdgeLength=0.0001, MinTolerance=0, Refine=True, RefineAngle=0, RelativeTolerance=0.65, SimplePlanes=True, Tolerance=0})
mesh_join_28 = MeshJoin(Meshes=flatten(mesh_brep_28))
mesh_join_29 = MeshJoin(Meshes=flatten(mesh_brep_29))
mesh_join_30 = MeshJoin(Meshes=flatten(mesh_brep_30))
reduce_mesh_10 = ReduceMesh(Mesh=mesh_join_30, FaceCount=20, Accuracy=1, FaceType=segmentacion_10, Distort=Toggle(False), Normalize=Toggle(True))  # -> Reduced, CountDifference
panel_11 = Panel(reduce_mesh_10.CountDifference)
python_3_script_45 = Python3Script(M=reduce_mesh_10.Reduced, B=rh_in_14_0_mapeado)  # -> a; inputs M: Mesh, B: list of Int32; same code as box_mapping_v1_0
python_3_script_46 = Python3Script(M=mesh_join_29, B=rh_in_14_0_mapeado)  # -> a; inputs M: Mesh, B: list of Int32; same code as box_mapping_v1_0
rh_out_mdp_zocalo_posterior = Geometry(python_3_script_45)
rh_out_zocalo_posterior_b = Geometry(python_3_script_46)

# ----
# Box Mapping 3.8
python_3_script_47 = Python3Script(M=mesh_join_28, B=rh_in_14_0_mapeado)  # -> a; inputs M: Mesh, B: list of Int32; same code as box_mapping_v1_0

# ---- group: Zocalo Posterior (continued)
rh_out_zocalo_posterior = Geometry(python_3_script_47)

# ---- group: Tapaluces Der (continued)
diagnostico_11 = Panel(python_3_script_42.Out)
mesh_brep_31 = MeshBrep(
    Brep=python_3_script_42.NURBS_Color,
    Settings={GridMaxCount=0, GridMinCount=16, JaggedSeams=False, MaxEdgeLength=0, MinEdgeLength=0.0001, MinTolerance=0, Refine=True, RefineAngle=0, RelativeTolerance=0.65, SimplePlanes=True, Tolerance=0})
mesh_brep_32 = MeshBrep(
    Brep=python_3_script_42.NURBS_Balance,
    Settings={GridMaxCount=0, GridMinCount=16, JaggedSeams=False, MaxEdgeLength=0, MinEdgeLength=0.0001, MinTolerance=0, Refine=True, RefineAngle=0, RelativeTolerance=0.65, SimplePlanes=True, Tolerance=0})
mesh_brep_33 = MeshBrep(
    Brep=python_3_script_42.NURBS_MDP,
    Settings={GridMaxCount=0, GridMinCount=16, JaggedSeams=False, MaxEdgeLength=0, MinEdgeLength=0.0001, MinTolerance=0, Refine=True, RefineAngle=0, RelativeTolerance=0.65, SimplePlanes=True, Tolerance=0})
mesh_join_31 = MeshJoin(Meshes=flatten(mesh_brep_31))
mesh_join_32 = MeshJoin(Meshes=flatten(mesh_brep_32))
mesh_join_33 = MeshJoin(Meshes=flatten(mesh_brep_33))
reduce_mesh_11 = ReduceMesh(Mesh=mesh_join_33, FaceCount=20, Accuracy=1, FaceType=segmentacion_11, Distort=Toggle(False), Normalize=Toggle(True))  # -> Reduced, CountDifference
panel_12 = Panel(reduce_mesh_11.CountDifference)
python_3_script_48 = Python3Script(M=reduce_mesh_11.Reduced, B=rh_in_11_0_mapeado)  # -> a; inputs M: Mesh, B: list of Int32; same code as box_mapping_v1_0
python_3_script_49 = Python3Script(M=mesh_join_32, B=rh_in_11_0_mapeado)  # -> a; inputs M: Mesh, B: list of Int32; same code as box_mapping_v1_0
rh_out_mdp_tapaluz_der = Geometry(python_3_script_48)
rh_out_tapaluz_der_b = Geometry(python_3_script_49)

# ----
# Box Mapping 3.8
python_3_script_50 = Python3Script(M=mesh_join_31, B=rh_in_11_0_mapeado)  # -> a; inputs M: Mesh, B: list of Int32; same code as box_mapping_v1_0

# ---- group: Tapaluces Der (continued)
rh_out_tapaluz_der = Geometry(python_3_script_50)

# ---- group: Costado Izquierdo (continued)
diagnostico_12 = Panel(python_3_script_43.Out)
mesh_brep_34 = MeshBrep(
    Brep=python_3_script_43.NURBS_Color,
    Settings={GridMaxCount=0, GridMinCount=16, JaggedSeams=False, MaxEdgeLength=0, MinEdgeLength=0.0001, MinTolerance=0, Refine=True, RefineAngle=0, RelativeTolerance=0.65, SimplePlanes=True, Tolerance=0})
mesh_brep_35 = MeshBrep(
    Brep=python_3_script_43.NURBS_Balance,
    Settings={GridMaxCount=0, GridMinCount=16, JaggedSeams=False, MaxEdgeLength=0, MinEdgeLength=0.0001, MinTolerance=0, Refine=True, RefineAngle=0, RelativeTolerance=0.65, SimplePlanes=True, Tolerance=0})
mesh_brep_36 = MeshBrep(
    Brep=python_3_script_43.NURBS_MDP,
    Settings={GridMaxCount=0, GridMinCount=16, JaggedSeams=False, MaxEdgeLength=0, MinEdgeLength=0.0001, MinTolerance=0, Refine=True, RefineAngle=0, RelativeTolerance=0.65, SimplePlanes=True, Tolerance=0})
mesh_join_34 = MeshJoin(Meshes=flatten(mesh_brep_34))
mesh_join_35 = MeshJoin(Meshes=flatten(mesh_brep_35))
mesh_join_36 = MeshJoin(Meshes=flatten(mesh_brep_36))
reduce_mesh_12 = ReduceMesh(Mesh=mesh_join_36, FaceCount=20, Accuracy=1, FaceType=segmentacion_12, Distort=Toggle(False), Normalize=Toggle(True))  # -> Reduced, CountDifference
panel_13 = Panel(reduce_mesh_12.CountDifference)
python_3_script_51 = Python3Script(M=reduce_mesh_12.Reduced, B=rh_in_12_0_mapeado)  # -> a; inputs M: Mesh, B: list of Int32; same code as box_mapping_v1_0
python_3_script_52 = Python3Script(M=mesh_join_35, B=rh_in_12_0_mapeado)  # -> a; inputs M: Mesh, B: list of Int32; same code as box_mapping_v1_0
rh_out_mdp_costado_izquierdo = Geometry(python_3_script_51)
rh_out_costado_izquierdo_b = Geometry(python_3_script_52)

# ----
# Box Mapping 3.8
python_3_script_53 = Python3Script(M=mesh_join_34, B=rh_in_12_0_mapeado)  # -> a; inputs M: Mesh, B: list of Int32; same code as box_mapping_v1_0

# ---- group: Costado Izquierdo (continued)
rh_out_costado_izquierdo = Geometry(python_3_script_53)

# ---- group: Paral Central (continued)
diagnostico_13 = Panel(python_3_script_44.Out)
mesh_brep_37 = MeshBrep(
    Brep=python_3_script_44.NURBS_Color,
    Settings={GridMaxCount=0, GridMinCount=16, JaggedSeams=False, MaxEdgeLength=0, MinEdgeLength=0.0001, MinTolerance=0, Refine=True, RefineAngle=0, RelativeTolerance=0.65, SimplePlanes=True, Tolerance=0})
mesh_brep_38 = MeshBrep(
    Brep=python_3_script_44.NURBS_Balance,
    Settings={GridMaxCount=0, GridMinCount=16, JaggedSeams=False, MaxEdgeLength=0, MinEdgeLength=0.0001, MinTolerance=0, Refine=True, RefineAngle=0, RelativeTolerance=0.65, SimplePlanes=True, Tolerance=0})
mesh_brep_39 = MeshBrep(
    Brep=python_3_script_44.NURBS_MDP,
    Settings={GridMaxCount=0, GridMinCount=16, JaggedSeams=False, MaxEdgeLength=0, MinEdgeLength=0.0001, MinTolerance=0, Refine=True, RefineAngle=0, RelativeTolerance=0.65, SimplePlanes=True, Tolerance=0})
mesh_join_37 = MeshJoin(Meshes=flatten(mesh_brep_37))
mesh_join_38 = MeshJoin(Meshes=flatten(mesh_brep_38))
mesh_join_39 = MeshJoin(Meshes=flatten(mesh_brep_39))
reduce_mesh_13 = ReduceMesh(Mesh=mesh_join_39, FaceCount=20, Accuracy=1, FaceType=segmentacion_13, Distort=Toggle(False), Normalize=Toggle(True))  # -> Reduced, CountDifference
panel_14 = Panel(reduce_mesh_13.CountDifference)
python_3_script_54 = Python3Script(M=reduce_mesh_13.Reduced, B=rh_in_13_0_mapeado)  # -> a; inputs M: Mesh, B: list of Int32; same code as box_mapping_v1_0
python_3_script_55 = Python3Script(M=mesh_join_38, B=rh_in_13_0_mapeado)  # -> a; inputs M: Mesh, B: list of Int32; same code as box_mapping_v1_0
rh_out_mdp_paral_central = Geometry(python_3_script_54)
rh_out_paral_central_b = Geometry(python_3_script_55)

# ----
# Box Mapping 3.8
python_3_script_56 = Python3Script(M=mesh_join_37, B=rh_in_13_0_mapeado)  # -> a; inputs M: Mesh, B: list of Int32; same code as box_mapping_v1_0

# ---- group: Paral Central (continued)
rh_out_paral_central = Geometry(python_3_script_56)

# ---- group: Sobre Zocalo F
rh_in_15_1_lado_balance = ValueList({"Cara A", "Cara B", "D/D"}, selected="Cara B")
rh_in_15_2_canto_frontal = ValueList({"Canto": 0, "MDP": 1}, selected="MDP")
rh_in_15_3_canto_trasero = ValueList({"Canto": 0, "MDP": 1}, selected="MDP")
rh_in_15_4canto_izquierdo_arriba = ValueList({"Canto": 0, "MDP": 1}, selected="MDP")
rh_in_15_5_canto_derecho_abajo = ValueList({"Canto": 0, "MDP": 1}, selected="MDP")
segmentacion_14 = ValueList({"Triángulos": 0, "Quads y triángulos (mixto)": 1, "Sólo quads si es posible": 2}, selected="Sólo quads si es posible")
rh_in_15_0_mapeado = ValueList({"Longitudinal": 0, "Atravesada": 1}, selected="Longitudinal")

# Materializer 3.4
python_3_script_57 = Python3Script(
    Brep_In=brep_14,
    Balance_Mode=rh_in_15_1_lado_balance,
    Canto_1=rh_in_15_2_canto_frontal,
    Canto_2=rh_in_15_3_canto_trasero,
    Canto_3=rh_in_15_4canto_izquierdo_arriba,
    Canto_4=rh_in_15_5_canto_derecho_abajo)  # -> Out, NURBS_Color, NURBS_Balance, NURBS_MDP; inputs Brep_In: list of Brep, Balance_Mode: String, Canto_1: String, Canto_2: String, Canto_3: String, Canto_4: String; same code as python_3_script_5

# ---- group: Reenguece Izq
rh_in_20_1_lado_balance = ValueList({"Cara A", "Cara B", "D/D"}, selected="Cara B")
rh_in_20_2_canto_frontal = ValueList({"Canto": 0, "MDP": 1}, selected="MDP")
rh_in_20_3_canto_trasero = ValueList({"Canto": 0, "MDP": 1}, selected="MDP")
rh_in_20_4canto_izquierdo_arriba = ValueList({"Canto": 0, "MDP": 1}, selected="MDP")
rh_in_20_5_canto_derecho_abajo = ValueList({"Canto": 0, "MDP": 1}, selected="MDP")
segmentacion_15 = ValueList({"Triángulos": 0, "Quads y triángulos (mixto)": 1, "Sólo quads si es posible": 2}, selected="Sólo quads si es posible")
rh_in_20_0_mapeado = ValueList({"Longitudinal": 0, "Atravesada": 1}, selected="Longitudinal")

# Materializer 3.4
python_3_script_58 = Python3Script(
    Brep_In=brep_15,
    Balance_Mode=rh_in_20_1_lado_balance,
    Canto_1=rh_in_20_2_canto_frontal,
    Canto_2=rh_in_20_3_canto_trasero,
    Canto_3=rh_in_20_4canto_izquierdo_arriba,
    Canto_4=rh_in_20_5_canto_derecho_abajo)  # -> Out, NURBS_Color, NURBS_Balance, NURBS_MDP; inputs Brep_In: list of Brep, Balance_Mode: String, Canto_1: String, Canto_2: String, Canto_3: String, Canto_4: String; same code as python_3_script_5

# ---- group: Refuerzao Zocalo
rh_in_19_1_lado_balance = ValueList({"Cara A", "Cara B", "D/D"}, selected="Cara B")
rh_in_19_2_canto_frontal = ValueList({"Canto": 0, "MDP": 1}, selected="MDP")
rh_in_19_3_canto_trasero = ValueList({"Canto": 0, "MDP": 1}, selected="MDP")
rh_in_19_4canto_izquierdo_arriba = ValueList({"Canto": 0, "MDP": 1}, selected="MDP")
rh_in_19_5_canto_derecho_abajo = ValueList({"Canto": 0, "MDP": 1}, selected="MDP")
segmentacion_16 = ValueList({"Triángulos": 0, "Quads y triángulos (mixto)": 1, "Sólo quads si es posible": 2}, selected="Sólo quads si es posible")
rh_in_19_0_mapeado = ValueList({"Longitudinal": 0, "Atravesada": 1}, selected="Longitudinal")

# Materializer 3.4
python_3_script_59 = Python3Script(
    Brep_In=brep_16,
    Balance_Mode=rh_in_19_1_lado_balance,
    Canto_1=rh_in_19_2_canto_frontal,
    Canto_2=rh_in_19_3_canto_trasero,
    Canto_3=rh_in_19_4canto_izquierdo_arriba,
    Canto_4=rh_in_19_5_canto_derecho_abajo)  # -> Out, NURBS_Color, NURBS_Balance, NURBS_MDP; inputs Brep_In: list of Brep, Balance_Mode: String, Canto_1: String, Canto_2: String, Canto_3: String, Canto_4: String; same code as python_3_script_5

# ---- group: Refuerzo Posterior Izq
rh_in_17_1_lado_balance = ValueList({"Cara A", "Cara B", "D/D"}, selected="Cara B")
rh_in_17_2_canto_frontal = ValueList({"Canto": 0, "MDP": 1}, selected="MDP")
rh_in_17_3_canto_trasero = ValueList({"Canto": 0, "MDP": 1}, selected="MDP")
rh_in_17_4canto_izquierdo_arriba = ValueList({"Canto": 0, "MDP": 1}, selected="MDP")
rh_in_17_5_canto_derecho_abajo = ValueList({"Canto": 0, "MDP": 1}, selected="MDP")
segmentacion_17 = ValueList({"Triángulos": 0, "Quads y triángulos (mixto)": 1, "Sólo quads si es posible": 2}, selected="Sólo quads si es posible")
rh_in_17_0_mapeado = ValueList({"Longitudinal": 0, "Atravesada": 1}, selected="Longitudinal")

# Materializer 3.4
python_3_script_60 = Python3Script(
    Brep_In=brep_17,
    Balance_Mode=rh_in_17_1_lado_balance,
    Canto_1=rh_in_17_2_canto_frontal,
    Canto_2=rh_in_17_3_canto_trasero,
    Canto_3=rh_in_17_4canto_izquierdo_arriba,
    Canto_4=rh_in_17_5_canto_derecho_abajo)  # -> Out, NURBS_Color, NURBS_Balance, NURBS_MDP; inputs Brep_In: list of Brep, Balance_Mode: String, Canto_1: String, Canto_2: String, Canto_3: String, Canto_4: String; same code as python_3_script_5

# ---- group: Sobre Zocalo F (continued)
diagnostico_14 = Panel(python_3_script_57.Out)
mesh_brep_40 = MeshBrep(
    Brep=python_3_script_57.NURBS_Color,
    Settings={GridMaxCount=0, GridMinCount=16, JaggedSeams=False, MaxEdgeLength=0, MinEdgeLength=0.0001, MinTolerance=0, Refine=True, RefineAngle=0, RelativeTolerance=0.65, SimplePlanes=True, Tolerance=0})
mesh_brep_41 = MeshBrep(
    Brep=python_3_script_57.NURBS_Balance,
    Settings={GridMaxCount=0, GridMinCount=16, JaggedSeams=False, MaxEdgeLength=0, MinEdgeLength=0.0001, MinTolerance=0, Refine=True, RefineAngle=0, RelativeTolerance=0.65, SimplePlanes=True, Tolerance=0})
mesh_brep_42 = MeshBrep(
    Brep=python_3_script_57.NURBS_MDP,
    Settings={GridMaxCount=0, GridMinCount=16, JaggedSeams=False, MaxEdgeLength=0, MinEdgeLength=0.0001, MinTolerance=0, Refine=True, RefineAngle=0, RelativeTolerance=0.65, SimplePlanes=True, Tolerance=0})
mesh_join_40 = MeshJoin(Meshes=flatten(mesh_brep_40))
mesh_join_41 = MeshJoin(Meshes=flatten(mesh_brep_41))
mesh_join_42 = MeshJoin(Meshes=flatten(mesh_brep_42))
reduce_mesh_14 = ReduceMesh(Mesh=mesh_join_42, FaceCount=20, Accuracy=1, FaceType=segmentacion_14, Distort=Toggle(False), Normalize=Toggle(True))  # -> Reduced, CountDifference
panel_15 = Panel(reduce_mesh_14.CountDifference)
python_3_script_61 = Python3Script(M=reduce_mesh_14.Reduced, B=rh_in_15_0_mapeado)  # -> a; inputs M: Mesh, B: list of Int32; same code as box_mapping_v1_0
python_3_script_62 = Python3Script(M=mesh_join_41, B=rh_in_15_0_mapeado)  # -> a; inputs M: Mesh, B: list of Int32; same code as box_mapping_v1_0
rh_out_mdp_sobre_zocalo_f = Geometry(python_3_script_61)
rh_out_sobre_zocalo_f_b = Geometry(python_3_script_62)

# ----
# Box Mapping 3.8
python_3_script_63 = Python3Script(M=mesh_join_40, B=rh_in_15_0_mapeado)  # -> a; inputs M: Mesh, B: list of Int32; same code as box_mapping_v1_0

# ---- group: Sobre Zocalo F (continued)
rh_out_sobre_zocalo_f = Geometry(python_3_script_63)

# ---- group: Reenguece Izq (continued)
diagnostico_15 = Panel(python_3_script_58.Out)
mesh_brep_43 = MeshBrep(
    Brep=python_3_script_58.NURBS_Color,
    Settings={GridMaxCount=0, GridMinCount=16, JaggedSeams=False, MaxEdgeLength=0, MinEdgeLength=0.0001, MinTolerance=0, Refine=True, RefineAngle=0, RelativeTolerance=0.65, SimplePlanes=True, Tolerance=0})
mesh_brep_44 = MeshBrep(
    Brep=python_3_script_58.NURBS_Balance,
    Settings={GridMaxCount=0, GridMinCount=16, JaggedSeams=False, MaxEdgeLength=0, MinEdgeLength=0.0001, MinTolerance=0, Refine=True, RefineAngle=0, RelativeTolerance=0.65, SimplePlanes=True, Tolerance=0})
mesh_brep_45 = MeshBrep(
    Brep=python_3_script_58.NURBS_MDP,
    Settings={GridMaxCount=0, GridMinCount=16, JaggedSeams=False, MaxEdgeLength=0, MinEdgeLength=0.0001, MinTolerance=0, Refine=True, RefineAngle=0, RelativeTolerance=0.65, SimplePlanes=True, Tolerance=0})
mesh_join_43 = MeshJoin(Meshes=flatten(mesh_brep_43))
mesh_join_44 = MeshJoin(Meshes=flatten(mesh_brep_44))
mesh_join_45 = MeshJoin(Meshes=flatten(mesh_brep_45))
reduce_mesh_15 = ReduceMesh(Mesh=mesh_join_45, FaceCount=20, Accuracy=1, FaceType=segmentacion_15, Distort=Toggle(False), Normalize=Toggle(True))  # -> Reduced, CountDifference
panel_16 = Panel(reduce_mesh_15.CountDifference)
python_3_script_64 = Python3Script(M=reduce_mesh_15.Reduced, B=rh_in_20_0_mapeado)  # -> a; inputs M: Mesh, B: list of Int32; same code as box_mapping_v1_0
python_3_script_65 = Python3Script(M=mesh_join_44, B=rh_in_20_0_mapeado)  # -> a; inputs M: Mesh, B: list of Int32; same code as box_mapping_v1_0
rh_out_mdp_reenguece_izq = Geometry(python_3_script_64)
rh_out_reenguece_izq_b = Geometry(python_3_script_65)

# ----
# Box Mapping 3.8
python_3_script_66 = Python3Script(M=mesh_join_43, B=rh_in_20_0_mapeado)  # -> a; inputs M: Mesh, B: list of Int32; same code as box_mapping_v1_0

# ---- group: Reenguece Izq (continued)
rh_out_reenguece_izq = Geometry(python_3_script_66)

# ---- group: Refuerzao Zocalo (continued)
diagnostico_16 = Panel(python_3_script_59.Out)
mesh_brep_46 = MeshBrep(
    Brep=python_3_script_59.NURBS_Color,
    Settings={GridMaxCount=0, GridMinCount=16, JaggedSeams=False, MaxEdgeLength=0, MinEdgeLength=0.0001, MinTolerance=0, Refine=True, RefineAngle=0, RelativeTolerance=0.65, SimplePlanes=True, Tolerance=0})
mesh_brep_47 = MeshBrep(
    Brep=python_3_script_59.NURBS_Balance,
    Settings={GridMaxCount=0, GridMinCount=16, JaggedSeams=False, MaxEdgeLength=0, MinEdgeLength=0.0001, MinTolerance=0, Refine=True, RefineAngle=0, RelativeTolerance=0.65, SimplePlanes=True, Tolerance=0})
mesh_brep_48 = MeshBrep(
    Brep=python_3_script_59.NURBS_MDP,
    Settings={GridMaxCount=0, GridMinCount=16, JaggedSeams=False, MaxEdgeLength=0, MinEdgeLength=0.0001, MinTolerance=0, Refine=True, RefineAngle=0, RelativeTolerance=0.65, SimplePlanes=True, Tolerance=0})
mesh_join_46 = MeshJoin(Meshes=flatten(mesh_brep_46))
mesh_join_47 = MeshJoin(Meshes=flatten(mesh_brep_47))
mesh_join_48 = MeshJoin(Meshes=flatten(mesh_brep_48))
reduce_mesh_16 = ReduceMesh(Mesh=mesh_join_48, FaceCount=20, Accuracy=1, FaceType=segmentacion_16, Distort=Toggle(False), Normalize=Toggle(True))  # -> Reduced, CountDifference
panel_17 = Panel(reduce_mesh_16.CountDifference)
python_3_script_67 = Python3Script(M=reduce_mesh_16.Reduced, B=rh_in_19_0_mapeado)  # -> a; inputs M: Mesh, B: list of Int32; same code as box_mapping_v1_0
python_3_script_68 = Python3Script(M=mesh_join_47, B=rh_in_19_0_mapeado)  # -> a; inputs M: Mesh, B: list of Int32; same code as box_mapping_v1_0
rh_out_mdp_refuerzao_zocalo = Geometry(python_3_script_67)
rh_out_refuerzao_zocalo_b = Geometry(python_3_script_68)

# ----
# Box Mapping 3.8
python_3_script_69 = Python3Script(M=mesh_join_46, B=rh_in_19_0_mapeado)  # -> a; inputs M: Mesh, B: list of Int32; same code as box_mapping_v1_0

# ---- group: Refuerzao Zocalo (continued)
rh_out_refuerzao_zocalo = Geometry(python_3_script_69)

# ---- group: Refuerzo Posterior Izq (continued)
diagnostico_17 = Panel(python_3_script_60.Out)
mesh_brep_49 = MeshBrep(
    Brep=python_3_script_60.NURBS_Color,
    Settings={GridMaxCount=0, GridMinCount=16, JaggedSeams=False, MaxEdgeLength=0, MinEdgeLength=0.0001, MinTolerance=0, Refine=True, RefineAngle=0, RelativeTolerance=0.65, SimplePlanes=True, Tolerance=0})
mesh_brep_50 = MeshBrep(
    Brep=python_3_script_60.NURBS_Balance,
    Settings={GridMaxCount=0, GridMinCount=16, JaggedSeams=False, MaxEdgeLength=0, MinEdgeLength=0.0001, MinTolerance=0, Refine=True, RefineAngle=0, RelativeTolerance=0.65, SimplePlanes=True, Tolerance=0})
mesh_brep_51 = MeshBrep(
    Brep=python_3_script_60.NURBS_MDP,
    Settings={GridMaxCount=0, GridMinCount=16, JaggedSeams=False, MaxEdgeLength=0, MinEdgeLength=0.0001, MinTolerance=0, Refine=True, RefineAngle=0, RelativeTolerance=0.65, SimplePlanes=True, Tolerance=0})
mesh_join_49 = MeshJoin(Meshes=flatten(mesh_brep_49))
mesh_join_50 = MeshJoin(Meshes=flatten(mesh_brep_50))
mesh_join_51 = MeshJoin(Meshes=flatten(mesh_brep_51))
reduce_mesh_17 = ReduceMesh(Mesh=mesh_join_51, FaceCount=20, Accuracy=1, FaceType=segmentacion_17, Distort=Toggle(False), Normalize=Toggle(True))  # -> Reduced, CountDifference
panel_18 = Panel(reduce_mesh_17.CountDifference)
python_3_script_70 = Python3Script(M=reduce_mesh_17.Reduced, B=rh_in_17_0_mapeado)  # -> a; inputs M: Mesh, B: list of Int32; same code as box_mapping_v1_0
python_3_script_71 = Python3Script(M=mesh_join_50, B=rh_in_17_0_mapeado)  # -> a; inputs M: Mesh, B: list of Int32; same code as box_mapping_v1_0
rh_out_mdp_refuerzo_posterior_izq = Geometry(python_3_script_70)
rh_out_refuerzo_posterior_izq_b = Geometry(python_3_script_71)

# ----
# Box Mapping 3.8
python_3_script_72 = Python3Script(M=mesh_join_49, B=rh_in_17_0_mapeado)  # -> a; inputs M: Mesh, B: list of Int32; same code as box_mapping_v1_0

# ---- group: Refuerzo Posterior Izq (continued)
rh_out_refuerzo_posterior_izq = Geometry(python_3_script_72)

# ---- group: Sobre Zocalo P
rh_in_16_1_lado_balance = ValueList({"Cara A", "Cara B", "D/D"}, selected="Cara B")
rh_in_16_2_canto_frontal = ValueList({"Canto": 0, "MDP": 1}, selected="MDP")
rh_in_16_3_canto_trasero = ValueList({"Canto": 0, "MDP": 1}, selected="MDP")
rh_in_16_4canto_izquierdo_arriba = ValueList({"Canto": 0, "MDP": 1}, selected="MDP")
rh_in_16_5_canto_derecho_abajo = ValueList({"Canto": 0, "MDP": 1}, selected="MDP")
segmentacion_18 = ValueList({"Triángulos": 0, "Quads y triángulos (mixto)": 1, "Sólo quads si es posible": 2}, selected="Sólo quads si es posible")
rh_in_16_0_mapeado = ValueList({"Longitudinal": 0, "Atravesada": 1}, selected="Longitudinal")

# Materializer 3.4
python_3_script_73 = Python3Script(
    Brep_In=brep_18,
    Balance_Mode=rh_in_16_1_lado_balance,
    Canto_1=rh_in_16_2_canto_frontal,
    Canto_2=rh_in_16_3_canto_trasero,
    Canto_3=rh_in_16_4canto_izquierdo_arriba,
    Canto_4=rh_in_16_5_canto_derecho_abajo)  # -> Out, NURBS_Color, NURBS_Balance, NURBS_MDP; inputs Brep_In: list of Brep, Balance_Mode: String, Canto_1: String, Canto_2: String, Canto_3: String, Canto_4: String; same code as python_3_script_5

# ---- group: Reenguece Der
rh_in_21_1_lado_balance = ValueList({"Cara A", "Cara B", "D/D"}, selected="Cara B")
rh_in_21_2_canto_frontal = ValueList({"Canto": 0, "MDP": 1}, selected="MDP")
rh_in_21_3_canto_trasero = ValueList({"Canto": 0, "MDP": 1}, selected="MDP")
rh_in_21_5_canto_derecho_abajo = ValueList({"Canto": 0, "MDP": 1}, selected="MDP")
rh_in_21_4canto_izquierdo_arriba = ValueList({"Canto": 0, "MDP": 1}, selected="MDP")
segmentacion_19 = ValueList({"Triángulos": 0, "Quads y triángulos (mixto)": 1, "Sólo quads si es posible": 2}, selected="Sólo quads si es posible")
rh_in_21_0_mapeado = ValueList({"Longitudinal": 0, "Atravesada": 1}, selected="Longitudinal")

# Materializer 3.4
python_3_script_74 = Python3Script(
    Brep_In=brep_19,
    Balance_Mode=rh_in_21_1_lado_balance,
    Canto_1=rh_in_21_2_canto_frontal,
    Canto_2=rh_in_21_3_canto_trasero,
    Canto_3=rh_in_21_4canto_izquierdo_arriba,
    Canto_4=rh_in_21_5_canto_derecho_abajo)  # -> Out, NURBS_Color, NURBS_Balance, NURBS_MDP; inputs Brep_In: list of Brep, Balance_Mode: String, Canto_1: String, Canto_2: String, Canto_3: String, Canto_4: String; same code as python_3_script_5

# ---- group: Refuerzo Posterior Der
rh_in_18_1_lado_balance = ValueList({"Cara A", "Cara B", "D/D"}, selected="Cara B")
rh_in_18_2_canto_frontal = ValueList({"Canto": 0, "MDP": 1}, selected="MDP")
rh_in_18_3_canto_trasero = ValueList({"Canto": 0, "MDP": 1}, selected="MDP")
rh_in_18_4canto_izquierdo_arriba = ValueList({"Canto": 0, "MDP": 1}, selected="MDP")
rh_in_18_5_canto_derecho_abajo = ValueList({"Canto": 0, "MDP": 1}, selected="MDP")
segmentacion_20 = ValueList({"Triángulos": 0, "Quads y triángulos (mixto)": 1, "Sólo quads si es posible": 2}, selected="Sólo quads si es posible")
rh_in_18_0_mapeado = ValueList({"Longitudinal": 0, "Atravesada": 1}, selected="Longitudinal")

# Materializer 3.4
python_3_script_75 = Python3Script(
    Brep_In=brep_20,
    Balance_Mode=rh_in_18_1_lado_balance,
    Canto_1=rh_in_18_2_canto_frontal,
    Canto_2=rh_in_18_3_canto_trasero,
    Canto_3=rh_in_18_4canto_izquierdo_arriba,
    Canto_4=rh_in_18_5_canto_derecho_abajo)  # -> Out, NURBS_Color, NURBS_Balance, NURBS_MDP; inputs Brep_In: list of Brep, Balance_Mode: String, Canto_1: String, Canto_2: String, Canto_3: String, Canto_4: String; same code as python_3_script_5

# ---- group: Sobre Zocalo P (continued)
diagnostico_18 = Panel(python_3_script_73.Out)
mesh_brep_52 = MeshBrep(
    Brep=python_3_script_73.NURBS_Color,
    Settings={GridMaxCount=0, GridMinCount=16, JaggedSeams=False, MaxEdgeLength=0, MinEdgeLength=0.0001, MinTolerance=0, Refine=True, RefineAngle=0, RelativeTolerance=0.65, SimplePlanes=True, Tolerance=0})
mesh_brep_53 = MeshBrep(
    Brep=python_3_script_73.NURBS_Balance,
    Settings={GridMaxCount=0, GridMinCount=16, JaggedSeams=False, MaxEdgeLength=0, MinEdgeLength=0.0001, MinTolerance=0, Refine=True, RefineAngle=0, RelativeTolerance=0.65, SimplePlanes=True, Tolerance=0})
mesh_brep_54 = MeshBrep(
    Brep=python_3_script_73.NURBS_MDP,
    Settings={GridMaxCount=0, GridMinCount=16, JaggedSeams=False, MaxEdgeLength=0, MinEdgeLength=0.0001, MinTolerance=0, Refine=True, RefineAngle=0, RelativeTolerance=0.65, SimplePlanes=True, Tolerance=0})
mesh_join_52 = MeshJoin(Meshes=flatten(mesh_brep_52))
mesh_join_53 = MeshJoin(Meshes=flatten(mesh_brep_53))
mesh_join_54 = MeshJoin(Meshes=flatten(mesh_brep_54))
reduce_mesh_18 = ReduceMesh(Mesh=mesh_join_54, FaceCount=20, Accuracy=1, FaceType=segmentacion_18, Distort=Toggle(False), Normalize=Toggle(True))  # -> Reduced, CountDifference
panel_19 = Panel(reduce_mesh_18.CountDifference)
python_3_script_76 = Python3Script(M=reduce_mesh_18.Reduced, B=rh_in_16_0_mapeado)  # -> a; inputs M: Mesh, B: list of Int32; same code as box_mapping_v1_0
python_3_script_77 = Python3Script(M=mesh_join_53, B=rh_in_16_0_mapeado)  # -> a; inputs M: Mesh, B: list of Int32; same code as box_mapping_v1_0
rh_out_mdp_sobre_zocalo_p = Geometry(python_3_script_76)
rh_out_sobre_zocalo_p_b = Geometry(python_3_script_77)

# ----
# Box Mapping 3.8
python_3_script_78 = Python3Script(M=mesh_join_52, B=rh_in_16_0_mapeado)  # -> a; inputs M: Mesh, B: list of Int32; same code as box_mapping_v1_0

# ---- group: Sobre Zocalo P (continued)
rh_out_sobre_zocalo_p = Geometry(python_3_script_78)

# ---- group: Reenguece Der (continued)
diagnostico_19 = Panel(python_3_script_74.Out)
mesh_brep_55 = MeshBrep(
    Brep=python_3_script_74.NURBS_Color,
    Settings={GridMaxCount=0, GridMinCount=16, JaggedSeams=False, MaxEdgeLength=0, MinEdgeLength=0.0001, MinTolerance=0, Refine=True, RefineAngle=0, RelativeTolerance=0.65, SimplePlanes=True, Tolerance=0})
mesh_brep_56 = MeshBrep(
    Brep=python_3_script_74.NURBS_Balance,
    Settings={GridMaxCount=0, GridMinCount=16, JaggedSeams=False, MaxEdgeLength=0, MinEdgeLength=0.0001, MinTolerance=0, Refine=True, RefineAngle=0, RelativeTolerance=0.65, SimplePlanes=True, Tolerance=0})
mesh_brep_57 = MeshBrep(
    Brep=python_3_script_74.NURBS_MDP,
    Settings={GridMaxCount=0, GridMinCount=16, JaggedSeams=False, MaxEdgeLength=0, MinEdgeLength=0.0001, MinTolerance=0, Refine=True, RefineAngle=0, RelativeTolerance=0.65, SimplePlanes=True, Tolerance=0})
mesh_join_55 = MeshJoin(Meshes=flatten(mesh_brep_55))
mesh_join_56 = MeshJoin(Meshes=flatten(mesh_brep_56))
mesh_join_57 = MeshJoin(Meshes=flatten(mesh_brep_57))
reduce_mesh_19 = ReduceMesh(Mesh=mesh_join_57, FaceCount=20, Accuracy=1, FaceType=segmentacion_19, Distort=Toggle(False), Normalize=Toggle(True))  # -> Reduced, CountDifference
panel_20 = Panel(reduce_mesh_19.CountDifference)
python_3_script_79 = Python3Script(M=reduce_mesh_19.Reduced, B=rh_in_21_0_mapeado)  # -> a; inputs M: Mesh, B: list of Int32; same code as box_mapping_v1_0
python_3_script_80 = Python3Script(M=mesh_join_56, B=rh_in_21_0_mapeado)  # -> a; inputs M: Mesh, B: list of Int32; same code as box_mapping_v1_0
rh_out_mdp_reenguece_der = Geometry(python_3_script_79)
rh_out_reenguece_der_b = Geometry(python_3_script_80)

# ----
# Box Mapping 3.8
python_3_script_81 = Python3Script(M=mesh_join_55, B=rh_in_21_0_mapeado)  # -> a; inputs M: Mesh, B: list of Int32; same code as box_mapping_v1_0

# ---- group: Reenguece Der (continued)
rh_out_reenguece_der = Geometry(python_3_script_81)

# ---- group: Refuerzo Posterior Der (continued)
diagnostico_20 = Panel(python_3_script_75.Out)
mesh_brep_58 = MeshBrep(
    Brep=python_3_script_75.NURBS_Color,
    Settings={GridMaxCount=0, GridMinCount=16, JaggedSeams=False, MaxEdgeLength=0, MinEdgeLength=0.0001, MinTolerance=0, Refine=True, RefineAngle=0, RelativeTolerance=0.65, SimplePlanes=True, Tolerance=0})
mesh_brep_59 = MeshBrep(
    Brep=python_3_script_75.NURBS_Balance,
    Settings={GridMaxCount=0, GridMinCount=16, JaggedSeams=False, MaxEdgeLength=0, MinEdgeLength=0.0001, MinTolerance=0, Refine=True, RefineAngle=0, RelativeTolerance=0.65, SimplePlanes=True, Tolerance=0})
mesh_brep_60 = MeshBrep(
    Brep=python_3_script_75.NURBS_MDP,
    Settings={GridMaxCount=0, GridMinCount=16, JaggedSeams=False, MaxEdgeLength=0, MinEdgeLength=0.0001, MinTolerance=0, Refine=True, RefineAngle=0, RelativeTolerance=0.65, SimplePlanes=True, Tolerance=0})
mesh_join_58 = MeshJoin(Meshes=flatten(mesh_brep_58))
mesh_join_59 = MeshJoin(Meshes=flatten(mesh_brep_59))
mesh_join_60 = MeshJoin(Meshes=flatten(mesh_brep_60))
reduce_mesh_20 = ReduceMesh(Mesh=mesh_join_60, FaceCount=20, Accuracy=1, FaceType=segmentacion_20, Distort=Toggle(False), Normalize=Toggle(True))  # -> Reduced, CountDifference
panel_21 = Panel(reduce_mesh_20.CountDifference)
python_3_script_82 = Python3Script(M=reduce_mesh_20.Reduced, B=rh_in_18_0_mapeado)  # -> a; inputs M: Mesh, B: list of Int32; same code as box_mapping_v1_0
python_3_script_83 = Python3Script(M=mesh_join_59, B=rh_in_18_0_mapeado)  # -> a; inputs M: Mesh, B: list of Int32; same code as box_mapping_v1_0
rh_out_mdp_refuerzo_posterior_der = Geometry(python_3_script_82)
rh_out_refuerzo_posterior_der_b = Geometry(python_3_script_83)

# ----
# Box Mapping 3.8
python_3_script_84 = Python3Script(M=mesh_join_58, B=rh_in_18_0_mapeado)  # -> a; inputs M: Mesh, B: list of Int32; same code as box_mapping_v1_0

# ---- group: Refuerzo Posterior Der (continued)
rh_out_refuerzo_posterior_der = Geometry(python_3_script_84)
