# Grasshopper definition LOD200_3DBimFab.ghx (Grasshopper 1.0.8)

# ---- group: Personalizacion / RH_IN:Distancia bajo laterales
rh_in_02_3_distancia_bajo_laterales = ValueList({"25", "30"}, selected="30")

# ---- group: Personalizacion / RH_IN:Profundidad cajon
rh_in_02_1_profundidad_cajon = ValueList({"351", "400"}, selected="351")

# ---- group: Personalizacion / RH_IN:Cantidada de Cajones
# FUNCIONALIDAD
rh_in_02_0_cantidada_de_cajones = ValueList({"1", "2", "3"}, selected="2")

# ---- group: Personalizacion / RH_IN:Altura lateral de cajon
rh_in_02_2_altura_lateral_de_cajon = ValueList({"102", "138", "147", "200"}, selected="102")

# ---- group: Personalizacion / RH_IN:Abrir Cajones
rh_in_02_5_abrir_cajones = Slider(0, range=0..300)

# ---- group: Personalizacion / RH_IN:Tipo Cajon
rh_in_02_4_tipo_cajon = ValueList({"Corredera Tipo X": 40, "Corredera Estandar": 27.5}, selected="Corredera Estandar")

# ---- group: Dimensiones Principales / RH_IN:Profundidad
rh_in_01_3_profundidad = Slider(400, range=200..1000)

# ---- group: Dimensiones Principales / RH_IN:Alto
rh_in_01_2_alto = Slider(600, range=300..1200)

# ---- group: Dimensiones Principales / RH_IN:Ancho
rh_in_01_1_ancho = Slider(500, range=300..1000)

# ---- group: Dimensiones Principales
# Box Cajonera
domain_box = DomainBox(Base=PlaneXY(0, 0, 0), X=rh_in_01_1_ancho, Y=rh_in_01_3_profundidad, Z=rh_in_01_2_alto)
deconstruct_brep = DeconstructBrep(Brep=domain_box)  # -> Faces, Edges, Vertices

# ----
number_slider = Slider(3, range=0..16)
unit_x = UnitX(Factor="-6")
unit_y = UnitY(Factor="-10")
unit_x_2 = UnitX(Factor="6")
unit_z = UnitZ(Factor="-6")
unit_y_2 = UnitY(Factor="-13")
unit_z_2 = UnitZ(Factor="6")
unit_y_3 = UnitY(Factor=rh_in_02_5_abrir_cajones)
negative = Negative(Value=unit_y_3)
unit_x_3 = UnitX(Factor="-6")
unit_y_4 = UnitY(Factor="-6")
unit_z_3 = UnitZ(Factor="15")
unit_x_4 = UnitX(Factor="6")
unit_y_5 = UnitY(Factor="6")
unit_z_4 = UnitZ(Factor="18")

# ----
# Costados de móveis
# Furniture side
# Costado de mueble
panel = Panel("8")
list_item = ListItem(List=deconstruct_brep.Edges, Index=panel, Wrap=True)
list_item_2 = ListItem(List=deconstruct_brep.Faces, Index="4", Wrap=True)
length = Length(Curve=list_item)
unit_z_5 = UnitZ(Factor="15")
subtraction = Subtraction(A=length, B="15")
extrude = Extrude(Base=list_item_2, Direction=unit_z_5)
unit_z_6 = UnitZ(Factor=subtraction)
move = Move(Geometry=extrude, Motion=unit_z_6)  # -> Geometry, Transform
deconstruct_brep_2 = DeconstructBrep(Brep=move.Geometry)  # -> Faces, Edges, Vertices
deconstruct_brep_3 = DeconstructBrep(Brep=extrude)  # -> Faces, Edges, Vertices
list_item_3 = ListItem(List=deconstruct_brep_2.Edges, Index="3", Wrap=True)
list_item_4 = ListItem(List=deconstruct_brep_3.Edges, Index="3", Wrap=True)
unit_z_7 = UnitZ(Factor="15")
list_item_5 = ListItem(List=deconstruct_brep_3.Edges, Index="2", Wrap=True)
length_2 = Length(Curve=list_item_5)
move_2 = Move(Geometry=list_item_4, Motion=unit_z_7)  # -> Geometry, Transform
unit_x_5 = UnitX(Factor="15")
subtraction_2 = Subtraction(A=length_2, B="15")
loft = Loft(
    Curves=[list_item_3, move_2.Geometry],
    Options={Adjust=False, Closed=False, LoftEnds=0, LoftSimp=0, LoftType=0, Rebuild=10, Refit=0.01})
extrude_2 = Extrude(Base=loft, Direction=unit_x_5)
unit_x_6 = UnitX(Factor=subtraction_2)
move_3 = Move(Geometry=extrude_2, Motion=unit_x_6)  # -> Geometry, Transform
unit_x_7 = UnitX(Factor="2")
negative_2 = Negative(Value=unit_x_7)

move_4 = Move(Geometry=move_3.Geometry, Motion=negative_2)  # -> Geometry, Transform
move_5 = Move(Geometry=extrude_2, Motion=unit_x_7)  # -> Geometry, Transform

deconstruct_brep_4 = DeconstructBrep(Brep=move_5.Geometry)  # -> Faces, Edges, Vertices
deconstruct_brep_5 = DeconstructBrep(Brep=move_4.Geometry)  # -> Faces, Edges, Vertices

# ----
# Box Interno
panel_2 = Panel("5")
list_item_6 = ListItem(List=deconstruct_brep_4.Faces, Index=panel_2, Wrap=True)
list_item_7 = ListItem(List=deconstruct_brep_5.Faces, Index="0", Wrap=True)
loft_2 = Loft(
    Curves=[list_item_7, list_item_6],
    Options={Adjust=False, Closed=False, LoftEnds=0, LoftSimp=0, LoftType=0, Rebuild=10, Refit=0.01})
deconstruct_brep_6 = DeconstructBrep(Brep=loft_2)  # -> Faces, Edges, Vertices
list_item_8 = ListItem(List=deconstruct_brep_6.Faces, Index="5", Wrap=True)
deconstruct_brep_7 = DeconstructBrep(Brep=list_item_8)  # -> Faces, Edges, Vertices

deconstruct_brep_8 = DeconstructBrep(Brep=list_item_7)  # -> Faces, Edges, Vertices
deconstruct_brep_9 = DeconstructBrep(Brep=list_item_6)  # -> Faces, Edges, Vertices
list_item_9 = ListItem(List=deconstruct_brep_9.Vertices, Index="2", Wrap=True)
move_6 = Move(Geometry=list_item_9, Motion=unit_x)  # -> Geometry, Transform
list_item_10 = ListItem(List=deconstruct_brep_8.Vertices, Index="3", Wrap=True)
move_7 = Move(Geometry=move_6.Geometry, Motion=unit_y)  # -> Geometry, Transform
move_8 = Move(Geometry=list_item_10, Motion=unit_x_2)  # -> Geometry, Transform
move_9 = Move(Geometry=move_7.Geometry, Motion=unit_z)  # -> Geometry, Transform
move_10 = Move(Geometry=move_8.Geometry, Motion=unit_y_2)  # -> Geometry, Transform
move_11 = Move(Geometry=move_10.Geometry, Motion=unit_z_2)  # -> Geometry, Transform
box_2pt = Box2Pt(PointA=move_9.Geometry, PointB=move_11.Geometry, Plane=PlaneXY(0, 0, 0))
list_item_11 = ListItem(List=deconstruct_brep_4.Vertices, Index="1", Wrap=True)

# ----
# Calculador Cajones
point = Point(deconstruct_brep_7.Vertices)
list_item_12 = ListItem(List=point, Index="1", Wrap=True)
list_item_13 = ListItem(List=point, Index="4", Wrap=True)
list_item_14 = ListItem(List=deconstruct_brep_7.Edges, Index="9", Wrap=True)
length_3 = Length(Curve=list_item_14)
altura_tapaluz = Panel("66")
altura_tapaluz_2 = Panel("36")
unit_z_8 = UnitZ(Factor=altura_tapaluz)
unit_x_8 = UnitX(Factor="-15")
multiplication = Multiplication(A=altura_tapaluz_2, B=rh_in_02_0_cantidada_de_cajones)
move_12 = Move(Geometry=list_item_12, Motion=unit_x_8)  # -> Geometry, Transform
longitud = Panel(multiplication)
negative_3 = Negative(Value=unit_z_8)
addition = Addition(A=length_3, B="15")
move_13 = Move(Geometry=list_item_12, Motion=negative_3)  # -> Geometry, Transform
unit_y_6 = UnitY(Factor="30")
subtraction_3 = Subtraction(A=addition, B=longitud)
move_14 = Move(Geometry=move_13.Geometry, Motion=unit_y_6)  # -> Geometry, Transform
unit_y_7 = UnitY(Factor="15")
panel_3 = Panel(subtraction_3)
division = Division(A=panel_3, B=rh_in_02_0_cantidada_de_cajones)
move_15 = Move(Geometry=list_item_13, Motion=unit_y_7)  # -> Geometry, Transform
alto_cajon = Panel(division)
unit_z_9 = UnitZ(Factor=alto_cajon)
negative_4 = Negative(Value=unit_z_9)
move_16 = Move(Geometry=list_item_13, Motion=negative_4)  # -> Geometry, Transform
unit_y_8 = UnitY(Factor="15")
negative_5 = Negative(Value=unit_y_8)
unit_x_9 = UnitX(Factor="-15")
move_17 = Move(Geometry=move_16.Geometry, Motion=negative_5)  # -> Geometry, Transform
negative_6 = Negative(Value=unit_x_9)
move_18 = Move(Geometry=move_17.Geometry, Motion=negative_6)  # -> Geometry, Transform
box_2pt_2 = Box2Pt(PointA=move_12.Geometry, PointB=move_18.Geometry, Plane=PlaneXY(0, 0, 0))
unit_z_10 = UnitZ(Factor=altura_tapaluz_2)
negative_7 = Negative(Value=unit_z_10)

# ---- group: TapaLuz
box_2pt_3 = Box2Pt(PointA=move_14.Geometry, PointB=move_15.Geometry, Plane=PlaneXY(0, 0, 0))

# ----
brep = Brep(box_2pt_3)

# ---- group: Frente de Cajon
move_19 = Move(Geometry=box_2pt_2, Motion=negative_7)  # -> Geometry, Transform

# ----
brep_2 = Brep(move_19.Geometry)

brep_3 = Brep(brep_2)

# ----
# Componentes posteriores del Cajon
area = Area(Geometry=brep_2)  # -> Area, Centroid
deconstruct_brep_10 = DeconstructBrep(Brep=brep_2)  # -> Faces, Edges, Vertices
yz_plane = YZPlane(Origin=area.Centroid)
unit_x_10 = UnitX(Factor=rh_in_02_4_tipo_cajon)
unit_z_11 = UnitZ(Factor=rh_in_02_3_distancia_bajo_laterales)
unit_x_11 = UnitX(Factor="15")
unit_y_9 = UnitY(Factor=rh_in_02_1_profundidad_cajon)
unit_z_12 = UnitZ(Factor=rh_in_02_2_altura_lateral_de_cajon)
unit_y_10 = UnitY(Factor="-15")

# ---- group: Punto Medio
list_item_15 = ListItem(List=deconstruct_brep_10.Vertices, Index="3", Wrap=True)

# ----
line = Line(StartPoint=list_item_15, EndPoint=list_item_11)
length_4 = Length(Curve=line)
addition_2 = Addition(A=length_4, B="15")
division_2 = Division(A=addition_2, B="2")

# ----
# A 2 cajones
unit_z_13 = UnitZ(Factor=addition_2)
unit_z_14 = UnitZ(Factor=addition_2)
negative_8 = Negative(Value=unit_z_13)
negative_9 = Negative(Value=unit_z_14)
move_20 = Move(Geometry=brep, Motion=negative_8)  # -> Geometry, Transform
stream_filter = StreamFilter(Gate=rh_in_02_0_cantidada_de_cajones, Stream2=move_20.Geometry)

# ----
# A 3 Cajones
unit_z_15 = UnitZ(Factor=division_2)
unit_z_16 = UnitZ(Factor=addition_2)
unit_z_17 = UnitZ(Factor=division_2)
unit_z_18 = UnitZ(Factor=addition_2)
negative_10 = Negative(Value=unit_z_15)
negative_11 = Negative(Value=unit_z_16)
negative_12 = Negative(Value=unit_z_17)
negative_13 = Negative(Value=unit_z_18)
move_21 = Move(Geometry=brep, Motion=negative_12)  # -> Geometry, Transform
move_22 = Move(Geometry=brep, Motion=negative_13)  # -> Geometry, Transform
stream_filter_2 = StreamFilter(Gate=rh_in_02_0_cantidada_de_cajones, Stream3=[move_22.Geometry, move_21.Geometry])

move_23 = Move(Geometry=list_item_15, Motion=unit_x_10)  # -> Geometry, Transform
move_24 = Move(Geometry=move_23.Geometry, Motion=unit_z_11)  # -> Geometry, Transform
move_25 = Move(Geometry=move_24.Geometry, Motion=unit_x_11)  # -> Geometry, Transform
move_26 = Move(Geometry=move_25.Geometry, Motion=unit_y_9)  # -> Geometry, Transform
move_27 = Move(Geometry=move_26.Geometry, Motion=unit_z_12)  # -> Geometry, Transform

move_28 = Move(Geometry=move_25.Geometry, Motion=unit_x_3)  # -> Geometry, Transform
move_29 = Move(Geometry=move_28.Geometry, Motion=unit_y_4)  # -> Geometry, Transform
move_30 = Move(Geometry=move_29.Geometry, Motion=unit_z_3)  # -> Geometry, Transform

# ----
# Lateral I
# de Cajon
box_2pt_4 = Box2Pt(PointA=move_24.Geometry, PointB=move_27.Geometry, Plane=PlaneXY(0, 0, 0))

brep_4 = Brep(box_2pt_4)

# ----
# Lateral D
# de Cajon
mirror = Mirror(Geometry=brep_4, Plane=yz_plane)  # -> Geometry, Transform

deconstruct_brep_11 = DeconstructBrep(Brep=mirror.Geometry)  # -> Faces, Edges, Vertices
brep_5 = Brep(mirror.Geometry)
list_item_16 = ListItem(List=deconstruct_brep_11.Vertices, Index="2", Wrap=True)
move_31 = Move(Geometry=list_item_16, Motion=unit_y_10)  # -> Geometry, Transform

# ----
# Posterior
# de Cajon
box_2pt_5 = Box2Pt(PointA=move_27.Geometry, PointB=move_31.Geometry, Plane=PlaneXY(0, 0, 0))

brep_6 = Brep(box_2pt_5)

deconstruct_brep_12 = DeconstructBrep(Brep=box_2pt_5)  # -> Faces, Edges, Vertices
list_item_17 = ListItem(List=deconstruct_brep_12.Vertices, Index="9", Wrap=True)
move_32 = Move(Geometry=list_item_17, Motion=unit_x_4)  # -> Geometry, Transform
move_33 = Move(Geometry=move_32.Geometry, Motion=unit_y_5)  # -> Geometry, Transform
move_34 = Move(Geometry=move_33.Geometry, Motion=unit_z_4)  # -> Geometry, Transform
box_2pt_6 = Box2Pt(PointA=move_30.Geometry, PointB=move_34.Geometry, Plane=PlaneXY(0, 0, 0))
move_35 = Move(Geometry=[brep_6, brep_5, brep_4, brep_2, box_2pt_6], Motion=negative)  # -> Geometry, Transform

stream_filter_3 = StreamFilter(Gate=rh_in_02_0_cantidada_de_cajones, Stream2=move_35.Geometry)
move_36 = Move(Geometry=stream_filter_3, Motion=negative_9)  # -> Geometry, Transform

stream_filter_4 = StreamFilter(Gate=rh_in_02_0_cantidada_de_cajones, Stream3=move_35.Geometry)
move_37 = Move(Geometry=stream_filter_4, Motion=negative_11)  # -> Geometry, Transform
move_38 = Move(Geometry=stream_filter_4, Motion=negative_10)  # -> Geometry, Transform

# ----
# Identificador piezas
explode_tree = ExplodeTree(Data=[move_38.Geometry, move_37.Geometry, move_36.Geometry])  # -> _000000, _0000000, _00000000, _000000000, Branch4
explode_tree_2 = ExplodeTree(Data=explode_tree._0000000)  # -> _0000000, Branch1, Branch2, Branch3, Branch4
brep_7 = Brep(explode_tree._000000)
brep_8 = Brep(explode_tree._00000000)
dispatch = Dispatch(List=explode_tree_2._0000000, DispatchPattern=[True, False])  # -> ListA, ListB
dispatch_2 = Dispatch(List=brep_8, DispatchPattern=[True, False])  # -> ListA, ListB
brep_9 = Brep(dispatch.ListB)
brep_10 = Brep(dispatch_2.ListB)

brep_11 = Brep(explode_tree._000000000)
brep_12 = Brep(dispatch_2.ListA)

# ---- group: Nesting Vetas
rh_in_03_1_cubierta_inferior = ValueList({"Longitudinal": 0, "Atravesada": 1}, selected="Longitudinal")
rh_in_03_2_lateral_izquierdo = ValueList({"Longitudinal": 0, "Atravesada": 1}, selected="Longitudinal")
rh_in_03_3_lateral_derecho = ValueList({"Longitudinal": 0, "Atravesada": 1}, selected="Longitudinal")
rh_in_03_5_tapa_luz = ValueList({"Longitudinal": 0, "Atravesada": 1}, selected="Longitudinal")
rh_in_03_6_lateral_izq_cajon = ValueList({"Longitudinal": 0, "Atravesada": 1}, selected="Longitudinal")
rh_in_03_7_posterior_de_cajon = ValueList({"Longitudinal": 0, "Atravesada": 1}, selected="Longitudinal")
rh_in_03_0_cubierta_superior = ValueList({"Longitudinal": 0, "Atravesada": 1}, selected="Longitudinal")
rh_in_03_4_frente_de_cajon = ValueList({"Longitudinal": 0, "Atravesada": 1}, selected="Longitudinal")
rh_in_03_9_espaldar_mueble = ValueList({"Longitudinal": 0, "Atravesada": 1}, selected="Longitudinal")
rh_in_03_8_fondo_cajon = ValueList({"Longitudinal": 0, "Atravesada": 1}, selected="Longitudinal")
cluster = Cluster(M=extrude, B=rh_in_03_1_cubierta_inferior)
cluster_2 = Cluster(M=box_2pt, B=rh_in_03_9_espaldar_mueble)
cluster_3 = Cluster(M=move_5.Geometry, B=rh_in_03_2_lateral_izquierdo)
cluster_4 = Cluster(M=move_4.Geometry, B=rh_in_03_3_lateral_derecho)
cluster_5 = Cluster(M=[stream_filter, brep, stream_filter_2], B=rh_in_03_5_tapa_luz)
cluster_6 = Cluster(M=[brep_4, brep_9], B=rh_in_03_6_lateral_izq_cajon)
cluster_7 = Cluster(M=[brep_10, brep_6, brep_12], B=rh_in_03_7_posterior_de_cajon)
cluster_8 = Cluster(M=[brep_11, box_2pt_6], B=rh_in_03_8_fondo_cajon)
rh_out_cubierta_inferior = Geometry(cluster)
rh_out_lateral_izquierdo = Geometry(cluster_3)
rh_out_lateral_derecho = Geometry(cluster_4)
rh_out_tapa_luz = Geometry(cluster_5)
rh_out_lateral_izq_cajon = Geometry(cluster_6)
rh_out_posterior_de_cajon = Geometry(cluster_7)
rh_out_espaldar_mueble = Geometry(cluster_2)
rh_out_fondo_cajon = Geometry(cluster_8)
mirror_2 = Mirror(Geometry=rh_out_lateral_izq_cajon, Plane=yz_plane)  # -> Geometry, Transform
rh_out_lateral_der_cajon = Geometry(mirror_2.Geometry)

# ----
cluster_9 = Cluster(M=[brep_7, brep_3], B=rh_in_03_4_frente_de_cajon)
cluster_10 = Cluster(M=move.Geometry, B=rh_in_03_0_cubierta_superior)

# ---- group: Nesting Vetas (continued)
rh_out_cubierta_superior = Geometry(cluster_10)
rh_out_frente_de_cajon = Geometry(cluster_9)

# ==== cluster Cluster
B = ClusterInput()
# Mapeado
M = ClusterInput()
python_3_script = Python3Script(M=M, B=B)  # -> a; inputs M: Mesh, B: Int32
# ---------- python_3_script: Python ----------
import Rhino

def aplicar_box_mapping_profesional(mesh_in, modo_veta=0, escala_caja_mm=600.0):
    if mesh_in is None:
        return None
        
    mesh = mesh_in.DuplicateMesh() if hasattr(mesh_in, "DuplicateMesh") else mesh_in
    if not isinstance(mesh, Rhino.Geometry.Mesh):
        return mesh_in

    # 1. Desoldar aristas vivas para separar las 6 caras
    mesh.Unweld(0.0, True)
    mesh.Normals.ComputeNormals()
    mesh.TextureCoordinates.Clear()

    # 2. Medir BoundingBox real de la pieza en mm
    bbox = mesh.GetBoundingBox(True)
    sx = max(1.0, bbox.Max.X - bbox.Min.X)
    sy = max(1.0, bbox.Max.Y - bbox.Min.Y)
    sz = max(1.0, bbox.Max.Z - bbox.Min.Z)

    # Identificar el espesor (menor dimensión, ej: 15 mm)
    min_dim = min(sx, sy, sz)

    # 3. Detectar si la cara principal es Atravesada (1) o Longitudinal (0)
    es_atravesada = False
    if isinstance(modo_veta, str):
        es_atravesada = "atravesad" in modo_veta.lower() or modo_veta in ["1", "3", "5"]
    elif isinstance(modo_veta, (int, float)):
        es_atravesada = int(modo_veta) in [1, 3, 5]

    escala = float(escala_caja_mm)

    # 4. Asignar UVs: Las caras rotan con el selector, los 4 cantos SIEMPRE corren a lo largo del borde
    for idx in range(mesh.Vertices.Count):
        v = mesh.Vertices[idx]
        n = mesh.Normals[idx] if idx < mesh.Normals.Count else Rhino.Geometry.Vector3f(0, 0, 1)
        
        lx = v.X - bbox.Min.X
        ly = v.Y - bbox.Min.Y
        lz = v.Z - bbox.Min.Z
        
        nx, ny, nz = abs(n.X), abs(n.Y), abs(n.Z)

        # -------------------------------------------------------------
        # CASO 1: Tablero Horizontal (Cubiertas, Entrepaños - Espesor en Z)
        # -------------------------------------------------------------
        if min_dim == sz:
            if nz >= nx and nz >= ny:
                # Caras Principales (Superior / Inferior) -> Responde a Longitudinal / Atravesada
                u = ly / escala if es_atravesada else lx / escala
                v_coord = lx / escala if es_atravesada else ly / escala
            elif ny >= nx and ny >= nz:
                # Canto Frontal / Trasero -> Veta corre a lo largo del ancho X
                u = lx / escala
                v_coord = lz / escala
            else:
                # Canto Lateral Izq / Der -> Veta corre a lo largo de la profundidad Y
                u = ly / escala
                v_coord = lz / escala

        # -------------------------------------------------------------
        # CASO 2: Tablero Vertical Lateral (Costados, Laterales - Espesor en X)
        # -------------------------------------------------------------
        elif min_dim == sx:
            if nx >= ny and nx >= nz:
                # Caras Principales (Caras exteriores e interiores)
                u = lz / escala if es_atravesada else ly / escala
                v_coord = ly / escala if es_atravesada else lz / escala
            elif ny >= nx and ny >= nz:
                # Canto Frontal / Trasero -> Veta corre a lo largo de la altura Z
                u = lz / escala
                v_coord = lx / escala
            else:
                # Canto Superior / Inferior -> Veta corre a lo largo de la profundidad Y
                u = ly / escala
                v_coord = lx / escala

        # -------------------------------------------------------------
        # CASO 3: Tablero Vertical Frontal (Frentes de Cajón, Tapa Luz, Puertas - Espesor en Y)
        # -------------------------------------------------------------
        else:
            if ny >= nx and ny >= nz:
                # Caras Principales (Frente y Trasera) -> Responde a Longitudinal / Atravesada
                u = lz / escala if es_atravesada else lx / escala
                v_coord = lx / escala if es_atravesada else lz / escala
            elif nz >= nx and nz >= ny:
                # Canto Superior / Inferior -> Veta corre a lo largo del ancho X
                u = lx / escala
                v_coord = ly / escala
            else:
                # Canto Lateral Izq / Der -> Veta corre a lo largo de la altura Z
                u = lz / escala
                v_coord = ly / escala

        mesh.TextureCoordinates.Add(float(u), float(v_coord))
        
    return mesh


if isinstance(M, list):
    resultado = [aplicar_box_mapping_profesional(item, B, 600.0) for item in M if item is not None]
else:
    resultado = aplicar_box_mapping_profesional(M, B, 600.0)

a = resultado
# ---------- end python_3_script ----------
a = ClusterOutput(python_3_script)
