# Grasshopper definition Cubierta.ghx (Grasshopper 1.0.8)

# ---- group: Dimensiones Principales
rh_in_01_1_ancho = Slider(498, range=300..2440)
rh_in_01_2_profundidad = Slider(480, range=200..600)
domain_box = DomainBox(Base=PlaneXY(0, 0, 0), X=rh_in_01_1_ancho, Y=rh_in_01_2_profundidad, Z="15")

# ---- group: Recedidos
deconstruct_brep = DeconstructBrep(Brep=domain_box)  # -> Faces, Edges, Vertices
list_item = ListItem(List=deconstruct_brep.Vertices, Index="0", Wrap=True)
list_item_2 = ListItem(List=deconstruct_brep.Vertices, Index="6", Wrap=True)
rh_in_derecho = Slider(0, range=0..200)
rh_in_izquierdo = Slider(0, range=0..200)
unit_x = UnitX(Factor=rh_in_derecho)
unit_x_2 = UnitX(Factor=rh_in_izquierdo)
negative = Negative(Value=unit_x_2)
move = Move(Geometry=list_item_2, Motion=unit_x)  # -> Geometry, Transform
move_2 = Move(Geometry=list_item, Motion=negative)  # -> Geometry, Transform
box_2pt = Box2Pt(PointA=move_2.Geometry, PointB=move.Geometry, Plane=PlaneXY(0, 0, 0))

# ----
deconstruct_brep_2 = DeconstructBrep(Brep=box_2pt)  # -> Faces, Edges, Vertices
list_item_3 = ListItem(List=deconstruct_brep_2.Faces, Index="0", Wrap=True)
list_item_4 = ListItem(List=deconstruct_brep_2.Edges, Index="11", Wrap=True)
list_item_5 = ListItem(List=deconstruct_brep_2.Faces, Index="3", Wrap=True)
area = Area(Geometry=list_item_5)  # -> Area, Centroid
curve_middle = CurveMiddle(Curve=list_item_4)
area_2 = Area(Geometry=list_item_3)  # -> Area, Centroid
line = Line(StartPoint=area.Centroid, EndPoint=curve_middle)
yz_plane = YZPlane(Origin=area_2.Centroid)
xz_plane = XZPlane(Origin=area.Centroid)
length = Length(Curve=line)
panel = Panel(length)
distancia_minima_al_borde = Panel("20")
paso_maquinas = Panel("32")
subtraction = Subtraction(A=panel, B=distancia_minima_al_borde)
division = Division(A=subtraction, B=paso_maquinas)
panel_2 = Panel(division)
round = Round(Number=panel_2)  # -> Nearest, Floor, Ceiling
panel_3 = Panel(round.Floor)
multiplication = Multiplication(A=panel_3, B=paso_maquinas)
unit_y = UnitY(Factor=multiplication)
negative_2 = Negative(Value=paso_maquinas)
move_3 = Move(Geometry=area.Centroid, Motion=unit_y)  # -> Geometry, Transform
unit_y_2 = UnitY(Factor=negative_2)

yz_plane_2 = YZPlane(Origin=move_3.Geometry)
cylinder = Cylinder(Base=yz_plane_2, Radius="4", Length="-10")
cap_holes = CapHoles(Brep=cylinder)
mirror = Mirror(Geometry=cap_holes, Plane=xz_plane)  # -> Geometry, Transform

# ---- group: Herrajes y Posiciones
point = Point(Point(-100, 0, 0))
mesh = Mesh(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)

mesh_2 = Mesh(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)
point_2 = Point(Point(-200, 0, 0))

point_3 = Point(Point(-300, 0, 0))
mesh_3 = Mesh(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)
mesh_4 = Mesh(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)
mesh_5 = Mesh(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)

# ----
vector_2pt = Vector2Pt(PointA=point_2, PointB=move_3.Geometry, Unitize=False)  # -> Vector, Length
move_4 = Move(Geometry=mesh_2, Motion=vector_2pt.Vector)  # -> Geometry, Transform

# ---- group: Herrajes y Posiciones
point_4 = Point(Point(-400, 0, 0))
mesh_6 = Mesh(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)

# Maquinado Tarugos + Tornillo Drywall *Izquierdo
# Tarugo
# Tornillo drywall
# Maquinado Minifix *Izquierdo
# Minifix
# Soportes entrepaño
# Soporte entrepaño
rh_in_02_5posicion_tornillo = ValueList({"-1": -32, "0", "1": 32, "2": 64}, selected="1")
rh_in_02_4_posicion_tarugo = ValueList({"-1": -32, "0", "1": 32, "2": 64}, selected="0")
rh_in_02_2_orientacion_minifix = ValueList({"abajo": 1, "arriba": 0}, selected="abajo")
rh_in_02_3posicion_minifix = ValueList({"-1": -32, "0", "1": 32, "2": 64}, selected="1")
unit_y_3 = UnitY(Factor=rh_in_02_3posicion_minifix)
yz_plane_3 = YZPlane(Origin=move_3.Geometry)
unit_y_4 = UnitY(Factor=rh_in_02_4_posicion_tarugo)
negative_3 = Negative(Value=unit_y_3)
deconstruct_brep_3 = DeconstructBrep(Brep=domain_box)  # -> Faces, Edges, Vertices
cylinder_2 = Cylinder(Base=yz_plane_3, Radius="3", Length="-15")
unit_x_3 = UnitX(Factor="22")
unit_y_5 = UnitY(Factor=rh_in_02_5posicion_tornillo)
negative_4 = Negative(Value=unit_y_4)
move_5 = Move(Geometry=move_3.Geometry, Motion=negative_3)  # -> Geometry, Transform
yz_plane_4 = YZPlane(Origin=move_5.Geometry)
cylinder_3 = Cylinder(Base=yz_plane_4, Radius="3.5", Length="24")
cylinder_4 = Cylinder(Base=yz_plane_4, Radius="4", Length="-10")
list_item_6 = ListItem(List=deconstruct_brep_3.Vertices, Index="0", Wrap=True)
list_item_7 = ListItem(List=deconstruct_brep_3.Vertices, Index="6", Wrap=True)
list_item_8 = ListItem(List=deconstruct_brep_3.Faces, Index="0", Wrap=True)
yz_plane_5 = YZPlane(Origin=move_5.Geometry)
move_6 = Move(Geometry=move_3.Geometry, Motion=unit_x_3)  # -> Geometry, Transform
cap_holes_2 = CapHoles(Brep=cylinder_3)
negative_5 = Negative(Value=unit_y_5)
cap_holes_3 = CapHoles(Brep=cylinder_4)
move_7 = Move(Geometry=move_3.Geometry, Motion=negative_4)  # -> Geometry, Transform
area_3 = Area(Geometry=list_item_8)  # -> Area, Centroid
unit_x_4 = UnitX(Factor="0.5")
unit_x_5 = UnitX(Factor="-0.5")
deconstruct_brep_4 = DeconstructBrep(Brep=cap_holes_2)  # -> Faces, Edges, Vertices
mirror_2 = Mirror(Geometry=cap_holes_3, Plane=xz_plane)  # -> Geometry, Transform
move_8 = Move(Geometry=move_4.Geometry, Motion=negative_5)  # -> Geometry, Transform
move_9 = Move(Geometry=list_item_6, Motion=unit_x_4)  # -> Geometry, Transform
move_10 = Move(Geometry=list_item_7, Motion=unit_x_5)  # -> Geometry, Transform
yz_plane_6 = YZPlane(Origin=area_3.Centroid)
unit_y_6 = UnitY(Factor=rh_in_02_5posicion_tornillo)
list_item_9 = ListItem(List=deconstruct_brep_4.Faces, Index="2", Wrap=True)
unit_y_7 = UnitY(Factor=rh_in_02_4_posicion_tarugo)
unit_y_8 = UnitY(Factor=rh_in_02_5posicion_tornillo)
area_4 = Area(Geometry=list_item_9)  # -> Area, Centroid
negative_6 = Negative(Value=unit_y_6)
unit_z = UnitZ(Factor="-4.5")
cylinder_5 = Cylinder(Base=yz_plane_3, Radius="1.5", Length="20")
mirror_3 = Mirror(Geometry=[cap_holes_3, mirror_2.Geometry], Plane=yz_plane)  # -> Geometry, Transform
box_2pt_2 = Box2Pt(PointA=move_9.Geometry, PointB=move_10.Geometry, Plane=PlaneXY(0, 0, 0))
negative_7 = Negative(Value=unit_y_7)
negative_8 = Negative(Value=unit_y_8)
mirror_4 = Mirror(Geometry=move_8.Geometry, Plane=xz_plane)  # -> Geometry, Transform
unit_z_2 = UnitZ(Factor="-7.5")
move_11 = Move(Geometry=cylinder_2, Motion=negative_6)  # -> Geometry, Transform
move_12 = Move(Geometry=area_4.Centroid, Motion=unit_z)  # -> Geometry, Transform
move_13 = Move(Geometry=move_6.Geometry, Motion=negative_7)  # -> Geometry, Transform
move_14 = Move(Geometry=move_3.Geometry, Motion=unit_z_2)  # -> Geometry, Transform
move_15 = Move(Geometry=cylinder_5, Motion=negative_8)  # -> Geometry, Transform
xy_plane = XYPlane(Origin=move_12.Geometry)
cap_holes_4 = CapHoles(Brep=move_11.Geometry)
yz_plane_7 = YZPlane(Origin=move_13.Geometry)
cap_holes_5 = CapHoles(Brep=move_15.Geometry)
cylinder_6 = Cylinder(Base=xy_plane, Radius="7.5", Length="12")
yz_plane_8 = YZPlane(Origin=move_5.Geometry)
cylinder_7 = Cylinder(Base=yz_plane_7, Radius="4", Length="-32")
cap_holes_6 = CapHoles(Brep=cylinder_6)
solid_union = SolidUnion(Breps=[cap_holes_6, cap_holes_2])
cap_holes_7 = CapHoles(Brep=cylinder_7)
rotate = Rotate(Geometry=solid_union, Angle=degrees("180"), Plane=yz_plane_8)  # -> Geometry, Transform
solid_union_2 = SolidUnion(Breps=[cap_holes_4, cap_holes_5])
stream_filter = StreamFilter(Gate=rh_in_02_2_orientacion_minifix, Stream0=solid_union, Stream1=rotate.Geometry)
solid_union_3 = SolidUnion(Breps=[solid_union_2, cap_holes_7])
mirror_5 = Mirror(Geometry=stream_filter, Plane=xz_plane)  # -> Geometry, Transform
mirror_6 = Mirror(Geometry=solid_union_3, Plane=xz_plane)  # -> Geometry, Transform
solid_union_4 = SolidUnion(Breps=[stream_filter, mirror_5.Geometry])  # -> flatten(Result)
solid_union_5 = SolidUnion(Breps=[mirror_6.Geometry, solid_union_3])  # -> flatten(Result)
mirror_7 = Mirror(Geometry=solid_union_4, Plane=yz_plane)  # -> Geometry, Transform
rh_in_02_1_union_derecha = ValueList({"Ya definida": 0, "Tornillo tarugo": 1, "Minifix": 2}, selected="Ya definida")
rh_in_02_0_union_izquierda = ValueList({"Ya definida": 0, "Tornillo tarugo": 1, "Minifix": 2, "Entrepaño": 3}, selected="Entrepaño")
mirror_8 = Mirror(Geometry=solid_union_5, Plane=yz_plane)  # -> Geometry, Transform
mirror_9 = Mirror(Geometry=[mirror_4.Geometry, move_8.Geometry], Plane=yz_plane)  # -> Geometry, Transform
stream_filter_2 = StreamFilter(Pieza=rh_in_02_0_union_izquierda, Stream0=box_2pt, Stream1=box_2pt, Stream2=box_2pt)
stream_filter_3 = StreamFilter(Maquinados=rh_in_02_0_union_izquierda, Stream1=solid_union_5, Stream2=solid_union_4)
stream_filter_4 = StreamFilter(Tornillos=rh_in_02_0_union_izquierda, Stream1=[mirror_4.Geometry, move_8.Geometry])
stream_filter_5 = StreamFilter(MaquinadoMinifxGuia=rh_in_02_0_union_izquierda, Stream2=[cap_holes_3, mirror_2.Geometry])
stream_filter_6 = StreamFilter(Maquinados=rh_in_02_1_union_derecha, Stream1=mirror_8.Geometry, Stream2=mirror_7.Geometry)
stream_filter_7 = StreamFilter(MaquinadoMinifxGuia=rh_in_02_1_union_derecha, Stream2=mirror_3.Geometry)
stream_filter_8 = StreamFilter(Tornillos=rh_in_02_1_union_derecha, Stream1=mirror_9.Geometry)
stream_filter_9 = StreamFilter(Entrepaño=rh_in_02_0_union_izquierda, Stream3=box_2pt_2)
rh_out_tornillo = Geometry([stream_filter_4, stream_filter_8])
solid_union_6 = SolidUnion(Breps=flatten([stream_filter_3, stream_filter_6]))

# ----
vector_2pt_2 = Vector2Pt(PointA=point_3, PointB=move_5.Geometry, Unitize=False)  # -> Vector, Length
vector_2pt_3 = Vector2Pt(PointA=point_3, PointB=move_5.Geometry, Unitize=False)  # -> Vector, Length
move_16 = Move(Geometry=mesh_3, Motion=vector_2pt_2.Vector)  # -> Geometry, Transform
move_17 = Move(Geometry=mesh_3, Motion=vector_2pt_3.Vector)  # -> Geometry, Transform
vector_2pt_4 = Vector2Pt(PointA=point_3, PointB=move_5.Geometry, Unitize=False)  # -> Vector, Length
vector_2pt_5 = Vector2Pt(PointA=point, PointB=move_7.Geometry, Unitize=False)  # -> Vector, Length
move_18 = Move(Geometry=mesh, Motion=vector_2pt_5.Vector)  # -> Geometry, Transform
move_19 = Move(Geometry=[mesh_4, mesh_5], Motion=vector_2pt_4.Vector)  # -> Geometry, Transform
vector_2pt_6 = Vector2Pt(PointA=point_4, PointB=move_14.Geometry, Unitize=False)  # -> Vector, Length
move_20 = Move(Geometry=mesh_6, Motion=vector_2pt_6.Vector)  # -> Geometry, Transform

# ---- group: Nurbs Cubierta
solid_difference = SolidDifference(BrepsA=stream_filter_2, BrepsB=solid_union_6)

# ----
nurbs_entrepaño = Geometry(stream_filter_9)

# ---- group: Apariencia Entrepaño
# 3BF Materializer v0.1
rh_in_04_0_mapeado_entrepaño = ValueList({"Longitudinal": 0, "Atravesada": 1}, selected="Longitudinal")
rh_in_04_1_lado_balance = ValueList({"Cara A", "Cara B", "D/D"}, selected="Cara B")
rh_in_04_2_canto_frontal = ValueList({"Canto": 0, "MDP": 1}, selected="MDP")
rh_in_04_3_canto_trasero = ValueList({"Canto": 0, "MDP": 1}, selected="MDP")
rh_in_04_4canto_izquierdo = ValueList({"Canto": 0, "MDP": 1}, selected="MDP")
rh_in_04_5_canto_derecho = ValueList({"Canto": 0, "MDP": 1}, selected="MDP")
python_3_script = Python3Script(
    Brep_In=nurbs_entrepaño,
    Balance_Mode=rh_in_04_1_lado_balance,
    Canto_1=rh_in_04_2_canto_frontal,
    Canto_2=rh_in_04_3_canto_trasero,
    Canto_3=rh_in_04_4canto_izquierdo,
    Canto_4=rh_in_04_5_canto_derecho)  # -> Out, NURBS_Color, NURBS_Balance, NURBS_MDP, Info_Pieza; inputs Brep_In: Brep, Balance_Mode: String, Canto_1: String, Canto_2: String, Canto_3: String, Canto_4: String
# ---------- python_3_script: Python ----------
import Rhino

def parse_balance(val):
    s = str(val).lower().strip().replace('"', '').replace("'", "")
    if s in ["6", "d/d", "dyd", "doble", "ninguno", "ambas"] or "d/d" in s or "dyd" in s:
        return "DD"
    if s in ["5", "cara a", "a"] or (s.startswith("a") and len(s) <= 6):
        return "A"
    if s in ["4", "cara b", "b"] or (s.startswith("b") and len(s) <= 6):
        return "B"
    if "ambos" in s:
        return "AMBOS"
    return "B"

def parse_canto(val):
    s = str(val).lower().strip().replace('"', '').replace("'", "")
    if s in ["0", "0.0", "canto", "true", "si", "sí", "con canto"] or ("canto" in s and "sin" not in s):
        return True # Madera / Color
    if s in ["1", "1.0", "mdp", "false", "no", "sin canto"] or "mdp" in s or "sin" in s:
        return False # Crudo / MDP
    return True

def desglosar_pieza_real_nurbs(brep_in, balance_mode="Cara B", c1="Canto", c2="Canto", c3="Canto", c4="Canto"):
    if brep_in is None:
        return [], [], [], "Brep de entrada es nulo"

    # 1. Medir BoundingBox de la envolvente exterior
    bbox = brep_in.GetBoundingBox(True)
    x0, x1 = bbox.Min.X, bbox.Max.X
    y0, y1 = bbox.Min.Y, bbox.Max.Y
    z0, z1 = bbox.Min.Z, bbox.Max.Z

    sx = max(0.1, x1 - x0)
    sy = max(0.1, y1 - y0)
    sz = max(0.1, z1 - z0)
    min_dim = min(sx, sy, sz)

    # Tolerancia geométrica para detectar planos exteriores
    tol = max(0.2, min_dim * 0.15)

    faces_A = []
    faces_B = []
    faces_cantos = {1: [], 2: [], 3: [], 4: []}
    faces_mecanizados = []

    # 2. Clasificar cada cara real de la pieza
    for i in range(brep_in.Faces.Count):
        f = brep_in.Faces[i]
        u = f.Domain(0).Mid
        v = f.Domain(1).Mid
        pt = f.PointAt(u, v)
        n = f.NormalAt(u, v)
        n.Unitize()
        nurbs_face = f.DuplicateFace(False)

        # -------------------------------------------------------------
        # CASO 1: Tablero Horizontal (Cubiertas / Entrepaños - Espesor en Z)
        # -------------------------------------------------------------
        if min_dim == sz:
            tipo_str = "Horizontal (Cubierta)"
            # Cara A (+Z exterior)
            if n.Z > 0.8 and abs(pt.Z - z1) < tol:
                faces_A.append(nurbs_face)
            # Cara B (-Z exterior)
            elif n.Z < -0.8 and abs(pt.Z - z0) < tol:
                faces_B.append(nurbs_face)
            # Canto 1: Frontal (-Y exterior)
            elif n.Y < -0.8 and abs(pt.Y - y0) < tol:
                faces_cantos[1].append(nurbs_face)
            # Canto 2: Trasero (+Y exterior)
            elif n.Y > 0.8 and abs(pt.Y - y1) < tol:
                faces_cantos[2].append(nurbs_face)
            # Canto 3: Izquierdo (-X exterior)
            elif n.X < -0.8 and abs(pt.X - x0) < tol:
                faces_cantos[3].append(nurbs_face)
            # Canto 4: Derecho (+X exterior)
            elif n.X > 0.8 and abs(pt.X - x1) < tol:
                faces_cantos[4].append(nurbs_face)
            else:
                # Perforaciones, brocas, avellanados, cajas minifix
                faces_mecanizados.append(nurbs_face)

        # -------------------------------------------------------------
        # CASO 2: Tablero Vertical Lateral (Costados - Espesor en X)
        # -------------------------------------------------------------
        elif min_dim == sx:
            tipo_str = "Vertical Lateral (Costado)"
            if n.X > 0.8 and abs(pt.X - x1) < tol:
                faces_A.append(nurbs_face)
            elif n.X < -0.8 and abs(pt.X - x0) < tol:
                faces_B.append(nurbs_face)
            elif n.Y < -0.8 and abs(pt.Y - y0) < tol:
                faces_cantos[1].append(nurbs_face) # Frontal
            elif n.Y > 0.8 and abs(pt.Y - y1) < tol:
                faces_cantos[2].append(nurbs_face) # Trasero
            elif n.Z > 0.8 and abs(pt.Z - z1) < tol:
                faces_cantos[3].append(nurbs_face) # Superior
            elif n.Z < -0.8 and abs(pt.Z - z0) < tol:
                faces_cantos[4].append(nurbs_face) # Inferior
            else:
                faces_mecanizados.append(nurbs_face)

        # -------------------------------------------------------------
        # CASO 3: Tablero Vertical Frontal (Frentes / Puertas - Espesor en Y)
        # -------------------------------------------------------------
        else:
            tipo_str = "Vertical Frontal (Frente / Puerta)"
            if n.Y > 0.8 and abs(pt.Y - y1) < tol:
                faces_A.append(nurbs_face)
            elif n.Y < -0.8 and abs(pt.Y - y0) < tol:
                faces_B.append(nurbs_face)
            elif n.Z > 0.8 and abs(pt.Z - z1) < tol:
                faces_cantos[1].append(nurbs_face) # Superior
            elif n.Z < -0.8 and abs(pt.Z - z0) < tol:
                faces_cantos[2].append(nurbs_face) # Inferior
            elif n.X < -0.8 and abs(pt.X - x0) < tol:
                faces_cantos[3].append(nurbs_face) # Izquierdo
            elif n.X > 0.8 and abs(pt.X - x1) < tol:
                faces_cantos[4].append(nurbs_face) # Derecho
            else:
                faces_mecanizados.append(nurbs_face)

    # 3. Asignación de Caras Principales según Balance
    modo_b = parse_balance(balance_mode)
    nurbs_color = []
    nurbs_balance = []
    nurbs_mdp = []

    if modo_b == "DD": # Doble Decorativo (ambas a Color)
        nurbs_color.extend(faces_A)
        nurbs_color.extend(faces_B)
        diag_bal = "D/D (Ambas Caras Madera)"
    elif modo_b == "A": # Balance en Cara A
        nurbs_balance.extend(faces_A)
        nurbs_color.extend(faces_B)
        diag_bal = "Balance Cara A"
    elif modo_b == "B": # Balance en Cara B
        nurbs_color.extend(faces_A)
        nurbs_balance.extend(faces_B)
        diag_bal = "Balance Cara B"
    else:
        nurbs_balance.extend(faces_A)
        nurbs_balance.extend(faces_B)
        diag_bal = "Ambos Balance"

    # 4. Asignación de Cantos (1: Frontal, 2: Trasero, 3: Izquierdo, 4: Derecho)
    cantos_in = {
        1: parse_canto(c1),
        2: parse_canto(c2),
        3: parse_canto(c3),
        4: parse_canto(c4)
    }

    c_color_count = 0
    for num_canto, tiene_canto in cantos_in.items():
        if tiene_canto:
            nurbs_color.extend(faces_cantos[num_canto])
            c_color_count += len(faces_cantos[num_canto])
        else:
            nurbs_mdp.extend(faces_cantos[num_canto])

    # 5. INYECCIÓN CRÍTICA: Todos los Mecanizados van SIEMPRE a MDP
    nurbs_mdp.extend(faces_mecanizados)

    diag = "{0} | {1} | Total Caras: {2} (A={3}, B={4}, Cantos={5}, Mecanizados={6}) | Breps Salida -> Color: {7}, Balance: {8}, MDP: {9}".format(
        tipo_str, diag_bal, brep_in.Faces.Count,
        len(faces_A), len(faces_B), sum(len(v) for v in faces_cantos.values()), len(faces_mecanizados),
        len(nurbs_color), len(nurbs_balance), len(nurbs_mdp)
    )

    return nurbs_color, nurbs_balance, nurbs_mdp, diag


# Ejecución
n_col, n_bal, n_mdp, diag_txt = desglosar_pieza_real_nurbs(
    Brep_In,
    Balance_Mode if 'Balance_Mode' in locals() else "Cara B",
    Canto_1 if 'Canto_1' in locals() else "Canto",
    Canto_2 if 'Canto_2' in locals() else "Canto",
    Canto_3 if 'Canto_3' in locals() else "Canto",
    Canto_4 if 'Canto_4' in locals() else "Canto"
)

# Salidas multinombre
NURBS_Color = n_col
Nurbs_Color = n_col
nurbs_color = n_col
Mesh_Color = n_col

NURBS_Balance = n_bal
Nurbs_Balance = n_bal
nurbs_balance = n_bal
Mesh_Balance = n_bal

NURBS_MDP = n_mdp
Nurbs_MDP = n_mdp
nurbs_mdp = n_mdp
Mesh_MDP = n_mdp

Info_Pieza = diag_txt
info_pieza = diag_txt
# ---------- end python_3_script ----------
mesh_brep = MeshBrep(
    Brep=python_3_script.NURBS_Color,
    Settings={GridMaxCount=0, GridMinCount=16, JaggedSeams=False, MaxEdgeLength=0, MinEdgeLength=0.0001, MinTolerance=0, Refine=True, RefineAngle=0, RelativeTolerance=0.65, SimplePlanes=True, Tolerance=0})
mesh_brep_2 = MeshBrep(
    Brep=python_3_script.NURBS_Balance,
    Settings={GridMaxCount=0, GridMinCount=16, JaggedSeams=False, MaxEdgeLength=0, MinEdgeLength=0.0001, MinTolerance=0, Refine=True, RefineAngle=0, RelativeTolerance=0.65, SimplePlanes=True, Tolerance=0})
mesh_brep_3 = MeshBrep(
    Brep=python_3_script.NURBS_MDP,
    Settings={GridMaxCount=0, GridMinCount=16, JaggedSeams=False, MaxEdgeLength=0, MinEdgeLength=0.0001, MinTolerance=0, Refine=True, RefineAngle=0, RelativeTolerance=0.65, SimplePlanes=True, Tolerance=0})
diagnostico = Panel(python_3_script.Info_Pieza)
mesh_join = MeshJoin(Meshes=flatten(mesh_brep))
mesh_join_2 = MeshJoin(Meshes=flatten(mesh_brep_2))
mesh_join_3 = MeshJoin(Meshes=flatten(mesh_brep_3))
python_3_script_2 = Python3Script(M=mesh_join, B=rh_in_04_0_mapeado_entrepaño)  # -> a; inputs M: Mesh, B: Int32
# ---------- python_3_script_2: Python ----------
import Rhino

def aplicar_box_mapping_profesional(mesh_in, modo_veta=0, escala_caja_mm=600.0):
    if mesh_in is None:
        return None
        
    mesh = mesh_in.DuplicateMesh() if hasattr(mesh_in, "DuplicateMesh") else mesh_in
    if not isinstance(mesh, Rhino.Geometry.Mesh):
        return mesh_in

    # 1. Desoldar aristas vivas para separar las 6 caras
    mesh.Unweld(0.0, True)
    mesh.Normals.ComputeNormals()
    mesh.TextureCoordinates.Clear()

    # 2. Medir BoundingBox real de la pieza en mm
    bbox = mesh.GetBoundingBox(True)
    sx = max(1.0, bbox.Max.X - bbox.Min.X)
    sy = max(1.0, bbox.Max.Y - bbox.Min.Y)
    sz = max(1.0, bbox.Max.Z - bbox.Min.Z)

    # Identificar el espesor (menor dimensión, ej: 15 mm)
    min_dim = min(sx, sy, sz)

    # 3. Detectar si la cara principal es Atravesada (1) o Longitudinal (0)
    es_atravesada = False
    if isinstance(modo_veta, str):
        es_atravesada = "atravesad" in modo_veta.lower() or modo_veta in ["1", "3", "5"]
    elif isinstance(modo_veta, (int, float)):
        es_atravesada = int(modo_veta) in [1, 3, 5]

    escala = float(escala_caja_mm)

    # 4. Asignar UVs: Las caras rotan con el selector, los 4 cantos SIEMPRE corren a lo largo del borde
    for idx in range(mesh.Vertices.Count):
        v = mesh.Vertices[idx]
        n = mesh.Normals[idx] if idx < mesh.Normals.Count else Rhino.Geometry.Vector3f(0, 0, 1)
        
        lx = v.X - bbox.Min.X
        ly = v.Y - bbox.Min.Y
        lz = v.Z - bbox.Min.Z
        
        nx, ny, nz = abs(n.X), abs(n.Y), abs(n.Z)

        # -------------------------------------------------------------
        # CASO 1: Tablero Horizontal (Cubiertas, Entrepaños - Espesor en Z)
        # -------------------------------------------------------------
        if min_dim == sz:
            if nz >= nx and nz >= ny:
                # Caras Principales (Superior / Inferior) -> Responde a Longitudinal / Atravesada
                u = ly / escala if es_atravesada else lx / escala
                v_coord = lx / escala if es_atravesada else ly / escala
            elif ny >= nx and ny >= nz:
                # Canto Frontal / Trasero -> Veta corre a lo largo del ancho X
                u = lx / escala
                v_coord = lz / escala
            else:
                # Canto Lateral Izq / Der -> Veta corre a lo largo de la profundidad Y
                u = ly / escala
                v_coord = lz / escala

        # -------------------------------------------------------------
        # CASO 2: Tablero Vertical Lateral (Costados, Laterales - Espesor en X)
        # -------------------------------------------------------------
        elif min_dim == sx:
            if nx >= ny and nx >= nz:
                # Caras Principales (Caras exteriores e interiores)
                u = lz / escala if es_atravesada else ly / escala
                v_coord = ly / escala if es_atravesada else lz / escala
            elif ny >= nx and ny >= nz:
                # Canto Frontal / Trasero -> Veta corre a lo largo de la altura Z
                u = lz / escala
                v_coord = lx / escala
            else:
                # Canto Superior / Inferior -> Veta corre a lo largo de la profundidad Y
                u = ly / escala
                v_coord = lx / escala

        # -------------------------------------------------------------
        # CASO 3: Tablero Vertical Frontal (Frentes de Cajón, Tapa Luz, Puertas - Espesor en Y)
        # -------------------------------------------------------------
        else:
            if ny >= nx and ny >= nz:
                # Caras Principales (Frente y Trasera) -> Responde a Longitudinal / Atravesada
                u = lz / escala if es_atravesada else lx / escala
                v_coord = lx / escala if es_atravesada else lz / escala
            elif nz >= nx and nz >= ny:
                # Canto Superior / Inferior -> Veta corre a lo largo del ancho X
                u = lx / escala
                v_coord = ly / escala
            else:
                # Canto Lateral Izq / Der -> Veta corre a lo largo de la altura Z
                u = lz / escala
                v_coord = ly / escala

        mesh.TextureCoordinates.Add(float(u), float(v_coord))
        
    return mesh


if isinstance(M, list):
    resultado = [aplicar_box_mapping_profesional(item, B, 600.0) for item in M if item is not None]
else:
    resultado = aplicar_box_mapping_profesional(M, B, 600.0)

a = resultado
# ---------- end python_3_script_2 ----------
python_3_script_3 = Python3Script(M=mesh_join_2, B=rh_in_04_0_mapeado_entrepaño)  # -> a; inputs M: Mesh, B: Int32; same code as python_3_script_2
python_3_script_4 = Python3Script(M=mesh_join_3, B=rh_in_04_0_mapeado_entrepaño)  # -> a; inputs M: Mesh, B: Int32; same code as python_3_script_2
rh_out_mdp_entrepaño = Geometry(python_3_script_4)
rh_out_color_entrepaño = Geometry(python_3_script_2)
rh_out_balance_entrepaño = Geometry(python_3_script_3)

# ---- group: Apariencia Cubierta
# 3BF Materializer v0.1
rh_in_03_0_mapeado = ValueList({"Longitudinal": 0, "Atravesada": 1}, selected="Longitudinal")
rh_in_03_1_lado_balance = ValueList({"Cara A", "Cara B", "D/D"}, selected="D/D")
rh_in_03_2_canto_frontal = ValueList({"Canto": 0, "MDP": 1}, selected="MDP")
rh_in_03_3_canto_trasero = ValueList({"Canto": 0, "MDP": 1}, selected="MDP")
rh_in_03_4canto_izquierdo = ValueList({"Canto": 0, "MDP": 1}, selected="MDP")
rh_in_03_5_canto_derecho = ValueList({"Canto": 0, "MDP": 1}, selected="MDP")
python_3_script_5 = Python3Script(
    Brep_In=solid_difference,
    Balance_Mode=rh_in_03_1_lado_balance,
    Canto_1=rh_in_03_2_canto_frontal,
    Canto_2=rh_in_03_3_canto_trasero,
    Canto_3=rh_in_03_4canto_izquierdo,
    Canto_4=rh_in_03_5_canto_derecho)  # -> Out, NURBS_Color, NURBS_Balance, NURBS_MDP, Info_Pieza; inputs Brep_In: Brep, Balance_Mode: String, Canto_1: String, Canto_2: String, Canto_3: String, Canto_4: String; same code as python_3_script
mesh_brep_4 = MeshBrep(
    Brep=python_3_script_5.NURBS_Color,
    Settings={GridMaxCount=0, GridMinCount=16, JaggedSeams=False, MaxEdgeLength=0, MinEdgeLength=0.0001, MinTolerance=0, Refine=True, RefineAngle=0, RelativeTolerance=0.65, SimplePlanes=True, Tolerance=0})
mesh_brep_5 = MeshBrep(
    Brep=python_3_script_5.NURBS_Balance,
    Settings={GridMaxCount=0, GridMinCount=16, JaggedSeams=False, MaxEdgeLength=0, MinEdgeLength=0.0001, MinTolerance=0, Refine=True, RefineAngle=0, RelativeTolerance=0.65, SimplePlanes=True, Tolerance=0})
mesh_brep_6 = MeshBrep(
    Brep=python_3_script_5.NURBS_MDP,
    Settings={GridMaxCount=0, GridMinCount=16, JaggedSeams=False, MaxEdgeLength=0, MinEdgeLength=0.0001, MinTolerance=0, Refine=True, RefineAngle=0, RelativeTolerance=0.65, SimplePlanes=True, Tolerance=0})
diagnostico_2 = Panel(python_3_script_5.Info_Pieza)
mesh_join_4 = MeshJoin(Meshes=flatten(mesh_brep_4))
mesh_join_5 = MeshJoin(Meshes=flatten(mesh_brep_5))
mesh_join_6 = MeshJoin(Meshes=flatten(mesh_brep_6))
python_3_script_6 = Python3Script(M=mesh_join_4, B=rh_in_03_0_mapeado)  # -> a; inputs M: Mesh, B: Int32; same code as python_3_script_2
python_3_script_7 = Python3Script(M=mesh_join_5, B=rh_in_03_0_mapeado)  # -> a; inputs M: Mesh, B: Int32; same code as python_3_script_2
python_3_script_8 = Python3Script(M=mesh_join_6, B=rh_in_03_0_mapeado)  # -> a; inputs M: Mesh, B: Int32; same code as python_3_script_2
rh_out_mdp_cubierta = Geometry(python_3_script_8)
rh_out_color_cubierta = Geometry(python_3_script_6)
rh_out_balance_cubierta = Geometry(python_3_script_7)

# ---- group: Herrajes y Posiciones (continued)
rotate_2 = Rotate(Geometry=move_16.Geometry, Angle=degrees("180"), Plane=yz_plane_5)  # -> Geometry, Transform
mirror_10 = Mirror(Geometry=move_18.Geometry, Plane=xz_plane)  # -> Geometry, Transform
mirror_11 = Mirror(Geometry=move_19.Geometry, Plane=xz_plane)  # -> Geometry, Transform
stream_filter_10 = StreamFilter(Gate=rh_in_02_2_orientacion_minifix, Stream0=move_16.Geometry, Stream1=rotate_2.Geometry)
mirror_12 = Mirror(Geometry=stream_filter_10, Plane=xz_plane)  # -> Geometry, Transform
mirror_13 = Mirror(Geometry=[move_19.Geometry, mirror_11.Geometry], Plane=yz_plane)  # -> Geometry, Transform
mirror_14 = Mirror(Geometry=[mirror_12.Geometry, stream_filter_10], Plane=yz_plane)  # -> Geometry, Transform
mirror_15 = Mirror(Geometry=move_20.Geometry, Plane=xz_plane)  # -> Geometry, Transform
mirror_16 = Mirror(Geometry=[mirror_15.Geometry, move_20.Geometry], Plane=yz_plane_6)  # -> Geometry, Transform
mirror_17 = Mirror(Geometry=[move_18.Geometry, mirror_10.Geometry], Plane=yz_plane)  # -> Geometry, Transform
stream_filter_11 = StreamFilter(Gate=rh_in_02_1_union_derecha, Stream2=mirror_14.Geometry)
stream_filter_12 = StreamFilter(Tarugos=rh_in_02_0_union_izquierda, Stream1=[mirror_10.Geometry, move_18.Geometry])
stream_filter_13 = StreamFilter(SoportesEntrepaño=rh_in_02_0_union_izquierda, Stream3=[move_20.Geometry, mirror_15.Geometry, mirror_16.Geometry])
stream_filter_14 = StreamFilter(Tarugos=rh_in_02_1_union_derecha, Stream1=mirror_17.Geometry)
stream_filter_15 = StreamFilter(Perno=rh_in_02_0_union_izquierda, Stream2=[move_19.Geometry, mirror_11.Geometry])
stream_filter_16 = StreamFilter(Perno=rh_in_02_1_union_derecha, Stream2=mirror_13.Geometry)
rh_out_soporte = Geometry(stream_filter_13)
rh_out_tarugo = Geometry([stream_filter_12, stream_filter_14])
rh_out_perno = Geometry([stream_filter_15, stream_filter_16])

# ----
stream_filter_17 = StreamFilter(Gate=rh_in_02_0_union_izquierda, Stream2=[mirror_12.Geometry, stream_filter_10])

# ---- group: Herrajes y Posiciones (continued)
rh_out_caja = Geometry([stream_filter_11, stream_filter_17])
