# Grasshopper definition sphere_from_params.gh (Grasshopper 1.0.8)

rh_in_origin = GetPoint(AtLeast=1, AtMost=1, Realtime=True, TreeAccess=False)
rh_in_radius = GetNumber(AtLeast=1, AtMost=1, Maximum=1.797693135e+308, Minimum=-1.797693135e+308, TreeAccess=False)
sphere = Sphere(Base=rh_in_origin, Radius=rh_in_radius)

# ---- group: RH_OUT:geometry
geometry = Geometry(sphere)
