# Grasshopper definition Cajon_Experimental_ShapeDriver_02.ghx (Grasshopper 1.0.8)

# ----
# FUNCIONALIDAD
altura_lateral_de_cajon = ValueList({"102", "138", "147", "200"}, selected="102")
cantidada_de_cajones = ValueList({"1", "2", "3"}, selected="3")
profundidad_cajon = ValueList({"351", "400"}, selected="351")
abrir_cajones = Slider(0, range=0..300)

# ----
# Cubiertas superior e inferior
ancho = Slider(600, range=300..1000)
profundidad = Slider(408, range=200..1000)
alto = Slider(900, range=300..1200)
domain_box = DomainBox(Base=PlaneXY(0, 0, 0), X=ancho, Y=profundidad, Z=alto)
deconstruct_brep = DeconstructBrep(Brep=domain_box)  # -> Faces, Edges, Vertices
list_item = ListItem(List=deconstruct_brep.Edges, Index="8", Wrap=True)
list_item_2 = ListItem(List=deconstruct_brep.Faces, Index="4", Wrap=True)
unit_z = UnitZ(Factor="15")
length = Length(Curve=list_item)
subtraction = Subtraction(A=length, B="15")
unit_z_2 = UnitZ(Factor=subtraction)
unit_z_3 = UnitZ(Factor="15")
unit_x = UnitX(Factor="15")

extrude = Extrude(Base=list_item_2, Direction=unit_z)
move = Move(Geometry=extrude, Motion=unit_z_2)  # -> Geometry, Transform

cubierta_superior = Geometry(move.Geometry)
cubierta_inferior = Geometry(extrude)
deconstruct_brep_2 = DeconstructBrep(Brep=move.Geometry)  # -> Faces, Edges, Vertices
deconstruct_brep_3 = DeconstructBrep(Brep=extrude)  # -> Faces, Edges, Vertices
list_item_3 = ListItem(List=deconstruct_brep_2.Edges, Index="3", Wrap=True)
list_item_4 = ListItem(List=deconstruct_brep_3.Edges, Index="3", Wrap=True)
list_item_5 = ListItem(List=deconstruct_brep_3.Edges, Index="2", Wrap=True)
length_2 = Length(Curve=list_item_5)
move_2 = Move(Geometry=list_item_4, Motion=unit_z_3)  # -> Geometry, Transform
subtraction_2 = Subtraction(A=length_2, B="15")

# ----
# Cubiertas laterales
loft = Loft(
    Curves=[list_item_3, move_2.Geometry],
    Options={Adjust=False, Closed=False, LoftEnds=0, LoftSimp=0, LoftType=0, Rebuild=10, Refit=0.01})
extrude_2 = Extrude(Base=loft, Direction=unit_x)
unit_x_2 = UnitX(Factor=subtraction_2)
move_3 = Move(Geometry=extrude_2, Motion=unit_x_2)  # -> Geometry, Transform
unit_x_3 = UnitX(Factor="2")
negative = Negative(Value=unit_x_3)

move_4 = Move(Geometry=move_3.Geometry, Motion=negative)  # -> Geometry, Transform
move_5 = Move(Geometry=extrude_2, Motion=unit_x_3)  # -> Geometry, Transform

deconstruct_brep_4 = DeconstructBrep(Brep=move_4.Geometry)  # -> Faces, Edges, Vertices
deconstruct_brep_5 = DeconstructBrep(Brep=move_5.Geometry)  # -> Faces, Edges, Vertices
lateral_izquierdo = Geometry(move_5.Geometry)
lateral_derecho = Geometry(move_4.Geometry)

# ----
# Box Interno
panel = Panel("5")
list_item_6 = ListItem(List=deconstruct_brep_5.Faces, Index=panel, Wrap=True)
list_item_7 = ListItem(List=deconstruct_brep_4.Faces, Index="0", Wrap=True)
loft_2 = Loft(
    Curves=[list_item_7, list_item_6],
    Options={Adjust=False, Closed=False, LoftEnds=0, LoftSimp=0, LoftType=0, Rebuild=10, Refit=0.01})
deconstruct_brep_6 = DeconstructBrep(Brep=loft_2)  # -> Faces, Edges, Vertices
list_item_8 = ListItem(List=deconstruct_brep_6.Faces, Index="5", Wrap=True)
deconstruct_brep_7 = DeconstructBrep(Brep=list_item_8)  # -> Faces, Edges, Vertices

# ----
# Calculador Cajones
point = Point(deconstruct_brep_7.Vertices)
list_item_9 = ListItem(List=point, Index="1", Wrap=True)
list_item_10 = ListItem(List=point, Index="4", Wrap=True)
list_item_11 = ListItem(List=deconstruct_brep_7.Edges, Index="9", Wrap=True)
length_3 = Length(Curve=list_item_11)
altura_tapaluz = Panel("66")
altura_tapaluz_2 = Panel("36")
unit_z_4 = UnitZ(Factor=altura_tapaluz)
unit_x_4 = UnitX(Factor="-15")
move_6 = Move(Geometry=list_item_9, Motion=unit_x_4)  # -> Geometry, Transform
negative_2 = Negative(Value=unit_z_4)
addition = Addition(A=length_3, B="15")
move_7 = Move(Geometry=list_item_9, Motion=negative_2)  # -> Geometry, Transform
unit_y = UnitY(Factor="30")
move_8 = Move(Geometry=move_7.Geometry, Motion=unit_y)  # -> Geometry, Transform
unit_y_2 = UnitY(Factor="15")
move_9 = Move(Geometry=list_item_10, Motion=unit_y_2)  # -> Geometry, Transform
unit_y_3 = UnitY(Factor="15")
negative_3 = Negative(Value=unit_y_3)
unit_x_5 = UnitX(Factor="-15")
negative_4 = Negative(Value=unit_x_5)
unit_z_5 = UnitZ(Factor=altura_tapaluz_2)
negative_5 = Negative(Value=unit_z_5)

# ---- group: TapaLuz
box_2pt = Box2Pt(PointA=move_8.Geometry, PointB=move_9.Geometry, Plane=PlaneXY(0, 0, 0))

# ----
# Distribuidor de cajones
panel_2 = Panel("1")
list_item_12 = ListItem(List=deconstruct_brep_5.Vertices, Index=panel_2, Wrap=True)
cantidad_de_cajones = Panel(cantidada_de_cajones)
abrir_cajones_2 = Panel(abrir_cajones)
unit_y_4 = UnitY(Factor=abrir_cajones_2)
brep = Brep(box_2pt)
negative_6 = Negative(Value=unit_y_4)

multiplication = Multiplication(A=altura_tapaluz_2, B=cantidad_de_cajones)
longitud = Panel(multiplication)
subtraction_3 = Subtraction(A=addition, B=longitud)
panel_3 = Panel(subtraction_3)
division = Division(A=panel_3, B=cantidad_de_cajones)
alto_cajon = Panel(division)
unit_z_6 = UnitZ(Factor=alto_cajon)
negative_7 = Negative(Value=unit_z_6)
move_10 = Move(Geometry=list_item_10, Motion=negative_7)  # -> Geometry, Transform
move_11 = Move(Geometry=move_10.Geometry, Motion=negative_3)  # -> Geometry, Transform
move_12 = Move(Geometry=move_11.Geometry, Motion=negative_4)  # -> Geometry, Transform
box_2pt_2 = Box2Pt(PointA=move_6.Geometry, PointB=move_12.Geometry, Plane=PlaneXY(0, 0, 0))

# ---- group: Frente de Cajon
move_13 = Move(Geometry=box_2pt_2, Motion=negative_5)  # -> Geometry, Transform

# ----
brep_2 = Brep(move_13.Geometry)

# ----
# Componentes posteriores del Cajon
# Punto Fondo
area = Area(Geometry=brep_2)  # -> Area, Centroid
deconstruct_brep_8 = DeconstructBrep(Brep=brep_2)  # -> Faces, Edges, Vertices
yz_plane = YZPlane(Origin=area.Centroid)
tipo_cajon = ValueList({"Corredera Tipo X": 40, "Corredera Estandar": 27.5}, selected="Corredera Estandar")
unit_x_6 = UnitX(Factor=tipo_cajon)
distancia_bajo_laterales = ValueList({"25", "30"}, selected="30")
unit_z_7 = UnitZ(Factor=distancia_bajo_laterales)
unit_x_7 = UnitX(Factor="15")
unit_y_5 = UnitY(Factor=profundidad_cajon)
unit_z_8 = UnitZ(Factor=altura_lateral_de_cajon)
unit_y_6 = UnitY(Factor="-15")
unit_z_9 = UnitZ(Factor="-2.7")
unit_y_7 = UnitY(Factor="-7")

# ---- group: Punto Medio
list_item_13 = ListItem(List=deconstruct_brep_8.Vertices, Index="3", Wrap=True)

# ----
line = Line(StartPoint=list_item_13, EndPoint=list_item_12)
length_4 = Length(Curve=line)
addition_2 = Addition(A=length_4, B="15")
division_2 = Division(A=addition_2, B="2")

# ----
# A 2 cajones
unit_z_10 = UnitZ(Factor=addition_2)
unit_z_11 = UnitZ(Factor=addition_2)
negative_8 = Negative(Value=unit_z_10)
negative_9 = Negative(Value=unit_z_11)
move_14 = Move(Geometry=brep, Motion=negative_8)  # -> Geometry, Transform
stream_filter = StreamFilter(Gate=cantidad_de_cajones, Stream2=move_14.Geometry)

# ----
# A 3 Cajones
unit_z_12 = UnitZ(Factor=division_2)
unit_z_13 = UnitZ(Factor=addition_2)
unit_z_14 = UnitZ(Factor=division_2)
unit_z_15 = UnitZ(Factor=addition_2)
negative_10 = Negative(Value=unit_z_12)
negative_11 = Negative(Value=unit_z_13)
negative_12 = Negative(Value=unit_z_14)
negative_13 = Negative(Value=unit_z_15)
move_15 = Move(Geometry=brep, Motion=negative_12)  # -> Geometry, Transform
move_16 = Move(Geometry=brep, Motion=negative_13)  # -> Geometry, Transform
stream_filter_2 = StreamFilter(Gate=cantidad_de_cajones, Stream3=[move_16.Geometry, move_15.Geometry])

move_17 = Move(Geometry=list_item_13, Motion=unit_x_6)  # -> Geometry, Transform
move_18 = Move(Geometry=move_17.Geometry, Motion=unit_z_7)  # -> Geometry, Transform
move_19 = Move(Geometry=move_18.Geometry, Motion=unit_x_7)  # -> Geometry, Transform
move_20 = Move(Geometry=move_19.Geometry, Motion=unit_y_5)  # -> Geometry, Transform
move_21 = Move(Geometry=move_20.Geometry, Motion=unit_z_8)  # -> Geometry, Transform
move_22 = Move(Geometry=move_18.Geometry, Motion=unit_y_7)  # -> Geometry, Transform

# ----
# Lateral I
# de Cajon
box_2pt_3 = Box2Pt(PointA=move_18.Geometry, PointB=move_21.Geometry, Plane=PlaneXY(0, 0, 0))

# ----
# Identificador piezas
tapa_luz = Geometry([stream_filter_2, brep, stream_filter])

brep_3 = Brep(box_2pt_3)

# ----
# Lateral D
# de Cajon
mirror = Mirror(Geometry=brep_3, Plane=yz_plane)  # -> Geometry, Transform

brep_4 = Brep(mirror.Geometry)
deconstruct_brep_9 = DeconstructBrep(Brep=mirror.Geometry)  # -> Faces, Edges, Vertices
list_item_14 = ListItem(List=deconstruct_brep_9.Vertices, Index="7", Wrap=True)
list_item_15 = ListItem(List=deconstruct_brep_9.Vertices, Index="2", Wrap=True)
move_23 = Move(Geometry=list_item_14, Motion=unit_z_9)  # -> Geometry, Transform
move_24 = Move(Geometry=list_item_15, Motion=unit_y_6)  # -> Geometry, Transform
lateral_der_cajon = Geometry(brep_4)

# ----
# Posterior
# de Cajon
box_2pt_4 = Box2Pt(PointA=move_21.Geometry, PointB=move_24.Geometry, Plane=PlaneXY(0, 0, 0))

# ----
# Fondo
box_2pt_5 = Box2Pt(PointA=move_22.Geometry, PointB=move_23.Geometry, Plane=PlaneXY(0, 0, 0))

brep_5 = Brep(box_2pt_4)

move_25 = Move(Geometry=[box_2pt_5, brep_5, brep_4, brep_3, brep_2], Motion=negative_6)  # -> Geometry, Transform

stream_filter_3 = StreamFilter(Gate=cantidad_de_cajones, Stream3=move_25.Geometry)
move_26 = Move(Geometry=stream_filter_3, Motion=negative_10)  # -> Geometry, Transform
move_27 = Move(Geometry=stream_filter_3, Motion=negative_11)  # -> Geometry, Transform

stream_filter_4 = StreamFilter(Gate=cantidad_de_cajones, Stream2=move_25.Geometry)
move_28 = Move(Geometry=stream_filter_4, Motion=negative_9)  # -> Geometry, Transform

explode_tree = ExplodeTree(Data=[move_26.Geometry, move_27.Geometry, move_28.Geometry])  # -> _000000, _0000000, _00000000, Branch3, Branch4
explode_tree_2 = ExplodeTree(Data=explode_tree._0000000)  # -> _0000000, Branch1, Branch2, Branch3, Branch4
dispatch = Dispatch(List=explode_tree_2._0000000, DispatchPattern=[True, False])  # -> ListA, ListB
brep_6 = Brep(explode_tree._00000000)
dispatch_2 = Dispatch(List=brep_6, DispatchPattern=[True, False])  # -> ListA, ListB
brep_7 = Brep(explode_tree._000000)
brep_8 = Brep(dispatch.ListA)
brep_9 = Brep(dispatch.ListB)
brep_10 = Brep(dispatch_2.ListB)
frente_de_cajon = Geometry([brep_7, brep_2])
posterior_de_cajon = Geometry([brep_5, brep_10])

lateral_izq_cajon = Geometry([brep_9, brep_3])

brep_11 = Brep(flatten([lateral_izq_cajon, lateral_der_cajon, posterior_de_cajon, frente_de_cajon, lateral_izquierdo, lateral_derecho, cubierta_inferior, cubierta_superior, tapa_luz]))
custom_preview = CustomPreview(Geometry=brep_11, Material=ColourSwatch(SwatchColor=RGBA(26, 131, 186, 170)))

deconstruct_brep_10 = DeconstructBrep(Brep=[frente_de_cajon, posterior_de_cajon, tapa_luz])  # -> Faces, Edges, Vertices
list_item_16 = ListItem(List=deconstruct_brep_10.Edges, Index=["8", "2"], Wrap=True)
length_5 = Length(Curve=list_item_16)
dispatch_3 = Dispatch(List=length_5, DispatchPattern=[True, False])  # -> flatten(ListA), flatten(ListB)
largo = Panel(dispatch_3.ListA)
ancho_2 = Panel(dispatch_3.ListB)

deconstruct_brep_11 = DeconstructBrep(Brep=[lateral_izq_cajon, lateral_der_cajon])  # -> Faces, Edges, Vertices
list_item_17 = ListItem(List=deconstruct_brep_11.Edges, Index=["8", "1"], Wrap=True)
length_6 = Length(Curve=list_item_17)
dispatch_4 = Dispatch(List=length_6, DispatchPattern=[True, False])  # -> flatten(ListA), flatten(ListB)

clean_tree = CleanTree(RemoveNulls=True, RemoveInvalid=True, RemoveEmpty=False, Tree=dispatch_4.ListA)
clean_tree_2 = CleanTree(RemoveNulls=True, RemoveInvalid=True, RemoveEmpty=False, Tree=dispatch_4.ListB)

largo_2 = Panel(clean_tree)
ancho_3 = Panel(clean_tree_2)
