# Grasshopper definition Cajon_Experimento_Viktor_AllTagged.ghx (Grasshopper 1.0.8)

# ----
# FUNCIONALIDAD
rh_in_altura_lateral_de_cajon = ValueList({"102", "138", "147", "200"}, selected="102")
rh_in_cantidada_de_cajones = ValueList({"1", "2", "3"}, selected="3")
rh_in_profundidad_cajon = ValueList({"351", "400"}, selected="351")
rh_in_abrir_cajones = Slider(0, range=0..300)

# ----
# Cubiertas superior e inferior
rh_in_profundidad = Slider(408, range=200..1000)
rh_in_ancho = Slider(600, range=300..1000)
rh_in_alto = Slider(900, range=300..1200)
domain_box = DomainBox(Base=PlaneXY(0, 0, 0), X=rh_in_ancho, Y=rh_in_profundidad, Z=rh_in_alto)
deconstruct_brep = DeconstructBrep(RH_OUTBrep=domain_box)  # -> Faces, Edges, Vertices
list_item = ListItem(List=deconstruct_brep.Edges, Index="8", Wrap=True)
list_item_2 = ListItem(List=deconstruct_brep.Faces, Index="4", Wrap=True)
unit_z = UnitZ(Factor="15")
length = Length(Curve=list_item)
subtraction = Subtraction(A=length, B="15")
unit_z_2 = UnitZ(Factor=subtraction)
unit_z_3 = UnitZ(Factor="15")
unit_x = UnitX(Factor="15")

extrude = Extrude(Base=list_item_2, Direction=unit_z)
move = Move(RH_OUTGeometry=extrude, Motion=unit_z_2)  # -> RH_OUTGeometry, RH_OUTTransform

rh_out_cubierta_superior = Geometry(move.RH_OUTGeometry)
rh_out_cubierta_inferior = Geometry(extrude)
deconstruct_brep_2 = DeconstructBrep(RH_OUTBrep=move.RH_OUTGeometry)  # -> Faces, Edges, Vertices
deconstruct_brep_3 = DeconstructBrep(RH_OUTBrep=extrude)  # -> Faces, Edges, Vertices
list_item_3 = ListItem(List=deconstruct_brep_2.Edges, Index="3", Wrap=True)
list_item_4 = ListItem(List=deconstruct_brep_3.Edges, Index="3", Wrap=True)
list_item_5 = ListItem(List=deconstruct_brep_3.Edges, Index="2", Wrap=True)
length_2 = Length(Curve=list_item_5)
move_2 = Move(RH_OUTGeometry=list_item_4, Motion=unit_z_3)  # -> RH_OUTGeometry, RH_OUTTransform
subtraction_2 = Subtraction(A=length_2, B="15")

# ----
# Cubiertas laterales
loft = Loft(
    Curves=[list_item_3, move_2.RH_OUTGeometry],
    Options={Adjust=False, Closed=False, LoftEnds=0, LoftSimp=0, LoftType=0, Rebuild=10, Refit=0.01})
extrude_2 = Extrude(Base=loft, Direction=unit_x)
unit_x_2 = UnitX(Factor=subtraction_2)
move_3 = Move(RH_OUTGeometry=extrude_2, Motion=unit_x_2)  # -> RH_OUTGeometry, RH_OUTTransform
unit_x_3 = UnitX(Factor="2")
negative = Negative(Value=unit_x_3)

move_4 = Move(RH_OUTGeometry=move_3.RH_OUTGeometry, Motion=negative)  # -> RH_OUTGeometry, RH_OUTTransform
move_5 = Move(RH_OUTGeometry=extrude_2, Motion=unit_x_3)  # -> RH_OUTGeometry, RH_OUTTransform

deconstruct_brep_4 = DeconstructBrep(RH_OUTBrep=move_4.RH_OUTGeometry)  # -> Faces, Edges, Vertices
deconstruct_brep_5 = DeconstructBrep(RH_OUTBrep=move_5.RH_OUTGeometry)  # -> Faces, Edges, Vertices
rh_out_lateral_izquierdo = Geometry(move_5.RH_OUTGeometry)
rh_out_lateral_derecho = Geometry(move_4.RH_OUTGeometry)

# ----
# Box Interno
panel = Panel("5")
list_item_6 = ListItem(List=deconstruct_brep_5.Faces, Index=panel, Wrap=True)
list_item_7 = ListItem(List=deconstruct_brep_4.Faces, Index="0", Wrap=True)
loft_2 = Loft(
    Curves=[list_item_7, list_item_6],
    Options={Adjust=False, Closed=False, LoftEnds=0, LoftSimp=0, LoftType=0, Rebuild=10, Refit=0.01})
deconstruct_brep_6 = DeconstructBrep(RH_OUTBrep=loft_2)  # -> Faces, Edges, Vertices
list_item_8 = ListItem(List=deconstruct_brep_6.Faces, Index="5", Wrap=True)
deconstruct_brep_7 = DeconstructBrep(RH_OUTBrep=list_item_8)  # -> Faces, Edges, Vertices

# ----
# Calculador Cajones
point = Point(deconstruct_brep_7.Vertices)
list_item_9 = ListItem(List=point, Index="1", Wrap=True)
list_item_10 = ListItem(List=point, Index="4", Wrap=True)
list_item_11 = ListItem(List=deconstruct_brep_7.Edges, Index="9", Wrap=True)
length_3 = Length(Curve=list_item_11)
rh_out_tapa_luz = Panel("66")
rh_out_tapa_luz_2 = Panel("36")
unit_z_4 = UnitZ(Factor=rh_out_tapa_luz)
unit_x_4 = UnitX(Factor="-15")
move_6 = Move(RH_OUTGeometry=list_item_9, Motion=unit_x_4)  # -> RH_OUTGeometry, RH_OUTTransform
negative_2 = Negative(Value=unit_z_4)
addition = Addition(A=length_3, B="15")
move_7 = Move(RH_OUTGeometry=list_item_9, Motion=negative_2)  # -> RH_OUTGeometry, RH_OUTTransform
unit_y = UnitY(Factor="30")
move_8 = Move(RH_OUTGeometry=move_7.RH_OUTGeometry, Motion=unit_y)  # -> RH_OUTGeometry, RH_OUTTransform
unit_y_2 = UnitY(Factor="15")
move_9 = Move(RH_OUTGeometry=list_item_10, Motion=unit_y_2)  # -> RH_OUTGeometry, RH_OUTTransform
unit_y_3 = UnitY(Factor="15")
negative_3 = Negative(Value=unit_y_3)
unit_x_5 = UnitX(Factor="-15")
negative_4 = Negative(Value=unit_x_5)
unit_z_5 = UnitZ(Factor=rh_out_tapa_luz_2)
negative_5 = Negative(Value=unit_z_5)

# ---- group: RH_OUT:Tapa Luz
box_2pt = Box2Pt(PointA=move_8.RH_OUTGeometry, PointB=move_9.RH_OUTGeometry, Plane=PlaneXY(0, 0, 0))

# ----
# Distribuidor de cajones
panel_2 = Panel("1")
list_item_12 = ListItem(List=deconstruct_brep_5.Vertices, Index=panel_2, Wrap=True)
cantidad_de_cajones = Panel(rh_in_cantidada_de_cajones)
abrir_cajones = Panel(rh_in_abrir_cajones)
unit_y_4 = UnitY(Factor=abrir_cajones)
rh_out_brep = Brep(box_2pt)
negative_6 = Negative(Value=unit_y_4)

multiplication = Multiplication(A=rh_out_tapa_luz_2, B=cantidad_de_cajones)
longitud = Panel(multiplication)
subtraction_3 = Subtraction(A=addition, B=longitud)
panel_3 = Panel(subtraction_3)
division = Division(A=panel_3, B=cantidad_de_cajones)
alto_cajon = Panel(division)
unit_z_6 = UnitZ(Factor=alto_cajon)
negative_7 = Negative(Value=unit_z_6)
move_10 = Move(RH_OUTGeometry=list_item_10, Motion=negative_7)  # -> RH_OUTGeometry, RH_OUTTransform
move_11 = Move(RH_OUTGeometry=move_10.RH_OUTGeometry, Motion=negative_3)  # -> RH_OUTGeometry, RH_OUTTransform
move_12 = Move(RH_OUTGeometry=move_11.RH_OUTGeometry, Motion=negative_4)  # -> RH_OUTGeometry, RH_OUTTransform
box_2pt_2 = Box2Pt(PointA=move_6.RH_OUTGeometry, PointB=move_12.RH_OUTGeometry, Plane=PlaneXY(0, 0, 0))

# ---- group: RH_OUT:Frente de Cajon
move_13 = Move(RH_OUTGeometry=box_2pt_2, Motion=negative_5)  # -> RH_OUTGeometry, RH_OUTTransform

# ----
rh_out_brep_2 = Brep(move_13.RH_OUTGeometry)

# ----
# Componentes posteriores del Cajon
# Punto Fondo
area = Area(RH_OUTGeometry=rh_out_brep_2)  # -> Area, Centroid
deconstruct_brep_8 = DeconstructBrep(RH_OUTBrep=rh_out_brep_2)  # -> Faces, Edges, Vertices
yz_plane = YZPlane(Origin=area.Centroid)
tipo_cajon = ValueList({"Corredera Tipo X": 40, "Corredera Estandar": 27.5}, selected="Corredera Estandar")
unit_x_6 = UnitX(Factor=tipo_cajon)
distancia_bajo_laterales = ValueList({"25", "30"}, selected="30")
unit_z_7 = UnitZ(Factor=distancia_bajo_laterales)
unit_x_7 = UnitX(Factor="15")
unit_y_5 = UnitY(Factor=rh_in_profundidad_cajon)
unit_z_8 = UnitZ(Factor=rh_in_altura_lateral_de_cajon)
unit_y_6 = UnitY(Factor="-15")
unit_z_9 = UnitZ(Factor="-2.7")
unit_y_7 = UnitY(Factor="-7")

# ---- group: RH_OUT:Punto Medio
list_item_13 = ListItem(List=deconstruct_brep_8.Vertices, Index="3", Wrap=True)

# ----
line = Line(StartPoint=list_item_13, EndPoint=list_item_12)
length_4 = Length(Curve=line)
addition_2 = Addition(A=length_4, B="15")
division_2 = Division(A=addition_2, B="2")

# ----
# A 2 cajones
unit_z_10 = UnitZ(Factor=addition_2)
unit_z_11 = UnitZ(Factor=addition_2)
negative_8 = Negative(Value=unit_z_10)
negative_9 = Negative(Value=unit_z_11)
move_14 = Move(RH_OUTGeometry=rh_out_brep, Motion=negative_8)  # -> RH_OUTTapaLuz, RH_OUTTransform
stream_filter = StreamFilter(Gate=cantidad_de_cajones, Stream2=move_14.RH_OUTTapaLuz)

# ----
# A 3 Cajones
unit_z_12 = UnitZ(Factor=division_2)
unit_z_13 = UnitZ(Factor=addition_2)
unit_z_14 = UnitZ(Factor=division_2)
unit_z_15 = UnitZ(Factor=addition_2)
negative_10 = Negative(Value=unit_z_12)
negative_11 = Negative(Value=unit_z_13)
negative_12 = Negative(Value=unit_z_14)
negative_13 = Negative(Value=unit_z_15)
move_15 = Move(RH_OUTGeometry=rh_out_brep, Motion=negative_12)  # -> RH_OUTTapaLuz, RH_OUTTransform
move_16 = Move(RH_OUTGeometry=rh_out_brep, Motion=negative_13)  # -> RH_OUTGeometry, RH_OUTTransform
stream_filter_2 = StreamFilter(Gate=cantidad_de_cajones, Stream3=[move_16.RH_OUTGeometry, move_15.RH_OUTTapaLuz])

move_17 = Move(RH_OUTGeometry=list_item_13, Motion=unit_x_6)  # -> RH_OUTGeometry, RH_OUTTransform
move_18 = Move(RH_OUTGeometry=move_17.RH_OUTGeometry, Motion=unit_z_7)  # -> RH_OUTGeometry, RH_OUTTransform
move_19 = Move(RH_OUTGeometry=move_18.RH_OUTGeometry, Motion=unit_x_7)  # -> RH_OUTGeometry, RH_OUTTransform
move_20 = Move(RH_OUTGeometry=move_19.RH_OUTGeometry, Motion=unit_y_5)  # -> RH_OUTGeometry, RH_OUTTransform
move_21 = Move(RH_OUTGeometry=move_20.RH_OUTGeometry, Motion=unit_z_8)  # -> RH_OUTGeometry, RH_OUTTransform
move_22 = Move(RH_OUTGeometry=move_18.RH_OUTGeometry, Motion=unit_y_7)  # -> RH_OUTGeometry, RH_OUTTransform

# ----
# Lateral I
# de Cajon
box_2pt_3 = Box2Pt(PointA=move_18.RH_OUTGeometry, PointB=move_21.RH_OUTGeometry, Plane=PlaneXY(0, 0, 0))

# ----
# Identificador piezas
rh_out_tapa_luz_3 = Geometry([stream_filter_2, rh_out_brep, stream_filter])

rh_out_brep_3 = Brep(box_2pt_3)

# ----
# Lateral D
# de Cajon
mirror = Mirror(RH_OUTGeometry=rh_out_brep_3, Plane=yz_plane)  # -> RH_OUTGeometry, RH_OUTTransform

rh_out_brep_4 = Brep(mirror.RH_OUTGeometry)
deconstruct_brep_9 = DeconstructBrep(RH_OUTBrep=mirror.RH_OUTGeometry)  # -> Faces, Edges, Vertices
list_item_14 = ListItem(List=deconstruct_brep_9.Vertices, Index="7", Wrap=True)
list_item_15 = ListItem(List=deconstruct_brep_9.Vertices, Index="2", Wrap=True)
move_23 = Move(RH_OUTGeometry=list_item_14, Motion=unit_z_9)  # -> RH_OUTGeometry, RH_OUTTransform
move_24 = Move(RH_OUTGeometry=list_item_15, Motion=unit_y_6)  # -> RH_OUTGeometry, RH_OUTTransform
rh_out_lateral_der_cajon = Geometry(rh_out_brep_4)

# ----
# Posterior
# de Cajon
box_2pt_4 = Box2Pt(PointA=move_21.RH_OUTGeometry, PointB=move_24.RH_OUTGeometry, Plane=PlaneXY(0, 0, 0))

# ----
# Fondo
box_2pt_5 = Box2Pt(PointA=move_22.RH_OUTGeometry, PointB=move_23.RH_OUTGeometry, Plane=PlaneXY(0, 0, 0))

rh_out_brep_5 = Brep(box_2pt_4)

move_25 = Move(RH_OUTGeometry=[box_2pt_5, rh_out_brep_5, rh_out_brep_4, rh_out_brep_3, rh_out_brep_2], Motion=negative_6)  # -> RH_OUTGeometry, RH_OUTTransform

stream_filter_3 = StreamFilter(Gate=cantidad_de_cajones, Stream3=move_25.RH_OUTGeometry)
move_26 = Move(RH_OUTGeometry=stream_filter_3, Motion=negative_10)  # -> RH_OUTGeometry, RH_OUTTransform
move_27 = Move(RH_OUTGeometry=stream_filter_3, Motion=negative_11)  # -> RH_OUTGeometry, RH_OUTTransform

stream_filter_4 = StreamFilter(Gate=cantidad_de_cajones, Stream2=move_25.RH_OUTGeometry)
move_28 = Move(RH_OUTGeometry=stream_filter_4, Motion=negative_9)  # -> RH_OUTGeometry, RH_OUTTransform

explode_tree = ExplodeTree(Data=[move_26.RH_OUTGeometry, move_27.RH_OUTGeometry, move_28.RH_OUTGeometry])  # -> _000000, _0000000, _00000000, Branch3, Branch4
explode_tree_2 = ExplodeTree(Data=explode_tree._0000000)  # -> _0000000, Branch1, Branch2, Branch3, Branch4
dispatch = Dispatch(List=explode_tree_2._0000000, DispatchPattern=[True, False])  # -> ListA, ListB
rh_out_brep_6 = Brep(explode_tree._00000000)
dispatch_2 = Dispatch(List=rh_out_brep_6, DispatchPattern=[True, False])  # -> ListA, ListB
rh_out_brep_7 = Brep(explode_tree._000000)
rh_out_brep_8 = Brep(dispatch.ListA)
rh_out_brep_9 = Brep(dispatch.ListB)
rh_out_brep_10 = Brep(dispatch_2.ListB)
rh_out_frente_de_cajon = Geometry([rh_out_brep_7, rh_out_brep_2])
rh_out_posterior_de_cajon = Geometry([rh_out_brep_5, rh_out_brep_10])

rh_out_lateral_izq_cajon = Geometry([rh_out_brep_9, rh_out_brep_3])

rh_out_brep_11 = Brep(flatten([rh_out_lateral_izq_cajon, rh_out_lateral_der_cajon, rh_out_posterior_de_cajon, rh_out_frente_de_cajon, rh_out_lateral_izquierdo, rh_out_lateral_derecho, rh_out_cubierta_inferior, rh_out_cubierta_superior, rh_out_tapa_luz_3]))
custom_preview = CustomPreview(RH_OUTGeometry=rh_out_brep_11, Material=ColourSwatch(SwatchColor=RGBA(26, 131, 186, 170)))

deconstruct_brep_10 = DeconstructBrep(RH_OUTBrep=[rh_out_frente_de_cajon, rh_out_posterior_de_cajon, rh_out_tapa_luz_3])  # -> Faces, Edges, Vertices
list_item_16 = ListItem(List=deconstruct_brep_10.Edges, Index=["8", "2"], Wrap=True)
length_5 = Length(Curve=list_item_16)
dispatch_3 = Dispatch(List=length_5, DispatchPattern=[True, False])  # -> flatten(ListA), flatten(ListB)
largo = Panel(dispatch_3.ListA)
ancho = Panel(dispatch_3.ListB)

deconstruct_brep_11 = DeconstructBrep(RH_OUTBrep=[rh_out_lateral_izq_cajon, rh_out_lateral_der_cajon])  # -> Faces, Edges, Vertices
list_item_17 = ListItem(List=deconstruct_brep_11.Edges, Index=["8", "1"], Wrap=True)
length_6 = Length(Curve=list_item_17)
dispatch_4 = Dispatch(List=length_6, DispatchPattern=[True, False])  # -> flatten(ListA), flatten(ListB)

clean_tree = CleanTree(RemoveNulls=True, RemoveInvalid=True, RemoveEmpty=False, Tree=dispatch_4.ListA)
clean_tree_2 = CleanTree(RemoveNulls=True, RemoveInvalid=True, RemoveEmpty=False, Tree=dispatch_4.ListB)

largo_2 = Panel(clean_tree)
ancho_2 = Panel(clean_tree_2)
