# Grasshopper definition Cajon.gh (Grasshopper 1.0.8)
# plug-ins: Pufferfish, TbGh21, Human

rh_in_07_altura_ranura_frente = Slider(15, range=5..80)
# Frente de Cajon
rh_in_01_ancho_frente = Slider(500, range=150..800)
rh_in_02_alto_frente = Slider(200, range=102..600)
# 1
domain_box = DomainBox(Base=PlaneXY(0, 0, 0), X=rh_in_01_ancho_frente, Y="15", Z=rh_in_02_alto_frente)
deconstruct_brep = DeconstructBrep(Brep=domain_box)  # -> Faces, Edges, Vertices
unit_z = UnitZ(Factor=rh_in_07_altura_ranura_frente)
list_item = ListItem(List=deconstruct_brep.Vertices, Index="3", Wrap=True)
list_item_2 = ListItem(List=deconstruct_brep.Vertices, Index="4", Wrap=True)
list_item_3 = ListItem(List=deconstruct_brep.Vertices, Index="5", Wrap=True)

deconstruct_brep_2 = DeconstructBrep(Brep=domain_box)  # -> Faces, Edges, Vertices
list_item_4 = ListItem(List=deconstruct_brep_2.Edges, Index="4", Wrap=True)
list_item_5 = ListItem(List=deconstruct_brep_2.Edges, Index="9", Wrap=True)
list_item_6 = ListItem(List=deconstruct_brep_2.Edges, Index="6", Wrap=True)
list_item_7 = ListItem(List=deconstruct_brep_2.Edges, Index="10", Wrap=True)
list_item_8 = ListItem(List=deconstruct_brep_2.Edges, Index="8", Wrap=True)
list_item_9 = ListItem(List=deconstruct_brep_2.Edges, Index="11", Wrap=True)
list_item_10 = ListItem(List=deconstruct_brep_2.Edges, Index="0", Wrap=True)
list_item_11 = ListItem(List=deconstruct_brep_2.Edges, Index="2", Wrap=True)
length = Length(Curve=[list_item_4, list_item_5, list_item_8, list_item_10])
panel = Panel(length)
set_value = SetValue(Object=[list_item_4, list_item_6], PropertyOrParameter=graft("name"), Value=graft("adelante"))
set_value_2 = SetValue(Object=[list_item_5, list_item_7], PropertyOrParameter=graft("name"), Value=graft("derecha"))
set_value_3 = SetValue(Object=[list_item_8, list_item_9], PropertyOrParameter=graft("name"), Value=graft("izquierda"))
set_value_4 = SetValue(Object=[list_item_10, list_item_11], PropertyOrParameter=graft("name"), Value=graft("atras"))
list_length = ListLength(List=panel)
lados_canteados = Panel(list_length)
desperdicio_mm = Panel("100")
canto_adelante_frente_de_cajon = Geometry(set_value)
canto_izquierdo_frente_de_cajon = Geometry(set_value_3)
canto_atras_frente_de_cajon = Geometry(set_value_4)
canto_derecha_frente_de_cajon = Geometry(set_value_2)
multiplication = Multiplication(A=lados_canteados, B=desperdicio_mm)
panel_2 = Panel(multiplication)
mass_addition = MassAddition(Input=[length, panel_2])  # -> Result, PartialResults
total_mm_cantos_pieza = Panel(mass_addition.Result)

line = Line(StartPoint=list_item_2, EndPoint=list_item_3)
move = Move(Geometry=list_item, Motion=unit_z)  # -> Geometry, Transform
curve_middle = CurveMiddle(Curve=line)
domain_box_2 = DomainBox(Base=move.Geometry, X=rh_in_01_ancho_frente, Y="-8", Z="4")
# 1
solid_difference = SolidDifference(BrepsA=domain_box, BrepsB=domain_box_2)

area = Area(Geometry=domain_box)  # -> Area, Centroid
text_style = TextStyle(Font="arial", Height="50")
create_text = CreateText(Location=area.Centroid, Text="1", Style=text_style, TextAlignment=6)
texto = Geometry(create_text)

unit_y = UnitY(Factor="-7.5")
move_2 = Move(Geometry=area.Centroid, Motion=unit_y)  # -> Geometry, Transform
xz_plane = XZPlane(Origin=move_2.Geometry)
yz_plane = YZPlane(Origin=move_2.Geometry)
xz_plane_2 = XZPlane(Origin=move_2.Geometry)
yz_plane_2 = YZPlane(Origin=move_2.Geometry)
cylinder = Cylinder(Base=xz_plane, Radius="2.5", Length="-15")
unit_x = UnitX(Factor="80")
cylinder_2 = Cylinder(Base=xz_plane_2, Radius="2.5", Length="-15")
unit_x_2 = UnitX(Factor="64")
move_3 = Move(Geometry=cylinder, Motion=unit_x)  # -> Geometry, Transform
move_4 = Move(Geometry=cylinder_2, Motion=unit_x_2)  # -> Geometry, Transform
rh_in_08_largo_lateral_de_cajon = ValueList({"300", "351", "400"}, selected="300")
mirror = Mirror(Geometry=move_3.Geometry, Plane=yz_plane)  # -> Geometry, Transform
mirror_2 = Mirror(Geometry=move_4.Geometry, Plane=yz_plane_2)  # -> Geometry, Transform
solid_union = SolidUnion(Breps=[move_3.Geometry, mirror.Geometry])
solid_union_2 = SolidUnion(Breps=[move_4.Geometry, mirror_2.Geometry])
oprimir_f5_si_se_pone_rojo = Expression(x=rh_in_08_largo_lateral_de_cajon, Expression="if (x=300, 0, if (x=351, 0,if (x=400, 1,\"z\")))")

rh_in_09_alto_lateral_de_cajon_300_351 = ValueList({"116", "123", "130", "138", "147", "157", "168", "182", "197"}, selected="138")
rh_in_10_alto_lateral_de_cajon_400 = ValueList({"102", "108", "114", "121", "129", "138", "147", "160", "173", "189", "209"}, selected="138")

stream_filter = StreamFilter(
    Gate=oprimir_f5_si_se_pone_rojo,
    Stream0=rh_in_09_alto_lateral_de_cajon_300_351,
    Stream1=rh_in_10_alto_lateral_de_cajon_400)
deconstruct_brep_3 = DeconstructBrep(Brep=solid_difference)  # -> Faces, Edges, Vertices

_04_recedido_izquierdo = ValueList({"0", "1", "2", "3", "4", "5"}, selected="0")
_03_lado_izquierdo = ValueList({"Parche": 27.5, "Semiparche": 18.5, "Interno": 9.5}, selected="Semiparche")

rh_in_11_paso_de_barrenos = ValueList({"16", "32", "64"}, selected="32")
unit_z_2 = UnitZ(Factor=rh_in_11_paso_de_barrenos)

_06_recedido_derecho = ValueList({"0", "1", "2", "3", "4", "5"}, selected="0")
_05_lado_derecho = ValueList({"Parche": 42.5, "Semiparche": 33.5, "Interno": 24.5}, selected="Semiparche")

list_item_12 = ListItem(List=deconstruct_brep_3.Vertices, Index="13", Wrap=True)
list_item_13 = ListItem(List=deconstruct_brep_3.Vertices, Index="11", Wrap=True)
oprimir_f5_si_se_pone_rojo_2 = Expression(x=_03_lado_izquierdo, Expression="if (x=27.5, 0,if (x=18.5, 1,if (x=9.5, 2,\"z\")))")
panel_3 = Panel("18.5")
oprimir_f5_si_se_pone_rojo_3 = Expression(x=_05_lado_derecho, Expression="if (x=42.5, 0,if (x=33.5, 1,if (x=24.5, 2,\"z\")))")
unit_y_2 = UnitY(Factor="-15")
negative = Negative(Value=_05_lado_derecho)
panel_4 = Panel(oprimir_f5_si_se_pone_rojo_2)
panel_5 = Panel(oprimir_f5_si_se_pone_rojo_3)
unit_y_3 = UnitY(Factor="-10")
stream_filter_2 = StreamFilter(Gate=panel_4, Stream0=_04_recedido_izquierdo)
addition = Addition(A=_03_lado_izquierdo, B=stream_filter_2)
unit_x_3 = UnitX(Factor=addition)
unit_y_4 = UnitY(Factor="-8")
stream_filter_3 = StreamFilter(Gate=panel_5, Stream0=_06_recedido_derecho)
subtraction = Subtraction(A=negative, B=stream_filter_3)
unit_x_4 = UnitX(Factor=subtraction)
move_5 = Move(Geometry=list_item_12, Motion=unit_x_3)  # -> Geometry, Transform
# 2
domain_box_3 = DomainBox(Base=move_5.Geometry, X="15", Y=rh_in_08_largo_lateral_de_cajon, Z=stream_filter)

area_2 = Area(Geometry=domain_box_3)  # -> Area, Centroid
text_style_2 = TextStyle(Font="arial", Height="50")
create_text_2 = CreateText(Location=area_2.Centroid, Text="2", Style=text_style_2, TextAlignment=6)
text = Text(create_text_2)
texto_2 = Geometry(text)

deconstruct_brep_4 = DeconstructBrep(Brep=domain_box_3)  # -> Faces, Edges, Vertices
deconstruct_brep_5 = DeconstructBrep(Brep=domain_box_3)  # -> Faces, Edges, Vertices
deconstruct_brep_6 = DeconstructBrep(Brep=domain_box_3)  # -> Faces, Edges, Vertices
deconstruct_brep_7 = DeconstructBrep(Brep=domain_box_3)  # -> Faces, Edges, Vertices
list_item_14 = ListItem(List=deconstruct_brep_6.Vertices, Index="3", Wrap=True)
list_item_15 = ListItem(List=deconstruct_brep_5.Faces, Index="2", Wrap=True)
list_item_16 = ListItem(List=deconstruct_brep_4.Faces, Index="0", Wrap=True)
list_item_17 = ListItem(List=deconstruct_brep_7.Vertices, Index="10", Wrap=True)
distance = Distance(PointA=move_5.Geometry, PointB=list_item_14)
area_3 = Area(Geometry=list_item_16)  # -> Area, Centroid
move_6 = Move(Geometry=list_item_17, Motion=unit_y_2)  # -> Geometry, Transform
area_4 = Area(Geometry=list_item_15)  # -> Area, Centroid
addition_2 = Addition(A=distance, B="7")
move_7 = Move(Geometry=area_3.Centroid, Motion=unit_z_2)  # -> Geometry, Transform
move_8 = Move(Geometry=area_4.Centroid, Motion=unit_z_2)  # -> Geometry, Transform
move_9 = Move(Geometry=move_7.Geometry, Motion=unit_y_3)  # -> Geometry, Transform
xz_plane_3 = XZPlane(Origin=move_9.Geometry)
cylinder_3 = Cylinder(Base=xz_plane_3, Radius="2.5", Length="-10")
move_10 = Move(Geometry=list_item_13, Motion=unit_x_4)  # -> Geometry, Transform
move_11 = Move(Geometry=move_8.Geometry, Motion=unit_y_4)  # -> Geometry, Transform
cap_holes = CapHoles(Brep=cylinder_3)
xy_plane = XYPlane(Origin=area_3.Centroid)
panel_6 = Panel(stream_filter_3)
unit_x_5 = UnitX(Factor="7.5")
xz_plane_4 = XZPlane(Origin=move_7.Geometry)
move_12 = Move(Geometry=move_11.Geometry, Motion=unit_x_5)  # -> Geometry, Transform
cylinder_4 = Cylinder(Base=xz_plane_4, Radius="3.5", Length="-22")
mirror_3 = Mirror(Geometry=move_7.Geometry, Plane=xy_plane)  # -> Geometry, Transform
xz_plane_5 = XZPlane(Origin=mirror_3.Geometry)
yz_plane_3 = YZPlane(Origin=move_12.Geometry)
cylinder_5 = Cylinder(Base=xz_plane_5, Radius="4", Length="-22")
yz_plane_4 = YZPlane(Origin=move_12.Geometry)
cylinder_6 = Cylinder(Base=yz_plane_3, Radius="3", Length="-15")
cap_holes_2 = CapHoles(Brep=cylinder_4)
xy_plane_2 = XYPlane(Origin=area_4.Centroid)
deconstruct_brep_8 = DeconstructBrep(Brep=cylinder_6)  # -> Faces, Edges, Vertices
cylinder_7 = Cylinder(Base=yz_plane_4, Radius="1.5", Length="10")
unit_y_5 = UnitY(Factor="-7")
cap_holes_3 = CapHoles(Brep=cylinder_5)
deconstruct_brep_9 = DeconstructBrep(Brep=cylinder_5)  # -> Faces, Edges, Vertices
unit_y_6 = UnitY(Factor="10")
list_item_18 = ListItem(List=deconstruct_brep_8.Edges, Index="0", Wrap=True)
cap_holes_4 = CapHoles(Brep=cylinder_7)
move_13 = Move(Geometry=move_5.Geometry, Motion=unit_y_5)  # -> Geometry, Transform
mirror_4 = Mirror(Geometry=cylinder_6, Plane=xy_plane_2)  # -> Geometry, Transform
deconstruct_brep_10 = DeconstructBrep(Brep=cap_holes_2)  # -> Faces, Edges, Vertices
list_item_19 = ListItem(List=deconstruct_brep_9.Edges, Index="2", Wrap=True)
mirror_5 = Mirror(Geometry=cap_holes_4, Plane=area_4.Centroid)  # -> Geometry, Transform
negative_2 = Negative(Value=unit_y_6)
list_item_20 = ListItem(List=deconstruct_brep_10.Faces, Index="4", Wrap=True)
extrude = Extrude(Base=list_item_19, Direction=negative_2)
solid_union_3 = SolidUnion(Breps=[cylinder_6, mirror_4.Geometry])
area_5 = Area(Geometry=list_item_20)  # -> Area, Centroid
unit_z_3 = UnitZ(Factor="-2.7")
unit_y_7 = UnitY(Factor="2")
cap_holes_5 = CapHoles(Brep=solid_union_3)
cap_holes_6 = CapHoles(Brep=extrude)
move_14 = Move(Geometry=area_5.Centroid, Motion=unit_y_7)  # -> Geometry, Transform
move_15 = Move(Geometry=move_5.Geometry, Motion=unit_z_3)  # -> Geometry, Transform
solid_union_4 = SolidUnion(Breps=[cap_holes_6, cap_holes_3])
unit_x_6 = UnitX(Factor="-4")
move_16 = Move(Geometry=move_14.Geometry, Motion=unit_x_6)  # -> Geometry, Transform
yz_plane_5 = YZPlane(Origin=move_16.Geometry)
cylinder_8 = Cylinder(Base=yz_plane_5, Radius="7.5", Length="12")
cap_holes_7 = CapHoles(Brep=cylinder_8)
solid_union_5 = SolidUnion(Breps=[cap_holes_7, cap_holes_2, cap_holes_5, cap_holes, solid_union_4])  # -> flatten(Result)

deconstruct_brep_11 = DeconstructBrep(Brep=domain_box_3)  # -> Faces, Edges, Vertices
list_item_21 = ListItem(List=deconstruct_brep_11.Edges, Index="5", Wrap=True)
list_item_22 = ListItem(List=deconstruct_brep_11.Edges, Index="7", Wrap=True)
length_2 = Length(Curve=list_item_21)
panel_7 = Panel(length_2)
list_length_2 = ListLength(List=panel_7)
lados_canteados_2 = Panel(list_length_2)
desperdicio_mm_2 = Panel("100")
set_value_5 = SetValue(Object=[list_item_21, list_item_22], PropertyOrParameter=graft("name"), Value=graft("adelante"))
multiplication_2 = Multiplication(A=lados_canteados_2, B=desperdicio_mm_2)
panel_8 = Panel(multiplication_2)
canto_adelante_lateral_izq_cajon = Geometry(set_value_5)
mass_addition_2 = MassAddition(Input=[length_2, panel_8])  # -> Result, PartialResults
total_mm_cantos_pieza_2 = Panel(mass_addition_2.Result)

solid_difference_2 = SolidDifference(BrepsA=domain_box_3, BrepsB=solid_union_5)  # -> flatten(Result)
deconstruct_brep_12 = DeconstructBrep(Brep=solid_difference_2)  # -> Faces, Edges, Vertices
list_item_23 = ListItem(List=deconstruct_brep_12.Edges, Index="15", Wrap=True)
# Manija ruteo Circular
_13_desplazamiento_manijas_ruteadas = Slider(0, range=-200..200)
area_6 = Area(Geometry=list_item_23)  # -> Area, Centroid
# Manija ruteo Barco
point = Point(Point(63, 438.5, 11.74947528))
xz_plane_6 = XZPlane(Origin=Point(0, 0, 0))
unit_x_7 = UnitX(Factor=_13_desplazamiento_manijas_ruteadas)
unit_x_8 = UnitX(Factor=_13_desplazamiento_manijas_ruteadas)
stream_filter_4 = StreamFilter(
    Gate=oprimir_f5_si_se_pone_rojo,
    Stream0=rh_in_09_alto_lateral_de_cajon_300_351,
    Stream1=rh_in_10_alto_lateral_de_cajon_400)
# TORNILLO 6 X 5-8 AVE PHI ZINC AGLOMERADO
panel_9 = Panel("90")

# ----
# Manija Soft 160
mesh = Mesh(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)
point_2 = Point(Point(63, 438.5, -2.830524719))

brep = Brep(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)
mesh_2 = Mesh(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)
point_3 = Point(Point(-785, 0, 712))
mesh_3 = Mesh(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)
mesh_4 = Mesh(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)

# ----
# Manija ABS
brep_2 = Brep(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)
mesh_5 = Mesh(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)
point_4 = Point(Point(-679.166076, 0, 812.5))
mesh_6 = Mesh(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)
mesh_7 = Mesh(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)

move_17 = Move(Geometry=curve_middle, Motion=unit_x_7)  # -> Geometry, Transform
move_18 = Move(Geometry=curve_middle, Motion=unit_x_8)  # -> Geometry, Transform

brep_3 = Brep(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)
point_5 = Point(Point(-255.7947091, -69.49538953, 122.8194407))

brep_4 = Brep(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)
point_6 = Point(Point(-255.7947091, 52.28274117, 122.8194407))

mesh_8 = Mesh(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)
unit_x_9 = UnitX(Factor="-160")
mesh_9 = Mesh(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)
unit_x_10 = UnitX(Factor="-160")
unit_x_11 = UnitX(Factor="-160")
unit_x_12 = UnitX(Factor="-128")
unit_x_13 = UnitX(Factor="-128")
move_to_point = MoveToPoint(Geometry=brep_3, PointA=point_5, PointB=move_17.Geometry)  # -> Moved, Vector, Transform
unit_x_14 = UnitX(Factor="-128")
move_to_point_2 = MoveToPoint(Geometry=brep_4, PointA=point_6, PointB=move_18.Geometry)  # -> Moved, Vector, Transform
move_19 = Move(Geometry=mesh_4, Motion=unit_x_10)  # -> Geometry, Transform
move_20 = Move(Motion=unit_x_11)  # -> Geometry, Transform
move_21 = Move(Geometry=mesh_2, Motion=unit_x_9)  # -> Geometry, Transform
move_22 = Move(Geometry=mesh_5, Motion=unit_x_12)  # -> Geometry, Transform
move_23 = Move(Geometry=mesh_7, Motion=unit_x_13)  # -> Geometry, Transform
move_24 = Move(Motion=unit_x_14)  # -> Geometry, Transform
rotate_3d = Rotate3D(Geometry=mesh, Angle=degrees(panel_9), Center=point, Axis=xz_plane_6)  # -> Geometry, Transform

# ----
# Corredera 350
point_7 = Point(Point(-327.0650687, 268.5127406, 341.655308))
point_8 = Point(Point(-327.0650687, 140.5127406, 341.655308))
point_9 = Point(Point(-327.0650687, 12.51274058, 341.655308))
point_10 = Point(Point(-327.0650687, -0.4872594195, 353.655308))
move_to_point_3 = MoveToPoint(Geometry=rotate_3d.Geometry, PointA=point, PointB=[point_8, point_10, point_9, point_7])  # -> Moved, Vector, Transform
mesh_10 = Mesh(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)
point_11 = Point(Point(-300.6849976, -13.48715019, 327.6552734))
move_to_point_4 = MoveToPoint(Geometry=move_to_point_3.Moved, PointA=point_11, PointB=move_15.Geometry)  # -> Moved, Vector, Transform
move_to_point_5 = MoveToPoint(Geometry=mesh_9, PointA=point_11, PointB=move_15.Geometry)  # -> Moved, Vector, Transform
move_to_point_6 = MoveToPoint(Geometry=mesh_10, PointA=point_11, PointB=move_15.Geometry)  # -> Moved, Vector, Transform
point_12 = Point(Point(-294.6850687, 302.0127406, 341.535308))
point_13 = Point(Point(-294.6850687, 162.0127406, 341.535308))
point_14 = Point(Point(-294.6850687, 22.01274058, 341.535308))
move_to_point_7 = MoveToPoint(Geometry=mesh, PointA=point, PointB=[point_12, point_13, point_14])  # -> Moved, Vector, Transform
move_to_point_8 = MoveToPoint(Geometry=move_to_point_7.Moved, PointA=point_11, PointB=move_15.Geometry)  # -> Moved, Vector, Transform

unit_x_15 = UnitX(Factor="13.88")
move_25 = Move(Geometry=point_9, Motion=unit_x_15)  # -> Geometry, Transform
yz_plane_6 = YZPlane(Origin=move_25.Geometry)
negative_3 = Negative(Value="1.5")
cylinder_9 = Cylinder(Base=yz_plane_6, Radius="1.5", Length=negative_3)
unit_y_8 = UnitY(Factor="256")
cap_holes_8 = CapHoles(Brep=cylinder_9)
move_26 = Move(Geometry=cap_holes_8, Motion=unit_y_8)  # -> Geometry, Transform
move_to_point_9 = MoveToPoint(Geometry=[move_26.Geometry, cap_holes_8], PointA=point_11, PointB=move_15.Geometry)  # -> Moved, Vector, Transform

# ----
# Corredera 300
point_15 = Point(Point(-679.4237742, -0.4872594195, 503.6826439))
point_16 = Point(Point(-679.4237742, 236.5127406, 491.6826439))
point_17 = Point(Point(-679.4237742, 140.5127406, 491.6826439))
point_18 = Point(Point(-679.4237742, 12.51274058, 491.6826439))
move_to_point_10 = MoveToPoint(Geometry=rotate_3d.Geometry, PointA=point, PointB=[point_17, point_15, point_18, point_16])  # -> Moved, Vector, Transform
mesh_11 = Mesh(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)
mesh_12 = Mesh(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)
point_19 = Point(Point(-653.0437031, -13.48715019, 477.6825952))
move_to_point_11 = MoveToPoint(Geometry=move_to_point_10.Moved, PointA=point_19, PointB=move_15.Geometry)  # -> Moved, Vector, Transform
move_to_point_12 = MoveToPoint(Geometry=mesh_11, PointA=point_19, PointB=move_15.Geometry)  # -> Moved, Vector, Transform
point_20 = Point(Point(-647.0437742, 250.0127406, 491.5626439))
point_21 = Point(Point(-647.0437742, 136.0127406, 491.5626439))
point_22 = Point(Point(-647.0437742, 22.01274058, 491.5626439))
move_to_point_13 = MoveToPoint(Geometry=mesh_12, PointA=point_19, PointB=move_15.Geometry)  # -> Moved, Vector, Transform
move_to_point_14 = MoveToPoint(Geometry=mesh, PointA=point, PointB=[point_20, point_21, point_22])  # -> Moved, Vector, Transform
move_to_point_15 = MoveToPoint(Geometry=move_to_point_14.Moved, PointA=point_19, PointB=move_15.Geometry)  # -> Moved, Vector, Transform

unit_x_16 = UnitX(Factor="13.88")
move_27 = Move(Geometry=point_18, Motion=unit_x_16)  # -> Geometry, Transform
yz_plane_7 = YZPlane(Origin=move_27.Geometry)
negative_4 = Negative(Value="1.5")
cylinder_10 = Cylinder(Base=yz_plane_7, Radius="1.5", Length=negative_4)
unit_y_9 = UnitY(Factor="224")
cap_holes_9 = CapHoles(Brep=cylinder_10)
move_28 = Move(Geometry=cap_holes_9, Motion=unit_y_9)  # -> Geometry, Transform
move_to_point_16 = MoveToPoint(Geometry=[move_28.Geometry, cap_holes_9], PointA=point_19, PointB=move_15.Geometry)  # -> Moved, Vector, Transform

# ----
# Corredera 400
point_23 = Point(Point(-327.0650687, 332.5127406, 63.05894384))
point_24 = Point(Point(-327.0650687, 236.5127406, 63.05894384))
point_25 = Point(Point(-327.0650687, 140.5127406, 63.05894384))
point_26 = Point(Point(-327.0650687, 12.51274058, 63.05894384))
point_27 = Point(Point(-327.0650687, -0.4872594195, 75.05894384))
move_to_point_17 = MoveToPoint(Geometry=rotate_3d.Geometry, PointA=point, PointB=[point_24, point_25, point_26, point_27, point_23])  # -> Moved, Vector, Transform
mesh_13 = Mesh(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)
point_28 = Point(Point(-300.6849976, -13.48715019, 49.05889511))
move_to_point_18 = MoveToPoint(Geometry=move_to_point_17.Moved, PointA=point_28, PointB=move_15.Geometry)  # -> Moved, Vector, Transform
move_to_point_19 = MoveToPoint(Geometry=mesh_8, PointA=point_28, PointB=move_15.Geometry)  # -> Moved, Vector, Transform
point_29 = Point(Point(-294.6850687, 350.0127406, 62.93894384))
point_30 = Point(Point(-294.6850687, 186.0127406, 62.93894384))
point_31 = Point(Point(-294.6850687, 22.01274058, 62.93894384))
move_to_point_20 = MoveToPoint(Geometry=mesh_13, PointA=point_28, PointB=move_15.Geometry)  # -> Moved, Vector, Transform
move_to_point_21 = MoveToPoint(Geometry=mesh, PointA=point, PointB=[point_29, point_30, point_31])  # -> Moved, Vector, Transform
move_to_point_22 = MoveToPoint(Geometry=move_to_point_21.Moved, PointA=point_28, PointB=move_15.Geometry)  # -> Moved, Vector, Transform

unit_x_17 = UnitX(Factor="13.88")
move_29 = Move(Geometry=point_26, Motion=unit_x_17)  # -> Geometry, Transform
yz_plane_8 = YZPlane(Origin=move_29.Geometry)
negative_5 = Negative(Value="1.5")
cylinder_11 = Cylinder(Base=yz_plane_8, Radius="1.5", Length=negative_5)
unit_y_10 = UnitY(Factor="320")
cap_holes_10 = CapHoles(Brep=cylinder_11)
move_30 = Move(Geometry=cap_holes_10, Motion=unit_y_10)  # -> Geometry, Transform
move_to_point_23 = MoveToPoint(Geometry=[move_30.Geometry, cap_holes_10], PointA=point_28, PointB=move_15.Geometry)  # -> Moved, Vector, Transform

move_to_point_24 = MoveToPoint(Geometry=[brep, move_20.Geometry], PointA=point_3, PointB=move_2.Geometry)  # -> Moved, Vector, Transform
move_to_point_25 = MoveToPoint(Geometry=mesh_3, PointA=point_3, PointB=move_2.Geometry)  # -> Moved, Vector, Transform
move_to_point_26 = MoveToPoint(Geometry=[mesh_2, move_21.Geometry], PointA=point_3, PointB=move_2.Geometry)  # -> Moved, Vector, Transform
move_to_point_27 = MoveToPoint(Geometry=[mesh_4, move_19.Geometry], PointA=point_3, PointB=move_2.Geometry)  # -> Moved, Vector, Transform
_12_estilo_frente = ValueList({"Sin manija": "0", "Manija soft 160": "1", "Manija Plana ABS": "2", "Manija Barco": "3", "Manija Medio Circulo": "4"}, selected="Sin manija")
unit_y_11 = UnitY(Factor="-7.5")
move_to_point_28 = MoveToPoint(Geometry=mesh_6, PointA=point_4, PointB=move_2.Geometry)  # -> Moved, Vector, Transform
move_to_point_29 = MoveToPoint(Geometry=[move_23.Geometry, mesh_7], PointA=point_4, PointB=move_2.Geometry)  # -> Moved, Vector, Transform
move_to_point_30 = MoveToPoint(Geometry=[move_22.Geometry, mesh_5], PointA=point_4, PointB=move_2.Geometry)  # -> Moved, Vector, Transform
move_to_point_31 = MoveToPoint(Geometry=brep_2, PointA=point_4, PointB=move_2.Geometry)  # -> Moved, Vector, Transform
unit_y_12 = UnitY(Factor="-7.5")
ocultar = ValueList({"Malla manija", "Malla deslizadores", "Nurbs piezas"}, selected="Malla manija")
stream_filter_5 = StreamFilter(ManijaSoft160=_12_estilo_frente, Stream1=move_to_point_25.Moved)
stream_filter_6 = StreamFilter(TornilloManija=_12_estilo_frente, Stream1=move_to_point_27.Moved)
stream_filter_7 = StreamFilter(Arandela=_12_estilo_frente, Stream1=move_to_point_26.Moved)
stream_filter_8 = StreamFilter(Nurbs=_12_estilo_frente, Stream1=[move_to_point_24.Moved, move_20.Geometry])
stream_filter_9 = StreamFilter(ManijaABS128=_12_estilo_frente, Stream2=move_to_point_28.Moved)
oprimir_f5_si_se_pone_rojo_4 = Expression(x=rh_in_08_largo_lateral_de_cajon, Expression="if (x=300 , 0, if (x=351, 1,if (x=400, 2,\"z\")))")
oprimir_f5_si_se_pone_rojo_5 = Expression(x=rh_in_08_largo_lateral_de_cajon, Expression="if (x=300 , 0, if (x=351, 1,if (x=400, 2,\"z\")))")
oprimir_f5_si_se_pone_rojo_6 = Expression(x=rh_in_08_largo_lateral_de_cajon, Expression="if (x=300 , 0, if (x=351, 1,if (x=400, 2,\"z\")))")
stream_filter_10 = StreamFilter(TornilloManija=_12_estilo_frente, Stream2=move_to_point_30.Moved)
stream_filter_11 = StreamFilter(Arandela=_12_estilo_frente, Stream2=move_to_point_29.Moved)
stream_filter_12 = StreamFilter(Nurbs=_12_estilo_frente, Stream2=move_to_point_31.Moved)
tornillo_manija = Geometry(stream_filter_6)
nurbs_manija_soft_160 = Geometry(stream_filter_8)
nurbs_manija_abs = Geometry(stream_filter_12)
tornillo_manija_2 = Geometry(stream_filter_10)
mesh_brep = MeshBrep(Settings={GridMaxCount=0, GridMinCount=16, JaggedSeams=False, MaxEdgeLength=0, MinEdgeLength=0.0001, MinTolerance=0, Refine=True, RefineAngle=0, RelativeTolerance=0.65, SimplePlanes=True, Tolerance=0})
area_7 = Area(Geometry=list_item_18)  # -> Area, Centroid
stream_filter_13 = StreamFilter(Corredera350Mueble=oprimir_f5_si_se_pone_rojo_4, Stream1=move_to_point_5.Moved)
stream_filter_14 = StreamFilter(Corredera350Lateral=oprimir_f5_si_se_pone_rojo_4, Stream1=move_to_point_6.Moved)
stream_filter_15 = StreamFilter(Corredera400Mueble=oprimir_f5_si_se_pone_rojo_6, Stream2=move_to_point_19.Moved)
stream_filter_16 = StreamFilter(Corredera300Mueble=oprimir_f5_si_se_pone_rojo_5, Stream0=move_to_point_12.Moved)
stream_filter_17 = StreamFilter(Corredera300Lateral=oprimir_f5_si_se_pone_rojo_5, Stream0=move_to_point_13.Moved)
stream_filter_18 = StreamFilter(Corredera400Lateral=oprimir_f5_si_se_pone_rojo_6, Stream2=move_to_point_20.Moved)
stream_filter_19 = StreamFilter(Maquinado=oprimir_f5_si_se_pone_rojo_6, Stream2=move_to_point_23.Moved)
stream_filter_20 = StreamFilter(Maquinado=oprimir_f5_si_se_pone_rojo_5, Stream0=move_to_point_16.Moved)
stream_filter_21 = StreamFilter(Tornillos=oprimir_f5_si_se_pone_rojo_4, Stream1=[move_to_point_8.Moved, move_to_point_4.Moved])
stream_filter_22 = StreamFilter(Maquinado=oprimir_f5_si_se_pone_rojo_4, Stream1=move_to_point_9.Moved)
stream_filter_23 = StreamFilter(Tornillos=oprimir_f5_si_se_pone_rojo_5, Stream0=[move_to_point_11.Moved, move_to_point_15.Moved])
stream_filter_24 = StreamFilter(Tornillos=oprimir_f5_si_se_pone_rojo_6, Stream2=[move_to_point_18.Moved, move_to_point_22.Moved])
set_value_6 = SetValue(ManijaSoft=[stream_filter_7, stream_filter_11], PropertyOrParameter=graft("name"), Value=graft("Arandela_0004632"))
set_value_7 = SetValue(ManijaABSNiquel=stream_filter_9, PropertyOrParameter=graft("name"), Value=graft("Manija_20010029"))
mesh_join = MeshJoin(Meshes=flatten(mesh_brep))
arandela_0004632 = Geometry(set_value_6)
domain_box_4 = DomainBox(Base=move_10.Geometry, X="15", Y=rh_in_08_largo_lateral_de_cajon, Z=stream_filter_4)

deconstruct_brep_13 = DeconstructBrep(Brep=domain_box_4)  # -> Faces, Edges, Vertices
list_item_24 = ListItem(List=deconstruct_brep_13.Edges, Index="5", Wrap=True)
list_item_25 = ListItem(List=deconstruct_brep_13.Edges, Index="7", Wrap=True)
length_3 = Length(Curve=list_item_24)
panel_10 = Panel(length_3)
list_length_3 = ListLength(List=panel_10)
desperdicio_mm_3 = Panel("100")
lados_canteados_3 = Panel(list_length_3)
set_value_8 = SetValue(Object=[list_item_25, list_item_24], PropertyOrParameter=graft("name"), Value=graft("adelante"))
multiplication_3 = Multiplication(A=lados_canteados_3, B=desperdicio_mm_3)
panel_11 = Panel(multiplication_3)
canto_adelante_lateral_izq_cajon_2 = Geometry(set_value_8)
mass_addition_3 = MassAddition(Input=[length_3, panel_11])  # -> Result, PartialResults
total_mm_cantos_pieza_3 = Panel(mass_addition_3.Result)

manija_20010029 = Geometry(set_value_7)

mesh_14 = Mesh(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)
point_32 = Point(Point(-389.0802685, 587.7908738, 233.8376515))

# ----
# Tornillo Drywall
point_33 = Point(Point(-134.1035289, 98.82507838, 261.6316499))
# Tarugo 8x50
mesh_15 = Mesh(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)

# ----
# Perno Minifix
mesh_16 = Mesh(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)
mesh_17 = Mesh(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)
point_34 = Point(Point(-97.39304191, 92.22770041, 276.790706))

deconstruct_brep_14 = DeconstructBrep(Brep=domain_box_4)  # -> Faces, Edges, Vertices
relay = Relay()
move_to_point_32 = MoveToPoint(Geometry=mesh_15, PointA=point_33, PointB=mirror_3.Geometry)  # -> Moved, Vector, Transform

area_8 = Area(Geometry=domain_box_4)  # -> Area, Centroid
text_style_3 = TextStyle(Font="arial", Height="50")
create_text_3 = CreateText(Location=area_8.Centroid, Text="3", Style=text_style_3, TextAlignment=6)
texto_3 = Geometry(create_text_3)

move_to_point_33 = MoveToPoint(Geometry=mesh_14, PointA=point_32, PointB=area_7.Centroid)  # -> Moved, Vector, Transform
unit_z_4 = UnitZ(Factor="-2.7")
move_to_point_34 = MoveToPoint(Geometry=mesh_17, PointA=point_34, PointB=move_7.Geometry)  # -> Moved, Vector, Transform
move_to_point_35 = MoveToPoint(Geometry=mesh_16, PointA=point_34, PointB=move_7.Geometry)  # -> Moved, Vector, Transform
list_item_26 = ListItem(List=deconstruct_brep_14.Vertices, Index="2", Wrap=True)
list_item_27 = ListItem(List=deconstruct_brep_14.Vertices, Index="7", Wrap=True)
mirror_6 = Mirror(Geometry=move_to_point_33.Moved, Plane=area_4.Centroid)  # -> Geometry, Transform
box_2pt = Box2Pt(PointA=move_6.Geometry, PointB=list_item_27, Plane=PlaneXY(0, 0, 0))

deconstruct_brep_15 = DeconstructBrep(Brep=box_2pt)  # -> Faces, Edges, Vertices
list_item_28 = ListItem(List=deconstruct_brep_15.Edges, Index="4", Wrap=True)
list_item_29 = ListItem(List=deconstruct_brep_15.Edges, Index="6", Wrap=True)
length_4 = Length(Curve=list_item_28)
panel_12 = Panel(length_4)
list_length_4 = ListLength(List=panel_12)
lados_canteados_4 = Panel(list_length_4)
desperdicio_mm_4 = Panel("100")
set_value_9 = SetValue(Object=[list_item_28, list_item_29], PropertyOrParameter=graft("name"), Value=graft("adelante"))
multiplication_4 = Multiplication(A=lados_canteados_4, B=desperdicio_mm_4)
panel_13 = Panel(multiplication_4)
mass_addition_4 = MassAddition(Input=[length_4, panel_13])  # -> Result, PartialResults
canto_adelante_lateral_izq_cajon_3 = Geometry(set_value_9)
total_mm_cantos_pieza_4 = Panel(mass_addition_4.Result)

move_31 = Move(Geometry=list_item_26, Motion=unit_z_4)  # -> Geometry, Transform
# 5
box_2pt_2 = Box2Pt(PointA=move_13.Geometry, PointB=move_31.Geometry, Plane=PlaneXY(0, 0, 0))
area_9 = Area(Geometry=box_2pt_2)  # -> Area, Centroid
yz_plane_9 = YZPlane(Origin=area_9.Centroid)
mirror_7 = Mirror(Geometry=[cap_holes_2, solid_union_4], Plane=yz_plane_9)  # -> Geometry, Transform
mirror_8 = Mirror(Geometry=[mirror_5.Geometry, cap_holes_4], Plane=yz_plane_9)  # -> Geometry, Transform

area_10 = Area(Geometry=box_2pt_2)  # -> Area, Centroid
text_style_4 = TextStyle(Font="arial", Height="50")
create_text_4 = CreateText(Location=area_10.Centroid, Text="5", Style=text_style_4, TextAlignment=6)
text_2 = Text(create_text_4)
texto_4 = Geometry(text_2)

# ---- group: Mapeado fondo
tipo_de_mapeado_fondo = ValueList({"Paral Atravesado": 0, "Paral": 1, "Frente": 2, "Puerta": 3, "Cubierta": 4, "Cubierta Atravesada": 5}, selected="Cubierta")
lado_color_fondo = ValueList({"Cara A": 4, "Cara B": 5, "D/D": 6}, selected="Cara B")
cluster = Cluster(
    brep=box_2pt_2,
    lado_balance=lado_color_fondo,
    gate_4=lado_color_fondo,
    gate_3=lado_color_fondo,
    gate_2=lado_color_fondo,
    gate=lado_color_fondo,
    tipo_de_mapeado=tipo_de_mapeado_fondo)  # -> caja_de_mapeo_2, caja_de_mapeo
set_value_10 = SetValue(MDFFondo=cluster.caja_de_mapeo, PropertyOrParameter=graft("name"), Value=graft("MDF_fondo"))
set_value_11 = SetValue(Object=cluster.caja_de_mapeo_2, PropertyOrParameter=graft("name"), Value=graft("Fondo"))
color_fondo = Geometry(set_value_11)
mdf_fondo = Geometry(set_value_10)

# ----
mirror_9 = Mirror(Geometry=solid_union_5, Plane=yz_plane_9)  # -> Geometry, Transform

solid_difference_3 = SolidDifference(BrepsA=solid_difference, BrepsB=flatten([mirror_9.Geometry, solid_union_5]))

solid_difference_4 = SolidDifference(BrepsA=solid_difference_3, BrepsB=solid_union_2)
solid_difference_5 = SolidDifference(BrepsA=solid_difference_3, BrepsB=solid_union)

# ---- group: Mapeado laterales de cajon
rh_in_tipo_de_mapeado_laterales = ValueList({"Paral atravesado": 0, "Paral": 1}, selected="Paral atravesado")
rh_in_lado_balance_laterales = ValueList({"Cara A": 3, "Cara B": 1, "D/D": 6}, selected="Cara A")
# 2 y 3
cluster_2 = Cluster_2(
    brep=solid_difference_2,
    color=rh_in_lado_balance_laterales,
    balance=rh_in_lado_balance_laterales,
    tipo_de_mapeado=rh_in_tipo_de_mapeado_laterales)  # -> caja_de_mapeo, caja_de_mapeo_2, caja_de_mapeo_3
set_value_12 = SetValue(Object=cluster_2.caja_de_mapeo, PropertyOrParameter=graft("name"), Value=graft("MDP"))
set_value_13 = SetValue(Object=cluster_2.caja_de_mapeo_2, PropertyOrParameter=graft("name"), Value=graft("Lateral izquierdo"))
set_value_14 = SetValue(Object=cluster_2.caja_de_mapeo_3, PropertyOrParameter=graft("name"), Value=graft("Lateral izquierdo balance"))
balance_lateral_izquierdo = Geometry(set_value_14)
color_lateral_izquierdo = Geometry(set_value_13)
mdp = Geometry(set_value_12)
mirror_10 = Mirror(Geometry=set_value_12, Plane=yz_plane_9)  # -> Geometry, Transform
mirror_11 = Mirror(Geometry=set_value_14, Plane=yz_plane_9)  # -> Geometry, Transform
mirror_12 = Mirror(Geometry=set_value_13, Plane=yz_plane_9)  # -> Geometry, Transform
set_value_15 = SetValue(Object=mirror_10.Geometry, PropertyOrParameter=graft("name"), Value=graft("MDP"))
set_value_16 = SetValue(Object=mirror_12.Geometry, PropertyOrParameter=graft("name"), Value=graft("Lateral derecho"))
set_value_17 = SetValue(Object=mirror_11.Geometry, PropertyOrParameter=graft("name"), Value=graft("Lateral derecho balance"))
balance_lateral_derecho = Geometry(set_value_17)
color_lateral_derecho = Geometry(set_value_16)
mdp_2 = Geometry(set_value_15)

# ----
solid_difference_6 = SolidDifference(BrepsA=solid_difference_3, BrepsB=move_to_point.Moved)
solid_difference_7 = SolidDifference(BrepsA=solid_difference_3, BrepsB=move_to_point_2.Moved)
stream_filter_25 = StreamFilter(
    Frente=_12_estilo_frente,
    Stream0=solid_difference_3,
    Stream1=solid_difference_5,
    Stream2=solid_difference_4,
    Stream3=solid_difference_6,
    Stream4=solid_difference_7)
# 3
solid_difference_8 = SolidDifference(BrepsA=domain_box_4, BrepsB=mirror_9.Geometry)  # -> flatten(Result)
solid_union_6 = SolidUnion(Breps=[cap_holes_4, mirror_5.Geometry, mirror_8.Geometry])
yz_plane_10 = YZPlane(Origin=area_9.Centroid)
yz_plane_11 = YZPlane(Origin=area_9.Centroid)

# ---- group: Mapeado frente de cajon
# 1
tipo_de_mapeado_frente = ValueList({"Paral Atravesado": 0, "Paral": 1, "Frente": 2, "Puerta": 3, "Cubierta": 4, "Cubierta Atravesada": 5}, selected="Frente")
lado_balance_frente = ValueList({"Cara A": 3, "Cara B": 1, "D/D": 6}, selected="Cara A")
cluster_3 = Cluster_4(
    gate_2=_12_estilo_frente,
    _4=stream_filter_25,
    color_3=lado_balance_frente,
    balance_3=lado_balance_frente,
    gate=_12_estilo_frente,
    _3=stream_filter_25,
    color_2=lado_balance_frente,
    balance_2=lado_balance_frente,
    gate_3=_12_estilo_frente,
    _0=stream_filter_25,
    _1=stream_filter_25,
    color=lado_balance_frente,
    _2=stream_filter_25,
    balance=lado_balance_frente,
    tipo_de_mapeado=tipo_de_mapeado_frente)  # -> caja_de_mapeo, caja_de_mapeo_2, caja_de_mapeo_3
set_value_18 = SetValue(Object=cluster_3.caja_de_mapeo, PropertyOrParameter=graft("name"), Value=graft("MDP"))
set_value_19 = SetValue(Object=cluster_3.caja_de_mapeo_3, PropertyOrParameter=graft("name"), Value=graft("Frente de cajon balance"))
set_value_20 = SetValue(Object=cluster_3.caja_de_mapeo_2, PropertyOrParameter=graft("name"), Value=graft("Frente de cajon"))
balance_frente_de_cajon = Geometry(set_value_19)
color_frente_de_cajon = Geometry(set_value_20)
mdp_3 = Geometry(set_value_18)

# ----
mirror_13 = Mirror(Geometry=move_to_point_32.Moved, Plane=yz_plane_10)  # -> Geometry, Transform
set_value_21 = SetValue(Corredera_400_20080033=stream_filter_18, PropertyOrParameter=graft("name"), Value=graft("Corredera_400_20080033"))
set_value_22 = SetValue(Corredera_350_20080001=stream_filter_14, PropertyOrParameter=graft("name"), Value=graft("Corredera_350_20080001"))
mirror_14 = Mirror(Geometry=[move_to_point_33.Moved, mirror_6.Geometry], Plane=yz_plane_9)  # -> Geometry, Transform
# 4
solid_difference_9 = SolidDifference(BrepsA=box_2pt, BrepsB=solid_union_6)
mirror_15 = Mirror(Geometry=move_to_point_34.Moved, Plane=yz_plane_11)  # -> Geometry, Transform
area_11 = Area(Geometry=solid_difference_9)  # -> Area, Centroid
mirror_16 = Mirror(Geometry=move_to_point_35.Moved, Plane=yz_plane_11)  # -> Geometry, Transform
corredera_400_20080033 = Geometry(set_value_21)
corredera_350_20080001 = Geometry(set_value_22)
deconstruct_brep_16 = DeconstructBrep(Brep=box_2pt)  # -> Faces, Edges, Vertices
yz_plane_12 = YZPlane(Origin=area_11.Centroid)
mirror_17 = Mirror(Geometry=stream_filter_19, Plane=yz_plane_12)  # -> Geometry, Transform
mirror_18 = Mirror(Geometry=stream_filter_13, Plane=yz_plane_12)  # -> Geometry, Transform
mirror_19 = Mirror(Geometry=stream_filter_21, Plane=yz_plane_12)  # -> Geometry, Transform
mirror_20 = Mirror(Geometry=stream_filter_22, Plane=yz_plane_12)  # -> Geometry, Transform
mirror_21 = Mirror(Geometry=stream_filter_15, Plane=yz_plane_12)  # -> Geometry, Transform
mirror_22 = Mirror(Geometry=stream_filter_24, Plane=yz_plane_12)  # -> Geometry, Transform
mirror_23 = Mirror(Geometry=stream_filter_20, Plane=yz_plane_12)  # -> Geometry, Transform
mirror_24 = Mirror(Geometry=stream_filter_23, Plane=yz_plane_12)  # -> Geometry, Transform
mirror_25 = Mirror(Geometry=stream_filter_18, Plane=yz_plane_12)  # -> Geometry, Transform
mirror_26 = Mirror(Geometry=stream_filter_14, Plane=yz_plane_12)  # -> Geometry, Transform
mirror_27 = Mirror(Geometry=stream_filter_17, Plane=yz_plane_12)  # -> Geometry, Transform
mirror_28 = Mirror(Geometry=stream_filter_16, Plane=yz_plane_12)  # -> Geometry, Transform
set_value_23 = SetValue(
    Corredera_300_20080038=[stream_filter_17, mirror_27.Geometry],
    PropertyOrParameter=graft("name"),
    Value=graft("Corredera_300_20080038"))  # -> flatten(Object)
set_value_24 = SetValue(
    Corredera_mueble=[stream_filter_15, mirror_21.Geometry, mirror_25.Geometry],
    PropertyOrParameter=graft("name"),
    Value=graft("Corredera_mueble"))
set_value_25 = SetValue(
    Corredera_mueble=[stream_filter_13, mirror_18.Geometry, mirror_26.Geometry],
    PropertyOrParameter=graft("name"),
    Value=graft("Corredera_mueble"))
corredera_400_20080033_2 = Geometry(set_value_24)
corredera_350_20080001_2 = Geometry(set_value_25)
list_item_30 = ListItem(List=deconstruct_brep_16.Vertices, Index="3", Wrap=True)
unit_x_18 = UnitX(Factor="30")
mesh_brep_2 = MeshBrep(
    Brep=[mirror_23.Geometry, stream_filter_20, mirror_20.Geometry, stream_filter_22, stream_filter_19, mirror_17.Geometry],
    Settings={GridMaxCount=0, GridMinCount=16, JaggedSeams=False, MaxEdgeLength=0, MinEdgeLength=0.0001, MinTolerance=0, Refine=True, RefineAngle=0, RelativeTolerance=0.65, SimplePlanes=True, Tolerance=0})
set_value_26 = SetValue(
    TornilloDrywall=[move_to_point_33.Moved, mirror_6.Geometry, mirror_14.Geometry],
    PropertyOrParameter=graft("name"),
    Value=graft("Tornillo_0000152"))
move_32 = Move(Geometry=list_item_30, Motion=unit_x_18)  # -> Geometry, Transform
move_33 = Move(Geometry=move_32.Geometry, Motion=unit_y_11)  # -> Geometry, Transform
move_to_point_36 = MoveToPoint(Geometry=mesh, PointA=point_2, PointB=move_33.Geometry)  # -> Moved, Vector, Transform
set_value_27 = SetValue(Maquinado=mesh_brep_2, PropertyOrParameter=graft("name"), Value=graft("Maquinado"))
set_value_28 = SetValue(Object=[mirror_15.Geometry, move_to_point_34.Moved], PropertyOrParameter=graft("name"), Value=graft("Perno_0007374"))
set_value_29 = SetValue(Object=[move_to_point_35.Moved, mirror_16.Geometry], PropertyOrParameter=graft("name"), Value=graft("Caja_0002715"))
tornillo_0000152 = Geometry(set_value_26)
mirror_29 = Mirror(Geometry=move_32.Geometry, Plane=yz_plane_9)  # -> Geometry, Transform
line_2 = Line(StartPoint=mirror_29.Geometry, EndPoint=move_32.Geometry)
move_34 = Move(Geometry=line_2, Motion=unit_y_12)  # -> Geometry, Transform
length_5 = Length(Curve=move_34.Geometry)
division = Division(A=length_5, B="100")
round = Round(Number=division)  # -> Nearest, Floor, Ceiling
division_2 = Division(A=length_5, B=round.Floor)
unit_x_19 = UnitX(Factor=division_2)
linear_array = LinearArray(Geometry=move_to_point_36.Moved, Direction=unit_x_19, Count=round.Ceiling)  # -> Geometry, Transform
set_value_30 = SetValue(
    TornilloAgromerado=[stream_filter_23, mirror_24.Geometry, stream_filter_21, mirror_19.Geometry, stream_filter_24, mirror_22.Geometry, linear_array.Geometry],
    PropertyOrParameter=graft("name"),
    Value=graft("Tornillo_0004705"))
tornillo_0004705 = Geometry(set_value_30)
set_value_31 = SetValue(
    Tarugo_20030001=[move_to_point_32.Moved, mirror_13.Geometry],
    PropertyOrParameter=graft("name"),
    Value=graft("Tarugo_20030001"))
maquinado = Geometry(set_value_27)
perno_0007374 = Geometry(set_value_28)
caja_0002715 = Geometry(set_value_29)
addition_3 = Addition(A=total_mm_cantos_pieza_3, B=total_mm_cantos_pieza_2, C=total_mm_cantos_pieza, D=total_mm_cantos_pieza_4)
tarugo_20030001 = Geometry(set_value_31)
panel_14 = Panel(addition_3)

area_12 = Area(Geometry=solid_difference_9)  # -> Area, Centroid
text_style_5 = TextStyle(Font="arial", Height="50")
create_text_5 = CreateText(Location=area_12.Centroid, Text="4", Style=text_style_5, TextAlignment=6)
texto_5 = Geometry(create_text_5)

canto_cajon = Text(panel_14)

# ---- group: Mapeado posterior de cajon
# 4
rh_in_lado_balance_posterior = ValueList({"Cara A": 3, "Cara B": 1, "D/D": 6}, selected="Cara A")
rh_in_tipo_de_mapeado_posterior = ValueList({"Paral Atravesado": 0, "Paral": 1, "Frente": 2, "Puerta": 3, "Cubierta": 4, "Cubierta Atravesada": 5}, selected="Frente")
cluster_4 = Cluster_3(
    brep=solid_difference_9,
    color=rh_in_lado_balance_posterior,
    balance=rh_in_lado_balance_posterior,
    tipo_de_mapeado=rh_in_tipo_de_mapeado_posterior)  # -> caja_de_mapeo, caja_de_mapeo_2, caja_de_mapeo_3
set_value_32 = SetValue(Object=cluster_4.caja_de_mapeo, PropertyOrParameter=graft("name"), Value=graft("MDP"))
set_value_33 = SetValue(Object=cluster_4.caja_de_mapeo_2, PropertyOrParameter=graft("name"), Value=graft("Posterior de cajon"))
set_value_34 = SetValue(Object=cluster_4.caja_de_mapeo_3, PropertyOrParameter=graft("name"), Value=graft("Posterior de cajon balance"))
balance_posterior_de_cajon = Geometry(set_value_34)
color_posterior_de_cajon = Geometry(set_value_33)
mdp_4 = Geometry(set_value_32)

# ---- group: Ocultar geometrias
mostrar_mallas_piezas = BooleanToggle(True)
mostrar_fondo = BooleanToggle(True)
mostrar_lateral_corredera = BooleanToggle(True)
mostrar_base_correderas = BooleanToggle(True)
mostrar_malla_manija = BooleanToggle(True)
stream_filter_26 = StreamFilter(
    Gate=mostrar_mallas_piezas,
    Stream1=[relay, cluster.caja_de_mapeo_2, cluster.caja_de_mapeo, cluster_4.caja_de_mapeo, cluster_4.caja_de_mapeo_2, cluster_4.caja_de_mapeo_3, cluster_3.caja_de_mapeo, cluster_3.caja_de_mapeo_2, cluster_3.caja_de_mapeo_3])
stream_filter_27 = StreamFilter(Gate=mostrar_malla_manija, Stream1=stream_filter_5)
stream_filter_28 = StreamFilter(Gate=mostrar_fondo, Stream1=box_2pt_2)
stream_filter_29 = StreamFilter(Gate=mostrar_lateral_corredera, Stream1=[stream_filter_16, mirror_28.Geometry])
stream_filter_30 = StreamFilter(Gate=mostrar_base_correderas, Stream1=set_value_23)
dispatch_multiple = DispatchMultiple(DispatchPattern=stream_filter_26, ListList0=stream_filter_26)  # -> ListList0, List0, List1, List2, List3, List4, List5, List6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

# ----
set_value_35 = SetValue(ManijaSoft=stream_filter_27, PropertyOrParameter=graft("name"), Value=graft("Manija_0004677"))
manija_0004677 = Geometry(set_value_35)
dispatch = Dispatch(List=stream_filter_30, DispatchPattern=[True, False])  # -> ListA, ListB
set_value_36 = SetValue(Corredera_mueble=[stream_filter_29, dispatch.ListB], PropertyOrParameter=graft("name"), Value=graft("Corredera_mueble"))
corredera_mueble = Geometry(set_value_36)
corredera_300_20080038 = Geometry(dispatch.ListA)

set_value_37 = SetValue(Object=stream_filter_28, PropertyOrParameter=graft("name"), Value=graft("FONDO DE CAJON"))

# ----
# 2
panel_15 = Panel("LATERAL IZQUIERDO CAJON")
set_value_38 = SetValue(Object=solid_difference_2, PropertyOrParameter=graft("name"), Value=graft(panel_15))

set_value_39 = SetValue(Object=stream_filter_25, PropertyOrParameter=graft("name"), Value=graft("FRENTE DE CAJON"))

# ---- group: Explosionar
explosionar_piezas = Slider(0, range=0..600)
explosionar_herrajes = Slider(0, range=0..600)
unit_y_13 = UnitY(Factor=explosionar_piezas)
unit_z_5 = UnitZ(Factor=explosionar_piezas)
unit_x_20 = UnitX(Factor=explosionar_piezas)
unit_y_14 = UnitY(Factor=explosionar_herrajes)
unit_z_6 = UnitZ(Factor=explosionar_herrajes)
unit_x_21 = UnitX(Factor=explosionar_herrajes)
negative_6 = Negative(Value=unit_x_20)
negative_7 = Negative(Value=unit_z_5)
negative_8 = Negative(Value=unit_y_13)
negative_9 = Negative(Value=unit_y_14)
negative_10 = Negative(Value=unit_x_21)
negative_11 = Negative(Value=unit_z_6)
move_35 = Move(LIzquierdo=set_value_38, Motion=negative_6)  # -> Geometry, Transform
move_36 = Move(DrywallI=[move_to_point_33.Moved, mirror_6.Geometry], Motion=negative_10)  # -> Geometry, Transform
move_37 = Move(DrywallD=mirror_14.Geometry, Motion=unit_x_21)  # -> Geometry, Transform
move_38 = Move(Geometry=set_value_37, Motion=unit_y_13)  # -> Geometry, Transform
move_39 = Move(Geometry=set_value_39, Motion=negative_8)  # -> Geometry, Transform

# ----
nurbs_fondo = Geometry(move_38.Geometry)

nurbs_lateral_izquierdo = Geometry(move_35.Geometry)

nurbs_frente = Geometry(move_39.Geometry)

set_value_40 = SetValue(Object=solid_difference_8, PropertyOrParameter=graft("name"), Value=graft("LATERAL DERECHO CAJON"))

set_value_41 = SetValue(Object=solid_difference_9, PropertyOrParameter=graft("name"), Value=graft("POSTERIOR DE CAJON"))

# ---- group: Explosionar (continued)
move_40 = Move(LDerecho=set_value_40, Motion=unit_x_20)  # -> Geometry, Transform
move_41 = Move(Posterior=set_value_41, Motion=unit_y_13)  # -> Geometry, Transform

# ----
nurbs_lateral_derecho = Geometry(move_40.Geometry)

nurbs_posterior_de_cajon = Geometry(move_41.Geometry)

# ==== cluster Cluster
brep = ClusterInput()
lado_balance = ClusterInput()
gate = ClusterInput()
gate_2 = ClusterInput()
gate_3 = ClusterInput()
gate_4 = ClusterInput()

# ----
# Deconstruccion
deconstruct_brep = DeconstructBrep(Brep=brep)  # -> Faces, Edges, Vertices
stream_filter = StreamFilter(Gate=gate, Stream6=deconstruct_brep.Faces)
stream_filter_2 = StreamFilter(Gate=gate_2, Stream5=deconstruct_brep.Faces)
stream_filter_3 = StreamFilter(Gate=gate_3, Stream4=deconstruct_brep.Faces)
list_item = ListItem(List=[stream_filter, stream_filter_3, stream_filter_2], Index="1", Wrap=True)
list_item_2 = ListItem(List=[stream_filter, stream_filter_3, stream_filter_2], Index="2", Wrap=True)
list_item_3 = ListItem(List=[stream_filter, stream_filter_3, stream_filter_2], Index="3", Wrap=True)
list_item_4 = ListItem(List=[stream_filter, stream_filter_3, stream_filter_2], Index="4", Wrap=True)
list_item_5 = ListItem(List=[stream_filter, stream_filter_3, stream_filter_2], Index="5", Wrap=True)
list_item_6 = ListItem(List=[stream_filter, stream_filter_3, stream_filter_2], Index="0", Wrap=True)
list_item_7 = ListItem(List=[stream_filter_3, stream_filter_2], LadoBalance=lado_balance, Wrap=True)
stream_filter_4 = StreamFilter(
    Gate=gate_4,
    Stream4=[list_item_6, list_item, list_item_2, list_item_3, list_item_5],
    Stream5=[list_item_6, list_item, list_item_2, list_item_3, list_item_4],
    Stream6=[list_item, list_item_2, list_item_3, list_item_4, list_item_5, list_item_6])
solid_union = SolidUnion(Breps=stream_filter_4)
mesh_brep = MeshBrep(
    Brep=list_item_7,
    Settings={GridMaxCount=0, GridMinCount=16, JaggedSeams=False, MaxEdgeLength=0, MinEdgeLength=0.0001, MinTolerance=0, Refine=True, RefineAngle=0, RelativeTolerance=0.65, SimplePlanes=True, Tolerance=0})
mesh_brep_2 = MeshBrep(
    Brep=solid_union,
    Settings={GridMaxCount=0, GridMinCount=16, JaggedSeams=False, MaxEdgeLength=0, MinEdgeLength=0.0001, MinTolerance=0, Refine=True, RefineAngle=0, RelativeTolerance=0.65, SimplePlanes=True, Tolerance=0})

tipo_de_mapeado = ClusterInput()

# ----
# Mapeado de Pieza
panel = Panel("600")
tamaño_de_textura = Number(panel)
domain_box = DomainBox(Base=PlaneXY(0, 0, 0), X=tamaño_de_textura, Y=tamaño_de_textura, Z=tamaño_de_textura)
unit_y = UnitY(Factor=1)
domain_box_2 = DomainBox(Base=PlaneXY(0, 0, 0), X=tamaño_de_textura, Y=tamaño_de_textura, Z=tamaño_de_textura)
unit_x = UnitX(Factor=1)
domain_box_3 = DomainBox(Base=PlaneXY(0, 0, 0), X=tamaño_de_textura, Y=tamaño_de_textura, Z=tamaño_de_textura)
unit_x_2 = UnitX(Factor=1)
domain_box_4 = DomainBox(Base=PlaneXY(0, 0, 0), X=tamaño_de_textura, Y=tamaño_de_textura, Z=tamaño_de_textura)
unit_x_3 = UnitX(Factor=1)
domain_box_5 = DomainBox(Base=PlaneXY(0, 0, 0), X=tamaño_de_textura, Y=tamaño_de_textura, Z=tamaño_de_textura)
unit_x_4 = UnitX(Factor=1)
domain_box_6 = DomainBox(Base=PlaneXY(0, 0, 0), X=tamaño_de_textura, Y=tamaño_de_textura, Z=tamaño_de_textura)
unit_z = UnitZ(Factor=1)
rotate_3d = Rotate3D(Geometry=domain_box, Angle=degrees("90"), Center=Point(0, 0, 0), Axis=unit_y)  # -> Geometry, Transform
rotate_3d_2 = Rotate3D(Geometry=domain_box_2, Angle=degrees("180"), Center=Point(0, 0, 0), Axis=unit_x)  # -> Geometry, Transform
rotate_3d_3 = Rotate3D(Geometry=domain_box_3, Angle=degrees("90"), Center=Point(0, 0, 0), Axis=unit_x_2)  # -> Geometry, Transform
rotate_3d_4 = Rotate3D(Geometry=domain_box_4, Angle=degrees("90"), Center=Point(0, 0, 0), Axis=unit_x_3)  # -> Geometry, Transform
rotate_3d_5 = Rotate3D(Geometry=domain_box_5, Angle=degrees("0"), Center=Point(0, 0, 0), Axis=unit_x_4)  # -> Geometry, Transform
rotate_3d_6 = Rotate3D(Geometry=domain_box_6, Angle=degrees("90"), Center=Point(0, 0, 0), Axis=unit_z)  # -> Geometry, Transform
unit_x_5 = UnitX(Factor=1)
unit_y_2 = UnitY(Factor=1)
unit_y_3 = UnitY(Factor=1)
unit_y_4 = UnitY(Factor=1)
unit_y_5 = UnitY(Factor=1)
unit_y_6 = UnitY(Factor=1)
rotate_3d_7 = Rotate3D(Geometry=rotate_3d_6.Geometry, Angle=degrees("0"), Center=Point(0, 0, 0), Axis=unit_y_2)  # -> CubiertaAtravesada, Transform
rotate_3d_8 = Rotate3D(Geometry=rotate_3d.Geometry, Angle=degrees("90"), Center=Point(0, 0, 0), Axis=unit_x_5)  # -> ParalAtravesado, Transform
rotate_3d_9 = Rotate3D(Geometry=rotate_3d_2.Geometry, Angle=degrees("90"), Center=Point(0, 0, 0), Axis=unit_y_4)  # -> Geometry, Transform
rotate_3d_10 = Rotate3D(Geometry=rotate_3d_4.Geometry, Angle=degrees("90"), Center=Point(0, 0, 0), Axis=unit_y_6)  # -> Geometry, Transform
rotate_3d_11 = Rotate3D(Geometry=rotate_3d_5.Geometry, Angle=degrees("0"), Center=Point(0, 0, 0), Axis=unit_y_3)  # -> Geometry, Transform
rotate_3d_12 = Rotate3D(Geometry=rotate_3d_3.Geometry, Angle=degrees("0"), Center=Point(0, 0, 0), Axis=unit_y_5)  # -> Geometry, Transform
stream_filter_5 = StreamFilter(
    Gate=tipo_de_mapeado,
    Stream0=rotate_3d_8.ParalAtravesado,
    Stream1=rotate_3d_9.Geometry,
    Stream2=rotate_3d_12.Geometry,
    Stream3=rotate_3d_10.Geometry,
    Stream4=rotate_3d_11.Geometry,
    Stream5=rotate_3d_7.CubiertaAtravesada)

boxmapping = BoxMapping(Mesh=mesh_brep_2, Box=stream_filter_5)
boxmapping_2 = BoxMapping(Mesh=mesh_brep, Box=stream_filter_5)
caja_de_mapeo = ClusterOutput(boxmapping)
caja_de_mapeo_2 = ClusterOutput(boxmapping_2)

# ==== cluster Cluster_2
brep = ClusterInput()
balance = ClusterInput()
color = ClusterInput()

# ----
# Pieza tipo Lateral de cajon
deconstruct_brep = DeconstructBrep(Brep=brep)  # -> Faces, Edges, Vertices
stream_filter = StreamFilter(Balance=balance, Stream1="1", Stream3="3")
stream_filter_2 = StreamFilter(Color=color, Stream1=["3", "5"], Stream3=["1", "5"], Stream6=["3", "1", "5"])
list_length = ListLength(List=deconstruct_brep.Faces)
cantidad_de_caras = Panel(list_length)
list_item = ListItem(List=deconstruct_brep.Faces, Index=stream_filter, Wrap=True)
list_item_2 = ListItem(List=deconstruct_brep.Faces, Index=stream_filter_2, Wrap=True)
subtraction = Subtraction(A=cantidad_de_caras, B="6")
series = Series(Start="6", Step="1", Count=subtraction)
list_item_3 = ListItem(List=deconstruct_brep.Faces, Index=[series, "2", "0", "4"], Wrap=True)
mesh_brep = MeshBrep(
    Color=list_item_2,
    Settings={GridMaxCount=0, GridMinCount=16, JaggedSeams=False, MaxEdgeLength=0, MinEdgeLength=0.0001, MinTolerance=0, Refine=True, RefineAngle=0, RelativeTolerance=0.65, SimplePlanes=True, Tolerance=0})
mesh_brep_2 = MeshBrep(
    Brep=list_item_3,
    Settings={GridMaxCount=0, GridMinCount=16, JaggedSeams=False, MaxEdgeLength=0, MinEdgeLength=0.0001, MinTolerance=0, Refine=True, RefineAngle=0, RelativeTolerance=0.65, SimplePlanes=True, Tolerance=0})
mesh_brep_3 = MeshBrep(
    Balance=list_item,
    Settings={GridMaxCount=0, GridMinCount=16, JaggedSeams=False, MaxEdgeLength=0, MinEdgeLength=0.0001, MinTolerance=0, Refine=True, RefineAngle=0, RelativeTolerance=0.65, SimplePlanes=True, Tolerance=0})
mesh_join = MeshJoin(Meshes=flatten(mesh_brep_2))
mesh_join_2 = MeshJoin(Meshes=mesh_brep)
mesh_join_3 = MeshJoin(Meshes=mesh_brep_3)

tipo_de_mapeado = ClusterInput()

# ----
# Mapeado
panel = Panel("600")
tamaño_de_textura = Number(panel)
domain_box = DomainBox(Base=PlaneXY(0, 0, 0), X=tamaño_de_textura, Y=tamaño_de_textura, Z=tamaño_de_textura)
unit_y = UnitY(Factor=1)
domain_box_2 = DomainBox(Base=PlaneXY(0, 0, 0), X=tamaño_de_textura, Y=tamaño_de_textura, Z=tamaño_de_textura)
unit_x = UnitX(Factor=1)
domain_box_3 = DomainBox(Base=PlaneXY(0, 0, 0), X=tamaño_de_textura, Y=tamaño_de_textura, Z=tamaño_de_textura)
unit_x_2 = UnitX(Factor=1)
domain_box_4 = DomainBox(Base=PlaneXY(0, 0, 0), X=tamaño_de_textura, Y=tamaño_de_textura, Z=tamaño_de_textura)
unit_x_3 = UnitX(Factor=1)
domain_box_5 = DomainBox(Base=PlaneXY(0, 0, 0), X=tamaño_de_textura, Y=tamaño_de_textura, Z=tamaño_de_textura)
unit_x_4 = UnitX(Factor=1)
domain_box_6 = DomainBox(Base=PlaneXY(0, 0, 0), X=tamaño_de_textura, Y=tamaño_de_textura, Z=tamaño_de_textura)
unit_z = UnitZ(Factor=1)
rotate_3d = Rotate3D(Geometry=domain_box, Angle=degrees("90"), Center=Point(0, 0, 0), Axis=unit_y)  # -> Geometry, Transform
rotate_3d_2 = Rotate3D(Geometry=domain_box_2, Angle=degrees("180"), Center=Point(0, 0, 0), Axis=unit_x)  # -> Geometry, Transform
rotate_3d_3 = Rotate3D(Geometry=domain_box_3, Angle=degrees("90"), Center=Point(0, 0, 0), Axis=unit_x_2)  # -> Geometry, Transform
rotate_3d_4 = Rotate3D(Geometry=domain_box_4, Angle=degrees("90"), Center=Point(0, 0, 0), Axis=unit_x_3)  # -> Geometry, Transform
rotate_3d_5 = Rotate3D(Geometry=domain_box_5, Angle=degrees("0"), Center=Point(0, 0, 0), Axis=unit_x_4)  # -> Geometry, Transform
rotate_3d_6 = Rotate3D(Geometry=domain_box_6, Angle=degrees("90"), Center=Point(0, 0, 0), Axis=unit_z)  # -> Geometry, Transform
unit_x_5 = UnitX(Factor=1)
unit_y_2 = UnitY(Factor=1)
unit_y_3 = UnitY(Factor=1)
unit_y_4 = UnitY(Factor=1)
unit_y_5 = UnitY(Factor=1)
unit_y_6 = UnitY(Factor=1)
rotate_3d_7 = Rotate3D(Geometry=rotate_3d.Geometry, Angle=degrees("90"), Center=Point(0, 0, 0), Axis=unit_x_5)  # -> ParalAtravesado, Transform
rotate_3d_8 = Rotate3D(Geometry=rotate_3d_2.Geometry, Angle=degrees("90"), Center=Point(0, 0, 0), Axis=unit_y_2)  # -> Geometry, Transform
rotate_3d_9 = Rotate3D(Geometry=rotate_3d_3.Geometry, Angle=degrees("0"), Center=Point(0, 0, 0), Axis=unit_y_3)  # -> Geometry, Transform
rotate_3d_10 = Rotate3D(Geometry=rotate_3d_4.Geometry, Angle=degrees("90"), Center=Point(0, 0, 0), Axis=unit_y_4)  # -> Geometry, Transform
rotate_3d_11 = Rotate3D(Geometry=rotate_3d_5.Geometry, Angle=degrees("0"), Center=Point(0, 0, 0), Axis=unit_y_5)  # -> Geometry, Transform
rotate_3d_12 = Rotate3D(Geometry=rotate_3d_6.Geometry, Angle=degrees("0"), Center=Point(0, 0, 0), Axis=unit_y_6)  # -> CubiertaAtravesada, Transform
stream_filter_3 = StreamFilter(
    Gate=tipo_de_mapeado,
    Stream0=rotate_3d_7.ParalAtravesado,
    Stream1=rotate_3d_8.Geometry,
    Stream2=rotate_3d_9.Geometry,
    Stream3=rotate_3d_10.Geometry,
    Stream4=rotate_3d_11.Geometry,
    Stream5=rotate_3d_12.CubiertaAtravesada)
boxmapping = BoxMapping(Mesh=mesh_join, Box=stream_filter_3)
boxmapping_2 = BoxMapping(Mesh=mesh_join_2, Box=stream_filter_3)
boxmapping_3 = BoxMapping(Mesh=mesh_join_3, Box=stream_filter_3)

caja_de_mapeo = ClusterOutput(boxmapping)
caja_de_mapeo_2 = ClusterOutput(boxmapping_2)
caja_de_mapeo_3 = ClusterOutput(boxmapping_3)

# ==== cluster Cluster_3
brep = ClusterInput()
balance = ClusterInput()
color = ClusterInput()

# ----
# Pieza tipo Lateral de cajon
deconstruct_brep = DeconstructBrep(Brep=brep)  # -> Faces, Edges, Vertices
stream_filter = StreamFilter(Balance=balance, Stream1="0", Stream3="2")
stream_filter_2 = StreamFilter(Color=color, Stream1=["5", "2"], Stream3=["0", "5"], Stream6=["0", "2", "5"])
list_length = ListLength(List=deconstruct_brep.Faces)
cantidad_de_caras = Panel(list_length)
list_item = ListItem(List=deconstruct_brep.Faces, Index=stream_filter, Wrap=True)
list_item_2 = ListItem(List=deconstruct_brep.Faces, Index=stream_filter_2, Wrap=True)
subtraction = Subtraction(A=cantidad_de_caras, B="6")
series = Series(Start="6", Step="1", Count=subtraction)
list_item_3 = ListItem(List=deconstruct_brep.Faces, Index=[series, "3", "4", "1"], Wrap=True)
mesh_brep = MeshBrep(
    Color=list_item_2,
    Settings={GridMaxCount=0, GridMinCount=16, JaggedSeams=False, MaxEdgeLength=0, MinEdgeLength=0.0001, MinTolerance=0, Refine=True, RefineAngle=0, RelativeTolerance=0.65, SimplePlanes=True, Tolerance=0})
mesh_brep_2 = MeshBrep(
    Balance=list_item,
    Settings={GridMaxCount=0, GridMinCount=16, JaggedSeams=False, MaxEdgeLength=0, MinEdgeLength=0.0001, MinTolerance=0, Refine=True, RefineAngle=0, RelativeTolerance=0.65, SimplePlanes=True, Tolerance=0})
mesh_brep_3 = MeshBrep(
    Brep=list_item_3,
    Settings={GridMaxCount=0, GridMinCount=16, JaggedSeams=False, MaxEdgeLength=0, MinEdgeLength=0.0001, MinTolerance=0, Refine=True, RefineAngle=0, RelativeTolerance=0.65, SimplePlanes=True, Tolerance=0})
mesh_join = MeshJoin(Meshes=flatten(mesh_brep_3))
mesh_join_2 = MeshJoin(Meshes=mesh_brep)
mesh_join_3 = MeshJoin(Meshes=mesh_brep_2)

tipo_de_mapeado = ClusterInput()

# ----
# Mapeado
panel = Panel("600")
tamaño_de_textura = Number(panel)
domain_box = DomainBox(Base=PlaneXY(0, 0, 0), X=tamaño_de_textura, Y=tamaño_de_textura, Z=tamaño_de_textura)
unit_y = UnitY(Factor=1)
domain_box_2 = DomainBox(Base=PlaneXY(0, 0, 0), X=tamaño_de_textura, Y=tamaño_de_textura, Z=tamaño_de_textura)
unit_x = UnitX(Factor=1)
domain_box_3 = DomainBox(Base=PlaneXY(0, 0, 0), X=tamaño_de_textura, Y=tamaño_de_textura, Z=tamaño_de_textura)
unit_x_2 = UnitX(Factor=1)
domain_box_4 = DomainBox(Base=PlaneXY(0, 0, 0), X=tamaño_de_textura, Y=tamaño_de_textura, Z=tamaño_de_textura)
unit_x_3 = UnitX(Factor=1)
domain_box_5 = DomainBox(Base=PlaneXY(0, 0, 0), X=tamaño_de_textura, Y=tamaño_de_textura, Z=tamaño_de_textura)
unit_x_4 = UnitX(Factor=1)
domain_box_6 = DomainBox(Base=PlaneXY(0, 0, 0), X=tamaño_de_textura, Y=tamaño_de_textura, Z=tamaño_de_textura)
unit_z = UnitZ(Factor=1)
rotate_3d = Rotate3D(Geometry=domain_box, Angle=degrees("90"), Center=Point(0, 0, 0), Axis=unit_y)  # -> Geometry, Transform
rotate_3d_2 = Rotate3D(Geometry=domain_box_2, Angle=degrees("180"), Center=Point(0, 0, 0), Axis=unit_x)  # -> Geometry, Transform
rotate_3d_3 = Rotate3D(Geometry=domain_box_3, Angle=degrees("90"), Center=Point(0, 0, 0), Axis=unit_x_2)  # -> Geometry, Transform
rotate_3d_4 = Rotate3D(Geometry=domain_box_4, Angle=degrees("90"), Center=Point(0, 0, 0), Axis=unit_x_3)  # -> Geometry, Transform
rotate_3d_5 = Rotate3D(Geometry=domain_box_5, Angle=degrees("0"), Center=Point(0, 0, 0), Axis=unit_x_4)  # -> Geometry, Transform
rotate_3d_6 = Rotate3D(Geometry=domain_box_6, Angle=degrees("90"), Center=Point(0, 0, 0), Axis=unit_z)  # -> Geometry, Transform
unit_x_5 = UnitX(Factor=1)
unit_y_2 = UnitY(Factor=1)
unit_y_3 = UnitY(Factor=1)
unit_y_4 = UnitY(Factor=1)
unit_y_5 = UnitY(Factor=1)
unit_y_6 = UnitY(Factor=1)
rotate_3d_7 = Rotate3D(Geometry=rotate_3d.Geometry, Angle=degrees("90"), Center=Point(0, 0, 0), Axis=unit_x_5)  # -> ParalAtravesado, Transform
rotate_3d_8 = Rotate3D(Geometry=rotate_3d_2.Geometry, Angle=degrees("90"), Center=Point(0, 0, 0), Axis=unit_y_2)  # -> Geometry, Transform
rotate_3d_9 = Rotate3D(Geometry=rotate_3d_3.Geometry, Angle=degrees("0"), Center=Point(0, 0, 0), Axis=unit_y_3)  # -> Geometry, Transform
rotate_3d_10 = Rotate3D(Geometry=rotate_3d_4.Geometry, Angle=degrees("90"), Center=Point(0, 0, 0), Axis=unit_y_4)  # -> Geometry, Transform
rotate_3d_11 = Rotate3D(Geometry=rotate_3d_5.Geometry, Angle=degrees("0"), Center=Point(0, 0, 0), Axis=unit_y_5)  # -> Geometry, Transform
rotate_3d_12 = Rotate3D(Geometry=rotate_3d_6.Geometry, Angle=degrees("0"), Center=Point(0, 0, 0), Axis=unit_y_6)  # -> CubiertaAtravesada, Transform
stream_filter_3 = StreamFilter(
    Gate=tipo_de_mapeado,
    Stream0=rotate_3d_7.ParalAtravesado,
    Stream1=rotate_3d_8.Geometry,
    Stream2=rotate_3d_9.Geometry,
    Stream3=rotate_3d_10.Geometry,
    Stream4=rotate_3d_11.Geometry,
    Stream5=rotate_3d_12.CubiertaAtravesada)
boxmapping = BoxMapping(Mesh=mesh_join, Box=stream_filter_3)
boxmapping_2 = BoxMapping(Mesh=mesh_join_2, Box=stream_filter_3)
boxmapping_3 = BoxMapping(Mesh=mesh_join_3, Box=stream_filter_3)

caja_de_mapeo = ClusterOutput(boxmapping)
caja_de_mapeo_2 = ClusterOutput(boxmapping_2)
caja_de_mapeo_3 = ClusterOutput(boxmapping_3)

# ==== cluster Cluster_4
gate = ClusterInput()
_3 = ClusterInput()
gate_2 = ClusterInput()
_4 = ClusterInput()
gate_3 = ClusterInput()
_0 = ClusterInput()
_1 = ClusterInput()
_2 = ClusterInput()
balance = ClusterInput()
color = ClusterInput()

stream_filter = StreamFilter(Gate=gate_3, Stream0=_0, Stream1=_1, Stream2=_2)
deconstruct_brep = DeconstructBrep(Brep=stream_filter)  # -> Faces, Edges, Vertices
stream_filter_2 = StreamFilter(Balance=balance, Stream1="0", Stream3=["2", "9"])
stream_filter_3 = StreamFilter(
    Color=color,
    Stream1=["5", "2", "1", "3", "4", "9"],
    Stream3=["0", "5", "1", "3", "4"],
    Stream6=["0", "2", "5", "1", "3", "4", "9"])
list_length = ListLength(List=deconstruct_brep.Faces)
cantidad_de_caras = Panel(list_length)
list_item = ListItem(List=deconstruct_brep.Faces, Index=stream_filter_2, Wrap=True)
list_item_2 = ListItem(List=deconstruct_brep.Faces, Index=stream_filter_3, Wrap=True)
subtraction = Subtraction(A=cantidad_de_caras, B="6")
series = Series(Start="6", Step="1", Count=subtraction)
shift_list = ShiftList(List=series, Shift="4", Wrap=Toggle(False))
panel = Panel(shift_list)
list_item_3 = ListItem(List=deconstruct_brep.Faces, Index=[panel, "6", "7", "8"], Wrap=True)
mesh_brep = MeshBrep(
    Color=list_item_2,
    Settings={GridMaxCount=0, GridMinCount=16, JaggedSeams=False, MaxEdgeLength=0, MinEdgeLength=0.0001, MinTolerance=0, Refine=True, RefineAngle=0, RelativeTolerance=0.65, SimplePlanes=True, Tolerance=0})
mesh_brep_2 = MeshBrep(
    Balance=list_item,
    Settings={GridMaxCount=0, GridMinCount=16, JaggedSeams=False, MaxEdgeLength=0, MinEdgeLength=0.0001, MinTolerance=0, Refine=True, RefineAngle=0, RelativeTolerance=0.65, SimplePlanes=True, Tolerance=0})
mesh_brep_3 = MeshBrep(
    Brep=list_item_3,
    Settings={GridMaxCount=0, GridMinCount=16, JaggedSeams=False, MaxEdgeLength=0, MinEdgeLength=0.0001, MinTolerance=0, Refine=True, RefineAngle=0, RelativeTolerance=0.65, SimplePlanes=True, Tolerance=0})
mesh_join = MeshJoin(Meshes=mesh_brep_2)
mesh_join_2 = MeshJoin(Meshes=mesh_brep)
mesh_join_3 = MeshJoin(Meshes=flatten(mesh_brep_3))

balance_2 = ClusterInput()
color_2 = ClusterInput()

# ----
# Barco
stream_filter_4 = StreamFilter(Gate=gate, Stream3=_3)
deconstruct_brep_2 = DeconstructBrep(Brep=stream_filter_4)  # -> Faces, Edges, Vertices
relay = Relay(["18", "19", "20", "21", "22", "23", "24"])
stream_filter_5 = StreamFilter(Balance=balance_2, Stream1="0", Stream3=["2", "9"])
stream_filter_6 = StreamFilter(
    Color=color_2,
    Stream1=["5", "1", "3", "4", "9", relay],
    Stream3=["5", "1", "3", "4", relay],
    Stream6=["5", "1", "3", "4", "9", relay])
list_length_2 = ListLength(List=deconstruct_brep_2.Faces)
cantidad_de_caras_2 = Panel(list_length_2)
list_item_4 = ListItem(List=deconstruct_brep_2.Faces, Index=stream_filter_5, Wrap=True)
list_item_5 = ListItem(List=deconstruct_brep_2.Faces, Index=stream_filter_6, Wrap=True)
subtraction_2 = Subtraction(A=cantidad_de_caras_2, B="6")
series_2 = Series(Start="6", Step="1", Count=subtraction_2)
shift_list_2 = ShiftList(List=series_2, Shift="4", Wrap=Toggle(False))
panel_2 = Panel(shift_list_2)
split_list = SplitList(List=panel_2, Index="8")  # -> ListA, ListB
panel_3 = Panel(split_list.ListA)
list_item_6 = ListItem(List=deconstruct_brep_2.Faces, Index=["6", "7", "8", panel_3], Wrap=True)
mesh_brep_4 = MeshBrep(
    Balance=list_item_4,
    Settings={GridMaxCount=0, GridMinCount=16, JaggedSeams=False, MaxEdgeLength=0, MinEdgeLength=0.0001, MinTolerance=0, Refine=True, RefineAngle=0, RelativeTolerance=0.65, SimplePlanes=True, Tolerance=0})
mesh_brep_5 = MeshBrep(
    Brep=list_item_6,
    Settings={GridMaxCount=0, GridMinCount=16, JaggedSeams=False, MaxEdgeLength=0, MinEdgeLength=0.0001, MinTolerance=0, Refine=True, RefineAngle=0, RelativeTolerance=0.65, SimplePlanes=True, Tolerance=0})
mesh_brep_6 = MeshBrep(
    Color=list_item_5,
    Settings={GridMaxCount=0, GridMinCount=16, JaggedSeams=False, MaxEdgeLength=0, MinEdgeLength=0.0001, MinTolerance=0, Refine=True, RefineAngle=0, RelativeTolerance=0.65, SimplePlanes=True, Tolerance=0})
mesh_join_4 = MeshJoin(Meshes=flatten(mesh_brep_4))
mesh_join_5 = MeshJoin(Meshes=mesh_brep_5)
mesh_join_6 = MeshJoin(Meshes=mesh_brep_6)

balance_3 = ClusterInput()
color_3 = ClusterInput()

# ----
# Pieza tipo Frente de cajon
# Medio circulo
stream_filter_7 = StreamFilter(Gate=gate_2, Stream4=_4)
deconstruct_brep_3 = DeconstructBrep(Brep=stream_filter_7)  # -> Faces, Edges, Vertices
relay_2 = Relay(["5", "18", "19"])
stream_filter_8 = StreamFilter(Balance=balance_3, Stream1="0", Stream3=["2", "9"])
stream_filter_9 = StreamFilter(
    Color=color_3,
    Stream1=["5", "2", "1", "3", "4", "9", relay_2],
    Stream3=["0", "5", "1", "3", "4", relay_2],
    Stream6=["0", "2", "5", "1", "3", "4", "9", relay_2])
list_length_3 = ListLength(List=deconstruct_brep_3.Faces)
cantidad_de_caras_3 = Panel(list_length_3)
list_item_7 = ListItem(List=deconstruct_brep_3.Faces, Index=stream_filter_8, Wrap=True)
list_item_8 = ListItem(List=deconstruct_brep_3.Faces, Index=stream_filter_9, Wrap=True)
subtraction_3 = Subtraction(A=cantidad_de_caras_3, B="6")
series_3 = Series(Start="6", Step="1", Count=subtraction_3)
shift_list_3 = ShiftList(List=series_3, Shift="4", Wrap=Toggle(False))
panel_4 = Panel(shift_list_3)
split_list_2 = SplitList(List=panel_4, Index="8")  # -> ListA, ListB
panel_5 = Panel(split_list_2.ListA)
list_item_9 = ListItem(List=deconstruct_brep_3.Faces, Index=["6", "7", "8", panel_5], Wrap=True)
mesh_brep_7 = MeshBrep(
    Color=list_item_8,
    Settings={GridMaxCount=0, GridMinCount=16, JaggedSeams=False, MaxEdgeLength=0, MinEdgeLength=0.0001, MinTolerance=0, Refine=True, RefineAngle=0, RelativeTolerance=0.65, SimplePlanes=True, Tolerance=0})
mesh_brep_8 = MeshBrep(
    Balance=list_item_7,
    Settings={GridMaxCount=0, GridMinCount=16, JaggedSeams=False, MaxEdgeLength=0, MinEdgeLength=0.0001, MinTolerance=0, Refine=True, RefineAngle=0, RelativeTolerance=0.65, SimplePlanes=True, Tolerance=0})
mesh_brep_9 = MeshBrep(
    Brep=list_item_9,
    Settings={GridMaxCount=0, GridMinCount=16, JaggedSeams=False, MaxEdgeLength=0, MinEdgeLength=0.0001, MinTolerance=0, Refine=True, RefineAngle=0, RelativeTolerance=0.65, SimplePlanes=True, Tolerance=0})
mesh_join_7 = MeshJoin(Meshes=mesh_brep_8)
mesh_join_8 = MeshJoin(Meshes=flatten(mesh_brep_9))
mesh_join_9 = MeshJoin(Meshes=mesh_brep_7)

list_item_10 = ListItem(List=deconstruct_brep.Faces, Index="3", Wrap=True)
list_item_11 = ListItem(List=deconstruct_brep.Faces, Index="1", Wrap=True)
deconstruct_brep_4 = DeconstructBrep(Brep=list_item_10)  # -> Faces, Edges, Vertices
deconstruct_brep_5 = DeconstructBrep(Brep=list_item_11)  # -> Faces, Edges, Vertices
list_item_12 = ListItem(List=deconstruct_brep_4.Vertices, Index="4", Wrap=True)
list_item_13 = ListItem(List=deconstruct_brep_4.Vertices, Index="7", Wrap=True)
list_item_14 = ListItem(List=deconstruct_brep_5.Vertices, Index="4", Wrap=True)
list_item_15 = ListItem(List=deconstruct_brep_5.Vertices, Index="7", Wrap=True)
yz_plane = YZPlane(Origin=list_item_12)
yz_plane_2 = YZPlane(Origin=list_item_14)
rectangle_2pt = Rectangle2Pt(Plane=yz_plane, PointA=list_item_12, PointB=list_item_13, Radius=0)  # -> Rectangle, Length
rectangle_2pt_2 = Rectangle2Pt(Plane=yz_plane_2, PointA=list_item_14, PointB=list_item_15, Radius=0)  # -> Rectangle, Length
taparuteo = Surface(rectangle_2pt_2.Rectangle)
taparuteo_2 = Surface(rectangle_2pt.Rectangle)

tipo_de_mapeado = ClusterInput()
mesh_brep_10 = MeshBrep(
    Brep=[taparuteo, taparuteo_2],
    Settings={GridMaxCount=0, GridMinCount=16, JaggedSeams=False, MaxEdgeLength=0, MinEdgeLength=0.0001, MinTolerance=0, Refine=True, RefineAngle=0, RelativeTolerance=0.65, SimplePlanes=True, Tolerance=0})

# ----
# Mapeado
panel_6 = Panel("600")
tamaño_de_textura = Number(panel_6)
domain_box = DomainBox(Base=PlaneXY(0, 0, 0), X=tamaño_de_textura, Y=tamaño_de_textura, Z=tamaño_de_textura)
unit_y = UnitY(Factor=1)
domain_box_2 = DomainBox(Base=PlaneXY(0, 0, 0), X=tamaño_de_textura, Y=tamaño_de_textura, Z=tamaño_de_textura)
unit_x = UnitX(Factor=1)
domain_box_3 = DomainBox(Base=PlaneXY(0, 0, 0), X=tamaño_de_textura, Y=tamaño_de_textura, Z=tamaño_de_textura)
unit_x_2 = UnitX(Factor=1)
domain_box_4 = DomainBox(Base=PlaneXY(0, 0, 0), X=tamaño_de_textura, Y=tamaño_de_textura, Z=tamaño_de_textura)
unit_x_3 = UnitX(Factor=1)
domain_box_5 = DomainBox(Base=PlaneXY(0, 0, 0), X=tamaño_de_textura, Y=tamaño_de_textura, Z=tamaño_de_textura)
unit_x_4 = UnitX(Factor=1)
domain_box_6 = DomainBox(Base=PlaneXY(0, 0, 0), X=tamaño_de_textura, Y=tamaño_de_textura, Z=tamaño_de_textura)
unit_z = UnitZ(Factor=1)
rotate_3d = Rotate3D(Geometry=domain_box, Angle=degrees("90"), Center=Point(0, 0, 0), Axis=unit_y)  # -> Geometry, Transform
rotate_3d_2 = Rotate3D(Geometry=domain_box_2, Angle=degrees("180"), Center=Point(0, 0, 0), Axis=unit_x)  # -> Geometry, Transform
rotate_3d_3 = Rotate3D(Geometry=domain_box_3, Angle=degrees("90"), Center=Point(0, 0, 0), Axis=unit_x_2)  # -> Geometry, Transform
rotate_3d_4 = Rotate3D(Geometry=domain_box_4, Angle=degrees("90"), Center=Point(0, 0, 0), Axis=unit_x_3)  # -> Geometry, Transform
rotate_3d_5 = Rotate3D(Geometry=domain_box_5, Angle=degrees("0"), Center=Point(0, 0, 0), Axis=unit_x_4)  # -> Geometry, Transform
rotate_3d_6 = Rotate3D(Geometry=domain_box_6, Angle=degrees("90"), Center=Point(0, 0, 0), Axis=unit_z)  # -> Geometry, Transform
unit_x_5 = UnitX(Factor=1)
unit_y_2 = UnitY(Factor=1)
unit_y_3 = UnitY(Factor=1)
unit_y_4 = UnitY(Factor=1)
unit_y_5 = UnitY(Factor=1)
unit_y_6 = UnitY(Factor=1)
rotate_3d_7 = Rotate3D(Geometry=rotate_3d.Geometry, Angle=degrees("90"), Center=Point(0, 0, 0), Axis=unit_x_5)  # -> ParalAtravesado, Transform
rotate_3d_8 = Rotate3D(Geometry=rotate_3d_2.Geometry, Angle=degrees("90"), Center=Point(0, 0, 0), Axis=unit_y_2)  # -> Geometry, Transform
rotate_3d_9 = Rotate3D(Geometry=rotate_3d_3.Geometry, Angle=degrees("0"), Center=Point(0, 0, 0), Axis=unit_y_3)  # -> Geometry, Transform
rotate_3d_10 = Rotate3D(Geometry=rotate_3d_4.Geometry, Angle=degrees("90"), Center=Point(0, 0, 0), Axis=unit_y_4)  # -> Geometry, Transform
rotate_3d_11 = Rotate3D(Geometry=rotate_3d_5.Geometry, Angle=degrees("0"), Center=Point(0, 0, 0), Axis=unit_y_5)  # -> Geometry, Transform
rotate_3d_12 = Rotate3D(Geometry=rotate_3d_6.Geometry, Angle=degrees("0"), Center=Point(0, 0, 0), Axis=unit_y_6)  # -> CubiertaAtravesada, Transform
stream_filter_10 = StreamFilter(
    Gate=tipo_de_mapeado,
    Stream0=rotate_3d_7.ParalAtravesado,
    Stream1=rotate_3d_8.Geometry,
    Stream2=rotate_3d_9.Geometry,
    Stream3=rotate_3d_10.Geometry,
    Stream4=rotate_3d_11.Geometry,
    Stream5=rotate_3d_12.CubiertaAtravesada)
boxmapping = BoxMapping(Mesh=[mesh_join_3, mesh_join_5, mesh_join_8], Box=stream_filter_10)
boxmapping_2 = BoxMapping(Mesh=[mesh_join_2, mesh_join_6, mesh_join_9, mesh_brep_10], Box=stream_filter_10)
boxmapping_3 = BoxMapping(Mesh=[mesh_join, mesh_join_4, mesh_join_7], Box=stream_filter_10)

caja_de_mapeo = ClusterOutput(boxmapping)
caja_de_mapeo_2 = ClusterOutput(boxmapping_2)
caja_de_mapeo_3 = ClusterOutput(boxmapping_3)
